# Grasshopper definition OutdoorAirSystem.gh (Grasshopper 0.9.76)
# plug-ins: Ironbug

nickname = Ironbug_DataFields(MinimumOutdoorAirFlowRate=Slider(0.1, range=0..0.1))
nickname_2 = Ironbug_OAController(Name_="namedd", Parameters=nickname)
panel = Panel(nickname_2)
nickname_3 = Ironbug_OutdoorAirSystem()
airloop = Ironbug_AirLoopHVAC(Supply=nickname_3)
panel_2 = Panel("C:\Users\Mingbo\Documents\GitHub\Ironbug\doc\osmFile\savedFromGH.osm")
nickname_4 = Ironbug_SaveOSModel(FilePath=panel_2, ZoneHVACs=airloop)
