# Grasshopper definition saveOSM.gh (Grasshopper 0.9.76)
# plug-ins: Ironbug

nickname = Ironbug_CoilHeatingWater()
nickname_2 = Ironbug_CoilHeatingWater()
panel = Panel("C:\Users\Mingbo\Documents\GitHub\Ironbug\doc\osmFile\savedFromGH.osm")
airloop = Ironbug_AirLoopHVAC(Supply=nickname_2)
nickname_3 = Ironbug_SaveOSModel(Model=airloop)
