# Grasshopper definition Sys00_IdealAirLoad.gh (Grasshopper 1.0.7)

# ---- group: Sys00_Ideal Air Load
# Double click the component for more details
sys00 = Sys00()

# ==== cluster Sys00
hbrooms = ClusterInput()  # Honeybee Rooms to which the HVAC system should be assigned.

# ----
# HBRooms
data = Data(flatten(hbrooms))
idealairload = Ironbug_ZoneHVACIdealLoadsAirSystem(dupNum=False)

roomsbyattr = HBRoomsByAttribute(rooms=flatten(data), attribute="zone")  # -> values, rooms; plug-in component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

lng = ListLength(List=roomsbyattr.values)
panel = Panel(lng)

duplicate = Ironbug_Duplicate(Reference=idealairload, Amount=panel)  # -> Objects, port
thermalzone = IB_ThermalZone(
    _HBRooms=data,
    ZoneEquipments_=duplicate.Objects,
    IsAirTerminalPriorToZoneEquipments=True,
    allowMultiAirloops=False,
    dupNum=False)

noairloop = Ironbug_NoAirLoop(OSZones=thermalzone)
hvacsystem = Ironbug_HVACSystem(AirLoops=flatten(noairloop))

hvacsystem_2 = ClusterOutput(hvacsystem)
