# Grasshopper definition Sys02_PTHP.gh (Grasshopper 1.0.7)

# ---- group: Sys02_PTHP
# Double click the component for more details
sys02 = Sys02()

# ==== cluster Sys02
hbrooms = ClusterInput()  # Honeybee Rooms to which the HVAC system should be assigned.

# ----
# HBRooms
data = Data(flatten(hbrooms))

# ----
# PTHP
panel = Panel("zone")
roomsbyattr = HBRoomsByAttribute(rooms=flatten(data), attribute=panel)  # -> values, rooms; plug-in component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
objparams = IB_ObjParams(PressureRise="300", DataFieldSetType="Ironbug.HVAC.IB_FanConstantVolume_FieldSet")
lng = ListLength(List=roomsbyattr.values)
panel_2 = Panel(lng)
fanconstant = Ironbug_FanConstantVolume(Parameters_=objparams, dupNum=False)

pt_heatpump = Ironbug_ZoneHVACPackagedTerminalHeatPump(Fan_=fanconstant, dupNum=False)

duplicate = Ironbug_Duplicate(Reference=pt_heatpump, Amount=panel_2)  # -> Objects, port
thermalzone = Ironbug_ThermalZone(
    HoneybeeZonesOrOsZones=data,
    ZoneEquipment=duplicate.Objects,
    IsAirTerminalPriorToZoneEquipments=True,
    allowMultiAirloops=False,
    dupNum=False)
noairloop = Ironbug_NoAirLoop(OSZones=thermalzone)

hvacsystem = Ironbug_HVACSystem(AirLoops=flatten(noairloop))

hvacsystem_2 = ClusterOutput(hvacsystem)
