# Grasshopper definition Sys03_SZAC.gh (Grasshopper 1.0.7)

# ---- group: Sys03_SZAC
# Double click the component for more details
sys03 = Sys03()

# ==== cluster Sys03
hbrooms = ClusterInput()  # Honeybee Rooms to which the HVAC system should be assigned.

# ----
# HBZones
data = Data(flatten(hbrooms))

coilhtngas = Ironbug_CoilHeatingGas(dupNum=False)
coilclndx1 = Ironbug_CoilCoolingDXSingleSpeed(dupNum=False)

# ----
# Sys03_SZAC
# Airloop
panel = Panel("zone")
roomsbyattr = HBRoomsByAttribute(rooms=flatten(data), attribute=panel)  # -> values, rooms; plug-in component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
diffuser = Ironbug_AirTerminalSingleDuctUncontrolled(dupNum=False)
objparams = IB_ObjParams(EconomizerControlType="DifferentialDryBulb", DataFieldSetType="Ironbug.HVAC.IB_ControllerOutdoorAir_FieldSet")
lng = ListLength(List=roomsbyattr.values)
duplicate = Ironbug_Duplicate(Reference=diffuser, Amount=lng)  # -> Objects, graft(port)
objparams_2 = IB_ObjParams(PressureRise="500", DataFieldSetType="Ironbug.HVAC.IB_FanConstantVolume_FieldSet")
thermalzone = Ironbug_ThermalZone(
    HoneybeeZonesOrOsZones=data,
    AirTerminal_=duplicate.Objects,
    IsAirTerminalPriorToZoneEquipments=True,
    allowMultiAirloops=False,
    dupNum=False)
fanconstant = Ironbug_FanConstantVolume(Parameters=objparams_2, dupNum=False)
graft = GraftTree(Tree=thermalzone, IncludeEmptyLists=True, IncludeNullItems=True)
lng_2 = ListLength(List=thermalzone)
objparams_3 = IB_ObjParams(
    AllOutdoorAirinCooling=Toggle(False),
    AllOutdoorAirinHeating=Toggle(False),
    CentralHeatingDesignSupplyAirTemperature="40",
    CentralHeatingMaximumSystemAirFlowRatio="1",
    DataFieldSetType="Ironbug.HVAC.IB_SizingSystem_FieldSet")
duplicate_2 = Ironbug_Duplicate(Reference=coilclndx1, Amount=lng_2)  # -> graft(Objects), port
duplicate_3 = Ironbug_Duplicate(Reference=coilhtngas, Amount=lng_2)  # -> graft(Objects), port
duplicate_4 = Ironbug_Duplicate(Reference=fanconstant, Amount=lng_2)  # -> graft(Objects), port
spm_szreheat = Ironbug_SetpointManagerSingleZoneReheat(ControlZone=graft, MinTemperature="-20", MaxTemperature="100", dupNum=False)
airloopbranches = AirLoopBranches(Branch1=graft)
sizingsystem = Ironbug_SizingSystem(Parameters_=objparams_3, dupNum=False)

oacontroller = Ironbug_OAController(Parameters_=objparams, dupNum=False)

oasystem = Ironbug_OutdoorAirSystem(Controller_=oacontroller)
duplicate_5 = Ironbug_Duplicate(Reference=oasystem, Amount=lng_2)  # -> graft(Objects), port
merge = Merge(Data1=duplicate_5.Objects, Data2=duplicate_2.Objects, Data3=duplicate_3.Objects, Data4=duplicate_4.Objects)  # -> simplify(Result)
merge_2 = Merge(Data1=simplify(merge), Data2=simplify(spm_szreheat))
airloop = Ironbug_AirLoopHVAC(Supply=merge_2, Demand=airloopbranches, SizingSystem=sizingsystem, dupNum=False)
hvacsystem = Ironbug_HVACSystem(AirLoops=flatten(airloop))

hvacsystem_2 = ClusterOutput(hvacsystem)
