# Grasshopper definition Sys04_SZHP.gh (Grasshopper 1.0.7)

# ---- group: Sys04_SZHP
# Double click the component for more details
sys04 = Sys04()

# ==== cluster Sys04
hbrooms = ClusterInput()  # Honeybee Rooms to which the HVAC system should be assigned.

# ----
# HBZones
rooms = Data(flatten(hbrooms))

coilclndx1 = Ironbug_CoilCoolingDXSingleSpeed(dupNum=False)
coilhtn_dx1 = Ironbug_CoilHeatingDXSingleSpeed(dupNum=False)
coilhtnelec = Ironbug_CoilHeatingElectric(dupNum=False)

# ----
# Sys04_SZHP
# Airloop
panel = Panel("zone")
roomsbyattr = HBRoomsByAttribute(rooms=flatten(rooms), attribute=panel)  # -> values, rooms; plug-in component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
diffuser = Ironbug_AirTerminalSingleDuctUncontrolled(dupNum=False)
objparams = IB_ObjParams(EconomizerControlType="NoEconomizer", DataFieldSetType="Ironbug.HVAC.IB_ControllerOutdoorAir_FieldSet")
lng = ListLength(List=roomsbyattr.values)
duplicate = Ironbug_Duplicate(Reference=diffuser, Amount=lng)  # -> Objects, port
objparams_2 = IB_ObjParams(PressureRise="500", DataFieldSetType="Ironbug.HVAC.IB_FanConstantVolume_FieldSet")
thermalzone = Ironbug_ThermalZone(
    HoneybeeZonesOrOsZones=rooms,
    AirTerminal_=duplicate.Objects,
    IsAirTerminalPriorToZoneEquipments=True,
    allowMultiAirloops=False,
    dupNum=False)
fanconstant = Ironbug_FanConstantVolume(Parameters=objparams_2, dupNum=False)
graft = GraftTree(Tree=thermalzone, IncludeEmptyLists=True, IncludeNullItems=True)
lng_2 = ListLength(List=thermalzone)
objparams_3 = IB_ObjParams(
    AllOutdoorAirinCooling=Toggle(False),
    AllOutdoorAirinHeating=Toggle(False),
    CentralHeatingDesignSupplyAirTemperature="40",
    CentralHeatingMaximumSystemAirFlowRatio="1",
    DataFieldSetType="Ironbug.HVAC.IB_SizingSystem_FieldSet")
spm_szreheat = Ironbug_SetpointManagerSingleZoneReheat(ControlZone=graft, MinTemperature="-20", MaxTemperature="100", dupNum=False)
airloopbranches = AirLoopBranches(Branch1=graft)
sizingsystem = Ironbug_SizingSystem(Parameters_=objparams_3, dupNum=False)

oacontroller = Ironbug_OAController(Parameters_=objparams, dupNum=False)

oasystem = Ironbug_OutdoorAirSystem(Controller_=oacontroller)
merge = Merge(Data1=oasystem, Data2=coilclndx1, Data3=coilhtn_dx1, Data4=coilhtnelec, Data5=fanconstant)

duplicate_2 = Ironbug_Duplicate(Reference=graft(merge), Amount=lng_2)  # -> Objects, port
flip = FlipMatrix(Data=duplicate_2.Objects)

merge_2 = Merge(Data1=simplify(flip), Data2=simplify(spm_szreheat))
airloop = Ironbug_AirLoopHVAC(Supply=merge_2, Demand=airloopbranches, SizingSystem=sizingsystem, dupNum=False)
hvacsystem = Ironbug_HVACSystem(AirLoops=flatten(airloop))

hvacsystem_2 = ClusterOutput(hvacsystem)
