# Grasshopper definition Sys06_PackagedVAV PFP Boxes.gh (Grasshopper 1.0.7)

# ---- group: Sys06_PackagedVAV PFP Boxes
# Double click the component for more details
sys06 = Sys06()

# ==== cluster Sys06
hbrooms = ClusterInput()  # Honeybee Rooms to which the HVAC system should be assigned.
# HBZones
data = Data(flatten(hbrooms))
roomsbyattr = HBRoomsByAttribute(rooms=flatten(data), attribute="zone")  # -> values, rooms; plug-in component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
objparams = IB_ObjParams(PressureRise="300", DataFieldSetType="Ironbug.HVAC.IB_FanConstantVolume_FieldSet")
fanconstant = Ironbug_FanConstantVolume(Parameters_=objparams, dupNum=False)
objparams_2 = IB_ObjParams(EconomizerControlType="DifferentialDryBulb", DataFieldSetType="Ironbug.HVAC.IB_ControllerOutdoorAir_FieldSet")
lng = ListLength(List=roomsbyattr.values)
parallelpiureheat = Ironbug_AirTerminalSingleDuctParallelPIUReheat(Fan_=fanconstant, dupNum=False)
objparams_3 = IB_ObjParams(PressureRise="500", DataFieldSetType="Ironbug.HVAC.IB_FanVariableVolume_FieldSet")
duplicate = Ironbug_Duplicate(Reference=parallelpiureheat, Amount=lng)  # -> Objects, port
oacontroller = Ironbug_OAController(Parameters_=objparams_2, dupNum=False)
objparams_4 = IB_ObjParams(
    AllOutdoorAirinCooling=Toggle(False),
    AllOutdoorAirinHeating=Toggle(False),
    CentralHeatingDesignSupplyAirTemperature="16.7",
    DataFieldSetType="Ironbug.HVAC.IB_SizingSystem_FieldSet")
oasystem = Ironbug_OutdoorAirSystem(Controller_=oacontroller)
thermalzone = Ironbug_ThermalZone(
    HoneybeeZonesOrOsZones=data,
    AirTerminal_=duplicate.Objects,
    IsAirTerminalPriorToZoneEquipments=True,
    allowMultiAirloops=False,
    dupNum=False)
coilhtnelec = Ironbug_CoilHeatingElectric(dupNum=False)
coilclndx2 = Ironbug_CoilCoolingDXTwoSpeed(dupNum=False)
fanvariable = Ironbug_FanVariableVolume(Parameters=objparams_3, dupNum=False)
spm_scheduled = Ironbug_SetpointManagerScheduled(Temperature="12.8", dupNum=False)
# Sys06_PackagedVAV_PFP
# Airloop
merge = Merge(Data1=oasystem, Data2=coilclndx2, Data3=coilhtnelec, Data4=fanvariable, Data5=spm_scheduled)
airloopbranches = AirLoopBranches(Branch1=thermalzone)
sizingsystem = Ironbug_SizingSystem(Parameters_=objparams_4, dupNum=False)
airloop = Ironbug_AirLoopHVAC(Supply=merge, Demand=airloopbranches, SizingSystem=sizingsystem, dupNum=False)
hvacsystem = Ironbug_HVACSystem(AirLoops=flatten(airloop))
hvacsystem_2 = ClusterOutput(hvacsystem)
