# Grasshopper definition Sys07_VAV Reheat.gh (Grasshopper 1.0.7)

# ---- group: Sys07_VAV Reheat
# Double click the component for more details
sys07 = Sys07()

# ==== cluster Sys07
hbrooms = ClusterInput()  # Honeybee Rooms to which the HVAC system should be assigned.

# ----
# HBZones
data = Data(flatten(hbrooms))
boiler = Ironbug_BoilerHotWater(dupNum=False)

# ----
# Sys07_VAV_Reheat
# Airloop
panel = Panel("zone")
roomsbyattr = HBRoomsByAttribute(rooms=flatten(data), attribute=panel)  # -> values, rooms; plug-in component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
coilhtnwater = Ironbug_CoilHeatingWater(dupNum=False)  # -> AirSide_CoilHeatingWater, WaterSide_CoilHeatingWater
lng = ListLength(List=roomsbyattr.values)
objparams = IB_ObjParams(EconomizerControlType="DifferentialDryBulb", DataFieldSetType="Ironbug.HVAC.IB_ControllerOutdoorAir_FieldSet")
duplicate = Ironbug_Duplicate(Reference=coilhtnwater.AirSide_CoilHeatingWater, Amount=lng)  # -> Objects, WaterSide_CoilHeatingWater
objparams_2 = IB_ObjParams(PressureRise="500", DataFieldSetType="Ironbug.HVAC.IB_FanVariableVolume_FieldSet")
oacontroller = Ironbug_OAController(Parameters_=objparams, dupNum=False)
objparams_3 = IB_ObjParams(
    AllOutdoorAirinCooling=Toggle(False),
    AllOutdoorAirinHeating=Toggle(False),
    CentralHeatingDesignSupplyAirTemperature="12.8",
    DataFieldSetType="Ironbug.HVAC.IB_SizingSystem_FieldSet")
vavreheat = Ironbug_AirTerminalSingleDuctVAVReheat(HeatingCoil=duplicate.Objects, dupNum=False)
coilclnwater = Ironbug_CoilCoolingWater(dupNum=False)  # -> AirSide_CoilCoolingWater, WaterSide_CoilCoolingWater
coilhtnwater_2 = Ironbug_CoilHeatingWater(dupNum=False)  # -> AirSide_CoilHeatingWater, WaterSide_CoilHeatingWater
oasystem = Ironbug_OutdoorAirSystem(Controller_=oacontroller)
thermalzone = Ironbug_ThermalZone(
    HoneybeeZonesOrOsZones=data,
    AirTerminal_=vavreheat,
    IsAirTerminalPriorToZoneEquipments=True,
    allowMultiAirloops=False,
    dupNum=False)
fanvariable = Ironbug_FanVariableVolume(Parameters=objparams_2, dupNum=False)
spm_scheduled = Ironbug_SetpointManagerScheduled(Temperature="12.8", dupNum=False)
branches = AirLoopBranches(Branch1=thermalzone)
sizingsystem = Ironbug_SizingSystem(Parameters_=objparams_3, dupNum=False)
merge = Merge(
    Data1=oasystem,
    Data2=coilclnwater.AirSide_CoilCoolingWater,
    Data3=coilhtnwater_2.AirSide_CoilHeatingWater,
    Data4=fanvariable,
    Data5=spm_scheduled)
airloop = Ironbug_AirLoopHVAC(Supply=merge, Demand=branches, SizingSystem=sizingsystem, dupNum=False)

# ----
# Chilled water loop
chiller_watercooled = Ironbug_ChillerElectricEIR_WaterCooled(dupNum=False)  # -> ChillerElectricEIR, ChillerElectricEIR_CondenserLoop
pumpvariable = Ironbug_PumpVariableSpeed(dupNum=False)
branches_2 = PlantBranches(Branch1=chiller_watercooled.ChillerElectricEIR, mapBranchToLoop=False)
spm_scheduled_2 = Ironbug_SetpointManagerScheduled(Temperature="6.7", dupNum=False)
branches_3 = PlantBranches(Branch1=coilclnwater.WaterSide_CoilCoolingWater, mapBranchToLoop=False)
cwloop = Ironbug_ChilledWaterPlantLoop(Supply=[pumpvariable, branches_2, spm_scheduled_2], Demand=branches_3, dupNum=False)

# ----
# Condenser water loop
coolingtower1 = Ironbug_CoolingTowerSingleSpeed(dupNum=False)
pipeadiabatic = Ironbug_PipeAdiabatic(dupNum=False)
spm_followoatemp = Ironbug_SetpointManagerFollowOutdoorAirTemperature(MaximumSetpointTemperature="80", MinimumSetpointTemperature="6", OffsetTemperatureDifference="1.5", dupNum=False)
pumpvariable_2 = Ironbug_PumpVariableSpeed(dupNum=False)
plantbranches = PlantBranches(Branch1=chiller_watercooled.ChillerElectricEIR_CondenserLoop, mapBranchToLoop=False)
branches_4 = PlantBranches(B1=coolingtower1, B2=pipeadiabatic, mapBranchToLoop=False)
dwloop = Ironbug_CondenserWaterPlantLoop(Supply=[pumpvariable_2, branches_4, spm_followoatemp], Demand=plantbranches, dupNum=False)

graft = GraftTree(Tree=duplicate.WaterSide_CoilHeatingWater, IncludeEmptyLists=True, IncludeNullItems=True)

# ----
# Hot water loop
panel_2 = Panel("67")
pumpvariable_3 = Ironbug_PumpVariableSpeed(dupNum=False)
plantbranches_2 = PlantBranches(Branch1=boiler, mapBranchToLoop=False)
spm_scheduled_3 = Ironbug_SetpointManagerScheduled(Temperature=panel_2, dupNum=False)
branches_5 = PlantBranches(B1=graft, B2=coilhtnwater_2.WaterSide_CoilHeatingWater, mapBranchToLoop=False)
hwloop = Ironbug_HotWaterPlantLoop(Supply=[pumpvariable_3, plantbranches_2, spm_scheduled_3], Demand=branches_5, dupNum=False)

merge_2 = Merge(Data1=hwloop, Data2=cwloop, Data3=dwloop)
hvacsystem = Ironbug_HVACSystem(AirLoops=flatten(airloop), PlantLoops=flatten(merge_2))

hvacsystem_2 = ClusterOutput(hvacsystem)
