# Grasshopper definition Sys08_VAV PFP Boxes.gh (Grasshopper 1.0.7)

# ---- group: Sys08_VAV PFP Boxes
# Double click the component for more details
sys08 = Sys08()

# ==== cluster Sys08
hbrooms = ClusterInput()  # Honeybee Rooms to which the HVAC system should be assigned.
data = Data(flatten(hbrooms))

# ----
# Airloop
panel = Panel("300")
objparams = IB_ObjParams(PressureRise=panel, DataFieldSetType="Ironbug.HVAC.IB_FanConstantVolume_FieldSet")
roomsbyattr = HBRoomsByAttribute(rooms=flatten(data), attribute="zone")  # -> values, rooms; plug-in component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
fanconstant = Ironbug_FanConstantVolume(Parameters_=objparams, dupNum=False)
lng = ListLength(List=roomsbyattr.values)
objparams_2 = IB_ObjParams(EconomizerControlType="DifferentialDryBulb", DataFieldSetType="Ironbug.HVAC.IB_ControllerOutdoorAir_FieldSet")
duplicate = Ironbug_Duplicate(Reference=fanconstant, Amount=lng)  # -> Objects, port
objparams_3 = IB_ObjParams(PressureRise="500", DataFieldSetType="Ironbug.HVAC.IB_FanVariableVolume_FieldSet")
oacontroller = Ironbug_OAController(Parameters_=objparams_2, dupNum=False)
parallelpiureheat = Ironbug_AirTerminalSingleDuctParallelPIUReheat(Fan_=duplicate.Objects, dupNum=False)
coilclnwater = Ironbug_CoilCoolingWater(dupNum=False)  # -> AirSide_CoilCoolingWater, WaterSide_CoilCoolingWater
oasystem = Ironbug_OutdoorAirSystem(Controller_=oacontroller)
thermalzone = Ironbug_ThermalZone(
    HoneybeeZonesOrOsZones=data,
    ZoneEquipment=parallelpiureheat,
    IsAirTerminalPriorToZoneEquipments=True,
    allowMultiAirloops=False,
    dupNum=False)
coilhtnelec = Ironbug_CoilHeatingElectric(dupNum=False)
fanvariable = Ironbug_FanVariableVolume(Parameters=objparams_3, dupNum=False)
spm_scheduled = Ironbug_SetpointManagerScheduled(Temperature="12.8", dupNum=False)
branches = AirLoopBranches(Branch1=thermalzone)
merge = Merge(Data1=oasystem, Data2=coilclnwater.AirSide_CoilCoolingWater, Data3=coilhtnelec, Data4=fanvariable, Data5=spm_scheduled)

# ----
# Chilled water loop
chiller_aircooled = Ironbug_ChillerElectricEIR_AirCooled(dupNum=False)
pumpvariable = Ironbug_PumpVariableSpeed(dupNum=False)
spm_scheduled_2 = Ironbug_SetpointManagerScheduled(Temperature="6.7", dupNum=False)
plantbranches = PlantBranches(Branch1=chiller_aircooled, mapBranchToLoop=False)
plantbranches_2 = PlantBranches(Branch1=coilclnwater.WaterSide_CoilCoolingWater, mapBranchToLoop=False)
cwloop = Ironbug_ChilledWaterPlantLoop(Supply=[pumpvariable, plantbranches, spm_scheduled_2], Demand=plantbranches_2, dupNum=False)

# ----
# Sys08_VAV_PFP
# HBZones
panel_2 = Panel("12.8")

objparams_4 = IB_ObjParams(
    AllOutdoorAirinCooling=Toggle(False),
    AllOutdoorAirinHeating=Toggle(False),
    CentralHeatingDesignSupplyAirTemperature=panel_2,
    DataFieldSetType="Ironbug.HVAC.IB_SizingSystem_FieldSet")
sizingsystem = Ironbug_SizingSystem(Parameters_=objparams_4, dupNum=False)
airloop = Ironbug_AirLoopHVAC(Supply=merge, Demand=branches, SizingSystem=sizingsystem, dupNum=False)

hvacsystem = Ironbug_HVACSystem(AirLoops=flatten(airloop), PlantLoops=flatten(cwloop))

hvacsystem_2 = ClusterOutput(hvacsystem)
