# Grasshopper definition Sys10_Furnace - Electric.gh (Grasshopper 1.0.7)

# ---- group: Sys10_Furnace - Electric
# Double click the component for more details
sys10 = Sys10()

# ==== cluster Sys10
hbrooms = ClusterInput()  # Honeybee Rooms to which the HVAC system should be assigned.
data = Data(flatten(hbrooms))

thermalzone = Ironbug_ThermalZone(HoneybeeZonesOrOsZones=data, IsAirTerminalPriorToZoneEquipments=True, allowMultiAirloops=False, dupNum=False)
coilhtnelec = Ironbug_CoilHeatingElectric(dupNum=False)

# ----
# Sys10_Warm Air Furnace - Electric
# Airloop
# HBZones
panel = Panel("DifferentialDryBulb")
objparams = IB_ObjParams(EconomizerControlType=panel, DataFieldSetType="Ironbug.HVAC.IB_ControllerOutdoorAir_FieldSet")
oacontroller = Ironbug_OAController(Parameters_=objparams, dupNum=False)
objparams_2 = IB_ObjParams(PressureRise="500", DataFieldSetType="Ironbug.HVAC.IB_FanConstantVolume_FieldSet")
objparams_3 = IB_ObjParams(
    AllOutdoorAirinCooling=Toggle(True),
    AllOutdoorAirinHeating=Toggle(True),
    CentralHeatingDesignSupplyAirTemperature="40",
    CentralHeatingMaximumSystemAirFlowRatio="1",
    DataFieldSetType="Ironbug.HVAC.IB_SizingSystem_FieldSet")
item = ListItem(List=thermalzone, Index=0, Wrap=True)
oasystem = Ironbug_OutdoorAirSystem(Controller_=oacontroller)
spm_szreheat = Ironbug_SetpointManagerSingleZoneReheat(ControlZone=flatten(item), MinTemperature=10, MaxTemperature=50, dupNum=False)
fanconstant = Ironbug_FanConstantVolume(Parameters_=objparams_2, dupNum=False)
airloopbranches = AirLoopBranches(Branch1=thermalzone)
sizingsystem = Ironbug_SizingSystem(Parameters_=objparams_3, dupNum=False)
merge = Merge(Data1=oasystem, Data2=coilhtnelec, Data3=fanconstant, Data4=spm_szreheat)
airloop = Ironbug_AirLoopHVAC(Supply=merge, Demand=airloopbranches, SizingSystem=sizingsystem, dupNum=False)
hvacsystem = Ironbug_HVACSystem(AirLoops=flatten(airloop))

hvacsystem_2 = ClusterOutput(hvacsystem)
