# Grasshopper definition Sys11_Fan Coil Units + DOAS.gh (Grasshopper 1.0.7)

# ---- group: Sys11_Fan Coil Units + DOAS
# Double click the component for more details
sys11 = Sys11()

# ==== cluster Sys11
hbrooms = ClusterInput()  # Honeybee Rooms to which the HVAC system should be assigned.
data = Data(flatten(hbrooms))

# ----
# FourPipeFanCoil
panel = Panel("zone")
roomsbyattr = HBRoomsByAttribute(rooms=flatten(data), attribute=panel)  # -> values, rooms; plug-in component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
coilclnwater = Ironbug_CoilCoolingWater(dupNum=False)  # -> AirSide_CoilCoolingWater, WaterSide_CoilCoolingWater
coilhtnwater = Ironbug_CoilHeatingWater(dupNum=False)  # -> AirSide_CoilHeatingWater, WaterSide_CoilHeatingWater
lng = ListLength(List=roomsbyattr.values)
objparams = IB_ObjParams(FanEfficiency="0.5", MotorEfficiency="0.9", PressureRise="75", DataFieldSetType="Ironbug.HVAC.IB_FanOnOff_FieldSet")
panel_2 = Panel(lng)
objparams_2 = IB_ObjParams(MaximumOutdoorAirFlowRate="0", DataFieldSetType="Ironbug.HVAC.IB_ZoneHVACFourPipeFanCoil_FieldSet")
duplicate = Ironbug_Duplicate(Reference=coilclnwater.AirSide_CoilCoolingWater, Amount=panel_2)  # -> Objects, graft(WaterSide_CoilCoolingWater)
duplicate_2 = Ironbug_Duplicate(Reference=coilhtnwater.AirSide_CoilHeatingWater, Amount=panel_2)  # -> Objects, graft(WaterSide_CoilHeatingWater)
fanonoff = Ironbug_FanOnOff(Parameters_=objparams, dupNum=False)
_4pipefancoil = Ironbug_ZoneHVACFourPipeFanCoil(HeatingCoil=duplicate_2.Objects, CoolingCoil=duplicate.Objects, Fan_=fanonoff, Parameters_=objparams_2, dupNum=False)

# ----
# Sys11_Fan Coil Units + DOAS
# Airloop
panel_3 = Panel("VentilationRequirement")
objparams_3 = IB_ObjParams(FanEfficiency="0.6", PressureRise="500", DataFieldSetType="Ironbug.HVAC.IB_FanConstantVolume_FieldSet")
objparams_4 = IB_ObjParams(
    AllOutdoorAirinCooling=Toggle(True),
    AllOutdoorAirinHeating=Toggle(True),
    CentralHeatingDesignSupplyAirTemperature="40",
    CentralHeatingMaximumSystemAirFlowRatio="1",
    TypeofLoadtoSizeOn=panel_3,
    DataFieldSetType="Ironbug.HVAC.IB_SizingSystem_FieldSet")
heatexchanger_air = Ironbug_HeatExchangerAirToAirSensibleAndLatent(dupNum=False)
coilclnwater_2 = Ironbug_CoilCoolingWater(dupNum=False)  # -> AirSide_CoilCoolingWater, WaterSide_CoilCoolingWater
coilhtnwater_2 = Ironbug_CoilHeatingWater(dupNum=False)  # -> AirSide_CoilHeatingWater, WaterSide_CoilHeatingWater
oasystem = Ironbug_OutdoorAirSystem(HeatRecovery_=heatexchanger_air)
thermalzone = Ironbug_ThermalZone(
    HoneybeeZonesOrOsZones=data,
    ZoneEquipment=_4pipefancoil,
    IsAirTerminalPriorToZoneEquipments=True,
    allowMultiAirloops=False,
    dupNum=False)
fanconstant = Ironbug_FanConstantVolume(Parameters_=objparams_3, dupNum=False)
spm_scheduled = Ironbug_SetpointManagerScheduled(Temperature="20", dupNum=False)
airloopbranches = AirLoopBranches(Branch1=thermalzone)
sizingsystem = Ironbug_SizingSystem(Parameters_=objparams_4, dupNum=False)
merge = Merge(
    Data1=oasystem,
    Data2=coilclnwater_2.AirSide_CoilCoolingWater,
    Data3=coilhtnwater_2.AirSide_CoilHeatingWater,
    Data4=fanconstant,
    Data5=spm_scheduled)
airloop = Ironbug_AirLoopHVAC(Supply=merge, Demand=airloopbranches, SizingSystem=sizingsystem, dupNum=False)

# ----
# Chilled water loop
panel_4 = Panel("0")
chiller_watercooled = Ironbug_ChillerElectricEIR_WaterCooled(dupNum=False)  # -> ChillerElectricEIR, ChillerElectricEIR_CondenserLoop
objparams_5 = IB_ObjParams(
    Coefficient1OfthePartLoadPerformanceCurve=panel_4,
    Coefficient2OfthePartLoadPerformanceCurve="0.0216",
    Coefficient3OfthePartLoadPerformanceCurve="-0.0325",
    Coefficient4OfthePartLoadPerformanceCurve="1.0095",
    RatedPumpHead="119563",
    DataFieldSetType="Ironbug.HVAC.IB_PumpVariableSpeed_FieldSet")
objparams_6 = IB_ObjParams(
    DesignLoopExitTemperature="6.7",
    LoopDesignTemperatureDifference="6.7",
    DataFieldSetType="Ironbug.HVAC.IB_SizingPlant_FieldSet")
objparams_7 = IB_ObjParams(MaximumLoopTemperature="98", DataFieldSetType="Ironbug.HVAC.IB_PlantLoop_FieldSet")
pumpvariable = Ironbug_PumpVariableSpeed(Parameters=objparams_5, dupNum=False)
plantbranches = PlantBranches(Branch1=chiller_watercooled.ChillerElectricEIR, mapBranchToLoop=False)
spm_scheduled_2 = Ironbug_SetpointManagerScheduled(Temperature="6.7", dupNum=False)
branches = PlantBranches(Branch1=coilclnwater_2.WaterSide_CoilCoolingWater, Branch=duplicate.WaterSide_CoilCoolingWater, mapBranchToLoop=False)
sizingplant = Ironbug_SizingPlant(Parameters_=objparams_6, dupNum=False)
cwloop = Ironbug_ChilledWaterPlantLoop(
    Supply=[pumpvariable, plantbranches, spm_scheduled_2],
    Demand=branches,
    SizingLoop=sizingplant,
    Parameters_=objparams_7,
    dupNum=False)

# ----
# Condenser water loop
panel_5 = Panel("0")
objparams_8 = IB_ObjParams(
    Coefficient1OfthePartLoadPerformanceCurve=panel_5,
    Coefficient2OfthePartLoadPerformanceCurve="0.0216",
    Coefficient3OfthePartLoadPerformanceCurve="-0.0325",
    Coefficient4OfthePartLoadPerformanceCurve="1.0095",
    RatedPumpHead="134508",
    DataFieldSetType="Ironbug.HVAC.IB_PumpVariableSpeed_FieldSet")
coolingtowerv = Ironbug_CoolingTowerVariableSpeed(dupNum=False)
pipeadiabatic = Ironbug_PipeAdiabatic(dupNum=False)
objparams_9 = IB_ObjParams(MaximumLoopTemperature="80", MinimumLoopTemperature="5", DataFieldSetType="Ironbug.HVAC.IB_PlantLoop_FieldSet")
spm_followoatemp = Ironbug_SetpointManagerFollowOutdoorAirTemperature(MaximumSetpointTemperature="80", MinimumSetpointTemperature="5", OffsetTemperatureDifference="0", dupNum=False)
pumpvariable_2 = Ironbug_PumpVariableSpeed(Parameters=objparams_8, dupNum=False)
branches_2 = PlantBranches(Branch1=coolingtowerv, Branch=pipeadiabatic, mapBranchToLoop=False)
branches_3 = PlantBranches(Branch1=chiller_watercooled.ChillerElectricEIR_CondenserLoop, mapBranchToLoop=False)
dwloop = Ironbug_CondenserWaterPlantLoop(Supply=[pumpvariable_2, branches_2, spm_followoatemp], Demand=branches_3, Parameters_=objparams_9, dupNum=False)

# ----
# Hot water loop
panel_6 = Panel("0")
objparams_10 = IB_ObjParams(
    Coefficient1OfthePartLoadPerformanceCurve=panel_6,
    Coefficient2OfthePartLoadPerformanceCurve="0.0216",
    Coefficient3OfthePartLoadPerformanceCurve="-0.0325",
    Coefficient4OfthePartLoadPerformanceCurve="1.0095",
    RatedPumpHead="119563",
    DataFieldSetType="Ironbug.HVAC.IB_PumpVariableSpeed_FieldSet")
objparams_11 = IB_ObjParams(NominalThermalEfficiency="0.9", DataFieldSetType="Ironbug.HVAC.IB_BoilerHotWater_FieldSet")
boilerhw = Ironbug_BoilerHotWater(Parameters=objparams_11, dupNum=False)
pumpvariable_3 = Ironbug_PumpVariableSpeed(Parameters=objparams_10, dupNum=False)
branches_4 = PlantBranches(Branch1=boilerhw, mapBranchToLoop=False)
branches_5 = PlantBranches(B1=duplicate_2.WaterSide_CoilHeatingWater, B2=coilhtnwater_2.WaterSide_CoilHeatingWater, mapBranchToLoop=False)
spm_scheduled_3 = Ironbug_SetpointManagerScheduled(Temperature="67", dupNum=False)
hwloop = Ironbug_HotWaterPlantLoop(Supply=[pumpvariable_3, branches_4, spm_scheduled_3], Demand=branches_5, dupNum=False)

# ----
# HBZones
merge_2 = Merge(Data1=hwloop, Data2=cwloop, Data3=dwloop)
hvacsystem = Ironbug_HVACSystem(AirLoops=flatten(airloop), PlantLoops=flatten(merge_2))

hvacsystem_2 = ClusterOutput(hvacsystem)
