# Grasshopper definition Sys12_Active Chilled Beams + DOAS.gh (Grasshopper 1.0.7)

# ---- group: Sys12_Active Chilled Beams + DOAS
# Double click the component for more details
sys12 = Sys12()

# ==== cluster Sys12
hbrooms = ClusterInput()  # Honeybee Rooms to which the HVAC system should be assigned.
data = Data(flatten(hbrooms))

# ----
# ADEG Water Chiller
cluster = Cluster()  # -> cvbiquadratic, cvbiquadratic_2, curve
objparams = IB_ObjParams(
    CoolingCapacityFunctionOfTemperature=cluster.cvbiquadratic,
    ElectricInputToCoolingOutputRatioFunctionOfPLR=cluster.curve,
    ElectricInputToCoolingOutputRatioFunctionOfTemperature=cluster.cvbiquadratic_2,
    DataFieldSetType="Ironbug.HVAC.IB_ChillerElectricEIR_FieldSet")
chiller_watercooled = IB_ChillerElectricEIR_WaterCooled(Parameters_=objparams, dupNum=False)  # -> ChillerElectricEIR, graft(ChillerElectricEIR_CondenserLoop)

# ----
# Chilled Beam + Baseboard
panel = Panel("zone")
roomsbyattr = HBRoomsByAttribute(rooms=flatten(data), attribute=panel)  # -> values, rooms; plug-in component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
coil_cooledbeam = Ironbug_CoilCoolingCooledBeam(dupNum=False)  # -> CoilCoolingCooledBeam, WaterSide_CoilCoolingWater
lng = ListLength(List=roomsbyattr.values)
coilhtn_baseboard = Ironbug_CoilHeatingWaterBaseboard(dupNum=False)  # -> CoilHeatingWaterBaseboard, WaterSide_CoilHeatingWater
duplicate = Ironbug_Duplicate(Reference=coil_cooledbeam.CoilCoolingCooledBeam, Amount=lng)  # -> Objects, WaterSide_CoilCoolingWater
duplicate_2 = Ironbug_Duplicate(Reference=coilhtn_baseboard.CoilHeatingWaterBaseboard, Amount=lng)  # -> Objects, WaterSide_CoilHeatingWater
baseboardwaterc = Ironbug_ZoneHVACBaseboardConvectiveWater(CoilHeatingWaterBaseboard=duplicate_2.Objects, dupNum=False)

# ----
# HBZones
panel_2 = Panel("Active")
objparams_2 = IB_ObjParams(CooledBeamType=panel_2, DataFieldSetType="Ironbug.HVAC.IB_AirTerminalSingleDuctConstantVolumeCooledBeam_FieldSet")
objparams_3 = IB_ObjParams(
    Coefficient2OfthePartLoadPerformanceCurve="0.0216",
    Coefficient3OfthePartLoadPerformanceCurve="-0.0325",
    Coefficient4OfthePartLoadPerformanceCurve="1.0095",
    RatedPumpHead="134508",
    DataFieldSetType="Ironbug.HVAC.IB_PumpVariableSpeed_FieldSet")
objparams_4 = IB_ObjParams(
    Coefficient2OfthePartLoadPerformanceCurve="0.0216",
    Coefficient3OfthePartLoadPerformanceCurve="-0.0325",
    Coefficient4OfthePartLoadPerformanceCurve="1.0095",
    RatedPumpHead="119563",
    DataFieldSetType="Ironbug.HVAC.IB_PumpVariableSpeed_FieldSet")
objparams_5 = IB_ObjParams(
    EconomizerLockout=Toggle(False),
    FrostControlType="ExhaustOnly",
    InitialDefrostTimeFraction="0.1670",
    RateofDefrostTimeFractionIncrease="0.024",
    ThresholdTemperature="-12.2",
    DataFieldSetType="Ironbug.HVAC.IB_HeatExchangerAirToAirSensibleAndLatent_FieldSet")
objparams_6 = IB_ObjParams(PressureRise="500", DataFieldSetType="Ironbug.HVAC.IB_FanVariableVolume_FieldSet")
heatexchanger_air = Ironbug_HeatExchangerAirToAirSensibleAndLatent(Parameters_=objparams_5, dupNum=False)
coilclnwater = Ironbug_CoilCoolingWater(dupNum=False)  # -> AirSide_CoilCoolingWater, WaterSide_CoilCoolingWater
coilhtnwater = Ironbug_CoilHeatingWater(dupNum=False)  # -> AirSide_CoilHeatingWater, WaterSide_CoilHeatingWater

chilledbeam = Ironbug_AirTerminalChilledBeam(CoolingCoil=duplicate.Objects, Parameters_=objparams_2, dupNum=False)
thermalzone = Ironbug_ThermalZone(
    HoneybeeZonesOrOsZones=data,
    AirTerminal_=chilledbeam,
    ZoneEquipment=baseboardwaterc,
    IsAirTerminalPriorToZoneEquipments=True,
    allowMultiAirloops=False,
    dupNum=False)

# ----
# DOAS
panel_3 = Panel("VentilationRequirement")
objparams_7 = IB_ObjParams(
    CentralHeatingDesignSupplyAirTemperature="40",
    CentralHeatingMaximumSystemAirFlowRatio="1",
    TypeofLoadtoSizeOn=panel_3,
    DataFieldSetType="Ironbug.HVAC.IB_SizingSystem_FieldSet")
oasystem = Ironbug_OutdoorAirSystem(HeatRecovery_=heatexchanger_air)
airloopbranches = AirLoopBranches(Branch1=thermalzone)
fanvariable = Ironbug_FanVariableVolume(Parameters_=objparams_6, dupNum=False)
spm_scheduled = Ironbug_SetpointManagerScheduled(Temperature="20", dupNum=False)
objparams_8 = IB_ObjParams(Name="DOAS", DataFieldSetType="Ironbug.HVAC.IB_AirLoopHVAC_FieldSet")
sizingsystem = Ironbug_SizingSystem(Parameters_=objparams_7, dupNum=False)
merge = Merge(
    Data1=oasystem,
    Data2=coilclnwater.AirSide_CoilCoolingWater,
    Data3=coilhtnwater.AirSide_CoilHeatingWater,
    Data4=fanvariable,
    Data5=spm_scheduled)
airloop = Ironbug_AirLoopHVAC(Supply=merge, Demand=airloopbranches, SizingSystem=sizingsystem, Parameters_=objparams_8, dupNum=False)

# ----
# Chilled water loop
graft = GraftTree(Tree=duplicate.WaterSide_CoilCoolingWater, IncludeEmptyLists=True, IncludeNullItems=True)
objparams_9 = IB_ObjParams(
    DesignLoopExitTemperature="6.7",
    LoopDesignTemperatureDifference="6.7",
    LoopType="Cooling",
    DataFieldSetType="Ironbug.HVAC.IB_SizingPlant_FieldSet")
pumpvariable = Ironbug_PumpVariableSpeed(Parameters=objparams_4, dupNum=False)
branches = PlantBranches(B1=graft, B2=coilclnwater.WaterSide_CoilCoolingWater, mapBranchToLoop=False)
branches_2 = PlantBranches(Branch1=chiller_watercooled.ChillerElectricEIR, mapBranchToLoop=False)
spm_scheduled_2 = Ironbug_SetpointManagerScheduled(Temperature="6.7", dupNum=False)
sizingplant = Ironbug_SizingPlant(Parameters_=objparams_9, dupNum=False)
cwloop = Ironbug_ChilledWaterPlantLoop(Supply=[pumpvariable, branches_2, spm_scheduled_2], Demand=branches, SizingLoop=sizingplant, dupNum=False)

# ----
# Condenser water loop
coolingtowerv = Ironbug_CoolingTowerVariableSpeed(dupNum=False)
pipeadiabatic = Ironbug_PipeAdiabatic(dupNum=False)
spm_followoatemp = Ironbug_SetpointManagerFollowOutdoorAirTemperature(dupNum=False)
pumpvariable_2 = Ironbug_PumpVariableSpeed(Parameters=objparams_3, dupNum=False)
plantbranches = PlantBranches(Branch1=chiller_watercooled.ChillerElectricEIR_CondenserLoop, mapBranchToLoop=False)
branches_3 = PlantBranches(B1=coolingtowerv, B2=pipeadiabatic, mapBranchToLoop=False)
dwloop = Ironbug_CondenserWaterPlantLoop(Supply=[pumpvariable_2, branches_3, spm_followoatemp], Demand=plantbranches, dupNum=False)

# ----
# Hot water loop
panel_4 = Panel("0.9")
graft_2 = GraftTree(Tree=duplicate_2.WaterSide_CoilHeatingWater, IncludeEmptyLists=True, IncludeNullItems=True)
pumpvariable_3 = Ironbug_PumpVariableSpeed(Parameters=objparams_4, dupNum=False)
spm_scheduled_3 = Ironbug_SetpointManagerScheduled(Temperature="67", dupNum=False)
branches_4 = PlantBranches(B1=graft_2, B2=coilhtnwater.WaterSide_CoilHeatingWater, mapBranchToLoop=False)

objparams_10 = IB_ObjParams(NominalThermalEfficiency=panel_4, DataFieldSetType="Ironbug.HVAC.IB_BoilerHotWater_FieldSet")

boiler = Ironbug_BoilerHotWater(Parameters_=objparams_10, dupNum=False)
plantbranches_2 = PlantBranches(Branch1=boiler, mapBranchToLoop=False)
hwloop = Ironbug_HotWaterPlantLoop(Supply=[pumpvariable_3, plantbranches_2, spm_scheduled_3], Demand=branches_4, dupNum=False)

merge_2 = Merge(Data1=hwloop, Data2=cwloop, Data3=dwloop)
hvacsystem = Ironbug_HVACSystem(AirLoops=flatten(airloop), PlantLoops=flatten(merge_2))

hvacsystem_2 = ClusterOutput(hvacsystem)

# ==== cluster Cluster
panel = Panel("""1.41E-01
6.55E-01
2.03E-01""")
objparams = IB_ObjParams(MaximumValueofx="20", MaximumValueofy="50", DataFieldSetType="Ironbug.HVAC.Curves.IB_CurveBiquadratic_FieldSet")
objparams_2 = IB_ObjParams(MaximumValueofx="20", MaximumValueofy="50", DataFieldSetType="Ironbug.HVAC.Curves.IB_CurveBiquadratic_FieldSet")
panel_2 = Panel("""4.68E-01
-1.38E-02
6.98E-04
1.09E-02
4.62E-04
-6.82E-04""")
objparams_3 = IB_ObjParams(MaximumValueofx="1.2", DataFieldSetType="Ironbug.HVAC.Curves.IB_CurveQuadratic_FieldSet")
panel_3 = Panel("""1.07E+00
4.29E-02
4.17E-04
-8.10E-03
-4.02E-05
-3.86E-04""")
curvebiquadratic = Ironbug_CurveBiquadratic(Coefficients=panel_3, Parameters_=objparams, dupNum=False)
curvebiquadratic_2 = Ironbug_CurveBiquadratic(Coefficients=panel_2, Parameters_=objparams_2, dupNum=False)
curvequadratic = Ironbug_CurveQuadratic(Coefficients=panel, Parameters_=objparams_3, dupNum=False)
curve = ClusterOutput(curvequadratic)
cvbiquadratic = ClusterOutput(curvebiquadratic)
cvbiquadratic_2 = ClusterOutput(curvebiquadratic_2)
