# Grasshopper definition Sys13_RadiantPanel + DOAS.gh (Grasshopper 1.0.7)

# ---- group: Rooms with radiant system
data = Data()

# ----
# Set the new construction set to the room
# Get room's construction set
# a = x.properties.energy.construction_set
python = GhPythonScript(x=data)  # -> out, a
# ---------- python: Python ----------
if x:
    a = x.properties.energy.construction_set
    print(x.properties.energy.construction_set.display_name)
# ---------- end python ----------
panel = Panel(python.out)

# ----
# Create a construction with INTERNAL SOURCE material
panel_2 = Panel("INTERNAL SOURCE")
opaquematnomass = HBOpaqueMaterialNoMass(name=panel_2, r_value="1")  # -> mat; plug-in component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
merge = Merge(
    Data1="8 in. Normalweight Concrete Floor",
    Data2="Roof Insulation [18]",
    Data3="Metal Surface",
    Data4=opaquematnomass,
    Data5="Metal Surface")
opaqueconstr = HBOpaqueConstruction(name="Radiant Construction", materials=merge)  # -> constr; plug-in component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
exteriorsubset = HBExteriorConstructionSubset(exterior_roof=opaqueconstr)  # -> exterior_set; plug-in component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
constructionset = HBConstructionSet(name="CSet_Rad", base_constr_set=python.a, exterior_subset=exteriorsubset)  # -> constr_set; plug-in component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

applyconstrset = HBApplyConstructionSet(rooms=data, constr_set=constructionset)  # -> rooms; plug-in component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
sys13 = Sys13(hbrooms=flatten(applyconstrset))

# ==== cluster Sys13

# ----
# Room
# with Radiant cooling and heating ceiling
hbrooms = ClusterInput()  # Honeybee Rooms to which the HVAC system should be assigned.
data = Data(hbrooms)

c_script = CSharpScript(GPM="950")  # -> m3s; inputs GPM: Double
# ---------- c_script: C# ----------
    m3s = GPM * 0.0000630902;
# ---------- end c_script ----------
objparams = IB_ObjParams(
    Coefficient1OfthePartLoadPerformanceCurve="0",
    Coefficient2OfthePartLoadPerformanceCurve="0.0216",
    Coefficient3OfthePartLoadPerformanceCurve="-0.0325",
    Coefficient4OfthePartLoadPerformanceCurve="1.0095",
    RatedFlowRate=c_script,
    DataFieldSetType="Ironbug.HVAC.IB_PumpVariableSpeed_FieldSet")
pumpvariable = Ironbug_PumpVariableSpeed(Parameters=objparams, dupNum=False)

c_script_2 = CSharpScript(GPM="740")  # -> m3s; inputs GPM: Double; same code as c_script
objparams_2 = IB_ObjParams(
    Coefficient1OfthePartLoadPerformanceCurve="0",
    Coefficient2OfthePartLoadPerformanceCurve="0.0216",
    Coefficient3OfthePartLoadPerformanceCurve="-0.0325",
    Coefficient4OfthePartLoadPerformanceCurve="1.0095",
    RatedFlowRate=c_script_2,
    DataFieldSetType="Ironbug.HVAC.IB_PumpVariableSpeed_FieldSet")
pumpvariable_2 = Ironbug_PumpVariableSpeed(Parameters=objparams_2, dupNum=False)

objparams_3 = IB_ObjParams(
    Coefficient1OfthePartLoadPerformanceCurve="0",
    Coefficient2OfthePartLoadPerformanceCurve="0.0216",
    Coefficient3OfthePartLoadPerformanceCurve="-0.0325",
    Coefficient4OfthePartLoadPerformanceCurve="1.0095",
    DataFieldSetType="Ironbug.HVAC.IB_PumpVariableSpeed_FieldSet")
pumpvariable_3 = Ironbug_PumpVariableSpeed(Parameters=objparams_3, dupNum=False)

pipeadiabatic = Ironbug_PipeAdiabatic(dupNum=False)

roomsbyattr = HBRoomsByAttribute(rooms=flatten(data), attribute="zone")  # -> values, rooms; plug-in component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
# Zone Radiant Panels
objparams_4 = IB_ObjParams(HeatingControlThrottlingRange="2", DataFieldSetType="Ironbug.HVAC.IB_CoilHeatingLowTempRadiantVarFlow_FieldSet")
objparams_5 = IB_ObjParams(CoolingControlThrottlingRange="2", DataFieldSetType="Ironbug.HVAC.IB_CoilCoolingLowTempRadiantVarFlow_FieldSet")
lng = ListLength(List=roomsbyattr.values)
objparams_6 = IB_ObjParams(RadiantSurfaceType="Ceilings", DataFieldSetType="Ironbug.HVAC.IB_ZoneHVACLowTempRadiantVarFlow_FieldSet")
vavnoreheat = Ironbug_AirTerminalSingleDuctVAVNoReheat(DuplicateNumber_=lng, dupNum=True)

data_2 = Data(lng)
coilhtn_lowtradv = Ironbug_CoilHeatingLowTempRadiantVarFlow(LowAirTemperature="21", Parameters_=objparams_4, DuplicateNumber_=data_2, dupNum=True)  # -> CoilHeatingLowTempRadiantVarFlow, graft(WaterSide_CoilHeatingLowTempRadiantVarFlow)
coilcln_lowtradv = Ironbug_CoilCoolingLowTempRadiantVarFlow(HighAirTemperature="24", Parameters_=objparams_5, DuplicateNumber_=data_2, dupNum=True)  # -> CoilCoolingLowTempRadiantVarFlow, graft(WaterSide_CoilCoolingLowTempRadiantVarFlow)
radiantvflow = Ironbug_ZoneHVACLowTempRadiantVarFlow(
    HeatingCoil=coilhtn_lowtradv.CoilHeatingLowTempRadiantVarFlow,
    CoolingCoil=coilcln_lowtradv.CoilCoolingLowTempRadiantVarFlow,
    Parameters_=objparams_6,
    dupNum=False)

thermalzone = Ironbug_ThermalZone(
    HoneybeeZonesOrOsZones=data,
    AirTerminal_=vavnoreheat,
    ZoneEquipment=radiantvflow,
    IsAirTerminalPriorToZoneEquipments=True,
    allowMultiAirloops=False,
    dupNum=False)

# ----
# DOAS
panel = Panel("VentilationRequirement")
objparams_7 = IB_ObjParams(ControlVariable="HumidityRatio", DataFieldSetType="Ironbug.HVAC.IB_ControllerWaterCoil_FieldSet")
objparams_8 = IB_ObjParams(
    CentralCoolingDesignSupplyAirTemperature="20",
    CentralHeatingDesignSupplyAirTemperature="20",
    CentralHeatingMaximumSystemAirFlowRatio="1",
    TypeofLoadtoSizeOn=panel,
    DataFieldSetType="Ironbug.HVAC.IB_SizingSystem_FieldSet")
controllerwatercoil = Ironbug_ControllerWaterCoil(Parameters_=objparams_7, dupNum=False)
humidity_ratio = Panel("0.009")
coilclnwater_adv = Ironbug_CoilCoolingWater_Adv(ControllerWaterCoil=controllerwatercoil, dupNum=False)  # -> flatten(AirSide_CoilCoolingWater), WaterSide_CoilCoolingWater
coilhtnwater = Ironbug_CoilHeatingWater(dupNum=False)  # -> AirSide_CoilHeatingWater, WaterSide_CoilHeatingWater
oasystem = Ironbug_OutdoorAirSystem()
spm_scheduled = Ironbug_SetpointManagerScheduled(Temperature=humidity_ratio, ControlVariable="MaximumHumidityRatio", dupNum=False)
fanvariable = Ironbug_FanVariableVolume(dupNum=False)
sizingsystem = Ironbug_SizingSystem(Parameters_=objparams_8, dupNum=False)
spm_scheduled_2 = Ironbug_SetpointManagerScheduled(Temperature="20", dupNum=False)
airloopbranches = AirLoopBranches(Branch1=thermalzone)
merge = Merge(
    Data2=oasystem,
    Data3=coilclnwater_adv.AirSide_CoilCoolingWater,
    Data4=spm_scheduled,
    Data5=coilhtnwater.AirSide_CoilHeatingWater,
    Data6=fanvariable,
    Data7=spm_scheduled_2)
airloop = Ironbug_AirLoopHVAC(Supply=merge, Demand=airloopbranches, SizingSystem=sizingsystem, dupNum=False)

# ----
# Chilled water loop
panel_2 = Panel("CoolingSetpointModulated")
objparams_9 = IB_ObjParams(ControlType=panel_2, DataFieldSetType="Ironbug.HVAC.IB_HeatExchangerFluidToFluid_FieldSet")
pipeadiabatic_2 = Ironbug_PipeAdiabatic(dupNum=False)
chiller_aircooled = Ironbug_ChillerElectricEIR_AirCooled(dupNum=False)
_55f = Panel("12.78")
heatexchangerfluid = Ironbug_HeatExchangerFluidToFluid(Parameters_=objparams_9, dupNum=False)  # -> AtDemand, AtSupply
branches = PlantBranches(B1=graft(coilclnwater_adv.WaterSide_CoilCoolingWater), B2=graft(pipeadiabatic_2), mapBranchToLoop=False)
objparams_10 = IB_ObjParams(DesignLoopExitTemperature=_55f, DataFieldSetType="Ironbug.HVAC.IB_SizingPlant_FieldSet")
spm_scheduled_3 = Ironbug_SetpointManagerScheduled(Temperature=_55f, dupNum=False)
branches_2 = PlantBranches(B1=chiller_aircooled, B2=pipeadiabatic_2, mapBranchToLoop=False)
objparams_11 = IB_ObjParams(
    MaximumLoopTemperature="98",
    MinimumLoopTemperature="1",
    Name="Main Chilled Water Loop",
    DataFieldSetType="Ironbug.HVAC.IB_PlantLoop_FieldSet")
sizingplant = Ironbug_SizingPlant(Parameters_=objparams_10, dupNum=False)
merge_2 = Merge(Data1=flatten(branches), Data2=flatten(heatexchangerfluid.AtDemand))
cwloop = Ironbug_ChilledWaterPlantLoop(
    Supply=[pumpvariable, branches_2, spm_scheduled_3],
    Demand=merge_2,
    SizingLoop=sizingplant,
    Parameters_=objparams_11,
    dupNum=False)

# ----
# Hot water loop
_130f = Panel("54.44")
boiler = Ironbug_BoilerHotWater(dupNum=False)
pipeadiabatic_3 = Ironbug_PipeAdiabatic(dupNum=False)
branches_3 = PlantBranches(
    B1=graft(coilhtnwater.WaterSide_CoilHeatingWater),
    B2=graft(coilhtn_lowtradv.WaterSide_CoilHeatingLowTempRadiantVarFlow),
    B3=graft(pipeadiabatic_3),
    mapBranchToLoop=False)
objparams_12 = IB_ObjParams(DesignLoopExitTemperature=_130f, DataFieldSetType="Ironbug.HVAC.IB_SizingPlant_FieldSet")
plantbranches = PlantBranches(B1=boiler, B2=pipeadiabatic_3, mapBranchToLoop=False)
spm_scheduled_4 = Ironbug_SetpointManagerScheduled(Temperature=_130f, dupNum=False)
sizingplant_2 = Ironbug_SizingPlant(Parameters_=objparams_12, dupNum=False)
hwloop = Ironbug_HotWaterPlantLoop(Supply=[pumpvariable_2, plantbranches, spm_scheduled_4], Demand=branches_3, SizingLoop=sizingplant_2, dupNum=False)

# ----
# Compensated Chilled water loop
# for radiant cooling panels
_65f = Panel("18.33")
pipeadiabatic_4 = Ironbug_PipeAdiabatic(dupNum=False)
objparams_13 = IB_ObjParams(DesignLoopExitTemperature=_65f, DataFieldSetType="Ironbug.HVAC.IB_SizingPlant_FieldSet")
objparams_14 = IB_ObjParams(Name="Compensated Chilled water loop", DataFieldSetType="Ironbug.HVAC.IB_PlantLoop_FieldSet")
spm_scheduled_5 = Ironbug_SetpointManagerScheduled(Temperature=_65f, dupNum=False)
branches_4 = PlantBranches(Branch1=heatexchangerfluid.AtSupply, Branch=pipeadiabatic, mapBranchToLoop=False)
branches_5 = PlantBranches(B1=coilcln_lowtradv.WaterSide_CoilCoolingLowTempRadiantVarFlow, B2=pipeadiabatic_4, mapBranchToLoop=False)
sizingplant_3 = Ironbug_SizingPlant(Parameters_=objparams_13, dupNum=False)
cwloop_2 = Ironbug_ChilledWaterPlantLoop(
    Supply=[pumpvariable_3, branches_4, spm_scheduled_5],
    Demand=branches_5,
    SizingLoop=sizingplant_3,
    Parameters_=objparams_14,
    dupNum=False)

hvacsystem = Ironbug_HVACSystem(AirLoops=flatten(airloop), PlantLoops=flatten([hwloop, cwloop, cwloop_2]))
hvacsystem_2 = ClusterOutput(hvacsystem)
