# Grasshopper definition Sys16_VRF + DOAS.gh (Grasshopper 1.0.7)

# ---- group: Sys16_VRF + DOAS
# Double click the component for more details
sys16 = Sys16()

# ==== cluster Sys16
hbrooms = ClusterInput()  # Honeybee Rooms to which the HVAC system should be assigned.
data = Data(flatten(hbrooms))

# ----
# VRF Terminals
panel = Panel("zone")
roomsbyattr = HBRoomsByAttribute(rooms=flatten(data), attribute=panel)  # -> values, rooms; plug-in component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
vrfterminal = Ironbug_ZoneHVACTerminalUnitVariableRefrigerantFlow(airloop=False, dupNum=False)  # -> VRFUnit_In, VRFUnit_Out
lng = ListLength(List=roomsbyattr.values)
duplicate = Ironbug_Duplicate(Reference=vrfterminal.VRFUnit_In, Amount=lng)  # -> Objects, ZoneHVACTerminalUnitVariableRefrigerantFlow
thermalzone = Ironbug_ThermalZone(
    HoneybeeZonesOrOsZones=data,
    ZoneEquipment=duplicate.Objects,
    IsAirTerminalPriorToZoneEquipments=True,
    allowMultiAirloops=False,
    dupNum=False)

# ----
# DOAS
panel_2 = Panel("VentilationRequirement")
oasystem = Ironbug_OutdoorAirSystem()
coilclndx1 = Ironbug_CoilCoolingDXSingleSpeed(dupNum=False)
coilhtngas = Ironbug_CoilHeatingGas(dupNum=False)
airloopbranches = AirLoopBranches(Branch1=thermalzone)
spm_scheduled = Ironbug_SetpointManagerScheduled(Temperature="20", dupNum=False)
objparams = IB_ObjParams(Name="DOAS", DataFieldSetType="Ironbug.HVAC.IB_AirLoopHVAC_FieldSet")

# ----
# HBZones
panel_3 = Panel("500")
objparams_2 = IB_ObjParams(PressureRise=panel_3, DataFieldSetType="Ironbug.HVAC.IB_FanConstantVolume_FieldSet")
objparams_3 = IB_ObjParams(MinimumHeatPumpPartLoadRatio="0.5", DataFieldSetType="Ironbug.HVAC.IB_AirConditionerVariableRefrigerantFlow_FieldSet")
vrfsystem = Ironbug_AirConditionerVariableRefrigerantFlow(_terminals=duplicate.ZoneHVACTerminalUnitVariableRefrigerantFlow, Parameters_=objparams_3, dupNum=False)

objparams_4 = IB_ObjParams(
    CentralHeatingDesignSupplyAirTemperature="40",
    CentralHeatingMaximumSystemAirFlowRatio="1",
    TypeofLoadtoSizeOn=panel_2,
    DataFieldSetType="Ironbug.HVAC.IB_SizingSystem_FieldSet")
fanconstant = Ironbug_FanConstantVolume(Parameters_=objparams_2, dupNum=False)
sizingsystem = Ironbug_SizingSystem(Parameters_=objparams_4, dupNum=False)
merge = Merge(Data1=oasystem, Data2=coilclndx1, Data3=coilhtngas, Data4=fanconstant, Data5=spm_scheduled)
airloop = Ironbug_AirLoopHVAC(Supply=merge, Demand=airloopbranches, SizingSystem=sizingsystem, Parameters_=objparams, dupNum=False)

hvacsystem = Ironbug_HVACSystem(AirLoops=flatten(airloop), VRFSystems=flatten(vrfsystem))

hvacsystem_2 = ClusterOutput(hvacsystem)
