# Grasshopper definition Sys01_PTAC_AllElec.gh (Grasshopper 1.0.7)

# ---- group: Sys01_PTAC_AllElec
# Double click the component for more details
sys01 = Sys01()

# ==== cluster Sys01
hbrooms = ClusterInput()  # Honeybee Rooms to which the HVAC system should be assigned.

# ----
# Cooling Coil Performance Curves
panel = Panel("1")
objparams = IB_ObjParams(
    MaximumCurveOutput=panel,
    MaximumValueofx=panel,
    MinimumCurveOutput="0.7",
    MinimumValueofx="0",
    DataFieldSetType="Ironbug.HVAC.Curves.IB_CurveQuadratic_FieldSet")
panel_2 = Panel("""0.342414409
0.034885008
-0.0006237
0.004977216
0.000437951
-0.000728028""")
objparams_2 = IB_ObjParams(MaximumValueofx="1.5", MinimumValueofx="0.5", DataFieldSetType="Ironbug.HVAC.Curves.IB_CurveQuadratic_FieldSet")
panel_3 = Panel("""1.1552
-0.1808
0.0256""")
objparams_3 = IB_ObjParams(
    MaximumValueofx="23.89",
    MaximumValueofy="46.11",
    MinimumValueofx="12.78",
    MinimumValueofy="23.89",
    DataFieldSetType="Ironbug.HVAC.Curves.IB_CurveBiquadratic_FieldSet")
panel_4 = Panel("""0.85
0.15
0""")
curvequadratic = IB_CurveQuadratic(Coefficients=panel_3, Parameters_=objparams_2, dupNum=False)
curvebiquadratic = IB_CurveBiquadratic(Coefficients=panel_2, Parameters_=objparams_3, dupNum=False)
curvequadratic_2 = IB_CurveQuadratic(Coefficients=panel_4, Parameters_=objparams, dupNum=False)
objparams_4 = IB_ObjParams(MaximumValueofx="1.5", MinimumValueofx="0.5", DataFieldSetType="Ironbug.HVAC.Curves.IB_CurveQuadratic_FieldSet")
panel_5 = Panel("""0.942587793
0.009543347
0.00068377
-0.011042676
0.000005249
-0.00000972""")
panel_6 = Panel("""0.8
0.2
0""")
objparams_5 = IB_ObjParams(
    MaximumValueofx="23.89",
    MaximumValueofy="46.11",
    MinimumValueofx="12.78",
    MinimumValueofy="23.89",
    DataFieldSetType="Ironbug.HVAC.Curves.IB_CurveBiquadratic_FieldSet")
curvequadratic_3 = IB_CurveQuadratic(Coefficients=panel_6, Parameters_=objparams_4, dupNum=False)
curvebiquadratic_2 = IB_CurveBiquadratic(Coefficients=panel_5, Parameters_=objparams_5, dupNum=False)
objparams_6 = IB_ObjParams(
    EnergyInputRatioFunctionOfFlowFractionCurve=curvequadratic,
    EnergyInputRatioFunctionOfTemperatureCurve=curvebiquadratic,
    PartLoadFractionCorrelationCurve=curvequadratic_2,
    TotalCoolingCapacityFunctionOfFlowFractionCurve=curvequadratic_3,
    TotalCoolingCapacityFunctionOfTemperatureCurve=curvebiquadratic_2,
    DataFieldSetType="Ironbug.HVAC.IB_CoilCoolingDXSingleSpeed_FieldSet")

# ----
# HBRooms
# PTAC
rooms = Data(flatten(hbrooms))

roomsbyattr = HBRoomsByAttribute(rooms=flatten(rooms), attribute="zone")  # -> values, rooms; plug-in component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
lng = ListLength(List=roomsbyattr.values)
panel_7 = Panel(lng)
objparams_7 = IB_ObjParams(FanEfficiency="0.52", PressureRise="331", DataFieldSetType="Ironbug.HVAC.IB_FanOnOff_FieldSet")
objparams_8 = IB_ObjParams(ZoneHeatingDesignSupplyAirTemperature="50", DataFieldSetType="Ironbug.HVAC.IB_SizingZone_FieldSet")
coilclndx1 = IB_CoilCoolingDXSingleSpeed(Parameters_=objparams_6, dupNum=False)
coilhtnelec = IB_CoilHeatingElectric(DuplicateNumber_=panel_7, dupNum=True)
fanonoff = IB_FanOnOff(Parameters_=objparams_7, dupNum=False)
ptac = Ironbug_ZoneHVACPackagedTerminalAirConditioner(HeatingCoil=coilhtnelec, CoolingCoil=coilclndx1, Fan_=fanonoff, dupNum=False)
sizingzone = IB_SizingZone(Parameters_=objparams_8, dupNum=False)
thermalzone = Ironbug_ThermalZone(
    HoneybeeZonesOrOsZones=rooms,
    ZoneEquipment=ptac,
    SizingZone=sizingzone,
    IsAirTerminalPriorToZoneEquipments=True,
    allowMultiAirloops=False,
    dupNum=False)

noairloop = Ironbug_NoAirLoop(OSZones=thermalzone)
hvacsystem = Ironbug_HVACSystem(AirLoops=flatten(noairloop))

hvacsystem_2 = ClusterOutput(hvacsystem)
