# Grasshopper definition Sys01_PTAC_Boiler.gh (Grasshopper 1.0.7)

# ---- group: Sys01_PTAC_Boiler
# Double click the component for more details
sys01 = Sys01()

# ==== cluster Sys01

# ----
# Cooling Coil Performance Curves
panel = Panel("1")
objparams = IB_ObjParams(
    MaximumCurveOutput=panel,
    MaximumValueofx=panel,
    MinimumCurveOutput="0.7",
    MinimumValueofx="0",
    DataFieldSetType="Ironbug.HVAC.Curves.IB_CurveQuadratic_FieldSet")
panel_2 = Panel("""0.342414409
0.034885008
-0.0006237
0.004977216
0.000437951
-0.000728028""")
objparams_2 = IB_ObjParams(MaximumValueofx="1.5", MinimumValueofx="0.5", DataFieldSetType="Ironbug.HVAC.Curves.IB_CurveQuadratic_FieldSet")
panel_3 = Panel("""1.1552
-0.1808
0.0256""")
objparams_3 = IB_ObjParams(
    MaximumValueofx="23.89",
    MaximumValueofy="46.11",
    MinimumValueofx="12.78",
    MinimumValueofy="23.89",
    DataFieldSetType="Ironbug.HVAC.Curves.IB_CurveBiquadratic_FieldSet")
panel_4 = Panel("""0.85
0.15
0""")
curvequadratic = IB_CurveQuadratic(Coefficients=panel_3, Parameters_=objparams_2, dupNum=False)
curvebiquadratic = IB_CurveBiquadratic(Coefficients=panel_2, Parameters_=objparams_3, dupNum=False)
curvequadratic_2 = IB_CurveQuadratic(Coefficients=panel_4, Parameters_=objparams, dupNum=False)
objparams_4 = IB_ObjParams(MaximumValueofx="1.5", MinimumValueofx="0.5", DataFieldSetType="Ironbug.HVAC.Curves.IB_CurveQuadratic_FieldSet")
panel_5 = Panel("""0.942587793
0.009543347
0.00068377
-0.011042676
0.000005249
-0.00000972""")
panel_6 = Panel("""0.8
0.2
0""")
objparams_5 = IB_ObjParams(
    MaximumValueofx="23.89",
    MaximumValueofy="46.11",
    MinimumValueofx="12.78",
    MinimumValueofy="23.89",
    DataFieldSetType="Ironbug.HVAC.Curves.IB_CurveBiquadratic_FieldSet")
curvequadratic_3 = IB_CurveQuadratic(Coefficients=panel_6, Parameters_=objparams_4, dupNum=False)
curvebiquadratic_2 = IB_CurveBiquadratic(Coefficients=panel_5, Parameters_=objparams_5, dupNum=False)
objparams_6 = IB_ObjParams(
    EnergyInputRatioFunctionOfFlowFractionCurve=curvequadratic,
    EnergyInputRatioFunctionOfTemperatureCurve=curvebiquadratic,
    PartLoadFractionCorrelationCurve=curvequadratic_2,
    TotalCoolingCapacityFunctionOfFlowFractionCurve=curvequadratic_3,
    TotalCoolingCapacityFunctionOfTemperatureCurve=curvebiquadratic_2,
    DataFieldSetType="Ironbug.HVAC.IB_CoilCoolingDXSingleSpeed_FieldSet")

hbrooms = ClusterInput()  # Honeybee Rooms to which the HVAC system should be assigned.
objparams_7 = IB_ObjParams(
    BoilerFlowMode="LeavingSetpointModulated",
    MaximumPartLoadRatio="1.2",
    NominalThermalEfficiency="0.78",
    DataFieldSetType="Ironbug.HVAC.IB_BoilerHotWater_FieldSet")
coilclndx1 = IB_CoilCoolingDXSingleSpeed(Parameters_=objparams_6, dupNum=False)

# ----
# HBRooms
# PTAC
rooms = Data(flatten(hbrooms))

roomsbyattr = HBRoomsByAttribute(rooms=flatten(rooms), attribute="zone")  # -> values, rooms; plug-in component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
objparams_8 = IB_ObjParams(FanEfficiency="0.52", PressureRise="331", DataFieldSetType="Ironbug.HVAC.IB_FanOnOff_FieldSet")
lng = ListLength(List=roomsbyattr.values)
objparams_9 = IB_ObjParams(ZoneHeatingDesignSupplyAirTemperature="50", DataFieldSetType="Ironbug.HVAC.IB_SizingZone_FieldSet")
coilhtnwater = Ironbug_CoilHeatingWater(DuplicateNumber_=lng, dupNum=True)  # -> AirSide_CoilHeatingWater, graft(WaterSide_CoilHeatingWater)
fanonoff = IB_FanOnOff(Parameters_=objparams_8, dupNum=False)
ptac = Ironbug_ZoneHVACPackagedTerminalAirConditioner(HeatingCoil=coilhtnwater.AirSide_CoilHeatingWater, CoolingCoil=coilclndx1, Fan_=fanonoff, dupNum=False)
sizingzone = IB_SizingZone(Parameters_=objparams_9, dupNum=False)
thermalzone = Ironbug_ThermalZone(
    HoneybeeZonesOrOsZones=rooms,
    ZoneEquipment=ptac,
    SizingZone=sizingzone,
    IsAirTerminalPriorToZoneEquipments=True,
    allowMultiAirloops=False,
    dupNum=False)

# ----
# Hot water loop
panel_7 = Panel("82.2")
boiler = Ironbug_BoilerHotWater(Parameters_=objparams_7, dupNum=False)
objparams_10 = IB_ObjParams(DesignLoopExitTemperature=panel_7, DataFieldSetType="Ironbug.HVAC.IB_SizingPlant_FieldSet")
pumpvariable = Ironbug_PumpVariableSpeed(dupNum=False)
plantbranches = PlantBranches(Branch1=boiler, mapBranchToLoop=False)
plantbranches_2 = PlantBranches(Branch1=coilhtnwater.WaterSide_CoilHeatingWater, mapBranchToLoop=False)
spm_scheduled = Ironbug_SetpointManagerScheduled(Temperature=panel_7, dupNum=False)
sizingplant = IB_SizingPlant(Parameters_=objparams_10, dupNum=False)
hotwaterloop = Ironbug_HotWaterPlantLoop(Supply=[pumpvariable, plantbranches, spm_scheduled], Demand=plantbranches_2, SizingLoop=sizingplant, dupNum=False)

noairloop = Ironbug_NoAirLoop(OSZones=thermalzone)
hvacsystem = Ironbug_HVACSystem(AirLoops=flatten(noairloop), PlantLoops=flatten(hotwaterloop))

hvacsystem_2 = ClusterOutput(hvacsystem)
