# Grasshopper definition Sys02_PTHP_Advanced.gh (Grasshopper 1.0.7)

# ---- group: Sys02_PTHP_Advanced
# Double click the component for more details
sys02 = Sys02()

# ==== cluster Sys02
hbrooms = ClusterInput()  # Honeybee Rooms to which the HVAC system should be assigned.

# ----
# Heating Coil Performance Curves
panel = Panel("-20")
objparams = IB_ObjParams(MaximumValueofx="20", MinimumValueofx=panel, DataFieldSetType="Ironbug.HVAC.Curves.IB_CurveCubic_FieldSet")
objparams_2 = IB_ObjParams(MaximumValueofx="1.5", MinimumValueofx="0.5", DataFieldSetType="Ironbug.HVAC.Curves.IB_CurveCubic_FieldSet")
objparams_3 = IB_ObjParams(MaximumValueofx="20", MinimumValueofx="-20", DataFieldSetType="Ironbug.HVAC.Curves.IB_CurveCubic_FieldSet")
panel_2 = Panel("""1.19248
-0.0300438
0.00103745
-0.000023328""")
panel_3 = Panel("""0.84
0.16
0.0
0.0""")
panel_4 = Panel("""0.758746
0.027626
0.000148716
0.0000034992""")
panel_5 = Panel("""1.3824
-0.4336
0.0512""")
panel_6 = Panel("""0.85
0.15
0""")
curvequadratic = IB_CurveQuadratic(Coefficients=panel_5, dupNum=False)
curvecubic = IB_CurveCubic(Coefficients=panel_2, Parameters_=objparams, dupNum=False)
curvequadratic_2 = IB_CurveQuadratic(Coefficients=panel_6, dupNum=False)
curvecubic_2 = IB_CurveCubic(Coefficients=panel_3, Parameters_=objparams_2, dupNum=False)
curvecubic_3 = IB_CurveCubic(Coefficients=panel_4, Parameters_=objparams_3, dupNum=False)
panel_7 = Panel(""" 0.297145
0.0430933
-0.000748766
0.00597727
0.000482112
-0.000956448""")
objparams_4 = IB_ObjParams(
    MaximumValueofx="29.44",
    MaximumValueofy="29.44",
    MinimumValueofx="-23.33",
    MinimumValueofy="-23.33",
    DataFieldSetType="Ironbug.HVAC.Curves.IB_CurveBiquadratic_FieldSet")
curvebiquadratic = IB_CurveBiquadratic(Coefficients=panel_7, Parameters_=objparams_4, dupNum=False)
objparams_5 = IB_ObjParams(
    DefrostControl="OnDemand",
    DefrostEnergyInputRatioFunctionofTemperatureCurve=curvebiquadratic,
    DefrostStrategy="ReverseCycle",
    EnergyInputRatioFunctionofFlowFractionCurve=curvequadratic,
    EnergyInputRatioFunctionofTemperatureCurve=curvecubic,
    PartLoadFractionCorrelationCurve=curvequadratic_2,
    RatedCOP="3.3",
    TotalHeatingCapacityFunctionofFlowFractionCurve=curvecubic_2,
    TotalHeatingCapacityFunctionofTemperatureCurve=curvecubic_3,
    DataFieldSetType="Ironbug.HVAC.IB_CoilHeatingDXSingleSpeed_FieldSet")

# ----
# Cooling Coil Performance Curves
# For Heat Pump
panel_8 = Panel("1.5")
panel_9 = Panel("""0.297145
0.0430933
-0.000748766
0.00597727
0.000482112
-0.000956448""")
objparams_6 = IB_ObjParams(MaximumValueofx=panel_8, MinimumValueofx="0.5", DataFieldSetType="Ironbug.HVAC.Curves.IB_CurveQuadratic_FieldSet")
objparams_7 = IB_ObjParams(MaximumValueofx="1", MinimumValueofx="0", DataFieldSetType="Ironbug.HVAC.Curves.IB_CurveQuadratic_FieldSet")
panel_10 = Panel("""1.156
-0.1816
0.0256""")
objparams_8 = IB_ObjParams(
    MaximumValueofx="23.89",
    MaximumValueofy="46.11",
    MinimumValueofx="12.78",
    MinimumValueofy="21.1",
    DataFieldSetType="Ironbug.HVAC.Curves.IB_CurveBiquadratic_FieldSet")
panel_11 = Panel("""0.85
0.15
0""")
curvequadratic_3 = IB_CurveQuadratic(Coefficients=panel_10, Parameters_=objparams_6, dupNum=False)
curvebiquadratic_2 = IB_CurveBiquadratic(Coefficients=panel_9, Parameters_=objparams_8, dupNum=False)
curvequadratic_4 = IB_CurveQuadratic(Coefficients=panel_11, Parameters_=objparams_7, dupNum=False)
objparams_9 = IB_ObjParams(MaximumValueofx="1.5", MinimumValueofx="0.5", DataFieldSetType="Ironbug.HVAC.Curves.IB_CurveQuadratic_FieldSet")
panel_12 = Panel("""0.766956
0.0107756
-0.0000414703
0.00134961
-0.000261144
0.000457488""")
panel_13 = Panel("""0.8
0.2
0""")
objparams_10 = IB_ObjParams(
    MaximumValueofx="23.89",
    MaximumValueofy="46.11",
    MinimumValueofx="12.78",
    MinimumValueofy="21.1",
    DataFieldSetType="Ironbug.HVAC.Curves.IB_CurveBiquadratic_FieldSet")
curvequadratic_5 = IB_CurveQuadratic(Coefficients=panel_13, Parameters_=objparams_9, dupNum=False)
curvebiquadratic_3 = IB_CurveBiquadratic(Coefficients=panel_12, Parameters_=objparams_10, dupNum=False)
objparams_11 = IB_ObjParams(
    EnergyInputRatioFunctionOfFlowFractionCurve=curvequadratic_3,
    EnergyInputRatioFunctionOfTemperatureCurve=curvebiquadratic_2,
    PartLoadFractionCorrelationCurve=curvequadratic_4,
    TotalCoolingCapacityFunctionOfFlowFractionCurve=curvequadratic_5,
    TotalCoolingCapacityFunctionOfTemperatureCurve=curvebiquadratic_3,
    DataFieldSetType="Ironbug.HVAC.IB_CoilCoolingDXSingleSpeed_FieldSet")

# ----
# HBRooms
# PTHP
rooms = Data(flatten(hbrooms))

roomsbyattr = HBRoomsByAttribute(rooms=flatten(rooms), attribute="zone")  # -> values, rooms; plug-in component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
lng = ListLength(List=roomsbyattr.values)
objparams_12 = IB_ObjParams(FanEfficiency="0.52", PressureRise="331", DataFieldSetType="Ironbug.HVAC.IB_FanOnOff_FieldSet")
panel_14 = Panel(lng)
objparams_13 = IB_ObjParams(
    ZoneCoolingDesignSupplyAirTemperature="13.8",
    ZoneHeatingDesignSupplyAirTemperature="50",
    DataFieldSetType="Ironbug.HVAC.IB_SizingZone_FieldSet")
coilhtn_dx1 = IB_CoilHeatingDXSingleSpeed(Parameters_=objparams_5, dupNum=False)
coilclndx1 = IB_CoilCoolingDXSingleSpeed(Parameters_=objparams_11, dupNum=False)
fanonoff = IB_FanOnOff(Parameters_=objparams_12, dupNum=False)
pt_heatpump = Ironbug_ZoneHVACPackagedTerminalHeatPump(HeatingCoil=coilhtn_dx1, CoolingCoil=coilclndx1, Fan_=fanonoff, dupNum=False)
sizingzone = IB_SizingZone(Parameters_=objparams_13, dupNum=False)
duplicate = Ironbug_Duplicate(Reference=pt_heatpump, Amount=panel_14)  # -> Objects, port
thermalzone = Ironbug_ThermalZone(
    HoneybeeZonesOrOsZones=rooms,
    ZoneEquipment=duplicate.Objects,
    SizingZone=sizingzone,
    IsAirTerminalPriorToZoneEquipments=True,
    allowMultiAirloops=False,
    dupNum=False)

noairloop = Ironbug_NoAirLoop(OSZones=thermalzone)
hvacsystem = Ironbug_HVACSystem(AirLoops=flatten(noairloop))

hvacsystem_2 = ClusterOutput(hvacsystem)
