# Grasshopper definition Sys03_SZAC_GasCoil.gh (Grasshopper 1.0.7)

# ---- group: Sys03_SZAC_GasCoil
# Double click the component for more details
sys03 = Sys03()

# ==== cluster Sys03
hbrooms = ClusterInput()  # Honeybee Rooms to which the HVAC system should be assigned.

# ----
# Cooling Coil Performance Curves
# For PSZ-AC
panel = Panel("1")
objparams = IB_ObjParams(
    MaximumCurveOutput=panel,
    MaximumValueofx=panel,
    MinimumCurveOutput="0.7",
    MinimumValueofx="0",
    DataFieldSetType="Ironbug.HVAC.Curves.IB_CurveQuadratic_FieldSet")
panel_2 = Panel("""0.28687133
0.023902164
-0.000810648
0.013458546
0.0003389364
-0.0004870044""")
panel_3 = Panel("""0.90949556
0.09864773
-0.00819488""")
objparams_2 = IB_ObjParams(
    MaximumValueofx="100",
    MaximumValueofy="100",
    MinimumValueofx="-100",
    MinimumValueofy="-100",
    DataFieldSetType="Ironbug.HVAC.Curves.IB_CurveBiquadratic_FieldSet")
curvebiquadratic = IB_CurveBiquadratic(Coefficients=panel_2, Parameters_=objparams_2, dupNum=False)
curvequadratic = IB_CurveQuadratic(Coefficients=panel_3, Parameters_=objparams, dupNum=False)
objparams_3 = IB_ObjParams(MaximumValueofx="100", MinimumValueofx="-100", DataFieldSetType="Ironbug.HVAC.Curves.IB_CurveQuadratic_FieldSet")
panel_4 = Panel("""0.9712123
-0.015275502
0.0014434524
-0.00039321
-0.0000068364
-0.0002905956""")
panel_5 = Panel("""1
0
0""")
objparams_4 = IB_ObjParams(
    MaximumValueofx="100",
    MaximumValueofy="100",
    MinimumValueofx="-100",
    MinimumValueofy="-100",
    DataFieldSetType="Ironbug.HVAC.Curves.IB_CurveBiquadratic_FieldSet")
curvequadratic_2 = IB_CurveQuadratic(Coefficients=panel_5, Parameters_=objparams_3, dupNum=False)
curvebiquadratic_2 = IB_CurveBiquadratic(Coefficients=panel_4, Parameters_=objparams_4, dupNum=False)
objparams_5 = IB_ObjParams(
    EnergyInputRatioFunctionOfFlowFractionCurve=curvequadratic_2,
    EnergyInputRatioFunctionOfTemperatureCurve=curvebiquadratic,
    PartLoadFractionCorrelationCurve=curvequadratic,
    TotalCoolingCapacityFunctionOfFlowFractionCurve=curvequadratic_2,
    TotalCoolingCapacityFunctionOfTemperatureCurve=curvebiquadratic_2,
    DataFieldSetType="Ironbug.HVAC.IB_CoilCoolingDXSingleSpeed_FieldSet")

supply_air_cooling_temperature = Panel("12.78")
supply_air_heating_temperature = Panel("50")
# HBZones
rooms = Data(flatten(hbrooms))

# ----
# Sys03_SZAC
# Airloop
panel_6 = Panel("zone")
roomsbyattr = HBRoomsByAttribute(rooms=flatten(rooms), attribute=panel_6)  # -> values, rooms; plug-in component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
objparams_6 = IB_ObjParams(
    ZoneCoolingDesignSupplyAirTemperature=supply_air_cooling_temperature,
    ZoneHeatingDesignSupplyAirTemperature=supply_air_heating_temperature,
    DataFieldSetType="Ironbug.HVAC.IB_SizingZone_FieldSet")
diffuser = Ironbug_AirTerminalSingleDuctUncontrolled(dupNum=False)
lng = ListLength(List=roomsbyattr.values)
sizingzone = IB_SizingZone(Parameters_=objparams_6, dupNum=False)
duplicate = Ironbug_Duplicate(Reference=diffuser, Amount=lng)  # -> Objects, graft(port)
thermalzone = Ironbug_ThermalZone(
    HoneybeeZonesOrOsZones=rooms,
    AirTerminal_=duplicate.Objects,
    SizingZone=sizingzone,
    IsAirTerminalPriorToZoneEquipments=True,
    allowMultiAirloops=False,
    dupNum=False)
objparams_7 = IB_ObjParams(FanEfficiency="0.54", MotorEfficiency="0.9", PressureRise="623", DataFieldSetType="Ironbug.HVAC.IB_FanOnOff_FieldSet")
panel_7 = Panel(supply_air_heating_temperature)
coilclndx1 = IB_CoilCoolingDXSingleSpeed(Parameters_=objparams_5, dupNum=False)
coilhtngas = Ironbug_CoilHeatingGas(dupNum=False)
fanonoff = IB_FanOnOff(Parameters_=objparams_7, dupNum=False)
graft = GraftTree(Tree=thermalzone, IncludeEmptyLists=True, IncludeNullItems=True)
objparams_8 = IB_ObjParams(
    AllOutdoorAirinCooling=Toggle(False),
    AllOutdoorAirinHeating=Toggle(False),
    CentralHeatingDesignSupplyAirTemperature=panel_7,
    CentralHeatingMaximumSystemAirFlowRatio="1",
    SizingOption="Coincident",
    DataFieldSetType="Ironbug.HVAC.IB_SizingSystem_FieldSet")
panel_8 = Panel(supply_air_cooling_temperature)
panel_9 = Panel(supply_air_heating_temperature)
oasystem = Ironbug_OutdoorAirSystem()
unitarysystem = IB_AirLoopHVACUnitarySystem(HeatingCoil=coilhtngas, CoolingCoil=coilclndx1, Fan_=fanonoff, ControllingZone=graft, dupNum=False)
spm_szreheat = Ironbug_SetpointManagerSingleZoneReheat(ControlZone=graft, MinTemperature=panel_8, MaxTemperature=panel_9, dupNum=False)
duplicate_2 = IB_Duplicate(Reference=graft(oasystem), Amount=lng)  # -> graft(Objects), graft(port)
objparams_9 = IB_ObjParams(NightCycleControlType="CycleOnAny", DataFieldSetType="Ironbug.HVAC.IB_AirLoopHVAC_FieldSet")
sizingsystem = Ironbug_SizingSystem(Parameters_=objparams_8, dupNum=False)
airloopbranches = AirLoopBranches(Branch1=graft)
merge = Merge(Data1=simplify(duplicate_2.Objects), Data2=simplify(unitarysystem), Data3=simplify(spm_szreheat))
airloop = Ironbug_AirLoopHVAC(Supply=merge, Demand=airloopbranches, SizingSystem=sizingsystem, Parameters_=objparams_9, dupNum=False)
hvacsystem = Ironbug_HVACSystem(AirLoops=flatten(airloop))

hvacsystem_2 = ClusterOutput(hvacsystem)
