# Grasshopper definition Sys04_SZHP_AllElec.gh (Grasshopper 1.0.7)

# ---- group: Sys04_SZHP_All_Elec
# Double click the component for more details
sys04 = Sys04()

# ==== cluster Sys04
hbrooms = ClusterInput()  # Honeybee Rooms to which the HVAC system should be assigned.

# ----
# Heating Coil Performance Curves
# For Heat Pump
panel = Panel("20")
objparams = IB_ObjParams(MaximumValueofx=panel, MinimumValueofx="-20", DataFieldSetType="Ironbug.HVAC.Curves.IB_CurveCubic_FieldSet")
objparams_2 = IB_ObjParams(MaximumValueofx="1.5", MinimumValueofx="0.5", DataFieldSetType="Ironbug.HVAC.Curves.IB_CurveCubic_FieldSet")
objparams_3 = IB_ObjParams(MaximumValueofx="20", MinimumValueofx="-20", DataFieldSetType="Ironbug.HVAC.Curves.IB_CurveCubic_FieldSet")
panel_2 = Panel("""0.84
0.16
0
0""")
panel_3 = Panel("""1.19248
-0.0300438
0.00103745
-0.000023328""")
panel_4 = Panel("""0.758746
0.027626
0.000148716
0.0000034992""")
panel_5 = Panel("""0.85
0.15
0""")
panel_6 = Panel("""1.3824
-0.4336
0.0512""")
curvecubic = IB_CurveCubic(Coefficients=panel_2, Parameters_=objparams_2, dupNum=False)
curvequadratic = IB_CurveQuadratic(Coefficients=panel_5, dupNum=False)
curvecubic_2 = IB_CurveCubic(Coefficients=panel_4, Parameters_=objparams, dupNum=False)
curvequadratic_2 = IB_CurveQuadratic(Coefficients=panel_6, dupNum=False)
curvecubic_3 = IB_CurveCubic(Coefficients=panel_3, Parameters_=objparams_3, dupNum=False)
panel_7 = Panel(""" 0.297145
0.0430933
-0.000748766
0.00597727
0.000482112
-0.000956448""")
objparams_4 = IB_ObjParams(
    MaximumValueofx="29.44",
    MaximumValueofy="29.44",
    MinimumValueofx="-23.33",
    MinimumValueofy="-23.33",
    DataFieldSetType="Ironbug.HVAC.Curves.IB_CurveBiquadratic_FieldSet")
curvebiquadratic = IB_CurveBiquadratic(Coefficients=panel_7, Parameters_=objparams_4, dupNum=False)
objparams_5 = IB_ObjParams(
    CrankcaseHeaterCapacity="50",
    DefrostControl="OnDemand",
    DefrostEnergyInputRatioFunctionofTemperatureCurve=curvebiquadratic,
    DefrostStrategy="ReverseCycle",
    EnergyInputRatioFunctionofFlowFractionCurve=curvequadratic_2,
    EnergyInputRatioFunctionofTemperatureCurve=curvecubic_3,
    MaximumOutdoorDryBulbTemperatureforCrankcaseHeaterOperation="4.4",
    MaximumOutdoorDryBulbTemperatureforDefrostOperation="1.67",
    MinimumOutdoorDryBulbTemperatureforCompressorOperation="-12.2",
    PartLoadFractionCorrelationCurve=curvequadratic,
    RatedCOP="3.3",
    TotalHeatingCapacityFunctionofFlowFractionCurve=curvecubic,
    TotalHeatingCapacityFunctionofTemperatureCurve=curvecubic_2,
    DataFieldSetType="Ironbug.HVAC.IB_CoilHeatingDXSingleSpeed_FieldSet")

supply_air_cooling_temperature = Panel("12.78")
supply_air_heating_temperature = Panel("50")
# HBZones
rooms = Data(flatten(hbrooms))

# ----
# Cooling Coil Performance Curves
# For Heat Pump
panel_8 = Panel("1")
objparams_6 = IB_ObjParams(MaximumValueofx=panel_8, MinimumValueofx="0", DataFieldSetType="Ironbug.HVAC.Curves.IB_CurveQuadratic_FieldSet")
objparams_7 = IB_ObjParams(MaximumValueofx="1.5", MinimumValueofx="0.5", DataFieldSetType="Ironbug.HVAC.Curves.IB_CurveQuadratic_FieldSet")
panel_9 = Panel("""0.297145
0.0430933
-0.000748766
0.00597727
0.000482112
-0.000956448""")
objparams_8 = IB_ObjParams(
    MaximumValueofx="23.89",
    MaximumValueofy="46.11",
    MinimumValueofx="12.78",
    MinimumValueofy="21.1",
    DataFieldSetType="Ironbug.HVAC.Curves.IB_CurveBiquadratic_FieldSet")
panel_10 = Panel("""1.1552
-0.1816
0.0256""")
panel_11 = Panel("""0.85
0.15
0""")
curvequadratic_3 = IB_CurveQuadratic(Coefficients=panel_11, Parameters_=objparams_6, dupNum=False)
curvebiquadratic_2 = IB_CurveBiquadratic(Coefficients=panel_9, Parameters_=objparams_8, dupNum=False)
curvequadratic_4 = IB_CurveQuadratic(Coefficients=panel_10, Parameters_=objparams_7, dupNum=False)
objparams_9 = IB_ObjParams(MaximumValueofx="1.5", MinimumValueofx="0.5", DataFieldSetType="Ironbug.HVAC.Curves.IB_CurveQuadratic_FieldSet")
panel_12 = Panel("""0.766956
0.0107756
-0.0000414703
0.00134961
-0.000261144
0.000457488""")
objparams_10 = IB_ObjParams(
    MaximumValueofx="23.89",
    MaximumValueofy="46.11",
    MinimumValueofx="12.78",
    MinimumValueofy="21.1",
    DataFieldSetType="Ironbug.HVAC.Curves.IB_CurveBiquadratic_FieldSet")
panel_13 = Panel("""0.8
0.2
0""")
curvebiquadratic_3 = IB_CurveBiquadratic(Coefficients=panel_12, Parameters_=objparams_10, dupNum=False)
curvequadratic_5 = IB_CurveQuadratic(Coefficients=panel_13, Parameters_=objparams_9, dupNum=False)
objparams_11 = IB_ObjParams(
    EnergyInputRatioFunctionOfFlowFractionCurve=curvequadratic_4,
    EnergyInputRatioFunctionOfTemperatureCurve=curvebiquadratic_2,
    PartLoadFractionCorrelationCurve=curvequadratic_3,
    TotalCoolingCapacityFunctionOfFlowFractionCurve=curvequadratic_5,
    TotalCoolingCapacityFunctionOfTemperatureCurve=curvebiquadratic_3,
    DataFieldSetType="Ironbug.HVAC.IB_CoilCoolingDXSingleSpeed_FieldSet")

coilhtnelec = IB_CoilHeatingElectric(dupNum=False)

# ----
# Sys03_SZHP
# Airloop
panel_14 = Panel("zone")
roomsbyattr = HBRoomsByAttribute(rooms=flatten(rooms), attribute=panel_14)  # -> values, rooms; plug-in component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
objparams_12 = IB_ObjParams(
    ZoneCoolingDesignSupplyAirTemperature=supply_air_cooling_temperature,
    ZoneHeatingDesignSupplyAirTemperature=supply_air_heating_temperature,
    DataFieldSetType="Ironbug.HVAC.IB_SizingZone_FieldSet")
lng = ListLength(List=roomsbyattr.values)
diffuser = Ironbug_AirTerminalSingleDuctUncontrolled(dupNum=False)
sizingzone = IB_SizingZone(Parameters_=objparams_12, dupNum=False)
duplicate = Ironbug_Duplicate(Reference=diffuser, Amount=lng)  # -> Objects, graft(port)
objparams_13 = IB_ObjParams(
    MaximumOutdoorDryBulbTemperatureforSupplementalHeaterOperation="4.4",
    DataFieldSetType="Ironbug.HVAC.IB_AirLoopHVACUnitarySystem_FieldSet")
thermalzone = Ironbug_ThermalZone(
    HoneybeeZonesOrOsZones=rooms,
    AirTerminal_=duplicate.Objects,
    SizingZone=sizingzone,
    IsAirTerminalPriorToZoneEquipments=True,
    allowMultiAirloops=False,
    dupNum=False)
objparams_14 = IB_ObjParams(FanEfficiency="0.54", MotorEfficiency="0.9", PressureRise="623", DataFieldSetType="Ironbug.HVAC.IB_FanOnOff_FieldSet")
panel_15 = Panel(supply_air_heating_temperature)
graft = GraftTree(Tree=thermalzone, IncludeEmptyLists=True, IncludeNullItems=True)
coilhtn_dx1 = IB_CoilHeatingDXSingleSpeed(Parameters_=objparams_5, dupNum=False)
coilclndx1 = IB_CoilCoolingDXSingleSpeed(Parameters_=objparams_11, dupNum=False)
oasystem = Ironbug_OutdoorAirSystem()
fanonoff = IB_FanOnOff(Parameters_=objparams_14, dupNum=False)
objparams_15 = IB_ObjParams(
    AllOutdoorAirinCooling=Toggle(False),
    AllOutdoorAirinHeating=Toggle(False),
    CentralHeatingDesignSupplyAirTemperature=panel_15,
    CentralHeatingMaximumSystemAirFlowRatio="1",
    SizingOption="Coincident",
    DataFieldSetType="Ironbug.HVAC.IB_SizingSystem_FieldSet")
panel_16 = Panel(supply_air_cooling_temperature)
panel_17 = Panel(supply_air_heating_temperature)
unitarysystem = IB_AirLoopHVACUnitarySystem(
    HeatingCoil=coilhtn_dx1,
    CoolingCoil=coilclndx1,
    Fan_=fanonoff,
    SupplementalHeatingCoil=coilhtnelec,
    ControllingZone=graft,
    Parameters_=objparams_13,
    dupNum=False)
duplicate_2 = IB_Duplicate(Reference=graft(oasystem), Amount=lng)  # -> graft(Objects), graft(port)
spm_szreheat = Ironbug_SetpointManagerSingleZoneReheat(ControlZone=graft, MinTemperature=panel_16, MaxTemperature=panel_17, dupNum=False)
objparams_16 = IB_ObjParams(NightCycleControlType="CycleOnAny", DataFieldSetType="Ironbug.HVAC.IB_AirLoopHVAC_FieldSet")
sizingsystem = Ironbug_SizingSystem(Parameters_=objparams_15, dupNum=False)
airloopbranches = AirLoopBranches(Branch1=graft)
merge = Merge(Data1=simplify(duplicate_2.Objects), Data2=simplify(unitarysystem), Data3=simplify(spm_szreheat))
airloop = Ironbug_AirLoopHVAC(Supply=merge, Demand=airloopbranches, SizingSystem=sizingsystem, Parameters_=objparams_16, dupNum=False)
hvacsystem = Ironbug_HVACSystem(AirLoops=flatten(airloop))

hvacsystem_2 = ClusterOutput(hvacsystem)
