# Grasshopper definition Sys05_PackagedVAV Gas Boiler Reheat.gh (Grasshopper 1.0.7)

# ---- group: Sys05_PackagedVAV Gas Boiler Reheat
# Double click the component for more details
sys05 = Sys05()

# ==== cluster Sys05
hbrooms = ClusterInput()  # Honeybee Rooms to which the HVAC system should be assigned.

# ----
# Sys05_PackagedVAV_Reheat
# Airloop
# HBZones
rooms = Data(flatten(hbrooms))
objparams = IB_ObjParams(
    AllOutdoorAirinCooling=Toggle(False),
    AllOutdoorAirinHeating=Toggle(False),
    CentralHeatingDesignSupplyAirTemperature="12.8",
    DataFieldSetType="Ironbug.HVAC.IB_SizingSystem_FieldSet")
oasystem = Ironbug_OutdoorAirSystem()
coilclndx2 = Ironbug_CoilCoolingDXTwoSpeed(dupNum=False)
fanvariable = Ironbug_FanVariableVolume(dupNum=False)
spm_scheduled = Ironbug_SetpointManagerScheduled(Temperature="12.8", dupNum=False)
sizingsystem = Ironbug_SizingSystem(Parameters_=objparams, dupNum=False)

roomsbyattr = HBRoomsByAttribute(rooms=flatten(rooms), attribute="zone")  # -> values, rooms; plug-in component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
objparams_2 = IB_ObjParams(
    RatedInletAirTemperature="12.8",
    RatedOutletAirTemperature="50",
    DataFieldSetType="Ironbug.HVAC.IB_CoilHeatingWater_FieldSet")
objparams_3 = IB_ObjParams(
    CoolingDesignAirFlowMethod="DesignDayWithLimit",
    ZoneCoolingDesignSupplyAirTemperature="12.8",
    ZoneHeatingDesignSupplyAirTemperature="50",
    DataFieldSetType="Ironbug.HVAC.IB_SizingZone_FieldSet")
objparams_4 = IB_ObjParams(MaximumReheatAirTemperature="50", DataFieldSetType="Ironbug.HVAC.IB_AirTerminalSingleDuctVAVReheat_FieldSet")
objparams_5 = IB_ObjParams(
    RatedInletAirTemperature="7.2",
    RatedOutletAirTemperature="12.8",
    DataFieldSetType="Ironbug.HVAC.IB_CoilHeatingWater_FieldSet")
sizingzone = IB_SizingZone(Parameters_=objparams_3, dupNum=False)
objparams_6 = IB_ObjParams(NightCycleControlType="CycleOnAny", DataFieldSetType="Ironbug.HVAC.IB_AirLoopHVAC_FieldSet")

lng = ListLength(List=roomsbyattr.values)
coilhtnwater = Ironbug_CoilHeatingWater(Parameters_=objparams_2, dupNum=False)  # -> AirSide_CoilHeatingWater, WaterSide_CoilHeatingWater
duplicate = Ironbug_Duplicate(Reference=coilhtnwater.AirSide_CoilHeatingWater, Amount=flatten(lng))  # -> Objects, graft(WaterSide_CoilHeatingWater)
vavreheat = Ironbug_AirTerminalSingleDuctVAVReheat(HeatingCoil=duplicate.Objects, Parameters_=objparams_4, dupNum=False)
coilhtnwater_2 = Ironbug_CoilHeatingWater(Parameters_=objparams_5, dupNum=False)  # -> AirSide_CoilHeatingWater, WaterSide_CoilHeatingWater
thermalzone = Ironbug_ThermalZone(
    HoneybeeZonesOrOsZones=rooms,
    AirTerminal_=vavreheat,
    SizingZone=sizingzone,
    IsAirTerminalPriorToZoneEquipments=True,
    allowMultiAirloops=False,
    dupNum=False)
airloopbranches = AirLoopBranches(Branch1=thermalzone)
merge = Merge(Data1=oasystem, Data2=coilclndx2, Data3=coilhtnwater_2.AirSide_CoilHeatingWater, Data4=fanvariable, Data5=spm_scheduled)
airloop = Ironbug_AirLoopHVAC(Supply=merge, Demand=airloopbranches, SizingSystem=sizingsystem, Parameters_=objparams_6, dupNum=False)

# ----
# Hot water loop
panel = Panel("LeavingSetpointModulated")
objparams_7 = IB_ObjParams(
    BoilerFlowMode=panel,
    MaximumPartLoadRatio="1.2",
    NominalThermalEfficiency="0.84",
    DataFieldSetType="Ironbug.HVAC.IB_BoilerHotWater_FieldSet")
boilerhw = Ironbug_BoilerHotWater(Parameters=objparams_7, dupNum=False)
objparams_8 = IB_ObjParams(MinimumLoopTemperature="10", DataFieldSetType="Ironbug.HVAC.IB_PlantLoop_FieldSet")
pumpvariable = Ironbug_PumpVariableSpeed(dupNum=False)
branches = PlantBranches(Branch1=boilerhw, mapBranchToLoop=False)
branches_2 = PlantBranches(B1=duplicate.WaterSide_CoilHeatingWater, B2=coilhtnwater_2.WaterSide_CoilHeatingWater, mapBranchToLoop=False)
spm_scheduled_2 = Ironbug_SetpointManagerScheduled(Temperature="82", dupNum=False)
hwloop = Ironbug_HotWaterPlantLoop(Supply=[pumpvariable, branches, spm_scheduled_2], Demand=branches_2, Parameters=objparams_8, dupNum=False)

hvacsystem = Ironbug_HVACSystem(AirLoops=flatten(airloop), PlantLoops=flatten(hwloop))

hvacsystem_2 = ClusterOutput(hvacsystem)
