# Grasshopper definition Sys06_PackagedVAV_PFP Elec Reheat.gh (Grasshopper 1.0.7)

# ---- group: Sys06_PackagedVAV_PFP Reheat
# Double click the component for more details
sys06 = Sys06()

# ==== cluster Sys06
hbrooms = ClusterInput()  # Honeybee Rooms to which the HVAC system should be assigned.
objparams = IB_ObjParams(PressureRise="300", DataFieldSetType="Ironbug.HVAC.IB_FanConstantVolume_FieldSet")

# ----
# Sys06_PackagedVAV_PFP Reheat
# Airloop
# HBZones
rooms = Data(flatten(hbrooms))
objparams_2 = IB_ObjParams(
    AllOutdoorAirinCooling=Toggle(False),
    AllOutdoorAirinHeating=Toggle(False),
    CentralHeatingDesignSupplyAirTemperature="12.8",
    DataFieldSetType="Ironbug.HVAC.IB_SizingSystem_FieldSet")
oasystem = Ironbug_OutdoorAirSystem()
coilclndx2 = Ironbug_CoilCoolingDXTwoSpeed(dupNum=False)
spm_scheduled = Ironbug_SetpointManagerScheduled(Temperature="12.8", dupNum=False)
sizingsystem = Ironbug_SizingSystem(Parameters_=objparams_2, dupNum=False)

roomsbyattr = HBRoomsByAttribute(rooms=flatten(rooms), attribute="zone")  # -> values, rooms; plug-in component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
objparams_3 = IB_ObjParams(
    EndUseSubcategory="VAV System Fans",
    FanEfficiency="0.616",
    FanPowerMinimumFlowFraction="0.25",
    FanPowerMinimumFlowRateInputMethod="Fraction",
    MotorEfficiency="0.895",
    PressureRise="996",
    DataFieldSetType="Ironbug.HVAC.IB_FanVariableVolume_FieldSet")
objparams_4 = IB_ObjParams(
    ZoneCoolingDesignSupplyAirTemperature="12.8",
    ZoneHeatingDesignSupplyAirTemperature="50",
    DataFieldSetType="Ironbug.HVAC.IB_SizingZone_FieldSet")
sizingzone = IB_SizingZone(Parameters_=objparams_4, dupNum=False)
coilhtnelec = IB_CoilHeatingElectric(dupNum=False)
objparams_5 = IB_ObjParams(NightCycleControlType="CycleOnAny", DataFieldSetType="Ironbug.HVAC.IB_AirLoopHVAC_FieldSet")

lng = ListLength(List=roomsbyattr.values)
fanvariable = Ironbug_FanVariableVolume(Parameters=objparams_3, dupNum=False)
merge = Merge(Data1=oasystem, Data2=coilclndx2, Data3=coilhtnelec, Data4=fanvariable, Data5=spm_scheduled)

fanconstant = IB_FanConstantVolume(Parameters_=objparams, DuplicateNumber_=lng, dupNum=True)
coilhtnelec_2 = IB_CoilHeatingElectric(DuplicateNumber_=lng, dupNum=True)
parallelpiureheat = IB_AirTerminalSingleDuctParallelPIUReheat(HeatingCoil=coilhtnelec_2, Fan_=fanconstant, dupNum=False)

thermalzone = Ironbug_ThermalZone(
    HoneybeeZonesOrOsZones=rooms,
    AirTerminal_=parallelpiureheat,
    SizingZone=sizingzone,
    IsAirTerminalPriorToZoneEquipments=True,
    allowMultiAirloops=False,
    dupNum=False)
airloopbranches = AirLoopBranches(Branch1=thermalzone)
airloop = Ironbug_AirLoopHVAC(Supply=merge, Demand=airloopbranches, SizingSystem=sizingsystem, Parameters_=objparams_5, dupNum=False)
hvacsystem = Ironbug_HVACSystem(AirLoops=flatten(airloop))

hvacsystem_2 = ClusterOutput(hvacsystem)
