# Grasshopper definition Sys13_RadiantCeiling+Elec DOAS.gh (Grasshopper 1.0.7)

# ---- group: Rooms with radiant system
# Set the new construction set
# For Radiant Ceiling
# 1
# HBRooms
data = Data()

# ----
# Get room's construction set
# a = x.properties.energy.construction_set
python = GhPythonScript(x=data)  # -> flatten(out), a
# ---------- python: Python ----------
if x:
    a = x.properties.energy.construction_set
    print(x.properties.energy.construction_set.display_name)
# ---------- end python ----------
panel = Panel(python.out)

# ----
# Ensure this setting matches
# the construction setting
# Change to Floors if you have radiant floor
panel_2 = Panel("Ceilings")

# ----
# Create a construction with INTERNAL SOURCE material
panel_3 = Panel("INTERNAL SOURCE")
opaquematnomass = HBOpaqueMaterialNoMass(name=panel_3, r_value="1")  # -> mat; plug-in component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
merge = Merge(
    Data1="8 in. Normalweight Concrete Floor",
    Data2="Roof Insulation [18]",
    Data3="Metal Surface",
    Data4=opaquematnomass,
    Data5="Metal Surface")
opaqueconstr = HBOpaqueConstruction(name="Radiant Construction", materials=merge)  # -> constr; plug-in component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
exteriorsubset = HBExteriorConstructionSubset(exterior_roof=opaqueconstr)  # -> exterior_set; plug-in component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

rev = ReverseList(List=merge)
opaqueconstr_2 = HBOpaqueConstruction(name="Radiant Construction Rev", materials=rev)  # -> constr; plug-in component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
interiorsubset = HBInteriorConstructionSubset(ceiling=opaqueconstr, interior_floor=opaqueconstr_2)  # -> interior_set; plug-in component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

constructionset = HBConstructionSet(name="CSet_Rad", base_constr_set=python.a, exterior_subset=exteriorsubset, interior_subset=interiorsubset)  # -> constr_set; plug-in component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

# ----
# 2
# Rooms
# with Radiant Panel Material
# Add these rooms back to HB Model
applyconstrset = HBApplyConstructionSet(rooms=graft(data), constr_set=graft(constructionset))  # -> rooms; plug-in component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

# ----
# 3
cluster = Cluster(hbrooms=flatten(applyconstrset), radiantsurfacetype=flatten(panel_2))

# ==== cluster Cluster
# Zone Radiant Panels
hbrooms = ClusterInput()  # Honeybee Rooms to which the HVAC system should be assigned.
radiantsurfacetype = ClusterInput()

# ----
# Main Heating Coil Parameters
panel = Panel("0.5")
objparams = IB_ObjParams(MaximumValueofx="1.5", MinimumValueofx=panel, DataFieldSetType="Ironbug.HVAC.Curves.IB_CurveCubic_FieldSet")
objparams_2 = IB_ObjParams(MaximumValueofx="20", MinimumValueofx="-20", DataFieldSetType="Ironbug.HVAC.Curves.IB_CurveCubic_FieldSet")
objparams_3 = IB_ObjParams(MaximumValueofx="20", MinimumValueofx="-20", DataFieldSetType="Ironbug.HVAC.Curves.IB_CurveCubic_FieldSet")
panel_2 = Panel("""1.19248
-0.0300438
0.00103745
-0.000023328""")
panel_3 = Panel("""0.84
0.16
0
0""")
panel_4 = Panel("""0.758746
0.027626
0.000148716
0.0000034992""")
panel_5 = Panel("""0.85
0.15
0""")
panel_6 = Panel("""1.3824
-0.4336
0.0512""")
curvecubic = IB_CurveCubic(Coefficients=panel_2, Parameters_=objparams_3, dupNum=False)
curvequadratic = IB_CurveQuadratic(Coefficients=panel_5, dupNum=False)
curvecubic_2 = IB_CurveCubic(Coefficients=panel_3, Parameters_=objparams, dupNum=False)
curvequadratic_2 = IB_CurveQuadratic(Coefficients=panel_6, dupNum=False)
curvecubic_3 = IB_CurveCubic(Coefficients=panel_4, Parameters_=objparams_2, dupNum=False)
objparams_4 = IB_ObjParams(
    DefrostControl="OnDemand",
    EnergyInputRatioFunctionofFlowFractionCurve=curvequadratic_2,
    EnergyInputRatioFunctionofTemperatureCurve=curvecubic,
    PartLoadFractionCorrelationCurve=curvequadratic,
    RatedCOP="3.3",
    TotalHeatingCapacityFunctionofFlowFractionCurve=curvecubic_2,
    TotalHeatingCapacityFunctionofTemperatureCurve=curvecubic_3,
    DataFieldSetType="Ironbug.HVAC.IB_CoilHeatingDXSingleSpeed_FieldSet")

objparams_5 = IB_ObjParams(MaximumCurveOutput="0.28", DataFieldSetType="Ironbug.HVAC.Curves.IB_CurveQuadratic_FieldSet")
panel_7 = Panel("""0.222149
0.503156
0.256905""")
panel_8 = Panel("""0.536234
0.005581
-0.0013654
0.0488966
-0.0012018
0.0010523""")
panel_9 = Panel("""1.0821822
0.0042977
-0.0013182
-0.0260781
0.0008256
-0.0006013""")
objparams_6 = IB_ObjParams(
    MaximumValueofx="10",
    MaximumValueofy="46.11",
    MinimumValueofx="5",
    MinimumValueofy="17.78",
    DataFieldSetType="Ironbug.HVAC.Curves.IB_CurveBiquadratic_FieldSet")
curvequadratic_3 = IB_CurveQuadratic(Coefficients=panel_7, Parameters_=objparams_5, dupNum=False)
curvebiquadratic = IB_CurveBiquadratic(Coefficients=panel_8, Parameters_=objparams_6, dupNum=False)
curvebiquadratic_2 = IB_CurveBiquadratic(Coefficients=panel_9, Parameters_=objparams_6, dupNum=False)
panel_10 = Panel("""0.33162901
-0.88567609
0.60556507
0.9484823""")
curvecubic_4 = IB_CurveCubic(Coefficients=panel_10, dupNum=False)
objparams_7 = IB_ObjParams(
    ChillerFlowMode="ConstantFlow",
    CondenserType="WaterCooled",
    CoolingCapacityFunctionOfTemperature=curvebiquadratic,
    ElectricInputToCoolingOutputRatioFunctionOfPLR=curvequadratic_3,
    ElectricInputToCoolingOutputRatioFunctionOfTemperature=curvebiquadratic_2,
    LeavingChilledWaterLowerTemperatureLimit="2.22",
    MinimumPartLoadRatio="0.15",
    MinimumUnloadingRatio="0.25",
    ReferenceCOP="6.28",
    ReferenceEnteringCondenserFluidTemperature="35",
    ReferenceLeavingChilledWaterTemperature="12.78",
    DataFieldSetType="Ironbug.HVAC.IB_ChillerElectricEIR_FieldSet")
objparams_8 = IB_ObjParams(
    DesignApproachTemperature="2.77",
    DesignInletAirWetBulbTemperature="26.66",
    DesignRangeTemperature="5.55",
    FanPowerRatioFunctionofAirFlowRateRatioCurve=curvecubic_4,
    FractionofTowerCapacityinFreeConvectionRegime="0.125",
    DataFieldSetType="Ironbug.HVAC.IB_CoolingTowerVariableSpeed_FieldSet")
objparams_9 = IB_ObjParams(
    Coefficient1OfthePartLoadPerformanceCurve="0",
    Coefficient2OfthePartLoadPerformanceCurve="0.0205",
    Coefficient3OfthePartLoadPerformanceCurve="0.4101",
    Coefficient4OfthePartLoadPerformanceCurve="0.5753",
    Name="Chilled Water Loop Secondary Pump",
    RatedPumpHead="134508",
    DataFieldSetType="Ironbug.HVAC.IB_PumpVariableSpeed_FieldSet")

data = Data(hbrooms)
roomsbyattr = HBRoomsByAttribute(rooms=flatten(data), attribute="zone")  # -> values, rooms; plug-in component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
objparams_10 = IB_ObjParams(HeatingControlThrottlingRange="2", DataFieldSetType="Ironbug.HVAC.IB_CoilHeatingLowTempRadiantVarFlow_FieldSet")
objparams_11 = IB_ObjParams(CoolingControlThrottlingRange="2", DataFieldSetType="Ironbug.HVAC.IB_CoilCoolingLowTempRadiantVarFlow_FieldSet")
lng = ListLength(List=roomsbyattr.values)
objparams_12 = IB_ObjParams(RadiantSurfaceType=radiantsurfacetype, DataFieldSetType="Ironbug.HVAC.IB_ZoneHVACLowTempRadiantVarFlow_FieldSet")
vavnoreheat = Ironbug_AirTerminalSingleDuctVAVNoReheat(DuplicateNumber_=lng, dupNum=True)

data_2 = Data(lng)
coilcln_lowtradv = Ironbug_CoilCoolingLowTempRadiantVarFlow(HighAirTemperature="24", Parameters_=objparams_11, DuplicateNumber_=data_2, dupNum=True)  # -> CoilCoolingLowTempRadiantVarFlow, WaterSide_CoilCoolingLowTempRadiantVarFlow
coilhtn_lowtradv = Ironbug_CoilHeatingLowTempRadiantVarFlow(LowAirTemperature="21", Parameters_=objparams_10, DuplicateNumber_=data_2, dupNum=True)  # -> CoilHeatingLowTempRadiantVarFlow, WaterSide_CoilHeatingLowTempRadiantVarFlow
radiantvflow = Ironbug_ZoneHVACLowTempRadiantVarFlow(
    HeatingCoil=coilhtn_lowtradv.CoilHeatingLowTempRadiantVarFlow,
    CoolingCoil=coilcln_lowtradv.CoilCoolingLowTempRadiantVarFlow,
    Parameters_=objparams_12,
    dupNum=False)

thermalzone = Ironbug_ThermalZone(
    HoneybeeZonesOrOsZones=data,
    AirTerminal_=vavnoreheat,
    ZoneEquipment=radiantvflow,
    IsAirTerminalPriorToZoneEquipments=True,
    allowMultiAirloops=False,
    dupNum=False)

# ----
# Hot water loop
panel_11 = Panel("LeavingSetpointModulated")
objparams_13 = IB_ObjParams(
    BoilerFlowMode=panel_11,
    MaximumPartLoadRatio="1.2",
    NominalThermalEfficiency="0.84",
    DataFieldSetType="Ironbug.HVAC.IB_BoilerHotWater_FieldSet")
graft = GraftTree(Tree=coilhtn_lowtradv.WaterSide_CoilHeatingLowTempRadiantVarFlow, IncludeEmptyLists=True, IncludeNullItems=True)
boiler = Ironbug_BoilerHotWater(Parameters_=objparams_13, dupNum=False)
objparams_14 = IB_ObjParams(
    DesignLoopExitTemperature="37.78",
    LoopDesignTemperatureDifference="5.55",
    DataFieldSetType="Ironbug.HVAC.IB_SizingPlant_FieldSet")
pumpvariable = Ironbug_PumpVariableSpeed(dupNum=False)
plantbranches = PlantBranches(Branch1=boiler, mapBranchToLoop=False)
plantbranches_2 = PlantBranches(Branch1=graft, mapBranchToLoop=False)
spm_scheduled = Ironbug_SetpointManagerScheduled(Temperature="37.78", dupNum=False)
sizingplant = IB_SizingPlant(Parameters_=objparams_14, dupNum=False)
hotwaterloop = Ironbug_HotWaterPlantLoop(Supply=[pumpvariable, plantbranches, spm_scheduled], Demand=plantbranches_2, SizingLoop=sizingplant, dupNum=False)

# ----
# Exhaust Fan
# DOAS
autosize = Number(-9999)
objparams_15 = IB_ObjParams(MinimumOutdoorAirFlowRate=autosize, DataFieldSetType="Ironbug.HVAC.IB_ControllerOutdoorAir_FieldSet")
toggle = BooleanToggle(True)
objparams_16 = IB_ObjParams(
    EndUseSubcategory="DOAS_Fans",
    FanEfficiency="0.55575",
    MotorEfficiency="0.855",
    PressureRise="373",
    DataFieldSetType="Ironbug.HVAC.IB_FanConstantVolume_FieldSet")
objparams_17 = IB_ObjParams(
    EndUseSubcategory="DOAS_Fans",
    FanEfficiency="0.55575",
    MotorEfficiency="0.855",
    PressureRise="622",
    DataFieldSetType="Ironbug.HVAC.IB_FanConstantVolume_FieldSet")
objparams_18 = IB_ObjParams(
    AllOutdoorAirinCooling=toggle,
    AllOutdoorAirinHeating=toggle,
    CentralCoolingDesignSupplyAirTemperature="15.6",
    CentralHeatingDesignSupplyAirTemperature="21.1",
    CentralHeatingMaximumSystemAirFlowRatio="1",
    SizingOption="Coincident",
    TypeofLoadtoSizeOn="VentilationRequirement",
    DataFieldSetType="Ironbug.HVAC.IB_SizingSystem_FieldSet")
oacontroller = IB_OAController(Parameters_=objparams_15, dupNum=False)
oasystem = Ironbug_OutdoorAirSystem(Controller_=oacontroller)
spm_oareset = IB_SetpointManagerOutdoorAirReset(
    SetpointatOutdoorHighTemperature="15.6",
    OutdoorHighTemperature="21.1",
    SetpointatOutdoorLowTemperature="21.1",
    OutdoorLowTemperature="12.8",
    dupNum=False)
coilhtn_dx1 = IB_CoilHeatingDXSingleSpeed(Parameters_=objparams_4, dupNum=False)
coilhtnelec = IB_CoilHeatingElectric(dupNum=False)
coilclndx1 = Ironbug_CoilCoolingDXSingleSpeed(dupNum=False)
fanconstant = Ironbug_FanConstantVolume(Parameters_=objparams_17, dupNum=False)
fanconstant_2 = Ironbug_FanConstantVolume(Parameters_=objparams_16, dupNum=False)
objparams_19 = IB_ObjParams(Name="DOAS", DataFieldSetType="Ironbug.HVAC.IB_AirLoopHVAC_FieldSet")
airloopbranches = AirLoopBranches(Branch1=thermalzone)
sizingsystem = Ironbug_SizingSystem(Parameters_=objparams_18, dupNum=False)
merge = Merge(
    Data1=fanconstant_2,
    Data2=oasystem,
    Data3=coilclndx1,
    Data4=coilhtn_dx1,
    Data5=coilhtnelec,
    Data6=fanconstant,
    Data7=spm_oareset)
airloop = Ironbug_AirLoopHVAC(Supply=merge, Demand=airloopbranches, SizingSystem=sizingsystem, Parameters_=objparams_19, dupNum=False)

# ----
# Chilled water loop
chiller_watercooled = Ironbug_ChillerElectricEIR_WaterCooled(Parameters_=objparams_7, dupNum=False)  # -> ChillerElectricEIR, ChillerElectricEIR_CondenserLoop
pipeadiabatic = IB_PipeAdiabatic(dupNum=False)
pipeadiabatic_2 = IB_PipeAdiabatic(dupNum=False)
objparams_20 = IB_ObjParams(
    DesignLoopExitTemperature="12.78",
    LoopDesignTemperatureDifference="2.78",
    LoopType="Cooling",
    DataFieldSetType="Ironbug.HVAC.IB_SizingPlant_FieldSet")
graft_2 = GraftTree(Tree=coilcln_lowtradv.WaterSide_CoilCoolingLowTempRadiantVarFlow, IncludeEmptyLists=True, IncludeNullItems=True)
objparams_21 = IB_ObjParams(RatedPumpHead="44836", DataFieldSetType="Ironbug.HVAC.IB_PumpConstantSpeed_FieldSet")
objparams_22 = IB_ObjParams(CommonPipeSimulation="CommonPipe", DataFieldSetType="Ironbug.HVAC.IB_PlantLoop_FieldSet")
pumpvariable_2 = Ironbug_PumpVariableSpeed(Parameters=objparams_9, dupNum=False)
pumpconstant = IB_PumpConstantSpeed(Parameters_=objparams_21, dupNum=False)
branches = PlantBranches(Branch1=chiller_watercooled.ChillerElectricEIR, Branch=pipeadiabatic, mapBranchToLoop=False)
spm_scheduled_2 = Ironbug_SetpointManagerScheduled(Temperature="12.78", dupNum=False)
branches_2 = PlantBranches(Branch1=graft_2, Branch=pipeadiabatic_2, mapBranchToLoop=False)
sizingplant_2 = IB_SizingPlant(Parameters_=objparams_20, dupNum=False)
cwloop = Ironbug_ChilledWaterPlantLoop(
    Supply=[pumpconstant, branches, spm_scheduled_2],
    Demand=[pumpvariable_2, branches_2],
    SizingLoop=sizingplant_2,
    Parameters_=objparams_22,
    dupNum=False)

# ----
# Condenser water loop
objparams_23 = IB_ObjParams(
    CoincidentSizingFactorMode="GlobalCoolingSizingFactor",
    DesignLoopExitTemperature="29.4",
    LoopDesignTemperatureDifference="5.5",
    LoopType="Condenser",
    SizingOption="Coincident",
    ZoneTimestepsinAveragingWindow="6",
    DataFieldSetType="Ironbug.HVAC.IB_SizingPlant_FieldSet")
coolingtowerv = IB_CoolingTowerVariableSpeed(Parameters_=objparams_8, dupNum=False)
pipeadiabatic_3 = Ironbug_PipeAdiabatic(dupNum=False)
objparams_24 = IB_ObjParams(RatedPumpHead="148556.6", DataFieldSetType="Ironbug.HVAC.IB_PumpConstantSpeed_FieldSet")
pipeadiabatic_4 = Ironbug_PipeAdiabatic(dupNum=False)
objparams_25 = IB_ObjParams(MaximumLoopTemperature="80", MinimumLoopTemperature="5", DataFieldSetType="Ironbug.HVAC.IB_PlantLoop_FieldSet")
pumpconstant_2 = IB_PumpConstantSpeed(Parameters_=objparams_24, dupNum=False)
spm_followoatemp = Ironbug_SetpointManagerFollowOutdoorAirTemperature(MaximumSetpointTemperature="29.4", MinimumSetpointTemperature="21.1", OffsetTemperatureDifference="2.77", dupNum=False)
plantbranches_3 = PlantBranches(Branch1=chiller_watercooled.ChillerElectricEIR_CondenserLoop, Branch=pipeadiabatic_3, mapBranchToLoop=False)
sizingplant_3 = IB_SizingPlant(Parameters_=objparams_23, dupNum=False)
branches_3 = PlantBranches(Branch1=coolingtowerv, Branch=pipeadiabatic_4, mapBranchToLoop=False)
dwloop = Ironbug_CondenserWaterPlantLoop(
    Supply=[pumpconstant_2, branches_3, spm_followoatemp],
    Demand=plantbranches_3,
    SizingLoop=sizingplant_3,
    Parameters_=objparams_25,
    dupNum=False)

merge_2 = Merge(Data1=hotwaterloop, Data2=cwloop, Data3=dwloop)
hvacsystem = Ironbug_HVACSystem(AirLoops=flatten(airloop), PlantLoops=flatten(merge_2))
hvacsystem_2 = ClusterOutput(hvacsystem)
