# Grasshopper definition Sys16_VRF+DOAS.gh (Grasshopper 1.0.7)

# ---- group: Sys16_VRF + DOAS
# Double click the component for more details
sys16 = Sys16()

# ==== cluster Sys16

# ----
# Cooling performance curves
panel = Panel("1")
objparams = IB_ObjParams(MaximumValueofx="30", MinimumValueofx="11", DataFieldSetType="Ironbug.HVAC.Curves.IB_CurveCubic_FieldSet")
objparams_2 = IB_ObjParams(MaximumValueofx="24", MinimumValueofx="15", DataFieldSetType="Ironbug.HVAC.Curves.IB_CurveCubic_FieldSet")
objparams_3 = IB_ObjParams(
    MaximumCurveOutput=panel,
    MaximumValueofx="1",
    MinimumCurveOutput="0",
    MinimumValueofx="0.25",
    DataFieldSetType="Ironbug.HVAC.Curves.IB_CurveCubic_FieldSet")
panel_2 = Panel("""0.0734992169827752
0.334783365234032
0.591613015486343
0.0""")
panel_3 = Panel("""25.73
-0.03150043
-0.01416595
0.0""")
panel_4 = Panel("""25.73473775
-0.03150043
-0.01416595
0.0""")
objparams_4 = IB_ObjParams(MaximumValueofx="1.5", MinimumValueofx="1", DataFieldSetType="Ironbug.HVAC.Curves.IB_CurveCubic_FieldSet")
objparams_5 = IB_ObjParams(
    MaximumCurveOutput="1.056",
    MaximumValueofx="2",
    MinimumCurveOutput="0.5",
    MinimumValueofx="0.5",
    DataFieldSetType="Ironbug.HVAC.Curves.IB_CurveCubic_FieldSet")
panel_5 = Panel("""1
0
0
0""")
panel_6 = Panel("""0.24034
-0.21873
1.97941
-1.02636""")
panel_7 = Panel("""0.85
0.15
0.0
0.0""")
objparams_6 = IB_ObjParams(MaximumValueofx="1", MinimumValueofx="1", DataFieldSetType="Ironbug.HVAC.Curves.IB_CurveCubic_FieldSet")
curvecubic = IB_CurveCubic(Coefficients=panel_2, Parameters_=objparams_3, dupNum=False)
curvecubic_2 = IB_CurveCubic(Coefficients=panel_3, Parameters_=objparams, dupNum=False)
curvecubic_3 = IB_CurveCubic(Coefficients=panel_5, Parameters_=objparams_4, dupNum=False)
curvecubic_4 = IB_CurveCubic(Coefficients=panel_4, Parameters_=objparams_2, dupNum=False)
curvecubic_5 = IB_CurveCubic(Coefficients=panel_6, Parameters_=objparams_5, dupNum=False)
curvecubic_6 = IB_CurveCubic(Coefficients=panel_7, Parameters_=objparams_6, dupNum=False)
objparams_7 = IB_ObjParams(
    MaximumCurveOutput="1.15",
    MaximumValueofx="23.9",
    MaximumValueofy="43.3",
    MinimumCurveOutput="0.27",
    MinimumValueofx="13.9",
    MinimumValueofy="-5",
    DataFieldSetType="Ironbug.HVAC.Curves.IB_CurveBiquadratic_FieldSet")
panel_8 = Panel("""-1.61908214818635
0.185964818731756
-0.00389610393381592
-0.00901995326324613
0.00030340007815629
0.000476048529099348""")
panel_9 = Panel("""-1.69653019339465
0.207248180531939
-0.00343146229659024
0.016381597419714
-6.7387172629965e-05
-0.000849848402870241""")
objparams_8 = IB_ObjParams(
    MaximumCurveOutput="1.33",
    MaximumValueofx="23.9",
    MaximumValueofy="43.3",
    MinimumCurveOutput="0.59",
    MinimumValueofx="13.9",
    MinimumValueofy="-5",
    DataFieldSetType="Ironbug.HVAC.Curves.IB_CurveBiquadratic_FieldSet")
panel_10 = Panel("""-1.4395110176
0.1619850459
-0.0034911781
0.0269442645
0.0001346163
-0.0006714941""")
panel_11 = Panel("""0.6867358
0.0207631
0.0005447
-0.0016218
-4.259e-07
-0.0003392""")
objparams_9 = IB_ObjParams(
    MaximumValueofx="24",
    MaximumValueofy="43",
    MinimumValueofx="15",
    MinimumValueofy="16",
    DataFieldSetType="Ironbug.HVAC.Curves.IB_CurveBiquadratic_FieldSet")
objparams_10 = IB_ObjParams(
    MaximumValueofx="23.9",
    MaximumValueofy="43.3",
    MinimumValueofx="15",
    MinimumValueofy="16.8",
    DataFieldSetType="Ironbug.HVAC.Curves.IB_CurveBiquadratic_FieldSet")
curvebiquadratic = IB_CurveBiquadratic(Coefficients=panel_9, Parameters_=objparams_8, dupNum=False)
curvebiquadratic_2 = IB_CurveBiquadratic(Coefficients=panel_11, Parameters_=objparams_9, dupNum=False)
curvebiquadratic_3 = IB_CurveBiquadratic(Coefficients=panel_8, Parameters_=objparams_7, dupNum=False)
curvebiquadratic_4 = IB_CurveBiquadratic(Coefficients=panel_10, Parameters_=objparams_10, dupNum=False)

hbrooms = ClusterInput()  # Honeybee Rooms to which the HVAC system should be assigned.

# ----
# Heating performance curves
panel_12 = Panel("1")
objparams_11 = IB_ObjParams(MaximumValueofx="23.9", MinimumValueofx="15", DataFieldSetType="Ironbug.HVAC.Curves.IB_CurveCubic_FieldSet")
objparams_12 = IB_ObjParams(MaximumValueofx="23.9", MinimumValueofx="15", DataFieldSetType="Ironbug.HVAC.Curves.IB_CurveCubic_FieldSet")
objparams_13 = IB_ObjParams(
    MaximumCurveOutput=panel_12,
    MaximumValueofx="1",
    MinimumCurveOutput="0",
    MinimumValueofx="0.25",
    DataFieldSetType="Ironbug.HVAC.Curves.IB_CurveCubic_FieldSet")
panel_13 = Panel("""0.0724906507105475
0.658189977561701
0.269259536275246
0.0""")
panel_14 = Panel("""58.577
-3.0255
0.0193
0.0""")
objparams_14 = IB_ObjParams(MaximumValueofx="1.5", MinimumValueofx="1", DataFieldSetType="Ironbug.HVAC.Curves.IB_CurveCubic_FieldSet")
objparams_15 = IB_ObjParams(
    MaximumCurveOutput="1.155",
    MaximumValueofx="2",
    MinimumCurveOutput="0.5",
    MinimumValueofx="0.5",
    DataFieldSetType="Ironbug.HVAC.Curves.IB_CurveCubic_FieldSet")
panel_15 = Panel("""58.577
-3.0255
0.0193
0.0""")
panel_16 = Panel("""1
0
0
0""")
panel_17 = Panel("""0.62115
-1.55798
3.36817
-1.4224""")
panel_18 = Panel("""0.85
0.15
0.0
0.0""")
objparams_16 = IB_ObjParams(MaximumValueofx="1", MinimumValueofx="1", DataFieldSetType="Ironbug.HVAC.Curves.IB_CurveCubic_FieldSet")
curvecubic_7 = IB_CurveCubic(Coefficients=panel_13, Parameters_=objparams_13, dupNum=False)
curvecubic_8 = IB_CurveCubic(Coefficients=panel_14, Parameters_=objparams_11, dupNum=False)
curvecubic_9 = IB_CurveCubic(Coefficients=panel_16, Parameters_=objparams_14, dupNum=False)
curvecubic_10 = IB_CurveCubic(Coefficients=panel_15, Parameters_=objparams_12, dupNum=False)
curvecubic_11 = IB_CurveCubic(Coefficients=panel_17, Parameters_=objparams_15, dupNum=False)
curvecubic_12 = IB_CurveCubic(Coefficients=panel_18, Parameters_=objparams_16, dupNum=False)
objparams_17 = IB_ObjParams(
    MaximumCurveOutput="1.184",
    MaximumValueofx="23.9",
    MaximumValueofy="13.3",
    MinimumCurveOutput="0.7",
    MinimumValueofx="16.1",
    MinimumValueofy="-25",
    DataFieldSetType="Ironbug.HVAC.Curves.IB_CurveBiquadratic_FieldSet")
panel_19 = Panel("""0.756830029796909
0.0457499799042671
-0.00136357240431388
0.0554884599902023
-0.00120700875497686
-0.00303329271420931""")
panel_20 = Panel("""0.983220174655636
0.0157167577703294
-0.000835032422884084
0.0522939264581759
-0.000531556035364549
-0.00190605953116024""")
objparams_18 = IB_ObjParams(
    MaximumCurveOutput="1.2",
    MaximumValueofx="23.9",
    MaximumValueofy="13.3",
    MinimumCurveOutput="0.51515151515",
    MinimumValueofx="16.1",
    MinimumValueofy="-25",
    DataFieldSetType="Ironbug.HVAC.Curves.IB_CurveBiquadratic_FieldSet")
panel_21 = Panel("""1.3885703646
-0.0229771462
0.000537274
-0.0273936962
0.0004030426
-5.9786e-05""")
panel_22 = Panel("""2.5859872368
-0.0953227101
0.0009553288
0.0
0.0
0.0""")
objparams_19 = IB_ObjParams(
    MaximumValueofx="27.2",
    MaximumValueofy="15",
    MinimumValueofx="21.1",
    MinimumValueofy="-994",
    DataFieldSetType="Ironbug.HVAC.Curves.IB_CurveBiquadratic_FieldSet")
objparams_20 = IB_ObjParams(
    MaximumValueofx="27.2",
    MaximumValueofy="1",
    MinimumValueofx="21.1",
    MinimumValueofy="0",
    DataFieldSetType="Ironbug.HVAC.Curves.IB_CurveBiquadratic_FieldSet")
curvebiquadratic_5 = IB_CurveBiquadratic(Coefficients=panel_20, Parameters_=objparams_18, dupNum=False)
curvebiquadratic_6 = IB_CurveBiquadratic(Coefficients=panel_22, Parameters_=objparams_19, dupNum=False)
curvebiquadratic_7 = IB_CurveBiquadratic(Coefficients=panel_19, Parameters_=objparams_17, dupNum=False)
curvebiquadratic_8 = IB_CurveBiquadratic(Coefficients=panel_21, Parameters_=objparams_20, dupNum=False)

data = Data(flatten(hbrooms))
objparams_21 = IB_ObjParams(
    OutdoorAirFlowRateDuringCoolingOperation="0",
    OutdoorAirFlowRateDuringHeatingOperation="0",
    OutdoorAirFlowRateWhenNoCoolingorHeatingisNeeded="0",
    DataFieldSetType="Ironbug.HVAC.IB_ZoneHVACTerminalUnitVariableRefrigerantFlow_FieldSet")

objparams_22 = IB_ObjParams(
    MaximumCurveOutput="1.155",
    MaximumValueofx="23.9",
    MaximumValueofy="50",
    MinimumCurveOutput="0.27",
    MinimumValueofx="13.9",
    MinimumValueofy="-5",
    DataFieldSetType="Ironbug.HVAC.Curves.IB_CurveBiquadratic_FieldSet")
# based on DAIKINREYQ 120 on BCL
# Reference:
# https://github.com/NREL/openstudio-standards/blob/master/lib/openstudio-standards/prototypes/common/objects/Prototype.AirConditionerVariableRefrigerantFlow.rb
panel_23 = Panel("""-1.61908214818635
0.185964818731756
-0.00389610393381592
-0.00901995326324613
0.00030340007815629
0.000476048529099348""")
curvebiquadratic_9 = IB_CurveBiquadratic(Coefficients=panel_23, Parameters_=objparams_22, dupNum=False)

objparams_23 = IB_ObjParams(
    ZoneCoolingDesignSupplyAirTemperature="12.8",
    ZoneHeatingDesignSupplyAirTemperature="40",
    DataFieldSetType="Ironbug.HVAC.IB_SizingZone_FieldSet")

# ----
# Main Heating Coil Parameters
panel_24 = Panel("0.5")
objparams_24 = IB_ObjParams(MaximumValueofx="1.5", MinimumValueofx=panel_24, DataFieldSetType="Ironbug.HVAC.Curves.IB_CurveCubic_FieldSet")
objparams_25 = IB_ObjParams(MaximumValueofx="20", MinimumValueofx="-20", DataFieldSetType="Ironbug.HVAC.Curves.IB_CurveCubic_FieldSet")
panel_25 = Panel("""1.19248
-0.0300438
0.00103745
-0.000023328""")
objparams_26 = IB_ObjParams(MaximumValueofx="20", MinimumValueofx="-20", DataFieldSetType="Ironbug.HVAC.Curves.IB_CurveCubic_FieldSet")
panel_26 = Panel("""0.84
0.16
0
0""")
panel_27 = Panel("""0.758746
0.027626
0.000148716
0.0000034992""")
panel_28 = Panel("""1.3824
-0.4336
0.0512""")
panel_29 = Panel("""0.85
0.15
0""")
curvecubic_13 = IB_CurveCubic(Coefficients=panel_26, Parameters_=objparams_24, dupNum=False)
curvequadratic = IB_CurveQuadratic(Coefficients=panel_29, dupNum=False)
curvecubic_14 = IB_CurveCubic(Coefficients=panel_25, Parameters_=objparams_26, dupNum=False)
curvequadratic_2 = IB_CurveQuadratic(Coefficients=panel_28, dupNum=False)
curvecubic_15 = IB_CurveCubic(Coefficients=panel_27, Parameters_=objparams_25, dupNum=False)
objparams_27 = IB_ObjParams(
    EnergyInputRatioFunctionofFlowFractionCurve=curvequadratic_2,
    EnergyInputRatioFunctionofTemperatureCurve=curvecubic_14,
    PartLoadFractionCorrelationCurve=curvequadratic,
    RatedCOP="3.3",
    TotalHeatingCapacityFunctionofFlowFractionCurve=curvecubic_13,
    TotalHeatingCapacityFunctionofTemperatureCurve=curvecubic_15,
    DataFieldSetType="Ironbug.HVAC.IB_CoilHeatingDXSingleSpeed_FieldSet")

sizingzone = IB_SizingZone(Parameters_=objparams_23, dupNum=False)
panel_30 = Panel("0.5")
objparams_28 = IB_ObjParams(
    CoolingCapacityRatioBoundaryCurve=curvecubic_2,
    CoolingCapacityRatioModifierFunctionofHighTemperatureCurve=curvebiquadratic_2,
    CoolingCapacityRatioModifierFunctionofLowTemperatureCurve=curvebiquadratic,
    CoolingCombinationRatioCorrectionFactorCurve=curvecubic_5,
    CoolingEnergyInputRatioBoundaryCurve=curvecubic_4,
    CoolingEnergyInputRatioModifierFunctionofHighPartLoadRatioCurve=curvecubic_3,
    CoolingEnergyInputRatioModifierFunctionofHighTemperatureCurve=curvebiquadratic_4,
    CoolingEnergyInputRatioModifierFunctionofLowPartLoadRatioCurve=curvecubic,
    CoolingEnergyInputRatioModifierFunctionofLowTemperatureCurve=curvebiquadratic_3,
    CoolingPartLoadFractionCorrelationCurve=curvecubic_6,
    DefrostControl="OnDemand",
    DefrostEnergyInputRatioModifierFunctionofTemperatureCurve=curvebiquadratic_9,
    DefrostStrategy="ReverseCycle",
    HeatingCapacityRatioBoundaryCurve=curvecubic_8,
    HeatingCapacityRatioModifierFunctionofHighTemperatureCurve=curvebiquadratic_6,
    HeatingCapacityRatioModifierFunctionofLowTemperatureCurve=curvebiquadratic_5,
    HeatingCombinationRatioCorrectionFactorCurve=curvecubic_11,
    HeatingEnergyInputRatioBoundaryCurve=curvecubic_10,
    HeatingEnergyInputRatioModifierFunctionofHighPartLoadRatioCurve=curvecubic_9,
    HeatingEnergyInputRatioModifierFunctionofHighTemperatureCurve=curvebiquadratic_8,
    HeatingEnergyInputRatioModifierFunctionofLowPartLoadRatioCurve=curvecubic_7,
    HeatingEnergyInputRatioModifierFunctionofLowTemperatureCurve=curvebiquadratic_7,
    HeatingPartLoadFractionCorrelationCurve=curvecubic_12,
    HeatingPerformanceCurveOutdoorTemperatureType="WetBulbTemperature",
    HeatPumpWasteHeatRecovery=Toggle(True),
    MaximumOutdoorTemperatureinCoolingMode="50",
    MaximumOutdoorTemperatureinHeatingMode="16.1",
    MaximumOutdoorTemperatureinHeatRecoveryMode="27.2",
    MinimumOutdoorTemperatureinCoolingMode="-15",
    MinimumOutdoorTemperatureinHeatingMode="-25",
    MinimumOutdoorTemperatureinHeatRecoveryMode="-10",
    RatedCoolingCOP="4.287",
    RatedHeatingCOP="4.147",
    DataFieldSetType="Ironbug.HVAC.IB_AirConditionerVariableRefrigerantFlow_FieldSet")

# ----
# HBZones
panel_31 = Panel("zone")
roomsbyattr = HBRoomsByAttribute(rooms=flatten(data), attribute=panel_31)  # -> values, rooms; plug-in component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
lng = ListLength(List=roomsbyattr.values)

# ----
# VRF Terminals
vrfterminal = Ironbug_ZoneHVACTerminalUnitVariableRefrigerantFlow(Parameters_=objparams_21, DuplicateNumber_=lng, airloop=False, dupNum=True)  # -> VRFUnit_In, VRFUnit_Out
thermalzone = Ironbug_ThermalZone(
    HoneybeeZonesOrOsZones=data,
    ZoneEquipment=vrfterminal.VRFUnit_In,
    SizingZone=sizingzone,
    IsAirTerminalPriorToZoneEquipments=True,
    allowMultiAirloops=False,
    dupNum=False)

# ----
# DOAS
# Backup Heating
autosize = Number(-9999)
objparams_29 = IB_ObjParams(MinimumOutdoorAirFlowRate=autosize, DataFieldSetType="Ironbug.HVAC.IB_ControllerOutdoorAir_FieldSet")
toggle = BooleanToggle(True)
objparams_30 = IB_ObjParams(
    EndUseSubcategory="DOAS_SupplyFan",
    FanEfficiency="0.55575",
    MotorEfficiency="0.855",
    PressureRise="373",
    DataFieldSetType="Ironbug.HVAC.IB_FanConstantVolume_FieldSet")
objparams_31 = IB_ObjParams(
    EndUseSubcategory="DOAS_SupplyFan",
    FanEfficiency="0.55575",
    MotorEfficiency="0.855",
    PressureRise="622",
    DataFieldSetType="Ironbug.HVAC.IB_FanConstantVolume_FieldSet")
objparams_32 = IB_ObjParams(
    AllOutdoorAirinCooling=toggle,
    AllOutdoorAirinHeating=toggle,
    CentralCoolingDesignSupplyAirTemperature="15.6",
    CentralHeatingDesignSupplyAirTemperature="21.1",
    CentralHeatingMaximumSystemAirFlowRatio="1",
    SizingOption="Coincident",
    TypeofLoadtoSizeOn="VentilationRequirement",
    DataFieldSetType="Ironbug.HVAC.IB_SizingSystem_FieldSet")
oacontroller = IB_OAController(Parameters_=objparams_29, dupNum=False)
oasystem = Ironbug_OutdoorAirSystem(Controller_=oacontroller)
spm_oareset = IB_SetpointManagerOutdoorAirReset(
    SetpointatOutdoorHighTemperature="15.6",
    OutdoorHighTemperature="21.1",
    SetpointatOutdoorLowTemperature="21.1",
    OutdoorLowTemperature="12.8",
    dupNum=False)
fanconstant = Ironbug_FanConstantVolume(Parameters_=objparams_30, dupNum=False)
coilhtn_dx1 = IB_CoilHeatingDXSingleSpeed(Parameters_=objparams_27, dupNum=False)
coilhtnelec = IB_CoilHeatingElectric(dupNum=False)
coilclndx1 = Ironbug_CoilCoolingDXSingleSpeed(dupNum=False)
fanconstant_2 = Ironbug_FanConstantVolume(Parameters_=objparams_31, dupNum=False)
objparams_33 = IB_ObjParams(Name="DOAS", DataFieldSetType="Ironbug.HVAC.IB_AirLoopHVAC_FieldSet")
airloopbranches = AirLoopBranches(Branch1=thermalzone)
sizingsystem = Ironbug_SizingSystem(Parameters_=objparams_32, dupNum=False)
merge = Merge(
    Data1=fanconstant,
    Data2=oasystem,
    Data3=coilclndx1,
    Data4=coilhtn_dx1,
    Data5=coilhtnelec,
    Data6=fanconstant_2,
    Data7=spm_oareset)
airloop = Ironbug_AirLoopHVAC(Supply=merge, Demand=airloopbranches, SizingSystem=sizingsystem, Parameters_=objparams_33, dupNum=False)

vrfsystem = Ironbug_AirConditionerVariableRefrigerantFlow(_terminals=vrfterminal.VRFUnit_Out, Parameters_=objparams_28, dupNum=False)
hvacsystem = Ironbug_HVACSystem(AirLoops=flatten(airloop), VRFSystems=flatten(vrfsystem))

hvacsystem_2 = ClusterOutput(hvacsystem)
