# Grasshopper definition Sys18_GeoThermal + DOAS.gh (Grasshopper 1.0.7)
# plug-ins: Ironbug.Grasshopper

brep = Brep([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])
roomsolid = HBRoomFromSolid(geo=flatten(brep), conditioned=True)  # -> report, rooms; plug-in component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

# ----
# HB Rooms
panel = Panel("zone")
data = Data(flatten(roomsolid.rooms))
roomsbyattr = HBRoomsByAttribute(rooms=flatten(data), attribute=panel)  # -> values, rooms; plug-in component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
objparams = IB_ObjParams(
    RatedCoolingCoefficientofPerformance="3.4",
    DataFieldSetType="Ironbug.HVAC.IB_CoilCoolingWaterToAirHeatPumpEquationFit_FieldSet")
objparams_2 = IB_ObjParams(
    RatedHeatingCoefficientofPerformance="4.2",
    DataFieldSetType="Ironbug.HVAC.IB_CoilHeatingWaterToAirHeatPumpEquationFit_FieldSet")
# Ground Heat Exchanger
panel_2 = Panel("0")
lng = ListLength(List=roomsbyattr.values)
objparams_3 = IB_ObjParams(
    OutdoorAirFlowRateDuringCoolingOperation=panel_2,
    OutdoorAirFlowRateDuringHeatingOperation=panel_2,
    OutdoorAirFlowRateWhenNoCoolingorHeatingisNeeded=panel_2,
    SupplyAirFlowRateWhenNoCoolingorHeatingisNeeded=panel_2,
    DataFieldSetType="Ironbug.HVAC.IB_ZoneHVACWaterToAirHeatPump_FieldSet")
objparams_4 = IB_ObjParams(
    FanTotalEfficiency="0.52",
    MotorEfficiency="0.8",
    PressureRise="330",
    DataFieldSetType="Ironbug.HVAC.IB_FanOnOff_FieldSet")
panel_3 = Panel(lng)
# Zonal system - WaterToAir Heat Pump
coilhtn_watertoair = Ironbug_CoilHeatingWaterToAirHeatPumpEquationFit(Parameters_=objparams_2, DuplicateNumber_=panel_3, dupNum=True)  # -> CoilHeatingWaterToAirHeatPumpEquationFit, graft(ToWaterLoop)
coilhtn_watertoair_2 = Ironbug_CoilCoolingWaterToAirHeatPumpEquationFit(Parameters_=objparams, DuplicateNumber_=panel_3, dupNum=True)  # -> CoilCoolingWaterToAirHeatPumpEquationFit, graft(ToWaterLoop)
fanonoff = Ironbug_FanOnOff(Parameters_=objparams_4, DuplicateNumber_=panel_3, dupNum=True)
waterairheatpump = Ironbug_ZoneHVACWaterToAirHeatPump(
    HeatingCoil=coilhtn_watertoair.CoilHeatingWaterToAirHeatPumpEquationFit,
    CoolingCoil=coilhtn_watertoair_2.CoilCoolingWaterToAirHeatPumpEquationFit,
    Fan_=fanonoff,
    Parameters_=objparams_3,
    dupNum=False)
vavnoreheat = Ironbug_AirTerminalSingleDuctVAVNoReheat(DuplicateNumber_=panel_3, dupNum=True)
thermalzone = Ironbug_ThermalZone(
    HoneybeeZonesOrOsZones=data,
    AirTerminal_=vavnoreheat,
    ZoneEquipment=waterairheatpump,
    IsAirTerminalPriorToZoneEquipments=True,
    allowMultiAirloops=False,
    dupNum=False)

# ----
# Main Heating Coil Parameters
panel_4 = Panel("1.5")
objparams_5 = IB_ObjParams(MaximumValueofx=panel_4, MinimumValueofx="0.5", DataFieldSetType="Ironbug.HVAC.Curves.IB_CurveCubic_FieldSet")
objparams_6 = IB_ObjParams(MaximumValueofx="20", MinimumValueofx="-20", DataFieldSetType="Ironbug.HVAC.Curves.IB_CurveCubic_FieldSet")
objparams_7 = IB_ObjParams(MaximumValueofx="20", MinimumValueofx="-20", DataFieldSetType="Ironbug.HVAC.Curves.IB_CurveCubic_FieldSet")
panel_5 = Panel("""1.19248
-0.0300438
0.00103745
-0.000023328""")
panel_6 = Panel("""0.84
0.16
0
0""")
panel_7 = Panel("""0.758746
0.027626
0.000148716
0.0000034992""")
panel_8 = Panel("""0.85
0.15
0""")
panel_9 = Panel("""1.3824
-0.4336
0.0512""")
curvecubic = IB_CurveCubic(Coefficients=panel_5, Parameters_=objparams_7, dupNum=False)
curvequadratic = IB_CurveQuadratic(Coefficients=panel_8, dupNum=False)
curvecubic_2 = IB_CurveCubic(Coefficients=panel_6, Parameters_=objparams_5, dupNum=False)
curvequadratic_2 = IB_CurveQuadratic(Coefficients=panel_9, dupNum=False)
curvecubic_3 = IB_CurveCubic(Coefficients=panel_7, Parameters_=objparams_6, dupNum=False)
objparams_8 = IB_ObjParams(
    DefrostControl="OnDemand",
    EnergyInputRatioFunctionofFlowFractionCurve=curvequadratic_2,
    EnergyInputRatioFunctionofTemperatureCurve=curvecubic,
    PartLoadFractionCorrelationCurve=curvequadratic,
    RatedCOP="3.3",
    TotalHeatingCapacityFunctionofFlowFractionCurve=curvecubic_2,
    TotalHeatingCapacityFunctionofTemperatureCurve=curvecubic_3,
    DataFieldSetType="Ironbug.HVAC.IB_CoilHeatingDXSingleSpeed_FieldSet")

model = HBModel(rooms=flatten(roomsolid.rooms))  # -> report, model; plug-in component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

# ----
# Exhaust Fan
# Backup Heating
# DOAS
autosize = Number(-9999)
airloopbranches = AirLoopBranches(Branch1=thermalzone)
objparams_9 = IB_ObjParams(MinimumOutdoorAirFlowRate=autosize, DataFieldSetType="Ironbug.HVAC.IB_ControllerOutdoorAir_FieldSet")
toggle = BooleanToggle(True)
objparams_10 = IB_ObjParams(
    EndUseSubcategory="DOAS_Fans",
    FanEfficiency="0.55575",
    MotorEfficiency="0.855",
    PressureRise="373",
    DataFieldSetType="Ironbug.HVAC.IB_FanConstantVolume_FieldSet")
objparams_11 = IB_ObjParams(
    EndUseSubcategory="DOAS_Fans",
    FanEfficiency="0.55575",
    MotorEfficiency="0.855",
    PressureRise="622",
    DataFieldSetType="Ironbug.HVAC.IB_FanConstantVolume_FieldSet")
objparams_12 = IB_ObjParams(
    AllOutdoorAirinCooling=toggle,
    AllOutdoorAirinHeating=toggle,
    CentralCoolingDesignSupplyAirTemperature="15.6",
    CentralHeatingDesignSupplyAirTemperature="21.1",
    CentralHeatingMaximumSystemAirFlowRatio="1",
    SizingOption="Coincident",
    TypeofLoadtoSizeOn="VentilationRequirement",
    DataFieldSetType="Ironbug.HVAC.IB_SizingSystem_FieldSet")
oacontroller = IB_OAController(Parameters_=objparams_9, dupNum=False)
oasystem = Ironbug_OutdoorAirSystem(Controller_=oacontroller)
spm_oareset = IB_SetpointManagerOutdoorAirReset(
    SetpointatOutdoorHighTemperature="15.6",
    OutdoorHighTemperature="21.1",
    SetpointatOutdoorLowTemperature="21.1",
    OutdoorLowTemperature="12.8",
    dupNum=False)
coilclndx2 = IB_CoilCoolingDXTwoSpeed(dupNum=False)
coilhtn_dx1 = IB_CoilHeatingDXSingleSpeed(Parameters_=objparams_8, dupNum=False)
coilhtnelec = IB_CoilHeatingElectric(dupNum=False)
fanconstant = Ironbug_FanConstantVolume(Parameters_=objparams_11, dupNum=False)
fanconstant_2 = Ironbug_FanConstantVolume(Parameters_=objparams_10, dupNum=False)
objparams_13 = IB_ObjParams(Name="DOAS", DataFieldSetType="Ironbug.HVAC.IB_AirLoopHVAC_FieldSet")
sizingsystem = Ironbug_SizingSystem(Parameters_=objparams_12, dupNum=False)
merge = Merge(
    Data1=fanconstant_2,
    Data2=oasystem,
    Data3=coilclndx2,
    Data4=coilhtn_dx1,
    Data5=coilhtnelec,
    Data6=fanconstant,
    Data7=spm_oareset)
airloop = Ironbug_AirLoopHVAC(Supply=merge, Demand=airloopbranches, SizingSystem=sizingsystem, Parameters_=objparams_13, dupNum=False)

outputparams = IB_OutputParams(SystemNodeTemperature=Toggle(True), outputFrequency=1)
panel_10 = Panel("http://climate.onebuilding.org/WMO_Region_4_North_and_Central_America/USA_United_States_of_America/MA_Massachusetts/USA_MA_Boston-Logan.Intl.AP.725090_TMY3.zip")
downloadepw = LBDownloadWeather(weather_URL=panel_10)  # -> epw_file, stat_file, ddy_file; plug-in component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
# Generate OSM
modeltoosm = HBModelToOSM(model=model.model, epw_file=downloadepw.epw_file, write=Toggle(False), run="2")  # -> report, jsons, osw, osm, idf, sql, zsz, rdd, html; plug-in component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
toggle_2 = BooleanToggle(False)

# ----
# use EMS and a PlantComponentTemperatureSource to mimic the operation of the ground heat exchanger.
# Reference:
# https://github.com/NREL/openstudio-standards/blob/12bbfabf3962af05b8c267c1da54b8e3a89217a0/lib/openstudio-standards/prototypes/common/objects/Prototype.hvac_systems.rb#L905
panel_11 = Panel("Ground HX Temp Sch")
scheduletype = IB_ScheduleTypeLimits(LowerLimitValue=0, UpperLimitValue="100", UnitType="Temperature", NumericType="Discrete")
schedule = IB_Schedule(ScheduleName=panel_11, ValuesOrRules="24", ScheduleType=scheduletype)
objparams_14 = IB_ObjParams(
    SourceTemperatureSchedule=schedule,
    TemperatureSpecificationType="Scheduled",
    DataFieldSetType="Ironbug.HVAC.IB_PlantComponentTemperatureSource_FieldSet")
plantcomponent_tsource = IB_PlantComponentTemperatureSource(Parameters_=objparams_14, dupNum=False)

objparams_15 = IB_ObjParams(Schedule=schedule, DataFieldSetType="Ironbug.HVAC.IB_SetpointManagerScheduled_FieldSet")

spm_scheduled = IB_SetpointManagerScheduled(Parameters_=objparams_15, dupNum=False)
merge_2 = Merge(Data1=plantcomponent_tsource, Data2=spm_scheduled)  # -> flatten(Result)

# ----
# Ground Heat
# Exchange Loop
high_entering_condition = Panel("90")
low_entering_condition = Panel("30")
delta_at_high_and_low_entering_condition = Panel("12")
c_script = CSharpScript(F=high_entering_condition)  # -> C; inputs F: Double
# ---------- c_script: C# ----------
    C = (F - 32) * 5 / 9;
# ---------- end c_script ----------
c_script_2 = CSharpScript(R=delta_at_high_and_low_entering_condition)  # -> K; inputs R: Double
# ---------- c_script_2: C# usings ----------
using System.IO;
using System.Linq;
using System.Data;
using System.Drawing;
using System.Reflection;
using System.Windows.Forms;
using System.Xml;
using System.Xml.Linq;
using System.Runtime.InteropServices;

using Rhino.DocObjects;
using Rhino.Collections;
using GH_IO;
using GH_IO.Serialization;
# ---------- c_script_2: C# ----------
    K = R * 5 / 9;
# ---------- end c_script_2 ----------
c_script_3 = CSharpScript(F=low_entering_condition)  # -> C; inputs F: Double; same code as c_script
panel_12 = Panel("Ground HX In Temp Sensor")
python = GhPythonScript(min_inlet=c_script_3, max_inlet=c_script, delta=c_script_2)  # -> min_outlet, max_outlet, slope, intercept
# ---------- python: Python ----------
__author__ = "mingo"
__version__ = "2023.06.12"


min_outlet = min_inlet + delta
max_outlet = max_inlet - delta
slope = (max_outlet - min_outlet) / (max_inlet - min_inlet)
intercept = min_outlet - (slope * min_inlet)
# ---------- end python ----------
_60_0_ft_h2o = Panel("179344.0152")
objparams_16 = IB_ObjParams(Name=panel_12, DataFieldSetType="Ironbug.HVAC.IB_Probe_FieldSet")
objparams_17 = IB_ObjParams(
    PumpControlType="Intermittent",
    RatedPumpHead=_60_0_ft_h2o,
    DataFieldSetType="Ironbug.HVAC.IB_PumpConstantSpeed_FieldSet")
pipeadiabatic = Ironbug_PipeAdiabatic(dupNum=False)
pipeadiabatic_2 = Ironbug_PipeAdiabatic(dupNum=False)
objparams_18 = IB_ObjParams(
    DesignLoopExitTemperature=python.max_outlet,
    LoopDesignTemperatureDifference=c_script_2,
    DataFieldSetType="Ironbug.HVAC.IB_SizingPlant_FieldSet")
objparams_19 = IB_ObjParams(
    MaximumLoopTemperature="80",
    MinimumLoopTemperature="5",
    Name="Ground Heat Pump Loop",
    DataFieldSetType="Ironbug.HVAC.IB_PlantLoop_FieldSet")
pumpconstant = IB_PumpConstantSpeed(Parameters_=objparams_17, dupNum=False)
probe = IB_Probe(Parameters_=[objparams_16, outputparams], dupNum=False)
sizingplant = IB_SizingPlant(Parameters_=objparams_18, dupNum=False)
plantbranches = PlantBranches(B1=pipeadiabatic_2, B2=coilhtn_watertoair.ToWaterLoop, B3=coilhtn_watertoair_2.ToWaterLoop, mapBranchToLoop=False)
plantbranches_2 = PlantBranches(B1=merge_2, B2=pipeadiabatic, mapBranchToLoop=False)
spm_scheduled_2 = IB_SetpointManagerScheduled(Parameters_=objparams_15, dupNum=False)
merge_3 = Merge(Data1=probe, Data2=pumpconstant, Data3=plantbranches_2, Data4=spm_scheduled_2)
hotwaterloop = IB_HotWaterPlantLoop(_supply=merge_3, _demand=plantbranches, SizingLoop=sizingplant, Parameters_=objparams_19, dupNum=False)

# ----
# EMS  Control outlet temperature
# # program to control outlet temperature
# # adjusts delta-t based on calculation of slope and intercept from control temperatures
# 
# SET Tin = Ground_HX_In_Temp_Sensor
# SET Tout = #{slope_c_per_c} * Tin + #{intercept_c}
# SET Ground_HX_Out_Temp_Actuator = Tout
panel_13 = Panel("Ground_HX_In_Temp_Sensor")
emssensor = IB_EMSSensor(_tagID=panel_13, _keyName=panel_12, _outputVariable="System Node Temperature")
intercept = Panel(python.intercept)
slope = Panel(python.slope)
emsactuator2 = IB_EMSActuator2(_obj=schedule, _tagID="Ground_HX_Out_Temp_Actuator", _type="Schedule:Year", _controlType="Schedule Value")
panel_14 = Panel("""      SET Tin = Ground_HX_In_Temp_Sensor
      SET Tout = 0.6 * Tin + 6.22
      SET Ground_HX_Out_Temp_Actuator = Tout""")
emsprogram = IB_EMSProgram(_name_="Ground_HX_Temperature_Control", _programBody=panel_14)
emsprogramcallingmanager = IB_EMSProgramCallingManager(_name_="Ground_HX_Calling_Manager", CallingPoint_="InsideHVACSystemIterationLoop", _programs=emsprogram)
ems = IB_EMS(Actuators=flatten(emsactuator2), Sensors=flatten(emssensor), ProgramCallingManagers=flatten(emsprogramcallingmanager))

# ----
# HVAC
hvacsystem = Ironbug_HVACSystem(AirLoops=flatten(airloop), PlantLoops=flatten(hotwaterloop))
# Add HVAC and EMS
savetofile = IB_SaveToFile(
    NewFilePath=modeltoosm.osm,
    HVACSystem=hvacsystem,
    EnergyManagementSystem=ems,
    _write=Toggle(False),
    OverrideMode=False,
    writeMode=0)
# Rerun OSM
runosm = HBRunOSM(osm=savetofile, epw_file=downloadepw.epw_file, translate=toggle_2, run=toggle_2)  # -> report, idf, sql, zsz, rdd, html; plug-in component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
customresult = HBReadCustomResult(sql=runosm.sql, output_names="System Node Temperature")  # -> results; plug-in component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
eui = HBEndUseIntensity(sql=runosm.sql)  # -> eui, eui_end_use, end_uses, gross_floor; plug-in component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
panel_15 = Panel(eui.end_uses)
panel_16 = Panel(customresult)
# DOAS
# DOAS
# HBZones
# Heat Pump Loop
panel_17 = Panel(eui.eui_end_use)
