# Grasshopper definition Air Source Heat Pump (ASHP).gh (Grasshopper 1.0.7)
# plug-ins: Ironbug.Grasshopper

# ----
# Air Source Heat Pump (ASHP)
panel = Panel("3.5")
objparams = IB_ObjParams(ReferenceCoefficientofPerformance="4.0", DataFieldSetType="Ironbug.HVAC.IB_HeatPumpPlantLoopEIRCooling_FieldSet")
objparams_2 = IB_ObjParams(ReferenceCoefficientofPerformance=panel, DataFieldSetType="Ironbug.HVAC.IB_HeatPumpPlantLoopEIRHeating_FieldSet")
clnhp_aircooled = IB_HeatPumpPlantLoopEIRCooling_AirCooled(Parameters_=objparams, dupNum=False)
htnhp = IB_HeatPumpPlantLoopEIRHeating_AirCoolded(CompanionCoolingHeatPump=clnhp_aircooled, Parameters_=objparams_2, dupNum=False)

# ----
# Chilled water loop
chiller_watercooled = Ironbug_ChillerElectricEIR_WaterCooled(dupNum=False)  # -> ChillerElectricEIR, ChillerElectricEIR_CondenserLoop
pumpvariable = Ironbug_PumpVariableSpeed(dupNum=False)
branches = PlantBranches(Branch1=clnhp_aircooled, mapBranchToLoop=False)
spm_scheduled = Ironbug_SetpointManagerScheduled(Temperature="12.7", dupNum=False)
branches_2 = PlantBranches(mapBranchToLoop=False)
cwloop = Ironbug_ChilledWaterPlantLoop(Supply=[pumpvariable, branches, spm_scheduled], Demand=branches_2, dupNum=False)

# ----
# Hot water loop
panel_2 = Panel("54")
pumpvariable_2 = Ironbug_PumpVariableSpeed(dupNum=False)
plantbranches = PlantBranches(Branch1=htnhp, mapBranchToLoop=False)
spm_scheduled_2 = Ironbug_SetpointManagerScheduled(Temperature=panel_2, dupNum=False)
branches_3 = PlantBranches(mapBranchToLoop=False)
hwloop = Ironbug_HotWaterPlantLoop(Supply=[pumpvariable_2, plantbranches, spm_scheduled_2], Demand=branches_3, dupNum=False)

merge = Merge(Data1=cwloop, Data2=hwloop)
hvacsystem = Ironbug_HVACSystem(PlantLoops=flatten(merge))
