# Grasshopper definition Availability Manager with Probe.gh (Grasshopper 1.0.7)
# plug-ins: Ironbug.Grasshopper

thermalzone = IB_ThermalZone(_HBRooms="test", IsAirTerminalPriorToZoneEquipments=True, allowMultiAirloops=False, dupNum=False)
# Add a probe in the outdoor air intake stream
# Probes can be added to any where of any loops
nodeprobe = IB_NodeProbe(dupNum=False)
# Setup probe in availability manager
# Use this probe as the sensor in
# availability manager to turn off the system
# based on the outdoor temperature
am_hioff = IB_AvailabilityManagerHighTemperatureTurnOff(SensorProbe=nodeprobe, dupNum=False)
oasystem = IB_OutdoorAirSystem(IntakeStream=nodeprobe)
airloopbranches = IB_AirLoopBranches(Branch1=thermalzone)
fansysmodel = IB_FanSystemModel(dupNum=False)
objparams = IB_ObjParams(AvailabilityManagers=am_hioff, DataFieldSetType="Ironbug.HVAC.IB_AirLoopHVAC_FieldSet")
merge = Merge(Data2=airloopbranches)  # -> flatten(Result)
merge_2 = Merge(Data1=oasystem, Data2=fansysmodel)
airloop = IB_AirLoopHVAC(_supply=merge_2, _demand=merge, Parameters_=objparams, dupNum=False)
