# Grasshopper definition DOAS (Advanced).gh (Grasshopper 1.0.7)
# plug-ins: Ironbug.Grasshopper

# HBZones
data = Data()

# ----
# Main Heating Coil Parameters
panel = Panel("1.5")
objparams = IB_ObjParams(MaximumValueofx=panel, MinimumValueofx="0.5", DataFieldSetType="Ironbug.HVAC.Curves.IB_CurveCubic_FieldSet")
objparams_2 = IB_ObjParams(MaximumValueofx="20", MinimumValueofx="-20", DataFieldSetType="Ironbug.HVAC.Curves.IB_CurveCubic_FieldSet")
panel_2 = Panel("""1.19248
-0.0300438
0.00103745
-0.000023328""")
objparams_3 = IB_ObjParams(MaximumValueofx="20", MinimumValueofx="-20", DataFieldSetType="Ironbug.HVAC.Curves.IB_CurveCubic_FieldSet")
panel_3 = Panel("""0.84
0.16
0
0""")
panel_4 = Panel("""0.758746
0.027626
0.000148716
0.0000034992""")
panel_5 = Panel("""0.85
0.15
0""")
panel_6 = Panel("""1.3824
-0.4336
0.0512""")
curvecubic = IB_CurveCubic(Coefficients=panel_2, Parameters_=objparams_3, dupNum=False)
curvequadratic = IB_CurveQuadratic(Coefficients=panel_5, dupNum=False)
curvecubic_2 = IB_CurveCubic(Coefficients=panel_3, Parameters_=objparams, dupNum=False)
curvequadratic_2 = IB_CurveQuadratic(Coefficients=panel_6, dupNum=False)
curvecubic_3 = IB_CurveCubic(Coefficients=panel_4, Parameters_=objparams_2, dupNum=False)
objparams_4 = IB_ObjParams(
    DefrostControl="OnDemand",
    EnergyInputRatioFunctionofFlowFractionCurve=curvequadratic_2,
    EnergyInputRatioFunctionofTemperatureCurve=curvecubic,
    PartLoadFractionCorrelationCurve=curvequadratic,
    RatedCOP="3.3",
    TotalHeatingCapacityFunctionofFlowFractionCurve=curvecubic_2,
    TotalHeatingCapacityFunctionofTemperatureCurve=curvecubic_3,
    DataFieldSetType="Ironbug.HVAC.IB_CoilHeatingDXSingleSpeed_FieldSet")

thermalzone = Ironbug_ThermalZone(HoneybeeZonesOrOsZones=data, IsAirTerminalPriorToZoneEquipments=True, allowMultiAirloops=False, dupNum=False)

# ----
# Exhaust Fan
# DOAS
# Backup Heating
autosize = Number(-9999)
objparams_5 = IB_ObjParams(MinimumOutdoorAirFlowRate=autosize, DataFieldSetType="Ironbug.HVAC.IB_ControllerOutdoorAir_FieldSet")
toggle = BooleanToggle(True)
objparams_6 = IB_ObjParams(
    EndUseSubcategory="DOAS_Fans",
    FanEfficiency="0.55575",
    MotorEfficiency="0.855",
    PressureRise="373",
    DataFieldSetType="Ironbug.HVAC.IB_FanConstantVolume_FieldSet")
objparams_7 = IB_ObjParams(
    EndUseSubcategory="DOAS_Fans",
    FanEfficiency="0.55575",
    MotorEfficiency="0.855",
    PressureRise="622",
    DataFieldSetType="Ironbug.HVAC.IB_FanConstantVolume_FieldSet")
objparams_8 = IB_ObjParams(
    AllOutdoorAirinCooling=toggle,
    AllOutdoorAirinHeating=toggle,
    CentralCoolingDesignSupplyAirTemperature="15.6",
    CentralHeatingDesignSupplyAirTemperature="21.1",
    CentralHeatingMaximumSystemAirFlowRatio="1",
    SizingOption="Coincident",
    TypeofLoadtoSizeOn="VentilationRequirement",
    DataFieldSetType="Ironbug.HVAC.IB_SizingSystem_FieldSet")
oacontroller = IB_OAController(Parameters_=objparams_5, dupNum=False)
oasystem = Ironbug_OutdoorAirSystem(Controller_=oacontroller)
spm_oareset = IB_SetpointManagerOutdoorAirReset(
    SetpointatOutdoorHighTemperature="15.6",
    OutdoorHighTemperature="21.1",
    SetpointatOutdoorLowTemperature="21.1",
    OutdoorLowTemperature="12.8",
    dupNum=False)
coilhtn_dx1 = IB_CoilHeatingDXSingleSpeed(Parameters_=objparams_4, dupNum=False)
coilhtnelec = IB_CoilHeatingElectric(dupNum=False)
coilclndx1 = Ironbug_CoilCoolingDXSingleSpeed(dupNum=False)
fanconstant = Ironbug_FanConstantVolume(Parameters_=objparams_7, dupNum=False)
fanconstant_2 = Ironbug_FanConstantVolume(Parameters_=objparams_6, dupNum=False)
objparams_9 = IB_ObjParams(Name="DOAS", DataFieldSetType="Ironbug.HVAC.IB_AirLoopHVAC_FieldSet")
airloopbranches = AirLoopBranches(Branch1=thermalzone)
sizingsystem = Ironbug_SizingSystem(Parameters_=objparams_8, dupNum=False)
merge = Merge(
    Data1=fanconstant_2,
    Data2=oasystem,
    Data3=coilclndx1,
    Data4=coilhtn_dx1,
    Data5=coilhtnelec,
    Data6=fanconstant,
    Data7=spm_oareset)
airloop = Ironbug_AirLoopHVAC(Supply=merge, Demand=airloopbranches, SizingSystem=sizingsystem, Parameters_=objparams_9, dupNum=False)

hvacsystem = Ironbug_HVACSystem(AirLoops=flatten(airloop))
