# Grasshopper definition DOAS.gh (Grasshopper 1.0.7)
# plug-ins: Ironbug.Grasshopper

# ----
# DOAS
thermalzone = IB_ThermalZone(IsAirTerminalPriorToZoneEquipments=True, dupNum=False)
objparams = IB_ObjParams(
    CentralHeatingMaximumSystemAirFlowRatio="1",
    TypeofLoadtoSizeOn="VentilationRequirement",
    DataFieldSetType="Ironbug.HVAC.IB_SizingSystem_FieldSet")
oasystem = Ironbug_OutdoorAirSystem()
coilclndx1 = Ironbug_CoilCoolingDXSingleSpeed(dupNum=False)
coilhtngas = Ironbug_CoilHeatingGas(dupNum=False)
fanvariable = Ironbug_FanVariableVolume(dupNum=False)
spm_scheduled = Ironbug_SetpointManagerScheduled(Temperature="21.11", dupNum=False)
airloopbranches = AirLoopBranches(Branch1=thermalzone)
objparams_2 = IB_ObjParams(Name="DOAS", DataFieldSetType="Ironbug.HVAC.IB_AirLoopHVAC_FieldSet")
sizingsystem = Ironbug_SizingSystem(Parameters_=objparams, dupNum=False)
merge = Merge(Data1=oasystem, Data2=coilclndx1, Data3=coilhtngas, Data4=fanvariable, Data5=spm_scheduled)
airloop = Ironbug_AirLoopHVAC(Supply=merge, Demand=airloopbranches, SizingSystem=sizingsystem, Parameters_=objparams_2, dupNum=False)
