# Grasshopper definition FanSystemModel (Coil Fan).gh (Grasshopper 1.0.7)
# plug-ins: Ironbug.Grasshopper

# ----
# FanSystemModel (Coil Fan)
panel = Panel("TotalEfficiencyAndPressure")
objparams = IB_ObjParams(
    DesignPowerSizingMethod=panel,
    DesignPressureRise="75",
    ElectricPowerMinimumFlowRateFraction="0",
    FanTotalEfficiency="0.5",
    MotorEfficiency="0.9",
    Name="Zone Equipment Fan",
    SpeedControlMethod="Discrete",
    DataFieldSetType="Ironbug.HVAC.IB_FanSystemModel_FieldSet")
panel_2 = Panel("""0.33,0.12
0.66,0.51
1,1""")
fansysmodel = IB_FanSystemModel(Speeds=panel_2, Parameters_=objparams, dupNum=False)
