# Grasshopper definition FanSystemModel (Zone Equipment Fan).gh (Grasshopper 1.0.7)
# plug-ins: Ironbug.Grasshopper

# ----
# FanSystemModel (Zone Equipment Fan)
panel = Panel("TotalEfficiencyAndPressure")
objparams = IB_ObjParams(
    DesignPowerSizingMethod=panel,
    DesignPressureRise="75",
    ElectricPowerMinimumFlowRateFraction="0",
    FanTotalEfficiency="0.5",
    MotorEfficiency="0.9",
    Name="Zone Equipment Fan",
    SpeedControlMethod="Discrete",
    DataFieldSetType="Ironbug.HVAC.IB_FanSystemModel_FieldSet")
fansysmodel = IB_FanSystemModel(Parameters_=objparams, dupNum=False)
