# Grasshopper definition FanSystemModel CV.gh (Grasshopper 1.0.7)
# plug-ins: Ironbug.Grasshopper

# ----
# FanSystemModel CV
panel = Panel("Discrete")
panel_2 = Panel("Fan CV")
objparams = IB_ObjParams(DesignPressureRise="250", SpeedControlMethod=panel, DataFieldSetType="Ironbug.HVAC.IB_FanSystemModel_FieldSet")
fansysmodel = IB_FanSystemModel(Parameters_=objparams, dupNum=False)
