# Grasshopper definition FanSystemModel VAV.gh (Grasshopper 1.0.7)
# plug-ins: Ironbug.Grasshopper

# ----
# FanSystemModel VAV
panel = Panel("""0.0407598940
0.08804497
-0.072926120
0.9437398230
0.0""")
curvequartic = IB_CurveQuartic(Coefficients=panel, dupNum=False)
objparams = IB_ObjParams(
    DesignPowerSizingMethod="TotalEfficiencyAndPressure",
    DesignPressureRise="1017.6",
    ElectricPowerFunctionofFlowFractionCurve=curvequartic,
    ElectricPowerMinimumFlowRateFraction="0",
    FanTotalEfficiency="0.6045",
    MotorEfficiency="0.93",
    Name="Fan VAV",
    SpeedControlMethod="Continuous",
    DataFieldSetType="Ironbug.HVAC.IB_FanSystemModel_FieldSet")
fansysmodel = IB_FanSystemModel(Parameters_=objparams, dupNum=False)
