# Grasshopper definition Heat Pump (Cooling DX Single Speed).gh (Grasshopper 1.0.7)
# plug-ins: Ironbug.Grasshopper

# ----
# Cooling Coil Performance Curves
# For Heat Pump
panel = Panel("1")
objparams = IB_ObjParams(MaximumValueofx=panel, MinimumValueofx="0", DataFieldSetType="Ironbug.HVAC.Curves.IB_CurveQuadratic_FieldSet")
objparams_2 = IB_ObjParams(MaximumValueofx="1.5", MinimumValueofx="0.5", DataFieldSetType="Ironbug.HVAC.Curves.IB_CurveQuadratic_FieldSet")
panel_2 = Panel("""0.297145
0.0430933
-0.000748766
0.00597727
0.000482112
-0.000956448""")
objparams_3 = IB_ObjParams(
    MaximumValueofx="23.89",
    MaximumValueofy="46.11",
    MinimumValueofx="12.78",
    MinimumValueofy="21.1",
    DataFieldSetType="Ironbug.HVAC.Curves.IB_CurveBiquadratic_FieldSet")
panel_3 = Panel("""1.1552
-0.1816
0.0256""")
panel_4 = Panel("""0.85
0.15
0""")
curvequadratic = IB_CurveQuadratic(Coefficients=panel_4, Parameters_=objparams, dupNum=False)
curvebiquadratic = IB_CurveBiquadratic(Coefficients=panel_2, Parameters_=objparams_3, dupNum=False)
curvequadratic_2 = IB_CurveQuadratic(Coefficients=panel_3, Parameters_=objparams_2, dupNum=False)
objparams_4 = IB_ObjParams(MaximumValueofx="1.5", MinimumValueofx="0.5", DataFieldSetType="Ironbug.HVAC.Curves.IB_CurveQuadratic_FieldSet")
panel_5 = Panel("""0.766956
0.0107756
-0.0000414703
0.00134961
-0.000261144
0.000457488""")
objparams_5 = IB_ObjParams(
    MaximumValueofx="23.89",
    MaximumValueofy="46.11",
    MinimumValueofx="12.78",
    MinimumValueofy="21.1",
    DataFieldSetType="Ironbug.HVAC.Curves.IB_CurveBiquadratic_FieldSet")
panel_6 = Panel("""0.8
0.2
0""")
curvebiquadratic_2 = IB_CurveBiquadratic(Coefficients=panel_5, Parameters_=objparams_5, dupNum=False)
curvequadratic_3 = IB_CurveQuadratic(Coefficients=panel_6, Parameters_=objparams_4, dupNum=False)
objparams_6 = IB_ObjParams(
    EnergyInputRatioFunctionOfFlowFractionCurve=curvequadratic_2,
    EnergyInputRatioFunctionOfTemperatureCurve=curvebiquadratic,
    PartLoadFractionCorrelationCurve=curvequadratic,
    TotalCoolingCapacityFunctionOfFlowFractionCurve=curvequadratic_3,
    TotalCoolingCapacityFunctionOfTemperatureCurve=curvebiquadratic_2,
    DataFieldSetType="Ironbug.HVAC.IB_CoilCoolingDXSingleSpeed_FieldSet")

coilclndx1 = IB_CoilCoolingDXSingleSpeed(Parameters_=objparams_6, dupNum=False)
