# Grasshopper definition Heat Pump (Heating DX Single Speed).gh (Grasshopper 1.0.7)
# plug-ins: Ironbug.Grasshopper

# ----
# Heating Coil Performance Curves
# For Heat Pump
panel = Panel("20")
objparams = IB_ObjParams(MaximumValueofx=panel, MinimumValueofx="-20", DataFieldSetType="Ironbug.HVAC.Curves.IB_CurveCubic_FieldSet")
objparams_2 = IB_ObjParams(MaximumValueofx="1.5", MinimumValueofx="0.5", DataFieldSetType="Ironbug.HVAC.Curves.IB_CurveCubic_FieldSet")
objparams_3 = IB_ObjParams(MaximumValueofx="20", MinimumValueofx="-20", DataFieldSetType="Ironbug.HVAC.Curves.IB_CurveCubic_FieldSet")
panel_2 = Panel("""0.84
0.16
0
0""")
panel_3 = Panel("""1.19248
-0.0300438
0.00103745
-0.000023328""")
panel_4 = Panel("""0.758746
0.027626
0.000148716
0.0000034992""")
panel_5 = Panel("""0.85
0.15
0""")
panel_6 = Panel("""1.3824
-0.4336
0.0512""")
curvecubic = IB_CurveCubic(Coefficients=panel_2, Parameters_=objparams_2, dupNum=False)
curvequadratic = IB_CurveQuadratic(Coefficients=panel_5, dupNum=False)
curvecubic_2 = IB_CurveCubic(Coefficients=panel_4, Parameters_=objparams, dupNum=False)
curvequadratic_2 = IB_CurveQuadratic(Coefficients=panel_6, dupNum=False)
curvecubic_3 = IB_CurveCubic(Coefficients=panel_3, Parameters_=objparams_3, dupNum=False)
panel_7 = Panel(""" 0.297145
0.0430933
-0.000748766
0.00597727
0.000482112
-0.000956448""")
objparams_4 = IB_ObjParams(
    MaximumValueofx="29.44",
    MaximumValueofy="29.44",
    MinimumValueofx="-23.33",
    MinimumValueofy="-23.33",
    DataFieldSetType="Ironbug.HVAC.Curves.IB_CurveBiquadratic_FieldSet")
curvebiquadratic = IB_CurveBiquadratic(Coefficients=panel_7, Parameters_=objparams_4, dupNum=False)
objparams_5 = IB_ObjParams(
    CrankcaseHeaterCapacity="50",
    DefrostControl="OnDemand",
    DefrostEnergyInputRatioFunctionofTemperatureCurve=curvebiquadratic,
    DefrostStrategy="ReverseCycle",
    EnergyInputRatioFunctionofFlowFractionCurve=curvequadratic_2,
    EnergyInputRatioFunctionofTemperatureCurve=curvecubic_3,
    MaximumOutdoorDryBulbTemperatureforCrankcaseHeaterOperation="4.4",
    MaximumOutdoorDryBulbTemperatureforDefrostOperation="1.67",
    MinimumOutdoorDryBulbTemperatureforCompressorOperation="-12.2",
    PartLoadFractionCorrelationCurve=curvequadratic,
    RatedCOP="3.3",
    TotalHeatingCapacityFunctionofFlowFractionCurve=curvecubic,
    TotalHeatingCapacityFunctionofTemperatureCurve=curvecubic_2,
    DataFieldSetType="Ironbug.HVAC.IB_CoilHeatingDXSingleSpeed_FieldSet")

coilhtn_dx1 = IB_CoilHeatingDXSingleSpeed(Parameters_=objparams_5, dupNum=False)
