# Grasshopper definition Heating DX Single Speed.gh (Grasshopper 1.0.7)
# plug-ins: Ironbug.Grasshopper

# ----
# DX Heating Coil Parameters
panel = Panel("0.5")
objparams = IB_ObjParams(MaximumValueofx="1.5", MinimumValueofx=panel, DataFieldSetType="Ironbug.HVAC.Curves.IB_CurveCubic_FieldSet")
objparams_2 = IB_ObjParams(MaximumValueofx="20", MinimumValueofx="-20", DataFieldSetType="Ironbug.HVAC.Curves.IB_CurveCubic_FieldSet")
objparams_3 = IB_ObjParams(MaximumValueofx="20", MinimumValueofx="-20", DataFieldSetType="Ironbug.HVAC.Curves.IB_CurveCubic_FieldSet")
panel_2 = Panel("""1.19248
-0.0300438
0.00103745
-0.000023328""")
panel_3 = Panel("""0.84
0.16
0
0""")
panel_4 = Panel("""0.758746
0.027626
0.000148716
0.0000034992""")
panel_5 = Panel("""0.85
0.15
0""")
panel_6 = Panel("""1.3824
-0.4336
0.0512""")
curvecubic = IB_CurveCubic(Coefficients=panel_2, Parameters_=objparams_3, dupNum=False)
curvequadratic = IB_CurveQuadratic(Coefficients=panel_5, dupNum=False)
curvecubic_2 = IB_CurveCubic(Coefficients=panel_3, Parameters_=objparams, dupNum=False)
curvequadratic_2 = IB_CurveQuadratic(Coefficients=panel_6, dupNum=False)
curvecubic_3 = IB_CurveCubic(Coefficients=panel_4, Parameters_=objparams_2, dupNum=False)
objparams_4 = IB_ObjParams(
    DefrostControl="OnDemand",
    EnergyInputRatioFunctionofFlowFractionCurve=curvequadratic_2,
    EnergyInputRatioFunctionofTemperatureCurve=curvecubic,
    PartLoadFractionCorrelationCurve=curvequadratic,
    RatedCOP="3.3",
    TotalHeatingCapacityFunctionofFlowFractionCurve=curvecubic_2,
    TotalHeatingCapacityFunctionofTemperatureCurve=curvecubic_3,
    DataFieldSetType="Ironbug.HVAC.IB_CoilHeatingDXSingleSpeed_FieldSet")

coilhtn_dx1 = IB_CoilHeatingDXSingleSpeed(Parameters_=objparams_4, dupNum=False)
