# Grasshopper definition Hot water loop.gh (Grasshopper 1.0.7)
# plug-ins: Ironbug.Grasshopper

# ----
# Hot water loop
pumpvariable = Ironbug_PumpVariableSpeed(dupNum=False)

objparams = IB_ObjParams(
    BoilerFlowMode="LeavingSetpointModulated",
    MaximumPartLoadRatio="1.2",
    NominalThermalEfficiency="0.78",
    DataFieldSetType="Ironbug.HVAC.IB_BoilerHotWater_FieldSet")
boiler = Ironbug_BoilerHotWater(Parameters_=objparams, dupNum=False)
objparams_2 = IB_ObjParams(DesignLoopExitTemperature="82.2", DataFieldSetType="Ironbug.HVAC.IB_SizingPlant_FieldSet")
plantbranches = PlantBranches(Branch1=boiler, mapBranchToLoop=False)
plantbranches_2 = PlantBranches(mapBranchToLoop=False)
spm_scheduled = Ironbug_SetpointManagerScheduled(Temperature="82.2", dupNum=False)
sizingplant = IB_SizingPlant(Parameters_=objparams_2, dupNum=False)
hotwaterloop = Ironbug_HotWaterPlantLoop(Supply=[pumpvariable, plantbranches, spm_scheduled], Demand=plantbranches_2, SizingLoop=sizingplant, dupNum=False)
