# Grasshopper definition Multi-level_loop.gh (Grasshopper 1.0.8)

# ----
# Developed by Zhengrong Tao
multi_level_loop = MultiLevelLoop()

# ==== cluster MultiLevelLoop
hb_room = ClusterInput()

# ----
# 1.Create an FCU terminal and set up a simple cooling heat pump.
list_length = ListLength(List=hb_room)
ib_coilcoolingwater = IB_CoilCoolingWater(DuplicateNumber_=list_length, dupNum=True)  # -> AirSide_CoilCoolingWater, graft(WaterSide_CoilCoolingWater)
ib_setpointmanagerscheduled = IB_SetpointManagerScheduled(Value="7", ControlVariable="Temperature", dupNum=False)
ib_pumpvariablespeed = IB_PumpVariableSpeed(dupNum=False)
ib_plantbranches = IB_PlantBranches(Branch1=ib_coilcoolingwater.WaterSide_CoilCoolingWater, mapBranchToLoop=False)
merge = Merge(Data1=ib_plantbranches)

# ----
# 2.First, heat it up to a certain temperature (for example, 45 degrees) using a heat pump.
# 
# And then it is sent to the heat exchanger.
panel = Panel("Temperature")
ib_heatpumpplantloopeirheating_airsource = IB_HeatPumpPlantLoopEIRHeating_AirSource(dupNum=False)
ib_setpointmanagerscheduled_2 = IB_SetpointManagerScheduled(Value="45", ControlVariable=panel, dupNum=False)
ib_pumpvariablespeed_2 = IB_PumpVariableSpeed(dupNum=False)
ib_plantbranches_2 = IB_PlantBranches(B1=ib_heatpumpplantloopeirheating_airsource, mapBranchToLoop=False)
merge_2 = Merge(Data1=ib_plantbranches_2, Data2=ib_pumpvariablespeed_2, Data3=ib_setpointmanagerscheduled_2)

ib_heatpumpplantloopeircooling_airsource = IB_HeatPumpPlantLoopEIRCooling_AirSource(CompanionHeatingHeatPump=ib_heatpumpplantloopeirheating_airsource, dupNum=False)
ib_plantbranches_3 = IB_PlantBranches(Branch1=ib_heatpumpplantloopeircooling_airsource, mapBranchToLoop=False)
merge_3 = Merge(Data1=ib_plantbranches_3, Data2=ib_pumpvariablespeed, Data3=ib_setpointmanagerscheduled)
ib_chilledwaterplantloop = IB_ChilledWaterPlantLoop(_supply=merge_3, _demand=merge, dupNum=False)

# ----
# 3.Connect the supply side of the heat exchanger in series with the boiler,
# 
# and provide the boiler with preheated hot water that is heated to a certain temperature (for example, 60°).
ib_coilheatingwater = IB_CoilHeatingWater(DuplicateNumber_=list_length, dupNum=True)  # -> AirSide_CoilHeatingWater, graft(WaterSide_CoilHeatingWater)
ib_heatexchangerfluidtofluid = IB_HeatExchangerFluidToFluid(dupNum=False)  # -> HeatExchangerFluidToFluid, HeatExchangerFluidToFluid_2
ib_boilerhotwater = IB_BoilerHotWater(dupNum=False)
ib_plantbranches_4 = IB_PlantBranches(Branch1=ib_heatexchangerfluidtofluid.HeatExchangerFluidToFluid, mapBranchToLoop=False)
ib_pumpconstantspeed = IB_PumpConstantSpeed(dupNum=False)
ib_plantbranches_5 = IB_PlantBranches(B1=ib_heatexchangerfluidtofluid.HeatExchangerFluidToFluid_2, B2=ib_boilerhotwater, mapBranchToLoop=False)
ib_plantbranches_6 = IB_PlantBranches(Branch1=ib_coilheatingwater.WaterSide_CoilHeatingWater, mapBranchToLoop=False)

ib_hotwaterplantloop = IB_HotWaterPlantLoop(_supply=merge_2, _demand=ib_plantbranches_4, dupNum=False)

# ----
# This is a simple case used to demonstrate the configuration method of multi-level loop coupling.
panel_2 = Panel("Temperature")
ib_zonehvacfourpipefancoil = IB_ZoneHVACFourPipeFanCoil(
    HeatingCoil=ib_coilheatingwater.AirSide_CoilHeatingWater,
    CoolingCoil=ib_coilcoolingwater.AirSide_CoilCoolingWater,
    dupNum=False)
ib_thermalzone = IB_ThermalZone(
    _HBRooms=hb_room,
    ZoneEquipments_=ib_zonehvacfourpipefancoil,
    IsAirTerminalPriorToZoneEquipments=True,
    allowMultiAirloops=False,
    dupNum=False)
ib_noairloop = IB_NoAirLoop(OSZones=ib_thermalzone)

ib_setpointmanagerscheduled_3 = IB_SetpointManagerScheduled(Value="60", ControlVariable=panel_2, dupNum=False)
merge_4 = Merge(Data1=ib_plantbranches_5, Data2=ib_pumpconstantspeed, Data3=ib_setpointmanagerscheduled_3)
ib_hotwaterplantloop_2 = IB_HotWaterPlantLoop(_supply=merge_4, _demand=ib_plantbranches_6, dupNum=False)

merge_5 = Merge(Data1=ib_chilledwaterplantloop, Data2=ib_hotwaterplantloop, Data3=ib_hotwaterplantloop_2)
ib_hvacsystem = IB_HVACSystem(AirLoops=flatten(ib_noairloop), PlantLoops=flatten(merge_5))

hvacsystem = ClusterOutput(ib_hvacsystem)
