# Grasshopper definition PerformanceCurve_ADEG Water Chiller.gh (Grasshopper 1.0.7)
# plug-ins: Ironbug.Grasshopper

# ----
# ADEG Water Chiller
panel = Panel("20")
objparams = IB_ObjParams(MaximumValueofx=panel, MaximumValueofy="50", DataFieldSetType="Ironbug.HVAC.Curves.IB_CurveBiquadratic_FieldSet")
panel_2 = Panel("""1.41E-01
6.55E-01
2.03E-01""")
panel_3 = Panel("""1.07E+00
4.29E-02
4.17E-04
-8.10E-03
-4.02E-05
-3.86E-04""")
objparams_2 = IB_ObjParams(MaximumValueofx="20", MaximumValueofy="50", DataFieldSetType="Ironbug.HVAC.Curves.IB_CurveBiquadratic_FieldSet")
objparams_3 = IB_ObjParams(MaximumValueofx="1.2", DataFieldSetType="Ironbug.HVAC.Curves.IB_CurveQuadratic_FieldSet")
panel_4 = Panel("""4.68E-01
-1.38E-02
6.98E-04
1.09E-02
4.62E-04
-6.82E-04""")
curvebiquadratic = Ironbug_CurveBiquadratic(Coefficients=panel_4, Parameters_=objparams_2, dupNum=False)
curvebiquadratic_2 = Ironbug_CurveBiquadratic(Coefficients=panel_3, Parameters_=objparams, dupNum=False)
curvequadratic = Ironbug_CurveQuadratic(Coefficients=panel_2, Parameters_=objparams_3, dupNum=False)
objparams_4 = IB_ObjParams(
    CoolingCapacityFunctionOfTemperature=curvebiquadratic_2,
    ElectricInputToCoolingOutputRatioFunctionOfPLR=curvequadratic,
    ElectricInputToCoolingOutputRatioFunctionOfTemperature=curvebiquadratic,
    DataFieldSetType="Ironbug.HVAC.IB_ChillerElectricEIR_FieldSet")
chiller_watercooled = IB_ChillerElectricEIR_WaterCooled(Parameters_=objparams_4, dupNum=False)  # -> ChillerElectricEIR, graft(ChillerElectricEIR_CondenserLoop)
