# Grasshopper definition Split AC (Cooling DX Single Speed).gh (Grasshopper 1.0.7)
# plug-ins: Ironbug.Grasshopper

# ----
# Cooling Coil Performance Curves
# Split AC or PTAC
panel = Panel("1")
objparams = IB_ObjParams(
    MaximumCurveOutput=panel,
    MaximumValueofx=panel,
    MinimumCurveOutput="0.7",
    MinimumValueofx="0",
    DataFieldSetType="Ironbug.HVAC.Curves.IB_CurveQuadratic_FieldSet")
panel_2 = Panel("""0.342414409
0.034885008
-0.0006237
0.004977216
0.000437951
-0.000728028""")
objparams_2 = IB_ObjParams(MaximumValueofx="1.5", MinimumValueofx="0.5", DataFieldSetType="Ironbug.HVAC.Curves.IB_CurveQuadratic_FieldSet")
panel_3 = Panel("""1.1552
-0.1808
0.0256""")
objparams_3 = IB_ObjParams(
    MaximumValueofx="23.89",
    MaximumValueofy="46.11",
    MinimumValueofx="12.78",
    MinimumValueofy="23.89",
    DataFieldSetType="Ironbug.HVAC.Curves.IB_CurveBiquadratic_FieldSet")
panel_4 = Panel("""0.85
0.15
0""")
curvequadratic = IB_CurveQuadratic(Coefficients=panel_3, Parameters_=objparams_2, dupNum=False)
curvebiquadratic = IB_CurveBiquadratic(Coefficients=panel_2, Parameters_=objparams_3, dupNum=False)
curvequadratic_2 = IB_CurveQuadratic(Coefficients=panel_4, Parameters_=objparams, dupNum=False)
objparams_4 = IB_ObjParams(MaximumValueofx="1.5", MinimumValueofx="0.5", DataFieldSetType="Ironbug.HVAC.Curves.IB_CurveQuadratic_FieldSet")
panel_5 = Panel("""0.942587793
0.009543347
0.00068377
-0.011042676
0.000005249
-0.00000972""")
panel_6 = Panel("""0.8
0.2
0""")
objparams_5 = IB_ObjParams(
    MaximumValueofx="23.89",
    MaximumValueofy="46.11",
    MinimumValueofx="12.78",
    MinimumValueofy="23.89",
    DataFieldSetType="Ironbug.HVAC.Curves.IB_CurveBiquadratic_FieldSet")
curvequadratic_3 = IB_CurveQuadratic(Coefficients=panel_6, Parameters_=objparams_4, dupNum=False)
curvebiquadratic_2 = IB_CurveBiquadratic(Coefficients=panel_5, Parameters_=objparams_5, dupNum=False)
objparams_6 = IB_ObjParams(
    EnergyInputRatioFunctionOfFlowFractionCurve=curvequadratic,
    EnergyInputRatioFunctionOfTemperatureCurve=curvebiquadratic,
    PartLoadFractionCorrelationCurve=curvequadratic_2,
    TotalCoolingCapacityFunctionOfFlowFractionCurve=curvequadratic_3,
    TotalCoolingCapacityFunctionOfTemperatureCurve=curvebiquadratic_2,
    DataFieldSetType="Ironbug.HVAC.IB_CoilCoolingDXSingleSpeed_FieldSet")

coilclndx1 = IB_CoilCoolingDXSingleSpeed(Parameters_=objparams_6, dupNum=False)
