# Grasshopper definition PVWatts.gh (Grasshopper 1.0.7)
# plug-ins: Ironbug.Grasshopper

# ---- group: PV Surface
brep = Brep(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)

# ----
# Geometry
brep_2 = Brep(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)
shade = HBShade(geo=brep)  # -> report, shades; plug-in component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
roomsolid = HBRoomFromSolid(geo=flatten(brep_2), conditioned=True)  # -> report, rooms; plug-in component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
panel = Panel("""0
0
0.4
0""")
aperturesbyratio = HBAperturesByRatio(hb_objs=flatten(roomsolid.rooms), ratio=panel)  # -> report, hb_objs; plug-in component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
model = HBModel(rooms=flatten(aperturesbyratio.hb_objs), shades=flatten(shade.shades))  # -> report, model; plug-in component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
vizwiref = HBVisualizeWireframe(hb_objs=flatten(model.model))  # -> geo; plug-in component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

panel_2 = Panel("https://energyplus-weather.s3.amazonaws.com/north_and_central_america_wmo_region_4/USA/MA/USA_MA_Boston-Logan.Intl.AP.725090_TMY/USA_MA_Boston-Logan.Intl.AP.725090_TMY.zip")
epwmap = LBEPWmap(epw_map=Button())  # -> report; plug-in component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
# EPW
downloadepw = LBDownloadWeather(weather_URL=panel_2)  # -> epw_file, stat_file, ddy_file; plug-in component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

toggle = BooleanToggle(True)
outputparams = IB_OutputParams(ElectricLoadCenterProducedElectricityRate=toggle, ElectricLoadCenterRequestedElectricityRate=toggle, outputFrequency=1)
objparams = IB_ObjParams(
    ElectricalBussType="DirectCurrentWithInverter",
    GeneratorOperationSchemeType="Baseload",
    DataFieldSetType="Ironbug.HVAC.IB_ElectricLoadCenterDistribution_FieldSet")

# ----
# Setup PV Watts
toggle_2 = BooleanToggle(True)
toggle_3 = BooleanToggle(True)
outputparams_2 = IB_OutputParams(GeneratorProducedDCElectricityRate=toggle_2, GeneratorPVCellTemperature=toggle_2, outputFrequency=1)
outputparams_3 = IB_OutputParams(InverterACOutputElectricityRate=toggle_3, InverterDCInputElectricityRate=toggle_3, outputFrequency=1)
objparams_2 = IB_ObjParams(
    ArrayType="FixedOpenRack",
    DCSystemCapacity="4000",
    ModuleType="Premium",
    DataFieldSetType="Ironbug.HVAC.IB_GeneratorPVWatts_FieldSet")
objparams_3 = IB_ObjParams(
    DCToACSizeRatio="1.1",
    InverterEfficiency="0.96",
    DataFieldSetType="Ironbug.HVAC.IB_ElectricLoadCenterInverterPVWatts_FieldSet")
pvwatts = IB_GeneratorPVWatts(ShadeSurface=shade.shades, Parameters_=[objparams_2, outputparams_2], dupNum=False)
inverterpvwatts = IB_ElectricLoadCenterInverterPVWatts(Parameters_=[outputparams_3, objparams_3], dupNum=False)
elc_distribution_subpanel = IB_ElectricLoadCenterDistribution(Generators=flatten(pvwatts), Inverter=inverterpvwatts, Parameters_=[outputparams, objparams], dupNum=False)
elc_mainpanel = IB_ElectricLoadCenter(_subPanels=flatten(elc_distribution_subpanel))

# ----
# Output Parameters
merge = Merge(Data1=outputparams, Data2=outputparams_3, Data3=outputparams_2)
python = GhPythonScript(x=merge)  # -> flatten(a)
# ---------- python: Python ----------
a = x.splitlines()
# ---------- end python ----------
panel_3 = Panel(python)
customoutput = HBCustomSimulationOutput(output_names=python)  # -> report, sim_output; plug-in component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
simpar = HBSimulationParameter(output=customoutput.sim_output, timestep=6)  # -> sim_par; plug-in component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

# ----
# Generate OSM
toggle_4 = BooleanToggle(False)
modeltoosm = HBModelToOSM(model=model.model, epw_file=downloadepw.epw_file, sim_par=simpar, write=toggle_4)  # -> report, jsons, osw, osm, idf, sql, zsz, rdd, html; plug-in component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

# ----
# Add ELC
toggle_5 = BooleanToggle(False)
savetofile = IB_SaveToFile(NewFilePath=modeltoosm.osm, ElectricLoadCenter=elc_mainpanel, _write=toggle_5, OverrideMode=False, writeMode=0)

# ----
# Run OSM
toggle_6 = BooleanToggle(False)
runosm = HBRunOSM(osm=savetofile, epw_file=downloadepw.epw_file, translate=toggle_6, run=toggle_6)  # -> report, idf, sql, zsz, rdd, html; plug-in component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

# ----
# Viz Results
customresult = HBReadCustomResult(sql=runosm.sql, output_names=panel_3)  # -> results; plug-in component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
hourlyplot = LBHourlyPlot(data=flatten(customresult))  # -> report, mesh, legend, borders, labels, title, vis_set; plug-in component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

panel_4 = Panel(modeltoosm.osm)
panel_5 = Panel(runosm.html)
