# Grasshopper definition PVs.gh (Grasshopper 1.0.7)
# plug-ins: Ironbug.Grasshopper

# ---- group: PV Surface
brep = Brep([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])

# ----
# Geometry
brep_2 = Brep(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)
roomsolid = HBRoomFromSolid(geo=flatten(brep_2), conditioned=True)  # -> report, rooms; plug-in component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
shade = HBShade(geo=brep)  # -> report, shades; plug-in component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
panel = Panel("""0
0
0.4
0""")
aperturesbyratio = HBAperturesByRatio(hb_objs=flatten(roomsolid.rooms), ratio=panel)  # -> report, hb_objs; plug-in component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
model = HBModel(rooms=flatten(aperturesbyratio.hb_objs), shades=flatten(shade.shades))  # -> report, model; plug-in component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
vizwiref = HBVisualizeWireframe(hb_objs=flatten(model.model))  # -> geo; plug-in component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

panel_2 = Panel(shade.shades)
item = ListItem(List=shade.shades, Index=0, Wrap=True)  # -> Item, Item1, Item2

panel_3 = Panel("https://energyplus-weather.s3.amazonaws.com/north_and_central_america_wmo_region_4/USA/MA/USA_MA_Boston-Logan.Intl.AP.725090_TMY/USA_MA_Boston-Logan.Intl.AP.725090_TMY.zip")
epwmap = LBEPWmap(epw_map=Button())  # -> report; plug-in component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
# EPW
downloadepw = LBDownloadWeather(weather_URL=panel_3)  # -> epw_file, stat_file, ddy_file; plug-in component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

outputparams = IB_OutputParams(ElectricLoadCenterProducedElectricityRate=Toggle(True), outputFrequency=1)
objparams = IB_ObjParams(
    ElectricalBussType="DirectCurrentWithInverter",
    GeneratorOperationSchemeType="Baseload",
    DataFieldSetType="Ironbug.HVAC.IB_ElectricLoadCenterDistribution_FieldSet")

# ----
# Setup PVs
toggle = BooleanToggle(True)
objparams_2 = IB_ObjParams(Name="Example SDM PV Model Inputs", DataFieldSetType="Ironbug.HVAC.IB_GeneratorPhotovoltaic_FieldSet")
objparams_3 = IB_ObjParams(Name="BP Solar BP275", DataFieldSetType="Ironbug.HVAC.IB_GeneratorPhotovoltaic_FieldSet")
objparams_4 = IB_ObjParams(Name="12percentEffPVhalfArea", DataFieldSetType="Ironbug.HVAC.IB_GeneratorPhotovoltaic_FieldSet")
pvperfsimple = IB_PhotovoltaicPerformanceSimple(dupNum=False)
outputparams_2 = IB_OutputParams(GeneratorProducedDCElectricityRate=toggle, GeneratorPVCellTemperature=toggle, outputFrequency=1)
pvperfsdm = IB_PhotovoltaicPerformanceEquivalentOneDiode(dupNum=False)
pvperfsandia = IB_PhotovoltaicPerformanceSandia(dupNum=False)
objparams_5 = IB_ObjParams(
    InverterEfficiency="1",
    RadiativeFraction="0",
    DataFieldSetType="Ironbug.HVAC.IB_ElectricLoadCenterInverterSimple_FieldSet")
photovoltaic = IB_GeneratorPhotovoltaic(ShadeSurface=item.Item, _performance_=pvperfsimple, Parameters_=[outputparams_2, objparams_4], dupNum=False)
photovoltaic_2 = IB_GeneratorPhotovoltaic(ShadeSurface=item.Item1, _performance_=pvperfsdm, Parameters_=[outputparams_2, objparams_2], dupNum=False)
photovoltaic_3 = IB_GeneratorPhotovoltaic(ShadeSurface=item.Item2, _performance_=pvperfsandia, Parameters_=[objparams_3, outputparams_2], dupNum=False)
invertersimple = IB_ElectricLoadCenterInverterSimple(Parameters_=objparams_5, dupNum=False)
elc_distribution_subpanel = IB_ElectricLoadCenterDistribution(
    Generators=flatten([photovoltaic, photovoltaic_2, photovoltaic_3]),
    Inverter=invertersimple,
    Parameters_=[outputparams, objparams],
    dupNum=False)
elc_mainpanel = IB_ElectricLoadCenter(_subPanels=flatten(elc_distribution_subpanel))

# ----
# Output Parameters
merge = Merge(Data1=outputparams, Data2=outputparams_2)
python = GhPythonScript(x=merge)  # -> flatten(a)
# ---------- python: Python ----------
a = x.splitlines()
# ---------- end python ----------
panel_4 = Panel(python)
customoutput = HBCustomSimulationOutput(output_names=python)  # -> report, sim_output; plug-in component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
simpar = HBSimulationParameter(output=customoutput.sim_output, timestep=6)  # -> sim_par; plug-in component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

# ----
# Generate OSM
toggle_2 = BooleanToggle(False)
modeltoosm = HBModelToOSM(model=model.model, epw_file=downloadepw.epw_file, sim_par=simpar, write=toggle_2)  # -> report, jsons, osw, osm, idf, sql, zsz, rdd, html; plug-in component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

# ----
# Add ELC
toggle_3 = BooleanToggle(False)
savetofile = IB_SaveToFile(NewFilePath=modeltoosm.osm, ElectricLoadCenter=elc_mainpanel, _write=toggle_3, OverrideMode=False, writeMode=0)

# ----
# Run OSM
toggle_4 = BooleanToggle(False)
runosm = HBRunOSM(osm=savetofile, epw_file=downloadepw.epw_file, translate=toggle_4, run=toggle_4)  # -> report, idf, sql, zsz, rdd, html; plug-in component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

# ----
# Viz Results
customresult = HBReadCustomResult(sql=runosm.sql, output_names=panel_4)  # -> results; plug-in component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
hourlyplot = LBHourlyPlot(data=flatten(customresult))  # -> report, mesh, legend, borders, labels, title, vis_set; plug-in component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

panel_5 = Panel(modeltoosm.osm)
panel_6 = Panel(runosm.html)
