# Grasshopper definition WindTurbine_MicroTurbine_Transformer.gh (Grasshopper 1.0.7)
# plug-ins: Ironbug.Grasshopper

# ---- group: PV Surface
brep = Brep(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)

# ----
# Geometry
brep_2 = Brep(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)
roomsolid = HBRoomFromSolid(geo=flatten(brep_2), conditioned=True)  # -> report, rooms; plug-in component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
shade = HBShade(geo=brep)  # -> report, shades; plug-in component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
panel = Panel("""0
0
0.4
0""")
aperturesbyratio = HBAperturesByRatio(hb_objs=flatten(roomsolid.rooms), ratio=panel)  # -> report, hb_objs; plug-in component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
model = HBModel(rooms=flatten(aperturesbyratio.hb_objs), shades=flatten(shade.shades))  # -> report, model; plug-in component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
vizwiref = HBVisualizeWireframe(hb_objs=flatten(model.model))  # -> geo; plug-in component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

outputparams = IB_OutputParams(ElectricLoadCenterProducedElectricityRate=Toggle(True), outputFrequency=1)
objparams = IB_ObjParams(
    ElectricalBussType="AlternatingCurrent",
    GeneratorOperationSchemeType="Baseload",
    DataFieldSetType="Ironbug.HVAC.IB_ElectricLoadCenterDistribution_FieldSet")

panel_2 = Panel("https://energyplus-weather.s3.amazonaws.com/north_and_central_america_wmo_region_4/USA/MA/USA_MA_Boston-Logan.Intl.AP.725090_TMY/USA_MA_Boston-Logan.Intl.AP.725090_TMY.zip")
epwmap = LBEPWmap(epw_map=Button())  # -> report; plug-in component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
# EPW
downloadepw = LBDownloadWeather(weather_URL=panel_2)  # -> epw_file, stat_file, ddy_file; plug-in component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

outputparams_2 = IB_OutputParams(ElectricLoadCenterProducedElectricityRate=Toggle(True), outputFrequency=1)
objparams_2 = IB_ObjParams(
    ElectricalBussType="DirectCurrentWithInverter",
    GeneratorOperationSchemeType="Baseload",
    DataFieldSetType="Ironbug.HVAC.IB_ElectricLoadCenterDistribution_FieldSet")

# ----
# Transformer: Power out to Grid
objparams_3 = IB_ObjParams(
    PerformanceInputMethod="RatedLosses",
    RatedLoadLoss="2000",
    RatedNoLoadLoss="300",
    TransformerUsage="PowerOutToGrid",
    DataFieldSetType="Ironbug.HVAC.IB_ElectricLoadCenterTransformer_FieldSet")
transformer = IB_ElectricLoadCenterTransformer(Parameters_=objparams_3, dupNum=False)

# ----
# Setup PV/WindTurbine
panel_3 = Panel("HorizontalAxisWindTurbine")
toggle = BooleanToggle(True)
outputparams_3 = IB_OutputParams(GeneratorProducedDCElectricityRate=toggle, GeneratorPVCellTemperature=toggle, outputFrequency=1)
pvperfsimple = IB_PhotovoltaicPerformanceSimple(dupNum=False)
objparams_4 = IB_ObjParams(
    Name="WT1",
    PowerControl="FixedSpeedVariablePitch",
    RotorType=panel_3,
    DataFieldSetType="Ironbug.HVAC.IB_GeneratorWindTurbine_FieldSet")
objparams_5 = IB_ObjParams(
    InverterEfficiency="1",
    RadiativeFraction="0",
    DataFieldSetType="Ironbug.HVAC.IB_ElectricLoadCenterInverterSimple_FieldSet")
objparams_6 = IB_ObjParams(Name="12percentEffPVhalfArea", DataFieldSetType="Ironbug.HVAC.IB_GeneratorPhotovoltaic_FieldSet")
photovoltaic = IB_GeneratorPhotovoltaic(ShadeSurface=shade.shades, _performance_=pvperfsimple, Parameters_=[outputparams_3, objparams_6], dupNum=False)
invertersimple = IB_ElectricLoadCenterInverterSimple(Parameters_=objparams_5, dupNum=False)

outputparams_4 = IB_OutputParams(GeneratorProducedACElectricityRate=toggle, outputFrequency=1)

# ----
# Backup Generators
panel_4 = Panel("Capstone C65")
objparams_7 = IB_ObjParams(FuelType="NaturalGas", Name=panel_4, DataFieldSetType="Ironbug.HVAC.IB_GeneratorMicroTurbine_FieldSet")
microturbine = IB_GeneratorMicroTurbine(Parameters_=objparams_7, dupNum=False)
elc_distribution_subpanel = IB_ElectricLoadCenterDistribution(Generators=flatten(microturbine), Inverter=invertersimple, Parameters_=[objparams, outputparams], dupNum=False)

# ----
# Output Parameters
merge = Merge(Data1=outputparams_2, Data2=outputparams_3, Data3=outputparams_4)
python = GhPythonScript(x=merge)  # -> flatten(a)
# ---------- python: Python ----------
a = x.splitlines()
# ---------- end python ----------
panel_5 = Panel(python)
customoutput = HBCustomSimulationOutput(output_names=python)  # -> report, sim_output; plug-in component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
simpar = HBSimulationParameter(output=customoutput.sim_output, timestep=6)  # -> sim_par; plug-in component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

windturbine = IB_GeneratorWindTurbine(Parameters_=[objparams_4, outputparams_4], dupNum=False)
merge_2 = Merge(Data1=photovoltaic, Data2=windturbine)  # -> flatten(Result)

elc_distribution_subpanel_2 = IB_ElectricLoadCenterDistribution(Generators=flatten(merge_2), Inverter=invertersimple, Parameters_=[outputparams_2, objparams_2], dupNum=False)

merge_3 = Merge(Data1=elc_distribution_subpanel_2, Data2=elc_distribution_subpanel)
elc_mainpanel = IB_ElectricLoadCenter(_subPanels=flatten(merge_3), PowerOutTransformer=transformer)

# ----
# Generate OSM
toggle_2 = BooleanToggle(False)
modeltoosm = HBModelToOSM(model=model.model, epw_file=downloadepw.epw_file, sim_par=simpar, write=toggle_2)  # -> report, jsons, osw, osm, idf, sql, zsz, rdd, html; plug-in component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

# ----
# Add ELC
toggle_3 = BooleanToggle(False)
savetofile = IB_SaveToFile(NewFilePath=modeltoosm.osm, ElectricLoadCenter=elc_mainpanel, _write=toggle_3, OverrideMode=False, writeMode=0)

# ----
# Run OSM
toggle_4 = BooleanToggle(False)
runosm = HBRunOSM(osm=savetofile, epw_file=downloadepw.epw_file, translate=toggle_4, run=toggle_4)  # -> report, idf, sql, zsz, rdd, html; plug-in component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

# ----
# Viz Results
customresult = HBReadCustomResult(sql=runosm.sql, output_names=panel_5)  # -> results; plug-in component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
hourlyplot = LBHourlyPlot(data=flatten(customresult))  # -> report, mesh, legend, borders, labels, title, vis_set; plug-in component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

panel_6 = Panel(modeltoosm.osm)
panel_7 = Panel(runosm.html)
