# Grasshopper definition Sys00_IdealAirLoad.gh (Grasshopper 1.0.7)

# ---- group: Sys00_Ideal Air Load
# Double click the component for more details
sys00 = Sys00()

# ==== cluster Sys00
hbzones = ClusterInput()

data = Data(flatten(hbzones))
lng = ListLength(List=data)
idealairload = Ironbug_ZoneHVACIdealLoadsAirSystem(dupNum=False)
panel = Panel(lng)
duplicate = Ironbug_Duplicate(Reference=idealairload, Amount=panel)  # -> Objects, port
thermalzone = IB_ThermalZone(_HBRooms=data, ZoneEquipments_=duplicate.Objects, IsAirTerminalPriorToZoneEquipments=True, dupNum=False)
noairloop = Ironbug_NoAirLoop(OSZones=thermalzone)

# ----
# HBRooms
hvacsystem = Ironbug_HVACSystem(AirLoops=flatten(noairloop))

hvacsystem_2 = ClusterOutput(hvacsystem)
