# Grasshopper definition Sys01_PTAC.gh (Grasshopper 0.9.76)

# ---- group: Sys01_PTAC
# Double click the component for more details
sys01 = Sys01()

# ==== cluster Sys01
hbzones = ClusterInput()

# ----
# HBZones
data = Data(flatten(hbzones))

# ----
# PTAC
panel = Panel("500")
lng = ListLength(List=data)
coilhtnwater = Ironbug_CoilHeatingWater()  # -> AirSide_CoilHeatingWater, WaterSide_CoilHeatingWater
objparams = Ironbug_ObjParams(PressureRise=panel, DataFieldSetType="Ironbug.HVAC.IB_FanConstantVolume_FieldSet")
panel_2 = Panel(lng)
duplicate = Ironbug_Duplicate(Reference=coilhtnwater.AirSide_CoilHeatingWater, Amount=panel_2)  # -> Objects, graft(WaterSide_CoilHeatingWater)
fanconstant = Ironbug_FanConstantVolume(Parameters_=objparams)
ptac = Ironbug_ZoneHVACPackagedTerminalAirConditioner(HeatingCoil=duplicate.Objects, Fan_=fanconstant)
thermalzone = Ironbug_ThermalZone(HoneybeeZonesOrOsZones=data, ZoneEquipment=ptac, IsAirTerminalPriorToZoneEquipments=True)
noairloop = Ironbug_NoAirLoop(OSZones=thermalzone)

# ----
# Hot water loop
boiler = Ironbug_BoilerHotWater()
pumpvariable = Ironbug_PumpVariableSpeed()
plantbranches = PlantBranches(Branch1=boiler)
plantbranches_2 = PlantBranches(Branch1=duplicate.WaterSide_CoilHeatingWater)
spm_scheduled = Ironbug_SetpointManagerScheduled(Temperature="67")
hotwaterloop = Ironbug_HotWaterPlantLoop(Supply=[pumpvariable, plantbranches, spm_scheduled], Demand=plantbranches_2)

hvacsystem = Ironbug_HVACSystem(AirLoops=flatten(noairloop), PlantLoops=flatten(hotwaterloop))

hvacsystem_2 = ClusterOutput(hvacsystem)
