# Grasshopper definition Sys02_PTHP.gh (Grasshopper 0.9.76)

# ---- group: Sys02_PTHP
# Double click the component for more details
sys02 = Sys02()

# ==== cluster Sys02
hbzones = ClusterInput()

# ----
# HBZones
data = Data(flatten(hbzones))

# ----
# PTHP
panel = Panel("300")
objparams = Ironbug_ObjParams(PressureRise=panel, DataFieldSetType="Ironbug.HVAC.IB_FanConstantVolume_FieldSet")
lng = ListLength(List=data)
panel_2 = Panel(lng)
fanconstant = Ironbug_FanConstantVolume(Parameters_=objparams)

pt_heatpump = Ironbug_ZoneHVACPackagedTerminalHeatPump(Fan_=fanconstant)

duplicate = Ironbug_Duplicate(Reference=pt_heatpump, Amount=panel_2)  # -> Objects, port
thermalzone = Ironbug_ThermalZone(HoneybeeZonesOrOsZones=data, ZoneEquipment=duplicate.Objects, IsAirTerminalPriorToZoneEquipments=True)
noairloop = Ironbug_NoAirLoop(OSZones=thermalzone)

hvacsystem = Ironbug_HVACSystem(AirLoops=flatten(noairloop))

hvacsystem_2 = ClusterOutput(hvacsystem)
