# Grasshopper definition Sys03_SZAC.gh (Grasshopper 0.9.76)

# ---- group: Sys03_SZAC
# Double click the component for more details
sys03 = Sys03()

# ==== cluster Sys03
hbzones = ClusterInput()

# ----
# HBZones
data = Data(flatten(hbzones))

coilhtngas = Ironbug_CoilHeatingGas()
coilclndx1 = Ironbug_CoilCoolingDXSingleSpeed()

# ----
# Sys03_SZAC
# Airloop
panel = Panel("DifferentialDryBulb")
lng = ListLength(List=data)
diffuser = Ironbug_AirTerminalSingleDuctUncontrolled()
objparams = Ironbug_ObjParams(EconomizerControlType=panel, DataFieldSetType="Ironbug.HVAC.IB_ControllerOutdoorAir_FieldSet")
duplicate = Ironbug_Duplicate(Reference=diffuser, Amount=lng)  # -> Objects, graft(port)
objparams_2 = Ironbug_ObjParams(PressureRise="500", DataFieldSetType="Ironbug.HVAC.IB_FanConstantVolume_FieldSet")
thermalzone = Ironbug_ThermalZone(HoneybeeZonesOrOsZones=data, AirTerminal_=duplicate.Objects, IsAirTerminalPriorToZoneEquipments=True)
fanconstant = Ironbug_FanConstantVolume(Parameters=objparams_2)
graft = GraftTree(Tree=thermalzone, IncludeEmptyLists=True, IncludeNullItems=True)
lng_2 = ListLength(List=thermalzone)
objparams_3 = Ironbug_ObjParams(
    AllOutdoorAirinCooling=Toggle(False),
    AllOutdoorAirinHeating=Toggle(False),
    CentralHeatingDesignSupplyAirTemperature="40",
    MinimumSystemAirFlowRatio="1",
    DataFieldSetType="Ironbug.HVAC.IB_SizingSystem_FieldSet")
duplicate_2 = Ironbug_Duplicate(Reference=coilclndx1, Amount=lng_2)  # -> graft(Objects), port
duplicate_3 = Ironbug_Duplicate(Reference=coilhtngas, Amount=lng_2)  # -> graft(Objects), port
duplicate_4 = Ironbug_Duplicate(Reference=fanconstant, Amount=lng_2)  # -> graft(Objects), port
spm_szreheat = Ironbug_SetpointManagerSingleZoneReheat(ControlZone=graft, MinTemperature="-20", MaxTemperature="100")
airloopbranches = AirLoopBranches(Branch1=graft)
sizingsystem = Ironbug_SizingSystem(Parameters_=objparams_3)

oacontroller = Ironbug_OAController(Parameters_=objparams)

oasystem = Ironbug_OutdoorAirSystem(Controller_=oacontroller)
duplicate_5 = Ironbug_Duplicate(Reference=oasystem, Amount=lng_2)  # -> graft(Objects), port
merge = Merge(Data1=duplicate_5.Objects, Data2=duplicate_2.Objects, Data3=duplicate_3.Objects, Data4=duplicate_4.Objects)  # -> simplify(Result)
merge_2 = Merge(Data1=simplify(merge), Data2=simplify(spm_szreheat))
airloop = Ironbug_AirLoopHVAC(Supply=merge_2, Demand=airloopbranches, SizingSystem=sizingsystem)
hvacsystem = Ironbug_HVACSystem(AirLoops=flatten(airloop))

hvacsystem_2 = ClusterOutput(hvacsystem)
