# Grasshopper definition Sys04_SZHP.gh (Grasshopper 0.9.76)

# ---- group: Sys04_SZHP
# Double click the component for more details
sys04 = Sys04()

# ==== cluster Sys04
hbzones = ClusterInput()

# ----
# HBZones
data = Data(flatten(hbzones))

coilclndx1 = Ironbug_CoilCoolingDXSingleSpeed()
coilhtn_dx1 = Ironbug_CoilHeatingDXSingleSpeed()
coilhtnelec = Ironbug_CoilHeatingElectric()

# ----
# Sys04_SZHP
# Airloop
panel = Panel("DifferentialDryBulb")
lng = ListLength(List=data)
diffuser = Ironbug_AirTerminalSingleDuctUncontrolled()
objparams = Ironbug_ObjParams(EconomizerControlType=panel, DataFieldSetType="Ironbug.HVAC.IB_ControllerOutdoorAir_FieldSet")
duplicate = Ironbug_Duplicate(Reference=diffuser, Amount=lng)  # -> Objects, port
objparams_2 = Ironbug_ObjParams(PressureRise="500", DataFieldSetType="Ironbug.HVAC.IB_FanConstantVolume_FieldSet")
thermalzone = Ironbug_ThermalZone(HoneybeeZonesOrOsZones=data, AirTerminal_=duplicate.Objects, IsAirTerminalPriorToZoneEquipments=True)
fanconstant = Ironbug_FanConstantVolume(Parameters=objparams_2)
graft = GraftTree(Tree=thermalzone, IncludeEmptyLists=True, IncludeNullItems=True)
lng_2 = ListLength(List=thermalzone)
objparams_3 = Ironbug_ObjParams(
    AllOutdoorAirinCooling=Toggle(False),
    AllOutdoorAirinHeating=Toggle(False),
    CentralHeatingDesignSupplyAirTemperature="40",
    MinimumSystemAirFlowRatio="1",
    DataFieldSetType="Ironbug.HVAC.IB_SizingSystem_FieldSet")
spm_szreheat = Ironbug_SetpointManagerSingleZoneReheat(ControlZone=graft, MinTemperature="-20", MaxTemperature="100")
airloopbranches = AirLoopBranches(Branch1=graft)
sizingsystem = Ironbug_SizingSystem(Parameters_=objparams_3)

oacontroller = Ironbug_OAController(Parameters_=objparams)

oasystem = Ironbug_OutdoorAirSystem(Controller_=oacontroller)
merge = Merge(Data1=oasystem, Data2=coilclndx1, Data3=coilhtn_dx1, Data4=coilhtnelec, Data5=fanconstant)

duplicate_2 = Ironbug_Duplicate(Reference=graft(merge), Amount=lng_2)  # -> Objects, port
flip = FlipMatrix(Data=duplicate_2.Objects)

merge_2 = Merge(Data1=simplify(flip), Data2=simplify(spm_szreheat))
airloop = Ironbug_AirLoopHVAC(Supply=merge_2, Demand=airloopbranches, SizingSystem=sizingsystem)
hvacsystem = Ironbug_HVACSystem(AirLoops=flatten(airloop))

hvacsystem_2 = ClusterOutput(hvacsystem)
