# Grasshopper definition Sys06_PackagedVAV PFP Boxes.gh (Grasshopper 0.9.76)

# ---- group: Sys06_PackagedVAV PFP Boxes
# Double click the component for more details
sys06 = Sys06()

# ==== cluster Sys06
hbzones = ClusterInput()
# HBZones
data = Data(flatten(hbzones))
objparams = Ironbug_ObjParams(PressureRise="300", DataFieldSetType="Ironbug.HVAC.IB_FanConstantVolume_FieldSet")
fanconstant = Ironbug_FanConstantVolume(Parameters_=objparams)
objparams_2 = Ironbug_ObjParams(EconomizerControlType="DifferentialDryBulb", DataFieldSetType="Ironbug.HVAC.IB_ControllerOutdoorAir_FieldSet")
lng = ListLength(List=data)
parallelpiureheat = Ironbug_AirTerminalSingleDuctParallelPIUReheat(Fan_=fanconstant)
objparams_3 = Ironbug_ObjParams(PressureRise="500", DataFieldSetType="Ironbug.HVAC.IB_FanVariableVolume_FieldSet")
duplicate = Ironbug_Duplicate(Reference=parallelpiureheat, Amount=lng)  # -> Objects, port
oacontroller = Ironbug_OAController(Parameters_=objparams_2)
objparams_4 = Ironbug_ObjParams(
    AllOutdoorAirinCooling=Toggle(False),
    AllOutdoorAirinHeating=Toggle(False),
    CentralHeatingDesignSupplyAirTemperature="16.7",
    DataFieldSetType="Ironbug.HVAC.IB_SizingSystem_FieldSet")
oasystem = Ironbug_OutdoorAirSystem(Controller_=oacontroller)
thermalzone = Ironbug_ThermalZone(HoneybeeZonesOrOsZones=data, AirTerminal_=duplicate.Objects, IsAirTerminalPriorToZoneEquipments=True)
coilhtnelec = Ironbug_CoilHeatingElectric()
coilclndx2 = Ironbug_CoilCoolingDXTwoSpeed()
fanvariable = Ironbug_FanVariableVolume(Parameters=objparams_3)
spm_scheduled = Ironbug_SetpointManagerScheduled(Temperature="12.8")
# Sys06_PackagedVAV_PFP
# Airloop
merge = Merge(Data1=oasystem, Data2=coilclndx2, Data3=coilhtnelec, Data4=fanvariable, Data5=spm_scheduled)
airloopbranches = AirLoopBranches(Branch1=thermalzone)
sizingsystem = Ironbug_SizingSystem(Parameters_=objparams_4)
airloop = Ironbug_AirLoopHVAC(Supply=merge, Demand=airloopbranches, SizingSystem=sizingsystem)
hvacsystem = Ironbug_HVACSystem(AirLoops=flatten(airloop))
hvacsystem_2 = ClusterOutput(hvacsystem)
