# Grasshopper definition Sys07_VAV Reheat.gh (Grasshopper 0.9.76)

# ---- group: Sys07_VAV Reheat
# Double click the component for more details
sys07 = Sys07()

# ==== cluster Sys07
hbzones = ClusterInput()

# ----
# HBZones
brep = Brep(flatten(hbzones))
boiler = Ironbug_BoilerHotWater()

# ----
# Sys07_VAV_Reheat
# Airloop
panel = Panel("DifferentialDryBulb")
lng = ListLength(List=brep)
coilhtnwater = Ironbug_CoilHeatingWater()  # -> AirSide_CoilHeatingWater, WaterSide_CoilHeatingWater
objparams = Ironbug_ObjParams(EconomizerControlType=panel, DataFieldSetType="Ironbug.HVAC.IB_ControllerOutdoorAir_FieldSet")
duplicate = Ironbug_Duplicate(Reference=coilhtnwater.AirSide_CoilHeatingWater, Amount=lng)  # -> Objects, WaterSide_CoilHeatingWater
objparams_2 = Ironbug_ObjParams(PressureRise="500", DataFieldSetType="Ironbug.HVAC.IB_FanVariableVolume_FieldSet")
oacontroller = Ironbug_OAController(Parameters_=objparams)
objparams_3 = Ironbug_ObjParams(
    AllOutdoorAirinCooling=Toggle(False),
    AllOutdoorAirinHeating=Toggle(False),
    CentralHeatingDesignSupplyAirTemperature="12.8",
    DataFieldSetType="Ironbug.HVAC.IB_SizingSystem_FieldSet")
vavreheat = Ironbug_AirTerminalSingleDuctVAVReheat(HeatingCoil=duplicate.Objects)
coilclnwater = Ironbug_CoilCoolingWater()  # -> AirSide_CoilCoolingWater, WaterSide_CoilCoolingWater
coilhtnwater_2 = Ironbug_CoilHeatingWater()  # -> AirSide_CoilHeatingWater, WaterSide_CoilHeatingWater
oasystem = Ironbug_OutdoorAirSystem(Controller_=oacontroller)
thermalzone = Ironbug_ThermalZone(HoneybeeZonesOrOsZones=brep, AirTerminal_=vavreheat, IsAirTerminalPriorToZoneEquipments=True)
fanvariable = Ironbug_FanVariableVolume(Parameters=objparams_2)
spm_scheduled = Ironbug_SetpointManagerScheduled(Temperature="12.8")
branches = AirLoopBranches(Branch1=thermalzone)
sizingsystem = Ironbug_SizingSystem(Parameters_=objparams_3)
merge = Merge(
    Data1=oasystem,
    Data2=coilclnwater.AirSide_CoilCoolingWater,
    Data3=coilhtnwater_2.AirSide_CoilHeatingWater,
    Data4=fanvariable,
    Data5=spm_scheduled)
airloop = Ironbug_AirLoopHVAC(Supply=merge, Demand=branches, SizingSystem=sizingsystem)

# ----
# Chilled water loop
chiller_watercooled = Ironbug_ChillerElectricEIR_WaterCooled()  # -> ChillerElectricEIR, ChillerElectricEIR_CondenserLoop
pumpvariable = Ironbug_PumpVariableSpeed()
branches_2 = PlantBranches(Branch1=chiller_watercooled.ChillerElectricEIR)
spm_scheduled_2 = Ironbug_SetpointManagerScheduled(Temperature="6.7")
branches_3 = PlantBranches(Branch1=coilclnwater.WaterSide_CoilCoolingWater)
cwloop = Ironbug_ChilledWaterPlantLoop(Supply=[pumpvariable, branches_2, spm_scheduled_2], Demand=branches_3)

# ----
# Condenser water loop
coolingtower1 = Ironbug_CoolingTowerSingleSpeed()
pipeadiabatic = Ironbug_PipeAdiabatic()
spm_followoatemp = Ironbug_SetpointManagerFollowOutdoorAirTemperature(MaximumSetpointTemperature="80", MinimumSetpointTemperature="6", OffsetTemperatureDifference="1.5")
pumpvariable_2 = Ironbug_PumpVariableSpeed()
plantbranches = PlantBranches(Branch1=chiller_watercooled.ChillerElectricEIR_CondenserLoop)
branches_4 = PlantBranches(B1=coolingtower1, B2=pipeadiabatic)
dwloop = Ironbug_CondenserWaterPlantLoop(Supply=[pumpvariable_2, branches_4, spm_followoatemp], Demand=plantbranches)

graft = GraftTree(Tree=duplicate.WaterSide_CoilHeatingWater, IncludeEmptyLists=True, IncludeNullItems=True)

# ----
# Hot water loop
panel_2 = Panel("67")
pumpvariable_3 = Ironbug_PumpVariableSpeed()
plantbranches_2 = PlantBranches(Branch1=boiler)
spm_scheduled_3 = Ironbug_SetpointManagerScheduled(Temperature=panel_2)
branches_5 = PlantBranches(B1=graft, B2=coilhtnwater_2.WaterSide_CoilHeatingWater)
hwloop = Ironbug_HotWaterPlantLoop(Supply=[pumpvariable_3, plantbranches_2, spm_scheduled_3], Demand=branches_5)

merge_2 = Merge(Data1=hwloop, Data2=cwloop, Data3=dwloop)
hvacsystem = Ironbug_HVACSystem(AirLoops=flatten(airloop), PlantLoops=flatten(merge_2))

hvacsystem_2 = ClusterOutput(hvacsystem)
