# Grasshopper definition Sys08_VAV PFP Boxes.gh (Grasshopper 0.9.76)

# ---- group: Sys08_VAV PFP Boxes
# Double click the component for more details
sys08 = Sys08()

# ==== cluster Sys08
hbzones = ClusterInput()

# ----
# Sys08_VAV_PFP
# HBZones
brep = Brep(flatten(hbzones))

# ----
# Airloop
panel = Panel("300")
objparams = Ironbug_ObjParams(PressureRise=panel, DataFieldSetType="Ironbug.HVAC.IB_FanConstantVolume_FieldSet")
fanconstant = Ironbug_FanConstantVolume(Parameters_=objparams)
lng = ListLength(List=brep)
objparams_2 = Ironbug_ObjParams(EconomizerControlType="DifferentialDryBulb", DataFieldSetType="Ironbug.HVAC.IB_ControllerOutdoorAir_FieldSet")
duplicate = Ironbug_Duplicate(Reference=fanconstant, Amount=lng)  # -> Objects, port
objparams_3 = Ironbug_ObjParams(PressureRise="500", DataFieldSetType="Ironbug.HVAC.IB_FanVariableVolume_FieldSet")
oacontroller = Ironbug_OAController(Parameters_=objparams_2)
objparams_4 = Ironbug_ObjParams(
    AllOutdoorAirinCooling=Toggle(False),
    AllOutdoorAirinHeating=Toggle(False),
    CentralHeatingDesignSupplyAirTemperature="12.8",
    DataFieldSetType="Ironbug.HVAC.IB_SizingSystem_FieldSet")
parallelpiureheat = Ironbug_AirTerminalSingleDuctParallelPIUReheat(Fan_=duplicate.Objects)
coilclnwater = Ironbug_CoilCoolingWater()  # -> AirSide_CoilCoolingWater, WaterSide_CoilCoolingWater
oasystem = Ironbug_OutdoorAirSystem(Controller_=oacontroller)
thermalzone = Ironbug_ThermalZone(HoneybeeZonesOrOsZones=brep, ZoneEquipment=parallelpiureheat, IsAirTerminalPriorToZoneEquipments=True)
coilhtnelec = Ironbug_CoilHeatingElectric()
fanvariable = Ironbug_FanVariableVolume(Parameters=objparams_3)
spm_scheduled = Ironbug_SetpointManagerScheduled(Temperature="12.8")
branches = AirLoopBranches(Branch1=thermalzone)
sizingsystem = Ironbug_SizingSystem(Parameters_=objparams_4)
merge = Merge(Data1=oasystem, Data2=coilclnwater.AirSide_CoilCoolingWater, Data3=coilhtnelec, Data4=fanvariable, Data5=spm_scheduled)
airloop = Ironbug_AirLoopHVAC(Supply=merge, Demand=branches, SizingSystem=sizingsystem)

# ----
# Chilled water loop
chiller_aircooled = Ironbug_ChillerElectricEIR_AirCooled()
pumpvariable = Ironbug_PumpVariableSpeed()
spm_scheduled_2 = Ironbug_SetpointManagerScheduled(Temperature="6.7")
plantbranches = PlantBranches(Branch1=chiller_aircooled)
plantbranches_2 = PlantBranches(Branch1=coilclnwater.WaterSide_CoilCoolingWater)
cwloop = Ironbug_ChilledWaterPlantLoop(Supply=[pumpvariable, plantbranches, spm_scheduled_2], Demand=plantbranches_2)

hvacsystem = Ironbug_HVACSystem(AirLoops=flatten(airloop), PlantLoops=flatten(cwloop))

hvacsystem_2 = ClusterOutput(hvacsystem)
