# Grasshopper definition Sys09_Furnace - Gas Fired.gh (Grasshopper 0.9.76)

# ---- group: Sys09_Furnace - Gas Fired
# Double click the component for more details
sys09 = Sys09()

# ==== cluster Sys09
hbzones = ClusterInput()

# ----
# Sys09_Warm Air Furnace - Gas Fired
# Airloop
# HBZones
brep = Brep(flatten(hbzones))
objparams = Ironbug_ObjParams(EconomizerControlType="DifferentialDryBulb", DataFieldSetType="Ironbug.HVAC.IB_ControllerOutdoorAir_FieldSet")
oacontroller = Ironbug_OAController(Parameters_=objparams)
objparams_2 = Ironbug_ObjParams(PressureRise="500", DataFieldSetType="Ironbug.HVAC.IB_FanConstantVolume_FieldSet")
objparams_3 = Ironbug_ObjParams(
    AllOutdoorAirinCooling=Toggle(True),
    AllOutdoorAirinHeating=Toggle(True),
    CentralHeatingDesignSupplyAirTemperature="40",
    MinimumSystemAirFlowRatio="1",
    DataFieldSetType="Ironbug.HVAC.IB_SizingSystem_FieldSet")
oasystem = Ironbug_OutdoorAirSystem(Controller_=oacontroller)
coilhtngas = Ironbug_CoilHeatingGas()
fanconstant = Ironbug_FanConstantVolume(Parameters_=objparams_2)
sizingsystem = Ironbug_SizingSystem(Parameters_=objparams_3)

thermalzone = Ironbug_ThermalZone(HoneybeeZonesOrOsZones=brep, IsAirTerminalPriorToZoneEquipments=True)

item = ListItem(List=thermalzone, Index=0, Wrap=True)
spm_szreheat = Ironbug_SetpointManagerSingleZoneReheat(ControlZone=flatten(item), MinTemperature=10, MaxTemperature=50)
airloopbranches = AirLoopBranches(Branch1=thermalzone)
merge = Merge(Data1=oasystem, Data2=coilhtngas, Data3=fanconstant, Data4=spm_szreheat)
airloop = Ironbug_AirLoopHVAC(Supply=merge, Demand=airloopbranches, SizingSystem=sizingsystem)
hvacsystem = Ironbug_HVACSystem(AirLoops=flatten(airloop))

hvacsystem_2 = ClusterOutput(hvacsystem)
