# Grasshopper definition Sys11_Fan Coil Units + DOAS.gh (Grasshopper 0.9.76)

# ---- group: Sys11_Fan Coil Units + DOAS
# Double click the component for more details
sys11 = Sys11()

# ==== cluster Sys11
hbzones = ClusterInput()

# ----
# HBZones
brep = Brep(flatten(hbzones))

# ----
# FourPipeFanCoil
panel = Panel("75")
coilclnwater = Ironbug_CoilCoolingWater()  # -> AirSide_CoilCoolingWater, WaterSide_CoilCoolingWater
coilhtnwater = Ironbug_CoilHeatingWater()  # -> AirSide_CoilHeatingWater, WaterSide_CoilHeatingWater
lng = ListLength(List=brep)
objparams = Ironbug_ObjParams(FanEfficiency="0.5", MotorEfficiency="0.9", PressureRise=panel, DataFieldSetType="Ironbug.HVAC.IB_FanOnOff_FieldSet")
panel_2 = Panel(lng)
objparams_2 = Ironbug_ObjParams(MaximumOutdoorAirFlowRate="0", DataFieldSetType="Ironbug.HVAC.IB_ZoneHVACFourPipeFanCoil_FieldSet")
duplicate = Ironbug_Duplicate(Reference=coilclnwater.AirSide_CoilCoolingWater, Amount=panel_2)  # -> Objects, graft(WaterSide_CoilCoolingWater)
duplicate_2 = Ironbug_Duplicate(Reference=coilhtnwater.AirSide_CoilHeatingWater, Amount=panel_2)  # -> Objects, graft(WaterSide_CoilHeatingWater)
fanonoff = Ironbug_FanOnOff(Parameters_=objparams)
_4pipefancoil = Ironbug_ZoneHVACFourPipeFanCoil(HeatingCoil=duplicate_2.Objects, CoolingCoil=duplicate.Objects, Fan_=fanonoff, Parameters_=objparams_2)

# ----
# Sys11_Fan Coil Units + DOAS
# Airloop
panel_3 = Panel("VentilationRequirement")
objparams_3 = Ironbug_ObjParams(FanEfficiency="0.6", PressureRise="500", DataFieldSetType="Ironbug.HVAC.IB_FanConstantVolume_FieldSet")
objparams_4 = Ironbug_ObjParams(
    AllOutdoorAirinCooling=Toggle(True),
    AllOutdoorAirinHeating=Toggle(True),
    CentralHeatingDesignSupplyAirTemperature="40",
    MinimumSystemAirFlowRatio="1",
    TypeofLoadtoSizeOn=panel_3,
    DataFieldSetType="Ironbug.HVAC.IB_SizingSystem_FieldSet")
heatexchanger_air = Ironbug_HeatExchangerAirToAirSensibleAndLatent()
coilclnwater_2 = Ironbug_CoilCoolingWater()  # -> AirSide_CoilCoolingWater, WaterSide_CoilCoolingWater
coilhtnwater_2 = Ironbug_CoilHeatingWater()  # -> AirSide_CoilHeatingWater, WaterSide_CoilHeatingWater
oasystem = Ironbug_OutdoorAirSystem(HeatRecovery_=heatexchanger_air)
thermalzone = Ironbug_ThermalZone(HoneybeeZonesOrOsZones=brep, ZoneEquipment=_4pipefancoil, IsAirTerminalPriorToZoneEquipments=True)
fanconstant = Ironbug_FanConstantVolume(Parameters_=objparams_3)
spm_scheduled = Ironbug_SetpointManagerScheduled(Temperature="20")
airloopbranches = AirLoopBranches(Branch1=thermalzone)
sizingsystem = Ironbug_SizingSystem(Parameters_=objparams_4)
merge = Merge(
    Data1=oasystem,
    Data2=coilclnwater_2.AirSide_CoilCoolingWater,
    Data3=coilhtnwater_2.AirSide_CoilHeatingWater,
    Data4=fanconstant,
    Data5=spm_scheduled)
airloop = Ironbug_AirLoopHVAC(Supply=merge, Demand=airloopbranches, SizingSystem=sizingsystem)

# ----
# Chilled water loop
panel_4 = Panel("0")
chiller_watercooled = Ironbug_ChillerElectricEIR_WaterCooled()  # -> ChillerElectricEIR, ChillerElectricEIR_CondenserLoop
objparams_5 = Ironbug_ObjParams(
    Coefficient1OfthePartLoadPerformanceCurve=panel_4,
    Coefficient2OfthePartLoadPerformanceCurve="0.0216",
    Coefficient3OfthePartLoadPerformanceCurve="-0.0325",
    Coefficient4OfthePartLoadPerformanceCurve="1.0095",
    RatedPumpHead="119563",
    DataFieldSetType="Ironbug.HVAC.IB_PumpVariableSpeed_FieldSet")
objparams_6 = Ironbug_ObjParams(
    DesignLoopExitTemperature="6.7",
    LoopDesignTemperatureDifference="6.7",
    DataFieldSetType="Ironbug.HVAC.IB_SizingPlant_FieldSet")
objparams_7 = Ironbug_ObjParams(MaximumLoopTemperature="98", DataFieldSetType="Ironbug.HVAC.IB_PlantLoop_FieldSet")
pumpvariable = Ironbug_PumpVariableSpeed(Parameters=objparams_5)
plantbranches = PlantBranches(Branch1=chiller_watercooled.ChillerElectricEIR)
spm_scheduled_2 = Ironbug_SetpointManagerScheduled(Temperature="6.7")
branches = PlantBranches(Branch1=coilclnwater_2.WaterSide_CoilCoolingWater, Branch=duplicate.WaterSide_CoilCoolingWater)
sizingplant = Ironbug_SizingPlant(Parameters_=objparams_6)
cwloop = Ironbug_ChilledWaterPlantLoop(Supply=[pumpvariable, plantbranches, spm_scheduled_2], Demand=branches, SizingLoop=sizingplant, Parameters_=objparams_7)

# ----
# Condenser water loop
panel_5 = Panel("0")
objparams_8 = Ironbug_ObjParams(
    Coefficient1OfthePartLoadPerformanceCurve=panel_5,
    Coefficient2OfthePartLoadPerformanceCurve="0.0216",
    Coefficient3OfthePartLoadPerformanceCurve="-0.0325",
    Coefficient4OfthePartLoadPerformanceCurve="1.0095",
    RatedPumpHead="134508",
    DataFieldSetType="Ironbug.HVAC.IB_PumpVariableSpeed_FieldSet")
coolingtowerv = Ironbug_CoolingTowerVariableSpeed()
pipeadiabatic = Ironbug_PipeAdiabatic()
objparams_9 = Ironbug_ObjParams(MaximumLoopTemperature="80", MinimumLoopTemperature="5", DataFieldSetType="Ironbug.HVAC.IB_PlantLoop_FieldSet")
spm_followoatemp = Ironbug_SetpointManagerFollowOutdoorAirTemperature(MaximumSetpointTemperature="80", MinimumSetpointTemperature="5", OffsetTemperatureDifference="0")
pumpvariable_2 = Ironbug_PumpVariableSpeed(Parameters=objparams_8)
branches_2 = PlantBranches(Branch1=coolingtowerv, Branch=pipeadiabatic)
branches_3 = PlantBranches(Branch1=chiller_watercooled.ChillerElectricEIR_CondenserLoop)
dwloop = Ironbug_CondenserWaterPlantLoop(Supply=[pumpvariable_2, branches_2, spm_followoatemp], Demand=branches_3, Parameters_=objparams_9)

# ----
# Hot water loop
panel_6 = Panel("0")
objparams_10 = Ironbug_ObjParams(
    Coefficient1OfthePartLoadPerformanceCurve=panel_6,
    Coefficient2OfthePartLoadPerformanceCurve="0.0216",
    Coefficient3OfthePartLoadPerformanceCurve="-0.0325",
    Coefficient4OfthePartLoadPerformanceCurve="1.0095",
    RatedPumpHead="119563",
    DataFieldSetType="Ironbug.HVAC.IB_PumpVariableSpeed_FieldSet")
objparams_11 = Ironbug_ObjParams(NominalThermalEfficiency="0.9", DataFieldSetType="Ironbug.HVAC.IB_BoilerHotWater_FieldSet")
boilerhw = Ironbug_BoilerHotWater(Parameters=objparams_11)
pumpvariable_3 = Ironbug_PumpVariableSpeed(Parameters=objparams_10)
branches_4 = PlantBranches(Branch1=boilerhw)
branches_5 = PlantBranches(B1=duplicate_2.WaterSide_CoilHeatingWater, B2=coilhtnwater_2.WaterSide_CoilHeatingWater)
spm_scheduled_3 = Ironbug_SetpointManagerScheduled(Temperature="67")
hwloop = Ironbug_HotWaterPlantLoop(Supply=[pumpvariable_3, branches_4, spm_scheduled_3], Demand=branches_5)

merge_2 = Merge(Data1=hwloop, Data2=cwloop, Data3=dwloop)
hvacsystem = Ironbug_HVACSystem(AirLoops=flatten(airloop), PlantLoops=flatten(merge_2))

hvacsystem_2 = ClusterOutput(hvacsystem)
