# Grasshopper definition Sys16_VRF + DOAS.gh (Grasshopper 0.9.76)

# ---- group: Sys16_VRF + DOAS
# Double click the component for more details
sys16 = Sys16()

# ==== cluster Sys16
hbzones = ClusterInput()

# ----
# HBZones
brep = Brep(flatten(hbzones))
objparams = Ironbug_ObjParams(PressureRise="500", DataFieldSetType="Ironbug.HVAC.IB_FanConstantVolume_FieldSet")

# ----
# VRF Terminals
vrfterminal = Ironbug_ZoneHVACTerminalUnitVariableRefrigerantFlow()  # -> VRFUnit_In, VRFUnit_Out
lng = ListLength(List=brep)
duplicate = Ironbug_Duplicate(Reference=vrfterminal.VRFUnit_In, Amount=lng)  # -> Objects, ZoneHVACTerminalUnitVariableRefrigerantFlow
thermalzone = Ironbug_ThermalZone(HoneybeeZonesOrOsZones=brep, ZoneEquipment=duplicate.Objects, IsAirTerminalPriorToZoneEquipments=True)

# ----
# DOAS
panel = Panel("VentilationRequirement")
objparams_2 = Ironbug_ObjParams(
    CentralHeatingDesignSupplyAirTemperature="40",
    MinimumSystemAirFlowRatio="1",
    TypeofLoadtoSizeOn=panel,
    DataFieldSetType="Ironbug.HVAC.IB_SizingSystem_FieldSet")
oasystem = Ironbug_OutdoorAirSystem()
coilclndx1 = Ironbug_CoilCoolingDXSingleSpeed()
coilhtngas = Ironbug_CoilHeatingGas()
fanconstant = Ironbug_FanConstantVolume(Parameters_=objparams)
airloopbranches = AirLoopBranches(Branch1=thermalzone)
spm_scheduled = Ironbug_SetpointManagerScheduled(Temperature="20")
objparams_3 = Ironbug_ObjParams(Name="DOAS", DataFieldSetType="Ironbug.HVAC.IB_AirLoopHVAC_FieldSet")
sizingsystem = Ironbug_SizingSystem(Parameters_=objparams_2)
merge = Merge(Data1=oasystem, Data2=coilclndx1, Data3=coilhtngas, Data4=fanconstant, Data5=spm_scheduled)
airloop = Ironbug_AirLoopHVAC(Supply=merge, Demand=airloopbranches, SizingSystem=sizingsystem, Parameters_=objparams_3)

vrfsystem = Ironbug_AirConditionerVariableRefrigerantFlow(_terminals=duplicate.ZoneHVACTerminalUnitVariableRefrigerantFlow)
hvacsystem = Ironbug_HVACSystem(AirLoops=flatten(airloop), VRFSystems=flatten(vrfsystem))

hvacsystem_2 = ClusterOutput(hvacsystem)
