# Grasshopper definition Chilled water loop.gh (Grasshopper 0.9.76)
# plug-ins: Ironbug.Grasshopper

# ----
# Chilled water loop
panel = Panel("0")
objparams = Ironbug_ObjParams(
    Coefficient1OfthePartLoadPerformanceCurve=panel,
    Coefficient2OfthePartLoadPerformanceCurve="0.0216",
    Coefficient3OfthePartLoadPerformanceCurve="-0.0325",
    Coefficient4OfthePartLoadPerformanceCurve="1.0095",
    DataFieldSetType="Ironbug.HVAC.IB_PumpVariableSpeed_FieldSet")
chiller_aircooled = Ironbug_ChillerElectricEIR_AirCooled()
pipeadiabatic = Ironbug_PipeAdiabatic()
pumpvariable = Ironbug_PumpVariableSpeed(Parameters=objparams)
plantbranches = PlantBranches(Branch1=chiller_aircooled, Branch=pipeadiabatic)
spm_scheduled = Ironbug_SetpointManagerScheduled(Temperature="6.7")
plantbranches_2 = PlantBranches()
cwloop = Ironbug_ChilledWaterPlantLoop(Supply=[pumpvariable, plantbranches, spm_scheduled], Demand=plantbranches_2)
