# Grasshopper definition Condenser water loop.gh (Grasshopper 0.9.76)
# plug-ins: Ironbug.Grasshopper

# ----
# Condenser water loop
panel = Panel("0")
objparams = Ironbug_ObjParams(
    Coefficient1OfthePartLoadPerformanceCurve=panel,
    Coefficient2OfthePartLoadPerformanceCurve="0.0216",
    Coefficient3OfthePartLoadPerformanceCurve="-0.0325",
    Coefficient4OfthePartLoadPerformanceCurve="1.0095",
    DataFieldSetType="Ironbug.HVAC.IB_PumpVariableSpeed_FieldSet")
coolingtowerv = Ironbug_CoolingTowerVariableSpeed()
pipeadiabatic = Ironbug_PipeAdiabatic()
spm_followoatemp = Ironbug_SetpointManagerFollowOutdoorAirTemperature(MaximumSetpointTemperature="80", MinimumSetpointTemperature="5", OffsetTemperatureDifference="0")
pumpvariable = Ironbug_PumpVariableSpeed(Parameters=objparams)
plantbranches = PlantBranches(Branch1=coolingtowerv, Branch=pipeadiabatic)
branches = PlantBranches()
dwloop = Ironbug_CondenserWaterPlantLoop(Supply=[pumpvariable, plantbranches, spm_followoatemp], Demand=branches)
