# Grasshopper definition DOAS.gh (Grasshopper 0.9.76)
# plug-ins: Ironbug.Grasshopper

# ----
# DOAS
thermalzone = Ironbug_ThermalZone(IsAirTerminalPriorToZoneEquipments=True)
oasystem = Ironbug_OutdoorAirSystem()
coilclndx1 = Ironbug_CoilCoolingDXSingleSpeed()
coilhtngas = Ironbug_CoilHeatingGas()
fanvariable = Ironbug_FanVariableVolume()
spm_scheduled = Ironbug_SetpointManagerScheduled(Temperature="21.11")
objparams = Ironbug_ObjParams(
    MinimumSystemAirFlowRatio="1",
    TypeofLoadtoSizeOn="VentilationRequirement",
    DataFieldSetType="Ironbug.HVAC.IB_SizingSystem_FieldSet")
airloopbranches = AirLoopBranches(Branch1=thermalzone)
objparams_2 = Ironbug_ObjParams(Name="DOAS", DataFieldSetType="Ironbug.HVAC.IB_AirLoopHVAC_FieldSet")
sizingsystem = Ironbug_SizingSystem(Parameters_=objparams)
merge = Merge(Data1=oasystem, Data2=coilclndx1, Data3=coilhtngas, Data4=fanvariable, Data5=spm_scheduled)
airloop = Ironbug_AirLoopHVAC(Supply=merge, Demand=airloopbranches, SizingSystem=sizingsystem, Parameters_=objparams_2)
