# Grasshopper definition GSHP_CentralHeatPumpPlantloops.gh (Grasshopper 0.9.76)
# plug-ins: Ironbug

# ----
# EIR
panel = Panel("40")
panel_2 = Panel("""0.92763489
-0.00667789
0.00022986
-0.00161427
0.000092
-0.0002995""")
objparams = Ironbug_ObjParams(
    MaximumValueofx="95",
    MaximumValueofy="46",
    MinimumValueofx="70",
    MinimumValueofy=panel,
    DataFieldSetType="Ironbug.HVAC.Curves.IB_CurveBiquadratic_FieldSet")
curvebiquadratic = Ironbug_CurveBiquadratic(Coefficients=panel_2, Parameters_=objparams)

# ----
# Capacity
panel_3 = Panel("40")
# Reference:
# https://github.com/NREL/EnergyPlus/blob/bee886ab567181a306a8c2e7c678d6a1063b0bb0/testfiles/CentralChillerHeaterSystem_Simultaneous_Cooling_Heating.idf
panel_4 = Panel("""0.43949801
0.00056385
-0.00001518
0.01713529
0.00011668
-0.00009652""")
objparams_2 = Ironbug_ObjParams(
    MaximumValueofx="95",
    MaximumValueofy="46",
    MinimumValueofx="70",
    MinimumValueofy=panel_3,
    DataFieldSetType="Ironbug.HVAC.Curves.IB_CurveBiquadratic_FieldSet")
curvebiquadratic_2 = Ironbug_CurveBiquadratic(Coefficients=panel_4, Parameters_=objparams_2)

objparams_3 = Ironbug_ObjParams(
    CoolingModeCoolingCapacityFunctionOfTemperatureCurve=curvebiquadratic_2,
    CoolingModeElectricInputToCoolingOutputRatioFunctionOfTemperatureCurve=curvebiquadratic,
    HeatingModeCoolingCapacityFunctionOfTemperatureCurve=curvebiquadratic_2,
    HeatingModeElectricInputToCoolingOutputRatioFunctionOfTemperatureCurve=curvebiquadratic,
    ReferenceCoolingModeCOP="5.5",
    ReferenceCoolingModeEvaporatorCapacity="12500",
    DataFieldSetType="Ironbug.HVAC.IB_ChillerHeaterPerformanceElectricEIR_FieldSet")

objparams_4 = Ironbug_ObjParams(NumberofChillerHeaterModules="3", DataFieldSetType="Ironbug.HVAC.IB_CentralHeatPumpSystemModule_FieldSet")
chillerheater = Ironbug_ChillerHeaterPerformanceElectricEIR(Parameters_=objparams_3)  # -> flatten(ChillerHeaters)
chillerheatermodule = Ironbug_CentralHeatPumpSystemModule(ChillerHeater=chillerheater, Parameters_=objparams_4)
centralheatpumpsystem = Ironbug_CentralHeatPumpSystem(ChillerHeaters=chillerheatermodule)  # -> ToDW_Demand, ToCW_Supply, ToHW_Supply

# ----
# Reference DataSet:
# https://github.com/NREL/EnergyPlus/blob/e94c9babac891617b828ec1a5f6f44b33dac491b/datasets/GLHERefData.idf
panel_5 = Panel("""-14.583933,               !- G-Function Ln(T/Ts) Value 1
    -1.972435,                !- G-Function G Value 1
    -14.459771,               !- G-Function Ln(T/Ts) Value 2
    -1.918855,                !- G-Function G Value 2
    -14.335609,               !- G-Function Ln(T/Ts) Value 3
    -1.859847,                !- G-Function G Value 3
    -14.211447,               !- G-Function Ln(T/Ts) Value 4
    -1.795084,                !- G-Function G Value 4
    -14.087285,               !- G-Function Ln(T/Ts) Value 5
    -1.724279,                !- G-Function G Value 5
    -13.963123,               !- G-Function Ln(T/Ts) Value 6
    -1.647199,                !- G-Function G Value 6
    -13.838961,               !- G-Function Ln(T/Ts) Value 7
    -1.563689,                !- G-Function G Value 7
    -13.714800,               !- G-Function Ln(T/Ts) Value 8
    -1.473689,                !- G-Function G Value 8
    -13.590638,               !- G-Function Ln(T/Ts) Value 9
    -1.377264,                !- G-Function G Value 9
    -13.466476,               !- G-Function Ln(T/Ts) Value 10
    -1.274618,                !- G-Function G Value 10
    -13.342314,               !- G-Function Ln(T/Ts) Value 11
    -1.166121,                !- G-Function G Value 11
    -13.218152,               !- G-Function Ln(T/Ts) Value 12
    -1.052323,                !- G-Function G Value 12
    -13.093990,               !- G-Function Ln(T/Ts) Value 13
    -0.933960,                !- G-Function G Value 13
    -12.969828,               !- G-Function Ln(T/Ts) Value 14
    -0.811952,                !- G-Function G Value 14
    -12.845666,               !- G-Function Ln(T/Ts) Value 15
    -0.687385,                !- G-Function G Value 15
    -12.721504,               !- G-Function Ln(T/Ts) Value 16
    -0.561478,                !- G-Function G Value 16
    -12.597342,               !- G-Function Ln(T/Ts) Value 17
    -0.435532,                !- G-Function G Value 17
    -12.473181,               !- G-Function Ln(T/Ts) Value 18
    -0.310858,                !- G-Function G Value 18
    -12.349019,               !- G-Function Ln(T/Ts) Value 19
    -0.188706,                !- G-Function G Value 19
    -12.224857,               !- G-Function Ln(T/Ts) Value 20
    -0.070175,                !- G-Function G Value 20
    -12.100695,               !- G-Function Ln(T/Ts) Value 21
    0.043861,                 !- G-Function G Value 21
    -11.976533,               !- G-Function Ln(T/Ts) Value 22
    0.152817,                 !- G-Function G Value 22
    -11.852371,               !- G-Function Ln(T/Ts) Value 23
    0.256421,                 !- G-Function G Value 23
    -11.728209,               !- G-Function Ln(T/Ts) Value 24
    0.354716,                 !- G-Function G Value 24
    -11.604047,               !- G-Function Ln(T/Ts) Value 25
    0.448017,                 !- G-Function G Value 25
    -11.479885,               !- G-Function Ln(T/Ts) Value 26
    0.536839,                 !- G-Function G Value 26
    -11.355724,               !- G-Function Ln(T/Ts) Value 27
    0.621812,                 !- G-Function G Value 27
    -11.231562,               !- G-Function Ln(T/Ts) Value 28
    0.703595,                 !- G-Function G Value 28
    -11.107400,               !- G-Function Ln(T/Ts) Value 29
    0.782798,                 !- G-Function G Value 29
    -10.983238,               !- G-Function Ln(T/Ts) Value 30
    0.859943,                 !- G-Function G Value 30
    -10.859076,               !- G-Function Ln(T/Ts) Value 31
    0.935443,                 !- G-Function G Value 31
    -10.734914,               !- G-Function Ln(T/Ts) Value 32
    1.009606,                 !- G-Function G Value 32
    -10.610752,               !- G-Function Ln(T/Ts) Value 33
    1.082655,                 !- G-Function G Value 33
    -10.486590,               !- G-Function Ln(T/Ts) Value 34
    1.154746,                 !- G-Function G Value 34
    -10.362428,               !- G-Function Ln(T/Ts) Value 35
    1.225994,                 !- G-Function G Value 35
    -10.238267,               !- G-Function Ln(T/Ts) Value 36
    1.296483,                 !- G-Function G Value 36
    -10.114105,               !- G-Function Ln(T/Ts) Value 37
    1.366279,                 !- G-Function G Value 37
    -9.989943,                !- G-Function Ln(T/Ts) Value 38
    1.435438,                 !- G-Function G Value 38
    -9.865781,                !- G-Function Ln(T/Ts) Value 39
    1.504008,                 !- G-Function G Value 39
    -9.741619,                !- G-Function Ln(T/Ts) Value 40
    1.572032,                 !- G-Function G Value 40
    -9.617457,                !- G-Function Ln(T/Ts) Value 41
    1.639551,                 !- G-Function G Value 41
    -9.493295,                !- G-Function Ln(T/Ts) Value 42
    1.706601,                 !- G-Function G Value 42
    -9.369133,                !- G-Function Ln(T/Ts) Value 43
    1.773217,                 !- G-Function G Value 43
    -9.244971,                !- G-Function Ln(T/Ts) Value 44
    1.839433,                 !- G-Function G Value 44
    -9.120809,                !- G-Function Ln(T/Ts) Value 45
    1.905279,                 !- G-Function G Value 45
    -8.996648,                !- G-Function Ln(T/Ts) Value 46
    1.970785,                 !- G-Function G Value 46
    -8.872486,                !- G-Function Ln(T/Ts) Value 47
    2.035979,                 !- G-Function G Value 47
    -8.748324,                !- G-Function Ln(T/Ts) Value 48
    2.100886,                 !- G-Function G Value 48
    -8.624162,                !- G-Function Ln(T/Ts) Value 49
    2.165530,                 !- G-Function G Value 49
    -8.500000,                !- G-Function Ln(T/Ts) Value 50
    2.273322,                 !- G-Function G Value 50
    -7.800000,                !- G-Function Ln(T/Ts) Value 51
    2.617322,                 !- G-Function G Value 51
    -7.200000,                !- G-Function Ln(T/Ts) Value 52
    2.913796,                 !- G-Function G Value 52
    -6.500000,                !- G-Function Ln(T/Ts) Value 53
    3.270114,                 !- G-Function G Value 53
    -5.900000,                !- G-Function Ln(T/Ts) Value 54
    3.632967,                 !- G-Function G Value 54
    -5.200000,                !- G-Function Ln(T/Ts) Value 55
    4.270751,                 !- G-Function G Value 55
    -4.500000,                !- G-Function Ln(T/Ts) Value 56
    5.385970,                 !- G-Function G Value 56
    -3.963000,                !- G-Function Ln(T/Ts) Value 57
    6.614535,                 !- G-Function G Value 57
    -3.270000,                !- G-Function Ln(T/Ts) Value 58
    9.514729,                 !- G-Function G Value 58
    -2.864000,                !- G-Function Ln(T/Ts) Value 59
    11.884430,                !- G-Function G Value 59
    -2.577000,                !- G-Function Ln(T/Ts) Value 60
    13.917405,                !- G-Function G Value 60
    -2.171000,                !- G-Function Ln(T/Ts) Value 61
    17.276215,                !- G-Function G Value 61
    -1.884000,                !- G-Function Ln(T/Ts) Value 62
    19.987269,                !- G-Function G Value 62
    -1.191000,                !- G-Function Ln(T/Ts) Value 63
    27.202388,                !- G-Function G Value 63
    -0.497000,                !- G-Function Ln(T/Ts) Value 64
    34.744246,                !- G-Function G Value 64
    -0.274000,                !- G-Function Ln(T/Ts) Value 65
    36.928229,                !- G-Function G Value 65
    -0.051000,                !- G-Function Ln(T/Ts) Value 66
    38.950610,                !- G-Function G Value 66
    0.196000,                 !- G-Function Ln(T/Ts) Value 67
    40.938405,                !- G-Function G Value 67
    0.419000,                 !- G-Function Ln(T/Ts) Value 68
    42.516547,                !- G-Function G Value 68
    0.642000,                 !- G-Function Ln(T/Ts) Value 69
    43.874104,                !- G-Function G Value 69
    0.873000,                 !- G-Function Ln(T/Ts) Value 70
    45.060864,                !- G-Function G Value 70
    1.112000,                 !- G-Function Ln(T/Ts) Value 71
    46.062146,                !- G-Function G Value 71
    1.335000,                 !- G-Function Ln(T/Ts) Value 72
    46.806423,                !- G-Function G Value 72
    1.679000,                 !- G-Function Ln(T/Ts) Value 73
    47.649018,                !- G-Function G Value 73
    2.028000,                 !- G-Function Ln(T/Ts) Value 74
    48.218660,                !- G-Function G Value 74
    2.275000,                 !- G-Function Ln(T/Ts) Value 75
    48.496086,                !- G-Function G Value 75
    3.003000,                 !- G-Function Ln(T/Ts) Value 76
    48.956674;                !- G-Function G Value 76""")
int = Integer("64")
objparams_5 = Ironbug_ObjParams(
    BoreHoleLength="76.2",
    BoreHoleRadius="0.05715",
    DesignFlowRate="0.1143",
    GroundThermalConductivity="2.493",
    GroundThermalHeatCapacity="2.4957E+6",
    GroutThermalConductivity="1.4714",
    MaximumLengthofSimulation="1",
    NumberofBoreHoles=int,
    PipeOutDiameter="0.0267",
    PipeThermalConductivity="0.389",
    PipeThickness="0.00243",
    UTubeDistance="0.047",
    DataFieldSetType="Ironbug.HVAC.IB_GroundHeatExchangerVertical_FieldSet")
groundhxvertical = Ironbug_GroundHeatExchangerVertical(GFunctions=panel_5, Parameters_=objparams_5)

c_script = CSharpScript(GPM="1020")  # -> m3s; inputs GPM: Double
# ---------- c_script: C# ----------
    m3s = GPM * 0.0000630902;
# ---------- end c_script ----------
objparams_6 = Ironbug_ObjParams(
    Coefficient1OfthePartLoadPerformanceCurve="0",
    Coefficient2OfthePartLoadPerformanceCurve="0.0216",
    Coefficient3OfthePartLoadPerformanceCurve="-0.0325",
    Coefficient4OfthePartLoadPerformanceCurve="1.0095",
    RatedFlowRate=c_script,
    DataFieldSetType="Ironbug.HVAC.IB_PumpVariableSpeed_FieldSet")
pumpvariable = Ironbug_PumpVariableSpeed(Parameters=objparams_6)

c_script_2 = CSharpScript(GPM="950")  # -> m3s; inputs GPM: Double; same code as c_script
objparams_7 = Ironbug_ObjParams(
    Coefficient1OfthePartLoadPerformanceCurve="0",
    Coefficient2OfthePartLoadPerformanceCurve="0.0216",
    Coefficient3OfthePartLoadPerformanceCurve="-0.0325",
    Coefficient4OfthePartLoadPerformanceCurve="1.0095",
    RatedFlowRate=c_script_2,
    DataFieldSetType="Ironbug.HVAC.IB_PumpVariableSpeed_FieldSet")
pumpvariable_2 = Ironbug_PumpVariableSpeed(Parameters=objparams_7)

# ----
# GeoThermal Heat Pump Loop
pipeadiabatic = Ironbug_PipeAdiabatic()
pipeadiabatic_2 = Ironbug_PipeAdiabatic()
plantbranches = PlantBranches(B1=groundhxvertical, B2=pipeadiabatic_2, mapBranchToLoop=False)
spm_scheduled = Ironbug_SetpointManagerScheduled(Temperature="20")
objparams_8 = Ironbug_ObjParams(Name="Heat Pump Loop", DataFieldSetType="Ironbug.HVAC.IB_PlantLoop_FieldSet")
plantbranches_2 = PlantBranches(B1=pipeadiabatic, B2=centralheatpumpsystem.ToDW_Demand, mapBranchToLoop=False)
merge = Merge(Data1=pumpvariable, Data2=plantbranches, Data3=spm_scheduled)
condenserwaterloop = Ironbug_CondenserWaterPlantLoop(Supply=merge, Demand=plantbranches_2, Parameters_=objparams_8)

pipeadiabatic_3 = Ironbug_PipeAdiabatic()

# ----
# Main Chilled water loop
panel_6 = Panel("45")
c_script_3 = CSharpScript(F=panel_6)  # -> C; inputs F: Double
# ---------- c_script_3: C# ----------
    C = (F - 32) * 5 / 9;
# ---------- end c_script_3 ----------
c_script_4 = CSharpScript(F="55")  # -> C; inputs F: Double; same code as c_script_3
branches = PlantBranches(mapBranchToLoop=False)
objparams_9 = Ironbug_ObjParams(DesignLoopExitTemperature=c_script_3, DataFieldSetType="Ironbug.HVAC.IB_SizingPlant_FieldSet")
objparams_10 = Ironbug_ObjParams(MaximumLoopTemperature="98", MinimumLoopTemperature="1", DataFieldSetType="Ironbug.HVAC.IB_PlantLoop_FieldSet")
branches_2 = PlantBranches(B1=centralheatpumpsystem.ToCW_Supply, B2=pipeadiabatic_3, mapBranchToLoop=False)
spm_dual = Ironbug_SetpointManagerScheduledDualSetpoint(HighTemperature=c_script_4, LowTemperature=c_script_3)
sizingplant = Ironbug_SizingPlant(Parameters_=objparams_9)
cwloop = Ironbug_ChilledWaterPlantLoop(Supply=[pumpvariable_2, branches_2, spm_dual], Demand=branches, SizingLoop=sizingplant, Parameters_=objparams_10)

objparams_11 = Ironbug_ObjParams(
    Coefficient1OfthePartLoadPerformanceCurve="0",
    Coefficient2OfthePartLoadPerformanceCurve="0.0216",
    Coefficient3OfthePartLoadPerformanceCurve="-0.0325",
    Coefficient4OfthePartLoadPerformanceCurve="1.0095",
    DataFieldSetType="Ironbug.HVAC.IB_PumpVariableSpeed_FieldSet")
pumpvariable_3 = Ironbug_PumpVariableSpeed(Parameters=objparams_11)

# ----
# Hot water loop
_130f = Panel("54.44")
pipeadiabatic_4 = Ironbug_PipeAdiabatic()
branches_3 = PlantBranches(mapBranchToLoop=False)
objparams_12 = Ironbug_ObjParams(DesignLoopExitTemperature=_130f, DataFieldSetType="Ironbug.HVAC.IB_SizingPlant_FieldSet")
spm_scheduled_2 = Ironbug_SetpointManagerScheduled(Temperature=_130f)
plantbranches_3 = PlantBranches(Branch1=centralheatpumpsystem.ToHW_Supply, Branch=pipeadiabatic_4, mapBranchToLoop=False)
sizingplant_2 = Ironbug_SizingPlant(Parameters_=objparams_12)
hwloop = Ironbug_HotWaterPlantLoop(Supply=[pumpvariable_3, plantbranches_3, spm_scheduled_2], Demand=branches_3, SizingLoop=sizingplant_2)
