# Grasshopper definition Hot water loop.gh (Grasshopper 0.9.76)
# plug-ins: Ironbug.Grasshopper

# ----
# Hot water loop
panel = Panel("0")
objparams = Ironbug_ObjParams(
    Coefficient1OfthePartLoadPerformanceCurve=panel,
    Coefficient2OfthePartLoadPerformanceCurve="0.0216",
    Coefficient3OfthePartLoadPerformanceCurve="-0.0325",
    Coefficient4OfthePartLoadPerformanceCurve="1.0095",
    DataFieldSetType="Ironbug.HVAC.IB_PumpVariableSpeed_FieldSet")
objparams_2 = Ironbug_ObjParams(NominalThermalEfficiency="0.9", DataFieldSetType="Ironbug.HVAC.IB_BoilerHotWater_FieldSet")
boilerhw = Ironbug_BoilerHotWater(Parameters=objparams_2)
pumpvariable = Ironbug_PumpVariableSpeed(Parameters=objparams)
plantbranches = PlantBranches(Branch1=boilerhw)
plantbranches_2 = PlantBranches()
spm_scheduled = Ironbug_SetpointManagerScheduled(Temperature="67")
hwloop = Ironbug_HotWaterPlantLoop(Supply=[pumpvariable, plantbranches, spm_scheduled], Demand=plantbranches_2)
