# Grasshopper definition PerformanceCurve_ADEG Water Chiller.gh (Grasshopper 0.9.76)
# plug-ins: Ironbug.Grasshopper

# ----
# ADEG Water Chiller
panel = Panel("20")
panel_2 = Panel("""1.41E-01
6.55E-01
2.03E-01""")
objparams = Ironbug_ObjParams(MaximumValueofx="20", MaximumValueofy="50", DataFieldSetType="Ironbug.HVAC.Curves.IB_CurveBiquadratic_FieldSet")
objparams_2 = Ironbug_ObjParams(MaximumValueofx=panel, MaximumValueofy="50", DataFieldSetType="Ironbug.HVAC.Curves.IB_CurveBiquadratic_FieldSet")
panel_3 = Panel("""4.68E-01
-1.38E-02
6.98E-04
1.09E-02
4.62E-04
-6.82E-04""")
objparams_3 = Ironbug_ObjParams(MaximumValueofx="1.2", DataFieldSetType="Ironbug.HVAC.Curves.IB_CurveQuadratic_FieldSet")
panel_4 = Panel("""1.07E+00
4.29E-02
4.17E-04
-8.10E-03
-4.02E-05
-3.86E-04""")
curvebiquadratic = Ironbug_CurveBiquadratic(Coefficients=panel_4, Parameters_=objparams)
curvebiquadratic_2 = Ironbug_CurveBiquadratic(Coefficients=panel_3, Parameters_=objparams_2)
curvequadratic = Ironbug_CurveQuadratic(Coefficients=panel_2, Parameters_=objparams_3)
chillerelec_adv = Ironbug_ChillerElectricEIR_Advanced(
    CoolingCapacityFunctionOfTemperatureCurve=curvebiquadratic,
    ElectricInputToCoolingOutputRatioFunctionOfTemperatureCurve=curvebiquadratic_2,
    ElectricInputToCoolingOutputRatioFunctionOfPartLoadRatioCurve=curvequadratic)  # -> ChillerElectricEIR, ChillerElectricEIR_CondenserLoop
