# Grasshopper definition 2Rm_VAVReheat.gh (Grasshopper 0.9.76)
# plug-ins: Python Interpreter, Ironbug

# Two rooms with
# VAV Reheat system
ladybug = Ladybug_Ladybug()  # -> Vviiiiiiiiiizzz; plug-in component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
brep = Brep([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])
mass2zone = Honeybee_Masses2Zones(zoneMasses=flatten(brep), maxRoofAngle=30, createHBZones=Toggle(True))  # -> readMe, HBZones; plug-in component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
honeybee = Honeybee_Honeybee()  # -> Vviiiiiiiiiizzz; plug-in component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
coilhw = Ironbug_CoilHeatingWater()
panel = Panel(mass2zone.HBZones)
lng = ListLength(List=mass2zone.HBZones)
puppets = Ironbug_CreatePuppets(Reference=coilhw, Amount=lng)
vavreheat = Ironbug_AirTerminalSingleDuctVAVReheat(HeatingCoil=puppets)

# ----
# Air loop
number_slider = Slider(12.778, range=0..100)
thermalzone = Ironbug_ThermalZone(HoneybeeZone=mass2zone.HBZones, AirTerminal_=vavreheat)
nickname = Ironbug_OutdoorAirSystem()
coilhw_2 = Ironbug_CoilHeatingWater()
coilcw = Ironbug_CoilCoolingWater()
spscheduled = Ironbug_SetpointManagerScheduled(Temperature=number_slider)
fanvariable = Ironbug_FanVariableVolume()
branches = AirLoopBranches(Branch1=thermalzone)
airloop = Ironbug_AirLoopHVAC(Supply=[nickname, coilcw, coilhw_2, fanvariable, spscheduled], Demand=branches)

# ----
# Hot water loop
number_slider_2 = Slider(65.6, range=0..100)
graft = GraftTree(Tree=puppets, IncludeEmptyLists=True, IncludeNullItems=True)
boilerhw = Ironbug_BoilerHotWater()
pumpvariable = Ironbug_PumpVariableSpeed()
boilerhw_2 = Ironbug_BoilerHotWater()
pumpvariable_2 = Ironbug_PumpVariableSpeed()
spoareset = Ironbug_SetpointManagerOutdoorAirReset(
    SetpointatOutdoorHighTemperature=number_slider_2,
    OutdoorHighTemperature=Slider(10, range=0..10),
    SetpointatOutdoorLowTemperature=Slider(82.2, range=0..100),
    OutdoorLowTemperature=Slider(-6.7, range=-10..0))
branches_2 = PlantBranches(Branch1=[boilerhw, pumpvariable], Branch=[boilerhw_2, pumpvariable_2])
branches_3 = PlantBranches(Branch1=graft, Branch=coilhw_2)
hwloop = Ironbug_HotWaterPlantLoop(Supply=[branches_2, spoareset], Demand=branches_3)

# ----
# Chilled water loop
pumpconstant = Ironbug_PumpConstantSpeed()
chillere = Ironbug_ChillerElectricEIR()
branches_4 = PlantBranches(Branch1=[chillere, pumpconstant])
branches_5 = PlantBranches(Branch1=coilcw)
cwloop = Ironbug_ChilledWaterPlantLoop(Supply=branches_4, Demand=branches_5)

# ----
# Condenser water loop
pumpvariable_3 = Ironbug_PumpVariableSpeed()
clntower1 = Ironbug_CoolingTowerSingleSpeed()
branches_6 = PlantBranches(Branch1=clntower1)
branches_7 = PlantBranches(Branch1=chillere)
dwloop = Ironbug_CondenserWaterPlantLoop(Supply=[pumpvariable_3, branches_6], Demand=branches_7)

nickname_2 = Ironbug_SaveOSModel(
    FilePath="C:\ladybug\hvacTest.osm",
    AirLoops=flatten(airloop),
    PlantLoops=flatten([cwloop, dwloop, hwloop]),
    _write=Toggle(False))
panel_2 = Panel(nickname_2)
