# Grasshopper definition 2Rm_VAVReheat_PuppetTest.gh (Grasshopper 0.9.76)
# plug-ins: Python Interpreter, Ironbug

# Two rooms with VAV Reheat system
ladybug = Ladybug_Ladybug()  # -> Vviiiiiiiiiizzz; plug-in component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
brep = Brep([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])
mass2zone = Honeybee_Masses2Zones(zoneMasses=flatten(brep), maxRoofAngle=30, createHBZones=Toggle(True))  # -> readMe, HBZones; plug-in component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
panel = Panel(mass2zone.HBZones)
honeybee = Honeybee_Honeybee()  # -> Vviiiiiiiiiizzz; plug-in component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
coilhw = Ironbug_CoilHeatingWater()
puppets = Ironbug_CreatePuppets(Reference=coilhw, Amount=Slider(2, range=0..10))
vavreheat = Ironbug_AirTerminalSingleDuctVAVReheat(HeatingCoil=puppets)
branches = PlantBranches(Branch1=puppets)
panel_2 = Panel(vavreheat)
fanvariable = Ironbug_FanVariableVolume()
thermalzone = Ironbug_ThermalZone(HoneybeeZone=mass2zone.HBZones, AirTerminal_=vavreheat)
branches_2 = AirLoopBranches(Branch1=thermalzone)
airloop = Ironbug_AirLoopHVAC(Supply=fanvariable, Demand=branches_2)
hwloop = Ironbug_HotWaterPlantLoop(Demand=branches)
nickname = Ironbug_SaveOSModel(PlantLoops=hwloop, AirLoops=airloop, _write=Toggle(False))
panel_3 = Panel(nickname)
