# Grasshopper definition 01_Demo.gh (Grasshopper 0.9.76)
# plug-ins: Ironbug

# ---- group: Extracted Coordinates
pt = Point([Point(360, 86, 0), Point(495, 171, 0), Point(488, 257, 0), Point(351, 344, 0), Point(245, 129, 0)])

# ----
# PNG
panel = Panel("C:\Users\Mingbo\Documents\GitHub\HoneybeeCSharp\doc\testFile\X_4.png")
panel_2 = Panel("C:\Users\Mingbo\Documents\GitHub\HoneybeeCSharp\doc\testFile\indoor_view_h.HDR")
# HDR
panel_3 = Panel("C:\Users\Mingbo\Documents\GitHub\HoneybeeCSharp\doc\testFile\AcceleRad_test_IMG_Perspective_GPU@fc.HDR")
pt_2 = ConstructPoint(XCoordinate=Slider(488, range=0..500), YCoordinate=Slider(325, range=0..500), ZCoordinate=0)

# ---- group: Extracted Coordinates
pt_3 = Point([Point(488, 325, 0), Point(165, 50, 0), Point(408, 63, 0), Point(464, 145, 0), Point(422, 260, 0), Point(322, 361, 0), Point(269, 380, 0), Point(226, 90, 0)])

# ----
viewdata = ViewData(DisableClickable=True, scale=1)  # -> ImagePath, ColorValues
panel_4 = Panel(viewdata.ColorValues)
