# Grasshopper definition 01_pgn.gh (Grasshopper 0.9.76)
# plug-ins: Archsim, Ironbug, embryoA

number_slider = Slider(440, range=0..1000)
number_slider_2 = Slider(0.5, range=0..1)
panel = Panel("C:\Users\Mingbo\Documents\GitHub\HoneybeeCSharp\doc\testFile\X_4.png")
panel_2 = Panel("C:\Users\Mingbo\Documents\GitHub\HoneybeeCSharp\doc\testFile\AcceleRad_test_IMG_Perspective_CPU@fc.TIF")
panel_3 = Panel("C:\Users\Mingbo\Documents\GitHub\HoneybeeCSharp\doc\testFile\indoor_view_h.HDR")
panel_4 = Panel("C:\Users\Mingbo\Documents\GitHub\HoneybeeCSharp\doc\testFile\AcceleRad_test_IMG_Perspective_GPU@fc.HDR")
pt = ConstructPoint(XCoordinate=number_slider, YCoordinate=number_slider, ZCoordinate=0)

# ---- group: Extracted Coordinates
pt_2 = Point([Point(440, 440, 0), Point(265, 132, 0), Point(368, 113, 0)])

# ----
viewer = ImageViewer(ViewportScale=1, DisableClickable=True, SaveImgWithCoords=False, scale=1)  # -> ImagePath, ColorValues
array_schedule = ArraySchedule(Hours=[1, 1, 1, 1, 1, 1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])
rec = DataRecorder(DataLimit=-10, RecordData=True)
image = ImageFromPath(S=1)
panel_5 = Panel(rec)
clean = CleanTree(RemoveNulls=True, RemoveInvalid=True, RemoveEmpty=True, Tree=panel_5)
panel_6 = Panel(clean)
