# Grasshopper definition 03_objParam.gh (Grasshopper 1.0.7)
# plug-ins: Ironbug.Grasshopper

objparams = Ironbug_ObjParams(NominalThermalEfficiency=Slider(0.6, range=0..1), DataFieldSetType="Ironbug.HVAC.IB_BoilerHotWater_DataFields")
panel = Panel(objparams)
boilerhw = Ironbug_BoilerHotWater(Parameters_=objparams)
panel_2 = Panel(boilerhw)
