# Grasshopper definition HVACSystemWorkflow.gh (Grasshopper 1.0.7)
# plug-ins: Ironbug.Grasshopper

brep = Brep([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])
intersectmass = IntersectMass(x=brep)  # -> out, A; inputs x: list of Brep
# ---------- intersectmass: C# ----------
    var tolerance = Rhino.RhinoDoc.ActiveDoc.ModelAbsoluteTolerance;
    List<Brep> allOldBreps = x;

    if (x.Count() > 0)
    {
      var results = allOldBreps.AsParallel().AsOrdered().Select(b => SplitBrepWithBreps(b, allOldBreps, tolerance));
      A = results;
    }

    //SplitBrepWithBreps(x[0], x, tolerance);
# ---------- intersectmass: C# additional code ----------
  static Brep SplitBrepWithBreps(Brep CurrentBrep, List<Brep> AllBreps, double tolerance)
  {
    var currentBrep = CurrentBrep;
    var allBreps = AllBreps;

    foreach (Brep item in allBreps)
    {
      var  tempBrep = currentBrep.Split(item, tolerance);
      if (tempBrep.Count() > 0)
      {
        var newBrep = Rhino.Geometry.Brep.JoinBreps(tempBrep, tolerance);

        currentBrep = newBrep.First();
        currentBrep.Faces.ShrinkFaces();
      }
    }
    return currentBrep;

  }
# ---------- end intersectmass ----------

objparams = Ironbug_ObjParams(PressureRise="500")
fanconstant = Ironbug_FanConstantVolume(Parameters=objparams)

honeybee = Honeybee_Honeybee()  # -> Vviiiiiiiiiizzz; plug-in component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
ladybug = Ladybug_Ladybug()  # -> Vviiiiiiiiiizzz; plug-in component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
coilhw = Ironbug_CoilHeatingWater()  # -> AirSide_CoilHeatingWater, WaterSide_CoilHeatingWater
coilhw_2 = Ironbug_CoilHeatingWater()  # -> AirSide_CoilHeatingWater, WaterSide_CoilHeatingWater
number_slider = Slider(0.7, range=0..1)
objparams_2 = Ironbug_ObjParams(EconomizerControlType="DifferentialDryBulb", DataFieldSetType="Ironbug.HVAC.IB_ControllerOutdoorAir_DataFieldSet")
mass2zone = Honeybee_Masses2Zones(zoneMasses=flatten(intersectmass.A), maxRoofAngle=30, createHBZones=Toggle(True))  # -> readMe, HBZones; plug-in component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
objparams_3 = Ironbug_ObjParams(EconomizerControlType="DifferentialDryBulb")
panel = Panel("https://www.energyplus.net/weather-download/north_and_central_america_wmo_region_4/USA/NY/USA_NY_New.York-LaGuardia.AP.725030_TMY3/all")
vavreheat = Ironbug_AirTerminalSingleDuctVAVReheat(HeatingCoil=coilhw.AirSide_CoilHeatingWater)
vavreheat_2 = Ironbug_AirTerminalSingleDuctVAVReheat(HeatingCoil=coilhw_2.AirSide_CoilHeatingWater)
glzparamlist = Honeybee_GlazingParametersList(northGlzParam=0, westGlzParam=0, southGlzParam=number_slider, eastGlzParam=number_slider)  # -> glzParamList; plug-in component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
oacontroller = Ironbug_OAController(Parameters=objparams_2)
objparams_4 = Ironbug_ObjParams(PressureRise="500", DataFieldSetType="Ironbug.HVAC.IB_FanVariableVolume_DataFields")
oacontroller_2 = Ironbug_OAController(Parameters=objparams_3)
objparams_5 = Ironbug_ObjParams(
    AllOutdoorAirinCooling=Toggle(False),
    AllOutdoorAirinHeating=Toggle(False),
    CentralHeatingDesignSupplyAirTemperature="12.8",
    DataFieldSetType="Ironbug.HVAC.IB_SizingSystem_FieldSet")
objparams_6 = Ironbug_ObjParams(PressureRise="500")
objparams_7 = Ironbug_ObjParams(
    AllOutdoorAirinCooling=Toggle(False),
    AllOutdoorAirinHeating=Toggle(False),
    CentralHeatingDesignSupplyAirTemperature="12.8")
oasystem = Ironbug_OutdoorAirSystem(Controller_=oacontroller)
coilcw = Ironbug_CoilCoolingWater()  # -> AirSide_CoilCoolingWater, WaterSide_CoilCoolingWater
coilhw_3 = Ironbug_CoilHeatingWater()  # -> AirSide_CoilHeatingWater, WaterSide_CoilHeatingWater
oasystem_2 = Ironbug_OutdoorAirSystem(Controller_=oacontroller_2)
coilhw_4 = Ironbug_CoilHeatingWater()  # -> AirSide_CoilHeatingWater, WaterSide_CoilHeatingWater
coilcdxtwo = Ironbug_CoilCoolingDXTwoSpeed()
spscheduled = Ironbug_SetpointManagerScheduled(Temperature="12.8")
solveadjc = Honeybee_SolveAdjacencies(HBZones=flatten(mass2zone.HBZones), removeCurrentAdjc=False, findAdjc=Toggle(True))  # -> readMe, HBZonesWADJ; plug-in component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
objparams_8 = Ironbug_ObjParams(
    DesignLoopExitTemperature="29.4",
    LoopDesignTemperatureDifference="5.6",
    LoopType="Condenser",
    DataFieldSetType="Ironbug.HVAC.IB_SizingPlant_DataFieldSet")
fanvariable = Ironbug_FanVariableVolume(Parameters=objparams_4)
glazingcreator = Honeybee_GlazingBasedOnRatio(HBObjects=solveadjc.HBZonesWADJ, glzRatio=glzparamlist, runIt=Toggle(True))  # -> readMe, HBObjWGLZ; plug-in component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
data = Data(flatten(glazingcreator.HBObjWGLZ))
thermalzone = Ironbug_ThermalZone(HoneybeeZone=data, AirTerminal_=vavreheat)
thermalzone_2 = Ironbug_ThermalZone(HoneybeeZone=data, AirTerminal_=vavreheat_2)
chillere = Ironbug_ChillerElectricEIR()  # -> ChillerElectricEIR, ChillerElectricEIR_CondenserLoop
spscheduled_2 = Ironbug_SetpointManagerScheduled(Temperature="12.8")
epw_stat = Ladybug_OpenEPWAndSTATWeatherFiles(weatherFileURL=panel)  # -> epwFile, statFile; plug-in component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

# ----
# Condenser water loop
clntower1 = Ironbug_CoolingTowerSingleSpeed()
spfollowoatemp = Ironbug_SetpointManagerFollowOutdoorAirTemperature(MinimumSetpointTemperature="6", OffsetTemperatureDifference="1.5")
pumpvariable = Ironbug_PumpVariableSpeed()
branches = PlantBranches(Branch1=clntower1)
branches_2 = PlantBranches(Branch1=chillere.ChillerElectricEIR_CondenserLoop)
dwloop = Ironbug_CondenserWaterPlantLoop(Supply=[pumpvariable, branches, spfollowoatemp], Demand=branches_2)

fanvariable_2 = Ironbug_FanVariableVolume(Parameters=objparams_6)

# ----
# Hot water loop
boilerhw = Ironbug_BoilerHotWater()
pumpvariable_2 = Ironbug_PumpVariableSpeed()
spscheduled_3 = Ironbug_SetpointManagerScheduled(Temperature="67")
branches_3 = PlantBranches(Branch1=boilerhw)
branches_4 = PlantBranches(B1=coilhw.WaterSide_CoilHeatingWater, B2=coilhw_3.WaterSide_CoilHeatingWater)
hwloop = Ironbug_HotWaterPlantLoop(Supply=[pumpvariable_2, branches_3, spscheduled_3], Demand=branches_4)

# ----
# Hot water loop
boilerhw_2 = Ironbug_BoilerHotWater()
pumpvariable_3 = Ironbug_PumpVariableSpeed()
spscheduled_4 = Ironbug_SetpointManagerScheduled(Temperature="67")
branches_5 = PlantBranches(Branch1=boilerhw_2)
branches_6 = PlantBranches(B1=coilhw_2.WaterSide_CoilHeatingWater, B2=coilhw_4.WaterSide_CoilHeatingWater)
hwloop_2 = Ironbug_HotWaterPlantLoop(Supply=[pumpvariable_3, branches_5, spscheduled_4], Demand=branches_6)

# ----
# Chilled water loop
panel_2 = Panel("6.7")
pumpvariable_4 = Ironbug_PumpVariableSpeed()
spscheduled_5 = Ironbug_SetpointManagerScheduled(Temperature=panel_2)
branches_7 = PlantBranches(Branch1=chillere.ChillerElectricEIR)

szsystem = Ironbug_SizingSystem(Parameters=objparams_5)
branches_8 = AirLoopBranches(Branch1=thermalzone)
szsystem_2 = Ironbug_SizingSystem(Parameters=objparams_7)
szplant = Ironbug_SizingPlant(Parameters_=objparams_8)
branches_9 = AirLoopBranches(Branch1=thermalzone_2)
branches_10 = PlantBranches(Branch1=coilcw.WaterSide_CoilCoolingWater)
merge = Merge(
    Data1=oasystem,
    Data2=coilcw.AirSide_CoilCoolingWater,
    Data3=coilhw_3.AirSide_CoilHeatingWater,
    Data4=fanvariable,
    Data5=spscheduled)
merge_2 = Merge(Data1=oasystem_2, Data2=coilcdxtwo, Data3=coilhw_4.AirSide_CoilHeatingWater, Data4=fanvariable_2, Data5=spscheduled_2)
airloop = Ironbug_AirLoopHVAC(Supply=merge, Demand=branches_8, SizingSystem=szsystem)
cwloop = Ironbug_ChilledWaterPlantLoop(Supply=[pumpvariable_4, branches_7, spscheduled_5], Demand=branches_10)
hvacsystemslist = Honeybee_HVACSystemsList({"-1. Thermostat Only": -1, "0. Ideal Air Loads": 0, "1. PTAC | Residential": 1, "2. PTHP | Residential": 2, "3. Packaged Single Zone - AC": 3, "4. Packaged Single Zone - HP": 4, "5. Packaged VAV w/ Reheat": 5, "6. Packaged VAV w/ PFP Boxes": 6, "7. VAV w/ Reheat": 7, "8. VAV w/ PFP Boxes": 8, "9. Warm Air Furnace - Gas Fired": 9, "10.Warm Air Furnace - Electric": 10, "11.Fan Coil Units + DOAS": 11, "12.Active Chilled Beams + DOAS": 12, "13.Radiant Floors + DOAS": 13, "14.Custom Rad Surfaces + DOAS": 14, "15.Heated Surfaces + VAV Cooling": 15, "16.VRF + DOAS": 16, "17.WSHP + DOAS": 17}, selected="7. VAV w/ Reheat")
airloop_2 = Ironbug_AirLoopHVAC(Supply=merge_2, Demand=branches_9, SizingSystem=szsystem_2)
merge_3 = Merge(Data1=hwloop, Data2=cwloop, Data3=dwloop)
hvacsystem = Ironbug_HVACSystem(AirLoops=flatten(airloop), PlantLoops=flatten(merge_3))
hvacsystem_2 = Ironbug_HVACSystem(AirLoops=flatten(airloop_2), PlantLoops=flatten(hwloop_2))
hvacsystem_3 = Honeybee_AssignHVACSystem(HBZones=glazingcreator.HBObjWGLZ, HVACSystems=hvacsystemslist)  # -> readMe, HBZones; plug-in component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
objviewer = Ironbug_ObjViewer(Object=cwloop)
toggle = BooleanToggle(False)  # disabled
toggle_2 = BooleanToggle(False)
panel_3 = Panel("OPS_Sys")  # disabled
panel_4 = Panel(objviewer)
exporttoopenstudio = Honeybee_ExportToOpenStudio(epwWeatherFile=epw_stat.epwFile, HBZones=flatten(glazingcreator.HBObjWGLZ), writeOSM=toggle, fileName=panel_3)  # -> readMe, osmFileAddress, idfFileAddress, resultFileAddress, eioFileAddress, rddFileAddress, htmlReport, studyFolder, model; disabled; plug-in component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
exporttoopenstudio_2 = Honeybee_ExportToOpenStudio(
    epwWeatherFile=epw_stat.epwFile,
    HBZones=flatten(hvacsystem_3.HBZones),
    writeOSM=toggle_2,
    openOpenStudio=toggle_2,
    fileName="HB_Sys")  # -> readMe, osmFileAddress, idfFileAddress, resultFileAddress, eioFileAddress, rddFileAddress, htmlReport, studyFolder, model; plug-in component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
exporttoopenstudio_3 = Honeybee_ExportToOpenStudio(
    epwWeatherFile=epw_stat.epwFile,
    HBZones=flatten(glazingcreator.HBObjWGLZ),
    HVACSystem=flatten(hvacsystem),
    writeOSM=Toggle(False),
    fileName="IB_Sys")  # -> readMe, osmFileAddress, idfFileAddress, resultFileAddress, eioFileAddress, rddFileAddress, htmlReport, studyFolder, model; plug-in component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
readepresult = Honeybee_ReadEPResult(resultFileAddress=exporttoopenstudio_2.resultFileAddress)  # -> totalThermalLoad, thermalLoadBalance, cooling, heating, electricLight, electricEquip, fanElectric, pumpElectric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; plug-in component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
c_script = CSharpScript(x=exporttoopenstudio.osmFileAddress, Reference="C:\openstudio-2.5.0\CSharp\openstudio\OpenStudio.dll")  # -> out, A; inputs x: String; disabled
# ---------- c_script: C# ----------
    if (string.IsNullOrEmpty(x))
    {
      return;
    }

    var p = new OpenStudio.Path(x);
    var m_o = OpenStudio.Model.load(p);
    Print(m_o.is_initialized().ToString());
    var m = m_o.get();
    var zs = m.getThermalZones();
    foreach (OpenStudio.ThermalZone z in zs)
    {
      
      var eqps = z.equipment();
      foreach (var e in eqps)
      {
		 e.remove();
      }
    }
    OpenStudio.OpenStudioModelHVAC.addSystemType1(m, zs);

    m.save(p, true);
# ---------- end c_script ----------
c_script_2 = CSharpScript(x=exporttoopenstudio_3.osmFileAddress, Reference="C:\openstudio-2.5.0\CSharp\openstudio\OpenStudio.dll")  # -> out, A; inputs x: String
# ---------- c_script_2: C# ----------
    if (!string.IsNullOrEmpty(x))
    {
      var p = new OpenStudio.Path(x);
      var m = OpenStudio.Model.load(p).get();
      var plantLps = m.getPlantLoops();
      foreach (OpenStudio.PlantLoop pl in plantLps)
      {
        
        var tp = pl.sizingPlant().loopType();
        Print(pl.nameString() + "_" + tp);
      }
    }
# ---------- end c_script_2 ----------
panel_5 = Panel(c_script_2.out)
panel_6 = Panel(exporttoopenstudio_3.osmFileAddress)
readepresult_2 = Honeybee_ReadEPResult(resultFileAddress=exporttoopenstudio_3.resultFileAddress)  # -> totalThermalLoad, thermalLoadBalance, cooling, heating, electricLight, electricEquip, fanElectric, pumpElectric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; plug-in component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
panel_7 = Panel(exporttoopenstudio.osmFileAddress)  # disabled
panel_8 = Panel(c_script.out)  # disabled
strnum = Ladybug_SeparateData(inputList=flatten(readepresult.cooling))  # -> numbers, strings; plug-in component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
strnum_2 = Ladybug_SeparateData(inputList=flatten(readepresult.heating))  # -> numbers, strings; plug-in component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
strnum_3 = Ladybug_SeparateData(inputList=flatten(readepresult_2.cooling))  # -> numbers, strings; plug-in component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
strnum_4 = Ladybug_SeparateData(inputList=flatten(readepresult_2.heating))  # -> numbers, strings; plug-in component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
ma = MassAddition(Input=flatten(strnum.numbers))  # -> Result, PartialResults
ma_2 = MassAddition(Input=strnum_2.numbers)  # -> Result, PartialResults
ma_3 = MassAddition(Input=strnum_3.numbers)  # -> Result, PartialResults
ma_4 = MassAddition(Input=strnum_4.numbers)  # -> Result, PartialResults
panel_9 = Panel(ma.Result)
panel_10 = Panel(ma_2.Result)
panel_12 = Panel(ma_4.Result)
panel_13 = Panel(ma_3.Result)

panel_15 = Panel("""1
0
0
0
0
0""")
cvbiquadratic = Ironbug_CurveBiquadratic(Coefficients=panel_15)
objparams_9 = Ironbug_ObjParams(EfficiencyCurveTemperatureEvaluationVariable="LeavingBoiler", NormalizedBoilerEfficiencyCurve=cvbiquadratic)

objparams_10 = Ironbug_ObjParams(PressureRise="300")
fanconstant_2 = Ironbug_FanConstantVolume(Parameters=objparams_10)

timer = Timer(TimerInterval=1000)
list = ValueList({"One": 1, "Two": 2, "Three": 2² - 1, "Four": Sqrt(16)}, selected="One")
knob = ControlKnob(Decimals=2, Limit=True, Maximum=10, Minimum=0, Range=1, Value=1.03)
digit_scroller = DigitScroller(Scroller_Digits=12, Scroller_Radix=9, Scroller_Value=0.25)
item = CherryPicker(ListIndex=0)
gradient = Gradient(LowerLimit=0, UpperLimit=1, stops=[0.15: RGB(255, 130, 160), 0.85: RGB(220, 0, 40)])
dam = DataDam(BufferDelay=10000000, BufferMode=0)
nblur = BlurNumbers(Strength=0.5, Iterations=1, Lock=True, Wrap=False)
hvactemplate = Ironbug_HVACTemplate(_run=Button())
list_2 = ValueList({"One": 1, "Two": 2, "Three": 2² - 1, "Four": Sqrt(16)}, selected="One")

# ----
# PTAC
coilhw_5 = Ironbug_CoilHeatingWater()  # -> AirSide_CoilHeatingWater, WaterSide_CoilHeatingWater
ptac = Ironbug_ZoneHVACPackagedTerminalAirConditioner(HeatingCoil=coilhw_5.AirSide_CoilHeatingWater, Fan_=fanconstant)

# ----
# HBZones
data_2 = Data(flatten(glazingcreator.HBObjWGLZ))

lng = ListLength(List=data_2)
thermalzone_3 = Ironbug_ThermalZone(HoneybeeZone=data_2, ZoneEquipments=ptac)

noairloop = Ironbug_NoAirLoop(OSZones=thermalzone_3)

lng_2 = ListLength(List=flatten(noairloop))
lng_3 = ListLength(List=flatten(thermalzone_3))
rec = DataRecorder(lng_2, DataLimit=-10, RecordData=True)
rec_2 = DataRecorder(lng_3, DataLimit=-10, RecordData=True)
panel_16 = Panel(rec)
panel_17 = Panel(rec_2)

# ----
# Hot water loop
boilerhw_3 = Ironbug_BoilerHotWater()
pumpvariable_5 = Ironbug_PumpVariableSpeed()
branches_11 = PlantBranches(Branch1=boilerhw_3)
branches_12 = PlantBranches(Branch1=coilhw_5.WaterSide_CoilHeatingWater)

spscheduled_6 = Ironbug_SetpointManagerScheduled(Temperature="67")

hwloop_3 = Ironbug_HotWaterPlantLoop(Supply=[pumpvariable_5, branches_11, spscheduled_6], Demand=branches_12)

hvacsystem_4 = Ironbug_HVACSystem(AirLoops=flatten(noairloop), PlantLoops=flatten(hwloop_3))

lng_4 = ListLength(List=hvacsystem_4)
lng_5 = ListLength(List=branches_12)
dam_2 = DataDam(DataA=hvacsystem_4, BufferDelay=10000000, BufferMode=0)  # disabled
rec_3 = DataRecorder(lng_4, DataLimit=-10, RecordData=True)
rec_4 = DataRecorder(lng_5, DataLimit=-10, RecordData=True)
panel_18 = Panel(rec_3)
rec_5 = DataRecorder(dam_2, DataLimit=-10, RecordData=True)  # disabled
panel_19 = Panel(rec_4)
panel_20 = Panel(rec_5)  # disabled

# ----
# PTHP
pthp = Ironbug_ZoneHVACPackagedTerminalHeatPump()

# ----
# HBZones
data_3 = Data()

thermalzone_4 = Ironbug_ThermalZone(HoneybeeZone=data_3, ZoneEquipments=pthp)
noairloop_2 = Ironbug_NoAirLoop(OSZones=thermalzone_4)

hvacsystem_5 = Ironbug_HVACSystem(AirLoops=flatten(noairloop_2))
