# Grasshopper definition OA Streams with SetPointManagers and Probes.gh (Grasshopper 1.0.7)
# plug-ins: Ironbug.Grasshopper

outputparams = Ironbug_OutputParams(SystemNodeTemperature=Toggle(True))
outputparams_2 = Ironbug_OutputParams(SystemNodeTemperature=Toggle(True))
outputparams_3 = Ironbug_OutputParams(SystemNodeTemperature=Toggle(True))
objparams = Ironbug_ObjParams(Name="p1", DataFieldSetType="Ironbug.HVAC.IB_Probe_FieldSet")
objparams_2 = Ironbug_ObjParams(Name="AfterCoil", DataFieldSetType="Ironbug.HVAC.IB_Probe_FieldSet")
objparams_3 = Ironbug_ObjParams(Name="p6", DataFieldSetType="Ironbug.HVAC.IB_Probe_FieldSet")
objparams_4 = Ironbug_ObjParams(Name="OA1", DataFieldSetType="Ironbug.HVAC.IB_Probe_FieldSet")
objparams_5 = Ironbug_ObjParams(Name="OA_AfterCoil", DataFieldSetType="Ironbug.HVAC.IB_Probe_FieldSet")
objparams_6 = Ironbug_ObjParams(Name="OA6", DataFieldSetType="Ironbug.HVAC.IB_Probe_FieldSet")
probe = Ironbug_Probe(Parameters_=[objparams, outputparams_2])
probe_2 = Ironbug_Probe(Parameters_=objparams_2)
coilclndx1 = Ironbug_CoilCoolingDXSingleSpeed()
fanvariable = Ironbug_FanVariableVolume()
spm_scheduled = Ironbug_SetpointManagerScheduled(Temperature="4")
spm_scheduled_2 = Ironbug_SetpointManagerScheduled(Temperature="6")
spm_scheduled_3 = Ironbug_SetpointManagerScheduled(Temperature="1")
probe_3 = Ironbug_Probe(Parameters_=objparams_3)
fanconstant = Ironbug_FanConstantVolume()
probe_4 = Ironbug_Probe(Parameters_=objparams_4)
probe_5 = Ironbug_Probe(Parameters_=[objparams_5, outputparams])
coilclndx1_2 = Ironbug_CoilCoolingDXSingleSpeed()
fanvariable_2 = Ironbug_FanVariableVolume()
spm_scheduled_4 = Ironbug_SetpointManagerScheduled(Temperature="14")
spm_scheduled_5 = Ironbug_SetpointManagerScheduled(Temperature="16")
spm_scheduled_6 = Ironbug_SetpointManagerScheduled(Temperature="11")
probe_6 = Ironbug_Probe(Parameters_=[objparams_6, outputparams_3])
fanconstant_2 = Ironbug_FanConstantVolume()
heatexchanger_air = Ironbug_HeatExchangerAirToAirSensibleAndLatent()
merge = Merge(
    Data1=probe,
    Data2=spm_scheduled_3,
    Data3=coilclndx1,
    Data4=probe_2,
    Data5=fanvariable,
    Data6=spm_scheduled,
    Data7=fanconstant,
    Data8=spm_scheduled_2,
    Data9=probe_3)
merge_2 = Merge(
    Data1=probe_4,
    Data2=spm_scheduled_6,
    Data3=coilclndx1_2,
    Data4=probe_5,
    Data5=fanvariable_2,
    Data6=heatexchanger_air,
    Data7=spm_scheduled_4,
    Data8=fanconstant_2,
    Data9=spm_scheduled_5,
    Data10=probe_6)
heatexchanger_air_2 = Ironbug_HeatExchangerAirToAirSensibleAndLatent()
oasystem = Ironbug_OutdoorAirSystem(ExhaustStream=merge, HeatRecovery_=heatexchanger_air_2, IntakeStream=merge_2)
fanvariable_3 = Ironbug_FanVariableVolume()
airloop = Ironbug_AirLoopHVAC(Supply=[oasystem, fanvariable_3])
heatexchanger_air_3 = Ironbug_HeatExchangerAirToAirSensibleAndLatent()
savetofile = Ironbug_SaveToFile(NewFilePath="C:\Users\mingo\OneDrive\Desktop\de\de.osm", AirLoops=flatten(airloop), _write=Toggle(False))
