# Grasshopper definition pyObj2CSharp.gh (Grasshopper 0.9.76)
# plug-ins: Python Interpreter, Ironbug

panel = Panel("C:\ladybug\Beijing_Beijing_CHN\Beijing_Beijing_CHN.epw")
path = FilePath("C:\ladybug\Beijing_Beijing_CHN\Beijing_Beijing_CHN.epw")
# C# Component
nickname = MyComponent1(Epw=panel)
# Python Script
python = PythonScript(x=panel)  # -> out, a
# ---------- python: Python ----------
from ladybug.wea import Wea

a = Wea.from_epw_file(x);
# ---------- end python ----------
# C# Script
c_script = CSharpScript(Reference="C:\Users\Mingbo\Documents\GitHub\Ironbug\src\Ironbug.Grasshopper\bin\Ironbug.Core.dll")  # -> out, A, B
# ---------- c_script: C# ----------
    var wea = new Wea();
    var w = wea.From_EpwFile(x);
    A = w;
    B = w.getRawObj();
# ---------- end c_script ----------
# C# Component
nickname_2 = ReadPyObj(Wea=nickname)  # -> Header, WeaC
# C# Script
c_script_2 = CSharpScript(x=python.a, Reference="C:\Users\Mingbo\Documents\GitHub\Ironbug\src\Ironbug.Grasshopper\bin\Ironbug.Core.dll")  # -> out, weaObj, weaPyObj
# ---------- c_script_2: C# ----------
    var obj = new Wea(x);
    weaObj = obj;
    weaPyObj = obj.getRawObj();
# ---------- end c_script_2 ----------
# Python Script
python_2 = PythonScript(x=c_script_2.weaObj)  # -> out, Header
# ---------- python_2: Python ----------
Header = x.Header
# ---------- end python_2 ----------
panel_2 = Panel(python_2.Header)
panel_3 = Panel(c_script_2.weaObj)
panel_4 = Panel(c_script_2.weaPyObj)
python_3 = PythonScript()  # -> out, a
# ---------- python_3: Python ----------
a = x.Header
# ---------- end python_3 ----------

# ---- group: type
python_4 = PythonScript()  # -> out, a
# ---------- python_4: Python ----------
a = type(x)
# ---------- end python_4 ----------
