# Grasshopper definition readAnnualResultIII.gh (Grasshopper 0.9.76)
# plug-ins: Python Interpreter, Ironbug

honeybee = Honeybee_Honeybee()  # -> Vviiiiiiiiiizzz; plug-in component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
ladybug = Ladybug_Ladybug()  # -> Vviiiiiiiiiizzz; plug-in component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
number_slider = Slider(10, range=0..10)
toggle = BooleanToggle(True)
box = DomainBox(Base=PlaneXY(0, 0, 0), X=number_slider, Y=number_slider, Z=Slider(3, range=0..10))
path = FilePath("C:\EnergyPlusV8-6-0\WeatherData\USA_CA_San.Francisco.Intl.AP.724940_TMY3.epw")
mass2zone = Honeybee_Masses2Zones(zoneMasses=flatten(box), isConditioned=True, maxRoofAngle=30, createHBZones=toggle)  # -> readMe, HBZones; plug-in component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
panel = Panel("""0
0
0.5
0""")
glazingcreator = Honeybee_GlazingBasedOnRatio(HBObjects=mass2zone.HBZones, glzRatio=panel, runIt=toggle)  # -> readMe, HBObjWGLZ; plug-in component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
wires = BrepWireframe(Brep=glazingcreator.HBObjWGLZ, Density=-1)
genhbzonetestpts = Honeybee_GenerateZoneTestPoints(
    HBZone=glazingcreator.HBObjWGLZ,
    gridSize=Slider(0.3, range=0..1),
    distBaseSrf=Slider(0.75, range=0..1),
    moveTestMesh=True)  # -> readMe, simplify(testPoints), simplify(ptsVectors), simplify(facesArea), simplify(mesh); plug-in component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
annualdaylightsimulation = Honeybee_AnnualDaylightSimulation(epwWeatherFile=path, testPoints=genhbzonetestpts.testPoints)  # -> analysisRecipe; plug-in component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
toggle_2 = BooleanToggle(False)
rundaylightanalysis = Honeybee_RunDaylightSimulation(
    HBObjects=flatten(glazingcreator.HBObjWGLZ),
    analysisRecipe=annualdaylightsimulation,
    writeRad=toggle_2,
    runRad=toggle_2,
    numOfCPUs=6,
    overwriteResults=True)  # -> readMe, analysisType, resultsUnit, results, testPts, resultFiles, radGeoFile, studyFolder, done; plug-in component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
pt = Point(genhbzonetestpts.testPoints)
data = Data(["c:\ladybug\unnamed\annualSimulation\unnamed_0.ill", "c:\ladybug\unnamed\annualSimulation\unnamed_1.ill", "c:\ladybug\unnamed\annualSimulation\unnamed_2.ill", "c:\ladybug\unnamed\annualSimulation\unnamed_3.ill", "c:\ladybug\unnamed\annualSimulation\unnamed_4.ill", "c:\ladybug\unnamed\annualSimulation\unnamed_5.ill"])
series = Series(Start=8, Step=1, Count=9)
panel_2 = Panel(series)
# read Annual Results I (8.2s)
readannualresultsi = Honeybee_ReadAnnualResultI(illFilesAddress=data, testPoints=simplify(pt), DLAIllumThresholds=300, runIt=Toggle(True))  # -> DLA, UDLI_Less_100, UDLI_100_2000, UDLI_More_2000, CDA, sDA, annualProfiles, htmReport; plug-in component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
# read Annual Results III (0.9s)
readannualresultsiii = CSharpScript(resultFilesAddress=data, minThreshold=300, maxThreshold=0)  # -> out, lessThanRange, inTheRange, moreThanRange; inputs resultFilesAddress: list of String, minThreshold: Double, maxThreshold: Double
# ---------- readannualresultsiii: C# ----------
    List < string > lines = new List<string>{};
    int ptsNumbers = 0;
    double min = minThreshold;
    double max = maxThreshold;

    var underT = new List<int>{};
    var withinT = new List<int>{};
    var aboveT = new List<int>{};

    var underTPercent = new List<double>{};
    var withinTPercent = new List<double>{};
    var aboveTPercent = new List<double>{};

    double oneHrToPercent = 1 / 32.85;


    double infinity = 1.0 / 0.0;
    if(max == 0)max = infinity;



    for(int f = 0; f < resultFilesAddress.Count; f++){
      lines = File.ReadAllLines(resultFilesAddress[f], System.Text.Encoding.GetEncoding(1252)).ToList();

      int catecount = lines[0].Split(' ').Length - 4;


      for(int i = 0; i < catecount; i++){
        //underT.Add(0);
        //withinT.Add(0);
        //aboveT.Add(0);
        underTPercent.Add(0);
        withinTPercent.Add(0);
        aboveTPercent.Add(0);
      }

      for(int i = 0; i < 8760; i++){
        string [] items = lines[i].Split(' ');
        //A = items;
        var hr = Convert.ToDouble(items[2]);

        if(hr >= 8 && hr < 17){

          for(int l = 0; l < catecount; l++){
            int item = Convert.ToInt32(items[l + 4]);
            int ptsIndex = l + ptsNumbers;

            if(item < min){
              //underT[ptsIndex] += 1;
              underTPercent[ptsIndex] += oneHrToPercent;
            }else if(item > max){
              //aboveT[ptsIndex] += 1;
              aboveTPercent[ptsIndex] += oneHrToPercent;
            }else{
              //withinT[ptsIndex] += 1;
              withinTPercent[ptsIndex] += oneHrToPercent;
            }
          }

        }
      }

      ptsNumbers += catecount;


    }



//
//    var nums = Enumerable.Range(0, ptsNumbers);
//    var queryUnder = from i in nums.AsParallel().AsOrdered()
//        select (underT[i] / 32.85);
//    var queryWithin = from i in nums.AsParallel().AsOrdered()
//        select (withinT[i] / 32.85);
//    var queryAbove = from i in nums.AsParallel().AsOrdered()
 //       select (aboveT[i] / 32.85);

//    queryUnder.ToList().ForEach(i => underTPercent.Add(i));
//    queryWithin.ToList().ForEach(i => withinTPercent.Add(i));
//    queryAbove.ToList().ForEach(i => aboveTPercent.Add(i));



    lessThanRange = underTPercent;
    inTheRange = withinTPercent;
    moreThanRange = aboveTPercent;
# ---------- end readannualresultsiii ----------
# read Annual Results II (31.5s)
readannualresultsii = Honeybee_ReadAnnualResultII(resultFilesAddress=data, testPts=pt, timeStep=1, runIt=Toggle(True))  # -> readMe, lessThanRange, inTheRange, moreThanRange; plug-in component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
readannualresultsiii_2 = Honeybee_ReadAnnualResultsIII(_illFilesAddress=data, _workingHours_=series, MinThreshold=300, MaxThreshold=0)  # -> DA_lessThanRange, DA_inTheRange, DA_moreThanRange, CDA
legendpar = Ladybug_LegendParameters(highBound=100)  # -> legendPar; plug-in component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
recolormesh = Ladybug_RecolorMesh(analysisResult=readannualresultsiii.inTheRange, inputMesh=genhbzonetestpts.mesh, legendPar=legendpar)  # -> readMe, newMesh, newLegend, legendBasePt, meshColors, legendColors; plug-in component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
mesh = Mesh([recolormesh.newMesh, recolormesh.newLegend])
