# Grasshopper definition 01_Heating_SingleUnitarySystem.gh (Grasshopper 1.0.7)
# plug-ins: LadybugGrasshopper, Ironbug.Grasshopper

panel = Panel("""0
1
1
1
0
0
0
0
0
0
0
0
0
0
0
0
0
0
0
0
0
0
0
0""")
schedule = IB_Schedule(ValuesOrRules=panel)

# ----
# FanSystemModel (Zone Equipment Fan)
panel_2 = Panel("TotalEfficiencyAndPressure")
objparams = IB_ObjParams(
    DesignPowerSizingMethod=panel_2,
    DesignPressureRise="75",
    ElectricPowerMinimumFlowRateFraction="0",
    FanTotalEfficiency="0.5",
    MotorEfficiency="0.9",
    Name="Zone Equipment Fan",
    SpeedControlMethod="Discrete",
    DataFieldSetType="Ironbug.HVAC.IB_FanSystemModel_FieldSet")

toggle = BooleanToggle(True)
outputparams = IB_OutputParams(FanElectricityEnergy=toggle, outputFrequency=1)
outputparams_2 = IB_OutputParams(HeatingCoilElectricityEnergy=toggle, outputFrequency=1)
# Rhino Unit: Meter
brep = Brep(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)
falsestart = LBFalseStartToggle(False)
epw_url = Panel("https://climate.onebuilding.org/WMO_Region_4_North_and_Central_America/USA_United_States_of_America/NY_New_York/USA_NY_New.York-Downtown.Manhattan.Heli.720553_TMYx.zip")
roomsolid = HBRoomFromSolid(geo=flatten(brep), conditioned=True)  # -> report, rooms; plug-in component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
objparams_2 = IB_ObjParams(MaximumSupplyAirTemperature="60", DataFieldSetType="Ironbug.HVAC.IB_AirLoopHVACUnitarySystem_FieldSet")
epwmap = LBEPWmap(epw_map=falsestart)  # -> report; plug-in component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
objparams_3 = IB_ObjParams(MaximumSupplyAirTemperature="60", DataFieldSetType="Ironbug.HVAC.IB_AirLoopHVACUnitarySystem_FieldSet")
thermalzone = IB_ThermalZone(_HBRooms=roomsolid.rooms, IsAirTerminalPriorToZoneEquipments=True, allowMultiAirloops=False, dupNum=False)
fansysmodel = IB_FanSystemModel(Parameters_=[outputparams, objparams], dupNum=False)
coilhtnelec = IB_CoilHeatingElectric(Parameters_=outputparams_2, dupNum=False)
panel_3 = Panel([outputparams, outputparams_2])
objparams_4 = IB_ObjParams(
    AllOutdoorAirinHeating=Toggle(False),
    CentralHeatingDesignSupplyAirTemperature="60",
    CentralHeatingMaximumSystemAirFlowRatio="1",
    DesignOutdoorAirFlowRate="0",
    TypeofLoadtoSizeOn="Sensible",
    DataFieldSetType="Ironbug.HVAC.IB_SizingSystem_FieldSet")
# 1. UnitHeater as a zone equipment
unitheater = IB_ZoneHVACUnitHeater(HeatingCoil=coilhtnelec, Fan_=fansysmodel, dupNum=False)
# 2. Unitary System as a zone equipment
unitarysystem = IB_AirLoopHVACUnitarySystem(HeatingCoil=coilhtnelec, Fan_=fansysmodel, ControllingZone=thermalzone, Parameters_=objparams_2, dupNum=False)
downloadepw = LBDownloadWeather(weather_URL=epw_url)  # -> epw_file, stat_file, ddy_file; plug-in component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
# 2. Unitary System as an air loop object
unitarysystem_2 = IB_AirLoopHVACUnitarySystem(HeatingCoil=coilhtnelec, Fan_=fansysmodel, ControllingZone=thermalzone, Parameters_=objparams_3, dupNum=False)
thermalzone_2 = IB_ThermalZone(
    _HBRooms=roomsolid.rooms,
    ZoneEquipments_=unitheater,
    IsAirTerminalPriorToZoneEquipments=True,
    allowMultiAirloops=False,
    dupNum=False)
airloopbranches = IB_AirLoopBranches(Branch1=thermalzone)
sizingsystem = IB_SizingSystem(Parameters_=objparams_4, dupNum=False)
noairloop = IB_NoAirLoop(OSZones=thermalzone_2)
airloop = IB_AirLoopHVAC(_supply=unitarysystem_2, _demand=airloopbranches, SizingSystem=sizingsystem, dupNum=False)
hvacsystem = IB_HVACSystem(AirLoops=flatten(noairloop))
hvacsystem_2 = IB_HVACSystem(AirLoops=flatten(airloop))
detailedhvac = HBDetailedHVAC(hb_objs=flatten(roomsolid.rooms), hvac_system=hvacsystem_2)  # -> report, hb_objs; plug-in component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
panel_4 = Panel("""Zone Heating Setpoint Not Met Time
Zone Cooling Setpoint Not Met Time""")
simoutput = HBSimulationOutput(comfort_metrics=Toggle(True))  # -> report, sim_output; plug-in component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
merge = Merge(Data1=panel_4, Data2=panel_3)
customoutput = HBCustomSimulationOutput(base_sim_output=simoutput.sim_output, output_names=panel_4)  # -> report, sim_output; plug-in component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
model = HBModel(rooms=flatten(detailedhvac.hb_objs))  # -> report, model; plug-in component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
panel_5 = Panel(merge)
simpar = HBSimulationParameter(output=customoutput.sim_output, timestep=6)  # -> sim_par; plug-in component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
toggle_2 = BooleanToggle(False)
modeltoosm = HBModelToOSM(model=model.model, epw_file=downloadepw.epw_file, sim_par=simpar, write=toggle_2, run=toggle_2)  # -> report, jsons, osw, osm, idf, sql, zsz, rdd, html; plug-in component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
panel_6 = Panel(modeltoosm.html)
panel_7 = Panel(modeltoosm.report)
eui = HBEndUseIntensity(sql=modeltoosm.sql)  # -> eui, eui_end_use, end_uses, gross_floor; plug-in component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
customresult = HBReadCustomResult(sql=modeltoosm.sql, output_names=merge)  # -> results; plug-in component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
roomcomfortresult = HBReadRoomComfortResult(sql=modeltoosm.sql)  # -> oper_temp, air_temp, rad_temp, rel_humidity; plug-in component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
panel_8 = Panel(eui.eui)
panel_9 = Panel(eui.end_uses)
panel_10 = Panel(eui.eui_end_use)
merge_2 = Merge(Data1=flatten(roomcomfortresult.air_temp), Data2=flatten(customresult))
hourlyplot = LBHourlyPlot(data=flatten(merge_2))  # -> report, mesh, legend, borders, labels, title, vis_set; plug-in component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
