# Grasshopper definition 01_Heating_before.gh (Grasshopper 1.0.7)
# plug-ins: LadybugGrasshopper

# Rhino Unit: Meter
brep = Brep(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)
# EPW URL: https://climate.onebuilding.org/WMO_Region_4_North_and_Central_America/USA_United_States_of_America/NY_New_York/USA_NY_New.York-Downtown.Manhattan.Heli.720553_TMYx.zip
falsestart = LBFalseStartToggle(False)
roomsolid = HBRoomFromSolid(geo=flatten(brep), conditioned=True)  # -> report, rooms; plug-in component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
epwmap = LBEPWmap(epw_map=falsestart)  # -> report; plug-in component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
