# Grasshopper definition 02_Heating_MultiZoneSystem.gh (Grasshopper 1.0.7)
# plug-ins: Ironbug.Grasshopper, LadybugGrasshopper

panel = Panel("""0
1
1
1
0
0
0
0
0
0
0
0
0
0
0
0
0
0
0
0
0
0
0
0""")

# ----
# FanSystemModel VAV
panel_2 = Panel("""0.0407598940
0.08804497
-0.072926120
0.9437398230
0.0""")
curvequartic = IB_CurveQuartic(Coefficients=panel_2, dupNum=False)
objparams = IB_ObjParams(
    DesignPowerSizingMethod="TotalEfficiencyAndPressure",
    DesignPressureRise="1017.6",
    ElectricPowerFunctionofFlowFractionCurve=curvequartic,
    ElectricPowerMinimumFlowRateFraction="0",
    FanTotalEfficiency="0.6045",
    MotorEfficiency="0.93",
    Name="Fan VAV",
    SpeedControlMethod="Continuous",
    DataFieldSetType="Ironbug.HVAC.IB_FanSystemModel_FieldSet")

schedule = IB_Schedule(ValuesOrRules=panel)

# ----
# FanSystemModel (Zone Equipment Fan)
panel_3 = Panel("TotalEfficiencyAndPressure")
objparams_2 = IB_ObjParams(
    DesignPowerSizingMethod=panel_3,
    DesignPressureRise="75",
    ElectricPowerMinimumFlowRateFraction="0",
    FanTotalEfficiency="0.5",
    MotorEfficiency="0.9",
    Name="Zone Equipment Fan",
    SpeedControlMethod="Discrete",
    DataFieldSetType="Ironbug.HVAC.IB_FanSystemModel_FieldSet")

diffuser = IB_AirTerminalSingleDuctConstantVolumeNoReheat(dupNum=False)
diffuser_2 = IB_AirTerminalSingleDuctConstantVolumeNoReheat(dupNum=False)
toggle = BooleanToggle(True)
toggle_2 = BooleanToggle(True)
falsestart = LBFalseStartToggle(False)
epw_url = Panel("https://climate.onebuilding.org/WMO_Region_4_North_and_Central_America/USA_United_States_of_America/NY_New_York/USA_NY_New.York-Downtown.Manhattan.Heli.720553_TMYx.zip")
recgrid = Rectangular(Plane=PlaneXY(0, 0, 0), SizeX="10", SizeY="20", ExtentX="1", ExtentY="1")  # -> Cells, Points
# Rhino Unit: Meter
brep = Brep([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])
outputparams = IB_OutputParams(FanElectricityEnergy=toggle, outputFrequency=1)
outputparams_2 = IB_OutputParams(HeatingCoilElectricityEnergy=toggle, outputFrequency=1)
outputparams_3 = IB_OutputParams(FanElectricityEnergy=toggle_2, outputFrequency=1)
outputparams_4 = IB_OutputParams(HeatingCoilElectricityEnergy=toggle_2, outputFrequency=1)
epwmap = LBEPWmap(epw_map=falsestart)  # -> report; plug-in component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
move = Move(Geometry=brep, Motion=graft(recgrid.Points))  # -> flatten(Geometry), Transform
objparams_3 = IB_ObjParams(MaximumSupplyAirTemperature="60", DataFieldSetType="Ironbug.HVAC.IB_AirLoopHVACUnitarySystem_FieldSet")
toggle_3 = BooleanToggle(False)
objparams_4 = IB_ObjParams(
    Temperature="23",
    DataFieldSetType="Ironbug.HVAC.AvailabilityManager.IB_AvailabilityManagerHighTemperatureTurnOff_FieldSet")
toggle_4 = BooleanToggle(False)
roomsolid = HBRoomFromSolid(geo=flatten(move.Geometry), conditioned=True)  # -> report, rooms; plug-in component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
objparams_5 = IB_ObjParams(
    AllOutdoorAirinCooling=toggle_3,
    AllOutdoorAirinHeating=toggle_3,
    CentralHeatingDesignSupplyAirTemperature="60",
    CentralHeatingMaximumSystemAirFlowRatio="1",
    DesignOutdoorAirFlowRate="0",
    TypeofLoadtoSizeOn="Sensible",
    DataFieldSetType="Ironbug.HVAC.IB_SizingSystem_FieldSet")
panel_4 = Panel([outputparams_4, outputparams_3])
# 2. Unitary System as an air loop object
fansysmodel = IB_FanSystemModel(Parameters_=[outputparams, objparams_2], dupNum=False)
coilhtnelec = IB_CoilHeatingElectric(Parameters_=outputparams_2, dupNum=False)
objparams_6 = IB_ObjParams(
    AllOutdoorAirinCooling=toggle_4,
    AllOutdoorAirinHeating=toggle_4,
    CentralHeatingDesignSupplyAirTemperature="60",
    CentralHeatingMaximumSystemAirFlowRatio="1",
    DesignOutdoorAirFlowRate="0",
    TypeofLoadtoSizeOn="Sensible",
    DataFieldSetType="Ironbug.HVAC.IB_SizingSystem_FieldSet")
nodeprobe = IB_NodeProbe(dupNum=False)
am_highoff = IB_AvailabilityManagerHighTemperatureTurnOff(SensorProbe=nodeprobe, Parameters_=objparams_4, dupNum=False)
downloadepw = LBDownloadWeather(weather_URL=epw_url)  # -> epw_file, stat_file, ddy_file; plug-in component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
coilhtnelec_2 = IB_CoilHeatingElectric(Parameters_=outputparams_4, dupNum=False)
spm_scheduled = IB_SetpointManagerScheduled(Value="60", ControlVariable="Temperature", dupNum=False)
fansysmodel_2 = IB_FanSystemModel(Parameters_=[outputparams_3, objparams], dupNum=False)
spm_htnavg = IB_SetpointManagerMultiZoneHeatingAverage(MaximumSetpointTemperature="60", dupNum=False)
roomattr = HBRoomAttributes({"Display Name": "display_name", "Simulation Name (Identifier)": "identifier", "Multiplier": "multiplier", "Floor Area Excluded": "exclude_floor_area", "Story": "story", "Volume": "volume", "Gross Floor Area": "floor_area", "Exposed Area": "exposed_area", "Exterior Wall Area": "exterior_wall_area", "Exterior Aperture Area": "exterior_aperture_area", "Average Floor Elevation": "average_floor_height"}, selected="Display Name")
solveadj = HBSolveAdjacency(rooms=flatten(roomsolid.rooms), run=Toggle(True))  # -> report, adj_rooms; plug-in component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
lng = ListLength(List=solveadj.adj_rooms)
lng_2 = ListLength(List=solveadj.adj_rooms)
panel_5 = Panel(lng)
panel_6 = Panel(lng_2)
diffuser_3 = IB_AirTerminalSingleDuctConstantVolumeNoReheat(DuplicateNumber_=panel_5, dupNum=True)
duplicate = IB_Duplicate(Reference=diffuser, Amount=panel_5)  # -> Objects, graft(port)
diffuser_4 = IB_AirTerminalSingleDuctConstantVolumeNoReheat(DuplicateNumber_=panel_6, dupNum=True)
duplicate_2 = IB_Duplicate(Reference=diffuser_2, Amount=panel_6)  # -> Objects, graft(port)
thermalzone = IB_ThermalZone(
    _HBRooms=solveadj.adj_rooms,
    AirTerminals_=diffuser_3,
    IsAirTerminalPriorToZoneEquipments=True,
    allowMultiAirloops=False,
    dupNum=False)
thermalzone_2 = IB_ThermalZone(
    _HBRooms=solveadj.adj_rooms,
    AirTerminals_=diffuser_4,
    IsAirTerminalPriorToZoneEquipments=True,
    allowMultiAirloops=False,
    dupNum=False)
item = ListItem(List=thermalzone, Index=0, Wrap=True)
objparams_7 = IB_ObjParams(AvailabilityManagers=am_highoff, DataFieldSetType="Ironbug.HVAC.IB_AirLoopHVAC_FieldSet")
unitarysystem = IB_AirLoopHVACUnitarySystem(HeatingCoil=coilhtnelec, Fan_=fansysmodel, ControllingZone=item, Parameters_=objparams_3, dupNum=False)
airloopbranches = IB_AirLoopBranches(Branch1=thermalzone)
airloopbranches_2 = IB_AirLoopBranches(Branch1=thermalzone_2)
merge = Merge(Data1=nodeprobe, Data2=coilhtnelec_2, Data3=fansysmodel_2, Data4=spm_htnavg)
sizingsystem = IB_SizingSystem(Parameters_=objparams_5, dupNum=False)
sizingsystem_2 = IB_SizingSystem(Parameters_=objparams_6, dupNum=False)
airloop = IB_AirLoopHVAC(_supply=unitarysystem, _demand=airloopbranches, SizingSystem=sizingsystem, dupNum=False)
airloop_2 = IB_AirLoopHVAC(_supply=merge, _demand=airloopbranches_2, SizingSystem=sizingsystem_2, Parameters_=objparams_7, dupNum=False)
hvacsystem = IB_HVACSystem(AirLoops=flatten(airloop))
hvacsystem_2 = IB_HVACSystem(AirLoops=flatten(airloop_2))
colorroomattr = HBColorRoomAttributes(rooms_model=flatten(solveadj.adj_rooms), attribute=roomattr)  # -> mesh, legend, wire_frame, values, colors, vis_set; plug-in component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
lng_3 = ListLength(List=airloop)
lng_4 = ListLength(List=airloop_2)
panel_7 = Panel(lng_3)
panel_8 = Panel("""Zone Heating Setpoint Not Met Time
Zone Cooling Setpoint Not Met Time""")
detailedhvac = HBDetailedHVAC(hb_objs=flatten(solveadj.adj_rooms), hvac_system=hvacsystem_2)  # -> report, hb_objs; plug-in component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
simoutput = HBSimulationOutput(comfort_metrics=Toggle(True))  # -> report, sim_output; plug-in component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
merge_2 = Merge(Data1=panel_8, Data2=panel_4)
customoutput = HBCustomSimulationOutput(base_sim_output=simoutput.sim_output, output_names=panel_8)  # -> report, sim_output; plug-in component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
model = HBModel(rooms=flatten(detailedhvac.hb_objs))  # -> report, model; plug-in component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
panel_9 = Panel(merge_2)
simpar = HBSimulationParameter(output=customoutput.sim_output, timestep=6)  # -> sim_par; plug-in component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
toggle_5 = BooleanToggle(False)
modeltoosm = HBModelToOSM(model=model.model, epw_file=downloadepw.epw_file, sim_par=simpar, write=toggle_5, run=toggle_5)  # -> report, jsons, osw, osm, idf, sql, zsz, rdd, html; plug-in component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
panel_10 = Panel(modeltoosm.html)
panel_11 = Panel(modeltoosm.report)
eui = HBEndUseIntensity(sql=modeltoosm.sql)  # -> eui, eui_end_use, end_uses, gross_floor; plug-in component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
customresult = HBReadCustomResult(sql=modeltoosm.sql, output_names=merge_2)  # -> results; plug-in component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
roomcomfortresult = HBReadRoomComfortResult(sql=modeltoosm.sql)  # -> oper_temp, air_temp, rad_temp, rel_humidity; plug-in component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
panel_12 = Panel(eui.eui)
panel_13 = Panel(eui.end_uses)
panel_14 = Panel(eui.eui_end_use)
merge_3 = Merge(Data1=flatten(roomcomfortresult.air_temp), Data2=flatten(customresult))
hourlyplot = LBHourlyPlot(data=flatten(merge_3))  # -> report, mesh, legend, borders, labels, title, vis_set; plug-in component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
