# Grasshopper definition 02_Heating_before.gh (Grasshopper 1.0.7)

recgrid = Rectangular(Plane=PlaneXY(0, 0, 0), SizeX="10", SizeY="20", ExtentX="9", ExtentY="9")  # -> Cells, Points
brep = Brep([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])
move = Move(Geometry=brep, Motion=graft(recgrid.Points))  # -> flatten(Geometry), Transform
roomsolid = HBRoomFromSolid(geo=flatten(move.Geometry), conditioned=True)  # -> report, rooms; plug-in component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
solveadj = HBSolveAdjacency(rooms=flatten(roomsolid.rooms), run=Toggle(True))  # -> report, adj_rooms; plug-in component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
