# Grasshopper definition 03_Heating_Baseboard.gh (Grasshopper 1.0.7)
# plug-ins: LadybugGrasshopper, Ironbug.Grasshopper

panel = Panel("""1.124970374
    0.014963852
   -0.02599835
    0.0
   -1.40464E-6
   -0.00153624""")
supply_hot_water_tempertature_c = Panel("80")
objparams = IB_ObjParams(
    MaximumValueofx="1",
    MaximumValueofy="85",
    MinimumValueofx="0.1",
    MinimumValueofy="30",
    DataFieldSetType="Ironbug.HVAC.Curves.IB_CurveBiquadratic_FieldSet")
toggle = BooleanToggle(True)
curvebiquadratic = IB_CurveBiquadratic(Coefficients=panel, Parameters_=objparams, dupNum=False)
outputparams = IB_OutputParams(BoilerHeatingRate=toggle, BoilerNaturalGasRate=toggle, outputFrequency=1)
objparams_2 = IB_ObjParams(
    BoilerFlowMode="LeavingSetpointModulated",
    EfficiencyCurveTemperatureEvaluationVariable="EnteringBoiler",
    Name="Condensing Boiler",
    NominalThermalEfficiency="0.89",
    NormalizedBoilerEfficiencyCurve=curvebiquadratic,
    ParasiticElectricLoad="25",
    WaterOutletUpperTemperatureLimit=supply_hot_water_tempertature_c,
    DataFieldSetType="Ironbug.HVAC.IB_BoilerHotWater_FieldSet")
toggle_2 = BooleanToggle(True)
falsestart = LBFalseStartToggle(False)
epw_url = Panel("https://climate.onebuilding.org/WMO_Region_4_North_and_Central_America/USA_United_States_of_America/NY_New_York/USA_NY_New.York-Downtown.Manhattan.Heli.720553_TMYx.zip")
recgrid = Rectangular(Plane=PlaneXY(0, 0, 0), SizeX="10", SizeY="20", ExtentX="1", ExtentY="1")  # -> Cells, Points
outputparams_2 = IB_OutputParams(PumpElectricityRate=toggle_2, PumpMassFlowRate=toggle_2, outputFrequency=1)
# Rhino Unit: Meter
brep = Brep([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])
objparams_3 = IB_ObjParams(
    RatedAverageWaterTemperature=supply_hot_water_tempertature_c,
    DataFieldSetType="Ironbug.HVAC.IB_CoilHeatingWaterBaseboardRadiant_FieldSet")
_20_deltat_f = Panel("11.1")
epwmap = LBEPWmap(epw_map=falsestart)  # -> report; plug-in component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
move = Move(Geometry=brep, Motion=graft(recgrid.Points))  # -> flatten(Geometry), Transform
boiler = IB_BoilerHotWater(Parameters_=[objparams_2, outputparams], dupNum=False)
objparams_4 = IB_ObjParams(
    DesignLoopExitTemperature=supply_hot_water_tempertature_c,
    LoopDesignTemperatureDifference=_20_deltat_f,
    DataFieldSetType="Ironbug.HVAC.IB_SizingPlant_FieldSet")
roomsolid = HBRoomFromSolid(geo=flatten(move.Geometry), conditioned=True)  # -> report, rooms; plug-in component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
pumpvariable = IB_PumpVariableSpeed(Parameters_=outputparams_2, dupNum=False)
spm_scheduled = IB_SetpointManagerScheduled(Value=supply_hot_water_tempertature_c, dupNum=False)
outputparams_3 = IB_OutputParams(BaseboardTotalHeatingRate=Toggle(True), outputFrequency=1)
plantbranches = IB_PlantBranches(Branch1=boiler, mapBranchToLoop=False)
downloadepw = LBDownloadWeather(weather_URL=epw_url)  # -> epw_file, stat_file, ddy_file; plug-in component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
panel_2 = Panel(boiler)
solveadj = HBSolveAdjacency(rooms=flatten(roomsolid.rooms), run=Toggle(True))  # -> report, adj_rooms; plug-in component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
merge = Merge(Data1=pumpvariable, Data2=plantbranches, Data3=spm_scheduled)
sizingplant = IB_SizingPlant(Parameters_=objparams_4, dupNum=False)
lng = ListLength(List=solveadj.adj_rooms)
coilhtn_baseboardrad = IB_CoilHeatingWaterBaseboardRadiant(Parameters_=objparams_3, DuplicateNumber_=lng, dupNum=True)  # -> CoilHeatingWaterBaseboardRadiant, graft(WaterSide_CoilHeatingWater)
plantbranches_2 = IB_PlantBranches(Branch1=coilhtn_baseboardrad.WaterSide_CoilHeatingWater, mapBranchToLoop=False)
panel_3 = Panel(outputparams_3)
baseboardwaterradc = IB_ZoneHVACBaseboardRadiantConvectiveWater(
    CoilHeatingWaterBaseboardRadiant=coilhtn_baseboardrad.CoilHeatingWaterBaseboardRadiant,
    Parameters_=outputparams_3,
    dupNum=False)
thermalzone = IB_ThermalZone(
    _HBRooms=solveadj.adj_rooms,
    ZoneEquipments_=baseboardwaterradc,
    IsAirTerminalPriorToZoneEquipments=True,
    allowMultiAirloops=False,
    dupNum=False)
hotwaterloop = IB_HotWaterPlantLoop(_supply=merge, _demand=plantbranches_2, SizingLoop=sizingplant, dupNum=False)
noairloop = IB_NoAirLoop(OSZones=thermalzone)
hvacsystem = IB_HVACSystem(AirLoops=flatten(noairloop), PlantLoops=flatten(hotwaterloop))
detailedhvac = HBDetailedHVAC(hb_objs=flatten(solveadj.adj_rooms), hvac_system=hvacsystem, name="Baseboard System")  # -> report, hb_objs; plug-in component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
hvactemplate = IB_HVACTemplate()
panel_4 = Panel("""Zone Heating Setpoint Not Met Time
Zone Cooling Setpoint Not Met Time""")
panel_5 = Panel("""Baseboard Total Heating Rate
Boiler Heating Rate
Boiler NaturalGas Rate
Pump Electricity Rate
Pump Mass Flow Rate""")
simoutput = HBSimulationOutput(comfort_metrics=Toggle(True))  # -> report, sim_output; plug-in component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
merge_2 = Merge(Data1=panel_4, Data2=panel_5)
customoutput = HBCustomSimulationOutput(base_sim_output=simoutput.sim_output, output_names=panel_4)  # -> report, sim_output; plug-in component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
model = HBModel(rooms=flatten(detailedhvac.hb_objs))  # -> report, model; plug-in component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
simpar = HBSimulationParameter(output=customoutput.sim_output, timestep=6)  # -> sim_par; plug-in component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
panel_6 = Panel(merge_2)
toggle_3 = BooleanToggle(False)
panel_7 = Panel("""Boiler NaturalGas Rate
Pump Electricity Rate""")
modeltoosm = HBModelToOSM(model=model.model, epw_file=downloadepw.epw_file, sim_par=simpar, write=toggle_3, run=toggle_3)  # -> report, jsons, osw, osm, idf, sql, zsz, rdd, html; plug-in component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
panel_8 = Panel(modeltoosm.html)
panel_9 = Panel(modeltoosm.report)
eui = HBEndUseIntensity(sql=modeltoosm.sql)  # -> eui, eui_end_use, end_uses, gross_floor; plug-in component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
customresult = HBReadCustomResult(sql=modeltoosm.sql, output_names=merge_2)  # -> results; plug-in component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
roomcomfortresult = HBReadRoomComfortResult(sql=modeltoosm.sql)  # -> oper_temp, air_temp, rad_temp, rel_humidity; plug-in component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
panel_10 = Panel(eui.eui)
panel_11 = Panel(eui.end_uses)
# Here I am assuming the peak hour happens at the same hour for all of the following sets of data
customresult_2 = HBReadCustomResult(sql=modeltoosm.sql, output_names="Baseboard Total Heating Rate")  # -> results; plug-in component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
customresult_3 = HBReadCustomResult(sql=modeltoosm.sql, output_names=panel_7)  # -> results; plug-in component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
panel_12 = Panel(eui.eui_end_use)
merge_3 = Merge(Data1=flatten(roomcomfortresult.air_temp), Data2=flatten(customresult))
hourlyplot = LBHourlyPlot(data=flatten(merge_3))  # -> report, mesh, legend, borders, labels, title, vis_set; plug-in component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
xdata = LBDeconstructData(data=customresult_2)  # -> header, values; plug-in component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
xdata_2 = LBDeconstructData(data=customresult_3)  # -> header, values; plug-in component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
bnd = Bounds(Numbers=xdata.values)
bnd_2 = Bounds(Numbers=xdata_2.values)
dedomain = DeconstructDomain(Domain=bnd)  # -> Start, flatten(End)
dedomain_2 = DeconstructDomain(Domain=bnd_2)  # -> Start, flatten(End)
ma = MassAddition(Input=dedomain.End)  # -> Result, PartialResults
ma_2 = MassAddition(Input=dedomain_2.End)  # -> Result, PartialResults
baseboard_heating_rate_w = Panel(ma.Result)
input_rate_boiler_pump_w = Panel(ma_2.Result)
division = Division(A=baseboard_heating_rate_w, B=input_rate_boiler_pump_w)
panel_13 = Panel(division)
