# Grasshopper definition 03_Heating_before.gh (Grasshopper 1.0.7)
# plug-ins: LadybugGrasshopper

falsestart = LBFalseStartToggle(False)
epw_url = Panel("https://climate.onebuilding.org/WMO_Region_4_North_and_Central_America/USA_United_States_of_America/NY_New_York/USA_NY_New.York-Downtown.Manhattan.Heli.720553_TMYx.zip")
recgrid = Rectangular(Plane=PlaneXY(0, 0, 0), SizeX="10", SizeY="20", ExtentX="1", ExtentY="1")  # -> Cells, Points
# Rhino Unit: Meter
brep = Brep([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])
epwmap = LBEPWmap(epw_map=falsestart)  # -> report; plug-in component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
move = Move(Geometry=brep, Motion=graft(recgrid.Points))  # -> flatten(Geometry), Transform
roomsolid = HBRoomFromSolid(geo=flatten(move.Geometry), conditioned=True)  # -> report, rooms; plug-in component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
downloadepw = LBDownloadWeather(weather_URL=epw_url)  # -> epw_file, stat_file, ddy_file; plug-in component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
solveadj = HBSolveAdjacency(rooms=flatten(roomsolid.rooms), run=Toggle(True))  # -> report, adj_rooms; plug-in component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
detailedhvac = HBDetailedHVAC(hb_objs=flatten(solveadj.adj_rooms), name="Baseboard System")  # -> report, hb_objs; plug-in component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
panel = Panel("""Zone Heating Setpoint Not Met Time
Zone Cooling Setpoint Not Met Time""")
panel_2 = Panel("""Baseboard Total Heating Rate
Boiler Heating Rate
Boiler NaturalGas Rate
Pump Electricity Rate
Pump Mass Flow Rate""")
simoutput = HBSimulationOutput(comfort_metrics=Toggle(True))  # -> report, sim_output; plug-in component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
merge = Merge(Data1=panel, Data2=panel_2)
customoutput = HBCustomSimulationOutput(base_sim_output=simoutput.sim_output, output_names=panel)  # -> report, sim_output; plug-in component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
model = HBModel(rooms=flatten(detailedhvac.hb_objs))  # -> report, model; plug-in component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
simpar = HBSimulationParameter(output=customoutput.sim_output, timestep=6)  # -> sim_par; plug-in component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
panel_3 = Panel(merge)
toggle = BooleanToggle(False)
panel_4 = Panel("""Boiler NaturalGas Rate
Pump Electricity Rate""")
modeltoosm = HBModelToOSM(model=model.model, epw_file=downloadepw.epw_file, sim_par=simpar, write=toggle, run=toggle)  # -> report, jsons, osw, osm, idf, sql, zsz, rdd, html; plug-in component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
panel_5 = Panel(modeltoosm.html)
panel_6 = Panel(modeltoosm.report)
eui = HBEndUseIntensity(sql=modeltoosm.sql)  # -> eui, eui_end_use, end_uses, gross_floor; plug-in component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
customresult = HBReadCustomResult(sql=modeltoosm.sql, output_names=merge)  # -> results; plug-in component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
roomcomfortresult = HBReadRoomComfortResult(sql=modeltoosm.sql)  # -> oper_temp, air_temp, rad_temp, rel_humidity; plug-in component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
panel_7 = Panel(eui.eui)
panel_8 = Panel(eui.end_uses)
customresult_2 = HBReadCustomResult(sql=modeltoosm.sql, output_names="Baseboard Total Heating Rate")  # -> results; plug-in component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
customresult_3 = HBReadCustomResult(sql=modeltoosm.sql, output_names=panel_4)  # -> results; plug-in component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
panel_9 = Panel(eui.eui_end_use)
merge_2 = Merge(Data1=flatten(roomcomfortresult.air_temp), Data2=flatten(customresult))
hourlyplot = LBHourlyPlot(data=flatten(merge_2))  # -> report, mesh, legend, borders, labels, title, vis_set; plug-in component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
xdata = LBDeconstructData(data=customresult_2)  # -> header, values; plug-in component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
xdata_2 = LBDeconstructData(data=customresult_3)  # -> header, values; plug-in component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
bnd = Bounds(Numbers=xdata.values)
bnd_2 = Bounds(Numbers=xdata_2.values)
dedomain = DeconstructDomain(Domain=bnd)  # -> Start, flatten(End)
dedomain_2 = DeconstructDomain(Domain=bnd_2)  # -> Start, flatten(End)
ma = MassAddition(Input=dedomain.End)  # -> Result, PartialResults
ma_2 = MassAddition(Input=dedomain_2.End)  # -> Result, PartialResults
baseboard_heating_rate_w = Panel(ma.Result)
input_rate_boiler_pump_w = Panel(ma_2.Result)
division = Division(A=baseboard_heating_rate_w, B=input_rate_boiler_pump_w)
panel_10 = Panel(division)
