# Grasshopper definition 04_Heating_HeatPump.gh (Grasshopper 1.0.7)
# plug-ins: LadybugGrasshopper, Ironbug.Grasshopper

falsestart = LBFalseStartToggle(False)
epw_url = Panel("https://climate.onebuilding.org/WMO_Region_4_North_and_Central_America/USA_United_States_of_America/NY_New_York/USA_NY_New.York-Downtown.Manhattan.Heli.720553_TMYx.zip")
recgrid = Rectangular(Plane=PlaneXY(0, 0, 0), SizeX="10", SizeY="20", ExtentX="1", ExtentY="1")  # -> Cells, Points
# Rhino Unit: Meter
brep = Brep([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])
epwmap = LBEPWmap(epw_map=falsestart)  # -> report; plug-in component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
move = Move(Geometry=brep, Motion=graft(recgrid.Points))  # -> flatten(Geometry), Transform
roomsolid = HBRoomFromSolid(geo=flatten(move.Geometry), conditioned=True)  # -> report, rooms; plug-in component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
downloadepw = LBDownloadWeather(weather_URL=epw_url)  # -> epw_file, stat_file, ddy_file; plug-in component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
roomenergyattr = HBRoomEnergyAttributes({"Program": "properties.energy.program_type.display_name", "Construction Set": "properties.energy.construction_set.display_name", "Is Conditioned": "properties.energy.is_conditioned", "People per Area [ppl/m2]": "properties.energy.people.people_per_area", "Area per Person [m2/ppl]": "properties.energy.people.area_per_person", "Lighting per Area [W/m2]": "properties.energy.lighting.watts_per_area"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}, selected="Cooling Setpoint [C]": "properties.energy.setpoint.cooling_setpoint")
solveadj = HBSolveAdjacency(rooms=flatten(roomsolid.rooms), run=Toggle(True))  # -> report, adj_rooms; plug-in component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

# ---- group: Rooms with radiant system
# Set the new construction set
# For Radiant Ceiling
# 1
# HBRooms
data = Data(solveadj.adj_rooms)

# ----
# Get room's construction set
# a = x.properties.energy.construction_set
python = GhPythonScript(x=data)  # -> flatten(out), a
# ---------- python: Python ----------
if x:
    a = x.properties.energy.construction_set
    print(x.properties.energy.construction_set.display_name)
# ---------- end python ----------
panel = Panel(python.out)

# ---- group: Rooms with radiant system
data_2 = Data(flatten(solveadj.adj_rooms))

# ----
outputparams = IB_OutputParams(HeatPumpElectricityRate=Toggle(True), outputFrequency=1)

# ----
# Air Source Heat Pump (ASHP)
panel_2 = Panel("3.5")
objparams = IB_ObjParams(ReferenceCoefficientofPerformance="4.0", DataFieldSetType="Ironbug.HVAC.IB_HeatPumpPlantLoopEIRCooling_FieldSet")
objparams_2 = IB_ObjParams(ReferenceCoefficientofPerformance=panel_2, DataFieldSetType="Ironbug.HVAC.IB_HeatPumpPlantLoopEIRHeating_FieldSet")
clnhp_aircooled = IB_HeatPumpPlantLoopEIRCooling_AirCooled(Parameters_=objparams, dupNum=False)
htnhp = IB_HeatPumpPlantLoopEIRHeating_AirCoolded(CompanionCoolingHeatPump=clnhp_aircooled, Parameters_=[objparams_2, outputparams], dupNum=False)

data_3 = Data(data_2)
lng = ListLength(List=data_3)
colorroomattr = HBColorRoomAttributes(rooms_model=flatten(solveadj.adj_rooms), attribute=roomenergyattr)  # -> mesh, legend, wire_frame, values, colors, vis_set; plug-in component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
objparams_3 = IB_ObjParams(MaximumWaterFlowRate="0", RatedCapacity="0", DataFieldSetType="Ironbug.HVAC.IB_CoilHeatingWater_FieldSet")
coilclnwater = IB_CoilCoolingWater(DuplicateNumber_=lng, dupNum=True)  # -> AirSide_CoilCoolingWater, graft(WaterSide_CoilCoolingWater)
outputparams_2 = IB_OutputParams(BaseboardTotalHeatingRate=Toggle(True), outputFrequency=1)
coilhtnwater = IB_CoilHeatingWater(Parameters_=objparams_3, DuplicateNumber_=lng, dupNum=True)  # -> AirSide_CoilHeatingWater, graft(WaterSide_CoilHeatingWater)
panel_3 = Panel(colorroomattr.values)
graft = GraftTree(Tree=coilhtnwater.WaterSide_CoilHeatingWater, IncludeEmptyLists=True, IncludeNullItems=True)
graft_2 = GraftTree(Tree=coilclnwater.WaterSide_CoilCoolingWater, IncludeEmptyLists=True, IncludeNullItems=True)
_4pipefancoil = IB_ZoneHVACFourPipeFanCoil(HeatingCoil=coilhtnwater.AirSide_CoilHeatingWater, CoolingCoil=coilclnwater.AirSide_CoilCoolingWater, dupNum=False)
coilclnwater_2 = IB_CoilCoolingWater(dupNum=False)  # -> AirSide_CoilCoolingWater, graft(WaterSide_CoilCoolingWater)

# ----
# Chilled water loop
chiller_watercooled = Ironbug_ChillerElectricEIR_WaterCooled(dupNum=False)  # -> ChillerElectricEIR, ChillerElectricEIR_CondenserLoop
pumpvariable = Ironbug_PumpVariableSpeed(dupNum=False)
branches = PlantBranches(Branch1=clnhp_aircooled, mapBranchToLoop=False)
spm_scheduled = Ironbug_SetpointManagerScheduled(Temperature="12.7", dupNum=False)
branches_2 = PlantBranches(B1=graft_2, B2=coilclnwater_2.WaterSide_CoilCoolingWater, mapBranchToLoop=False)
cwloop = Ironbug_ChilledWaterPlantLoop(Supply=[pumpvariable, branches, spm_scheduled], Demand=branches_2, dupNum=False)

coilhtnwater_2 = IB_CoilHeatingWater(dupNum=False)  # -> AirSide_CoilHeatingWater, graft(WaterSide_CoilHeatingWater)
panel_4 = Panel("""Zone Heating Setpoint Not Met Time
Zone Cooling Setpoint Not Met Time""")
panel_5 = Panel("""Baseboard Total Heating Rate
Heat Pump Electricity Rate
Pump Electricity Rate
Pump Mass Flow Rate""")
simoutput = HBSimulationOutput(comfort_metrics=Toggle(True))  # -> report, sim_output; plug-in component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
merge = Merge(Data1=panel_4, Data2=panel_5)
customoutput = HBCustomSimulationOutput(base_sim_output=simoutput.sim_output, output_names=panel_4)  # -> report, sim_output; plug-in component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
simpar = HBSimulationParameter(output=customoutput.sim_output, timestep=6)  # -> sim_par; plug-in component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
panel_6 = Panel(merge)
toggle = BooleanToggle(True)
panel_7 = Panel("""Heat Pump Electricity Rate
Pump Electricity Rate""")
panel_8 = Panel("2")

# ----
# Create a construction with INTERNAL SOURCE material
panel_9 = Panel("INTERNAL SOURCE")
opaquematnomass = HBOpaqueMaterialNoMass(name=panel_9, r_value="1")  # -> mat; plug-in component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
merge_2 = Merge(
    Data1="8 in. Normalweight Concrete Floor",
    Data2="Roof Insulation [18]",
    Data3="Metal Surface",
    Data4=opaquematnomass,
    Data5="Metal Surface")
opaqueconstr = HBOpaqueConstruction(name="Radiant Construction", materials=merge_2)  # -> constr; plug-in component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
exteriorsubset = HBExteriorConstructionSubset(exterior_roof=opaqueconstr)  # -> exterior_set; plug-in component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

rev = ReverseList(List=merge_2)
opaqueconstr_2 = HBOpaqueConstruction(name="Radiant Construction Rev", materials=rev)  # -> constr; plug-in component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
interiorsubset = HBInteriorConstructionSubset(ceiling=opaqueconstr, interior_floor=opaqueconstr_2)  # -> interior_set; plug-in component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

constructionset = HBConstructionSet(name="CSet_Rad", base_constr_set=python.a, exterior_subset=exteriorsubset, interior_subset=interiorsubset)  # -> constr_set; plug-in component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

# ----
# 2
# Rooms
# with Radiant Panel Material
# Add these rooms back to HB Model
applyconstrset = HBApplyConstructionSet(rooms=graft(data), constr_set=graft(constructionset))  # -> rooms; plug-in component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

# ----
# Hot water loop
panel_10 = Panel("""1.124970374
    0.014963852
   -0.02599835
    0.0
   -1.40464E-6
   -0.00153624""")
supply_hot_water_tempertature_c = Panel("54")
objparams_4 = IB_ObjParams(
    MaximumValueofx="1",
    MaximumValueofy="85",
    MinimumValueofx="0.1",
    MinimumValueofy="30",
    DataFieldSetType="Ironbug.HVAC.Curves.IB_CurveBiquadratic_FieldSet")
curvebiquadratic = IB_CurveBiquadratic(Coefficients=panel_10, Parameters_=objparams_4, dupNum=False)
toggle_2 = BooleanToggle(True)
_20_deltat_f = Panel("11.1")
outputparams_3 = IB_OutputParams(PumpElectricityRate=toggle_2, PumpMassFlowRate=toggle_2, outputFrequency=1)
objparams_5 = IB_ObjParams(
    DesignLoopExitTemperature=supply_hot_water_tempertature_c,
    LoopDesignTemperatureDifference=_20_deltat_f,
    DataFieldSetType="Ironbug.HVAC.IB_SizingPlant_FieldSet")
spm_scheduled_2 = IB_SetpointManagerScheduled(Value=supply_hot_water_tempertature_c, dupNum=False)
plantbranches = IB_PlantBranches(Branch1=htnhp, mapBranchToLoop=False)
pumpvariable_2 = IB_PumpVariableSpeed(Parameters_=outputparams_3, dupNum=False)
sizingplant = IB_SizingPlant(Parameters_=objparams_5, dupNum=False)
merge_3 = Merge(Data1=pumpvariable_2, Data2=plantbranches, Data3=spm_scheduled_2)

objparams_6 = IB_ObjParams(
    RatedAverageWaterTemperature=supply_hot_water_tempertature_c,
    DataFieldSetType="Ironbug.HVAC.IB_CoilHeatingWaterBaseboardRadiant_FieldSet")
coilhtn_baseboardrad = IB_CoilHeatingWaterBaseboardRadiant(Parameters_=objparams_6, DuplicateNumber_=lng, dupNum=True)  # -> CoilHeatingWaterBaseboardRadiant, graft(WaterSide_CoilHeatingWater)

plantbranches_2 = IB_PlantBranches(
    B1=graft,
    B2=coilhtn_baseboardrad.WaterSide_CoilHeatingWater,
    B3=coilhtnwater_2.WaterSide_CoilHeatingWater,
    mapBranchToLoop=False)
hotwaterloop = IB_HotWaterPlantLoop(_supply=merge_3, _demand=plantbranches_2, SizingLoop=sizingplant, dupNum=False)

baseboardwaterradc = IB_ZoneHVACBaseboardRadiantConvectiveWater(
    CoilHeatingWaterBaseboardRadiant=coilhtn_baseboardrad.CoilHeatingWaterBaseboardRadiant,
    Parameters_=outputparams_2,
    dupNum=False)
merge_4 = Merge(Data1=graft(baseboardwaterradc), Data2=graft(_4pipefancoil))
zoneequipmentgroup = IB_ZoneEquipmentGroup(ZoneEquipments=merge_4)  # -> flatten(ZoneEquipmentGroup)
merge_5 = Merge(Data1=cwloop, Data3=hotwaterloop)
panel_11 = Panel(zoneequipmentgroup)
thermalzone = IB_ThermalZone(
    _HBRooms=data_2,
    ZoneEquipments_=zoneequipmentgroup,
    IsAirTerminalPriorToZoneEquipments=True,
    allowMultiAirloops=False,
    dupNum=False)

# ----
# Exhaust Fan
# DOAS
autosize = Number(-9999)
objparams_7 = IB_ObjParams(MinimumOutdoorAirFlowRate=autosize, DataFieldSetType="Ironbug.HVAC.IB_ControllerOutdoorAir_FieldSet")
toggle_3 = BooleanToggle(True)
objparams_8 = IB_ObjParams(
    EndUseSubcategory="DOAS_Fans",
    FanEfficiency="0.55575",
    MotorEfficiency="0.855",
    PressureRise="373",
    DataFieldSetType="Ironbug.HVAC.IB_FanConstantVolume_FieldSet")
objparams_9 = IB_ObjParams(
    EndUseSubcategory="DOAS_Fans",
    FanEfficiency="0.55575",
    MotorEfficiency="0.855",
    PressureRise="622",
    DataFieldSetType="Ironbug.HVAC.IB_FanConstantVolume_FieldSet")
objparams_10 = IB_ObjParams(
    AllOutdoorAirinCooling=toggle_3,
    AllOutdoorAirinHeating=toggle_3,
    CentralCoolingDesignSupplyAirTemperature="15.6",
    CentralHeatingDesignSupplyAirTemperature="21.1",
    CentralHeatingMaximumSystemAirFlowRatio="1",
    SizingOption="Coincident",
    TypeofLoadtoSizeOn="VentilationRequirement",
    DataFieldSetType="Ironbug.HVAC.IB_SizingSystem_FieldSet")
oacontroller = IB_OAController(Parameters_=objparams_7, dupNum=False)
oasystem = Ironbug_OutdoorAirSystem(Controller_=oacontroller)
spm_oareset = IB_SetpointManagerOutdoorAirReset(
    SetpointatOutdoorHighTemperature="15.6",
    OutdoorHighTemperature="21.1",
    SetpointatOutdoorLowTemperature="21.1",
    OutdoorLowTemperature="12.8",
    dupNum=False)
fanconstant = Ironbug_FanConstantVolume(Parameters_=objparams_9, dupNum=False)
fanconstant_2 = Ironbug_FanConstantVolume(Parameters_=objparams_8, dupNum=False)
airloopbranches = AirLoopBranches(B2=thermalzone)
objparams_11 = IB_ObjParams(Name="DOAS", DataFieldSetType="Ironbug.HVAC.IB_AirLoopHVAC_FieldSet")
sizingsystem = Ironbug_SizingSystem(Parameters_=objparams_10, dupNum=False)
merge_6 = Merge(
    Data1=fanconstant_2,
    Data2=oasystem,
    Data3=coilclnwater_2.AirSide_CoilCoolingWater,
    Data4=coilhtnwater_2.AirSide_CoilHeatingWater,
    Data6=fanconstant,
    Data7=spm_oareset)
airloop = Ironbug_AirLoopHVAC(Supply=merge_6, Demand=airloopbranches, SizingSystem=sizingsystem, Parameters_=objparams_11, dupNum=False)

hvacsystem = IB_HVACSystem(AirLoops=flatten(airloop), PlantLoops=flatten(merge_5))
detailedhvac = HBDetailedHVAC(hb_objs=flatten(data_2), hvac_system=hvacsystem, name="Heat Pump System")  # -> report, hb_objs; plug-in component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
model = HBModel(rooms=flatten(detailedhvac.hb_objs))  # -> report, model; plug-in component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
modeltoosm = HBModelToOSM(model=model.model, epw_file=downloadepw.epw_file, sim_par=simpar, write=toggle, run=toggle)  # -> report, jsons, osw, osm, idf, sql, zsz, rdd, html; plug-in component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
panel_12 = Panel(modeltoosm.html)
panel_13 = Panel(modeltoosm.report)
eui = HBEndUseIntensity(sql=modeltoosm.sql)  # -> eui, eui_end_use, end_uses, gross_floor; plug-in component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
panel_14 = Panel(modeltoosm.osm)
customresult = HBReadCustomResult(sql=modeltoosm.sql, output_names=merge)  # -> results; plug-in component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
roomcomfortresult = HBReadRoomComfortResult(sql=modeltoosm.sql)  # -> oper_temp, air_temp, rad_temp, rel_humidity; plug-in component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
panel_15 = Panel(eui.eui)
panel_16 = Panel(eui.end_uses)
# Here I am assuming the peak hour happens at the same hour for all of the following sets of data
customresult_2 = HBReadCustomResult(sql=modeltoosm.sql, output_names="Baseboard Total Heating Rate")  # -> results; plug-in component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
customresult_3 = HBReadCustomResult(sql=modeltoosm.sql, output_names=panel_7)  # -> results; plug-in component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
panel_17 = Panel(eui.eui_end_use)
merge_7 = Merge(Data2=flatten(customresult))
hourlyplot = LBHourlyPlot(data=flatten(merge_7))  # -> report, mesh, legend, borders, labels, title, vis_set; plug-in component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
xdata = LBDeconstructData(data=customresult_2)  # -> header, values; plug-in component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
xdata_2 = LBDeconstructData(data=customresult_3)  # -> header, values; plug-in component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
bnd = Bounds(Numbers=xdata.values)
bnd_2 = Bounds(Numbers=xdata_2.values)
dedomain = DeconstructDomain(Domain=bnd)  # -> Start, flatten(End)
dedomain_2 = DeconstructDomain(Domain=bnd_2)  # -> Start, flatten(End)
ma = MassAddition(Input=dedomain.End)  # -> Result, PartialResults
ma_2 = MassAddition(Input=dedomain_2.End)  # -> Result, PartialResults
baseboard_heating_rate_w = Panel(ma.Result)
input_rate_hp_pump_w = Panel(ma_2.Result)
division = Division(A=baseboard_heating_rate_w, B=input_rate_hp_pump_w)
panel_18 = Panel(division)
