# Grasshopper definition TestGenerator.gh (Grasshopper 1.0.7)
# plug-ins: Ironbug.Grasshopper

number_slider = Slider(10, range=0..10)
number_slider_2 = Slider(5, range=0..10)
domain_box = DomainBox(Base=PlaneXY(0, 0, 0), X=number_slider, Y=number_slider, Z=number_slider_2)
Y = UnitY(Factor=number_slider)
move = Move(Geometry=domain_box, Motion=Y)  # -> Geometry, Transform
merge = Merge(Data1=domain_box, Data2=move.Geometry)
Z = UnitZ(Factor=number_slider_2)
panel = Panel("""0
1""")
hvactemplate = IB_HVACTemplate()
move_2 = Move(Geometry=merge, Motion=Z)  # -> Geometry, Transform
merge_2 = Merge(Data1=merge, Data2=move_2.Geometry)
all_air = HBAllAirHVACTemplates({"VAV chiller with gas boiler reheat": "VAV_Chiller_Boiler", "VAV chiller with central air source heat pump reheat": "VAV_Chiller_ASHP", "VAV chiller with district hot water reheat": "VAV_Chiller_DHW", "VAV chiller with PFP boxes": "VAV_Chiller_PFP", "VAV chiller with gas coil reheat": "VAV_Chiller_GasCoil", "VAV air-cooled chiller with gas boiler reheat": "VAV_ACChiller_Boiler", "VAV air-cooled chiller with central air source heat pump reheat": "VAV_ACChiller_ASHP", "VAV air-cooled chiller with district hot water reheat": "VAV_ACChiller_DHW", "VAV air-cooled chiller with PFP boxes": "VAV_ACChiller_PFP", "VAV air-cooled chiller with gas coil reheat": "VAV_ACChiller_GasCoil"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}, selected="VAV chiller with gas boiler reheat")
roomsolid = HBRoomFromSolid(geo=flatten(merge_2), conditioned=True)  # -> report, rooms; plug-in component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
panel_2 = Panel("""Sys01_PTAC_AllElec
Sys01_PTAC_Boiler
Sys02_PTHP_Advanced
Sys03_SZAC_GasCoil
Sys04_SZHP_All_Elec
Sys05_PVAV Gas Boiler Reheat
Sys06_PackagedVAV_PFP Reheat
Sys07_VAV Reheat
Sys16_VRF + DOAS""")
solveadj = HBSolveAdjacency(rooms=flatten(roomsolid.rooms), run=Toggle(True))  # -> report, adj_rooms; plug-in component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
item = ListItem(List=solveadj.adj_rooms, Index=panel, Wrap=True)
rooms = Data(solveadj.adj_rooms)

# ---- group: Sys16_VRF + DOAS
# Double click the component for more details
sys16 = Sys16(data=flatten(rooms))

# ---- group: Sys03_SZAC_GasCoil
# Double click the component for more details
cluster = Cluster_4(rooms=rooms)

# ---- group: Sys07_VAV Reheat
# Double click the component for more details
cluster_2 = Cluster_8(rooms=rooms)

# ---- group: Sys01_PTAC_AllElec
# Double click the component for more details
cluster_3 = Cluster(rooms=rooms)

# ---- group: Sys01_PTAC_Boiler
# Double click the component for more details
cluster_4 = Cluster_2(rooms=rooms)

# ---- group: Sys06_PackagedVAV_PFP Reheat
# Double click the component for more details
cluster_5 = Cluster_7(rooms=rooms)

# ---- group: Sys02_PTHP_Advanced
# Double click the component for more details
cluster_6 = Cluster_3(rooms=rooms)

# ---- group: Sys05_PackagedVAV Gas Boiler Reheat
# Double click the component for more details
cluster_7 = Cluster_6(rooms=rooms)

# ----
int = Integer(Slider(3, range=0..10))

# ---- group: Sys04_SZHP_All_Elec
# Double click the component for more details
cluster_8 = Cluster_5(rooms=rooms)

# ----
allairhvac = HBAllAirHVAC(rooms=flatten(solveadj.adj_rooms), system_type=all_air)  # -> report, rooms; plug-in component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
item_2 = ListItem(List=panel_2, Index=int, Wrap=True)
panel_3 = Panel("D:\Dev\Ironbug\src\Ironbug.HVAC_Tests\TestSource\Integration Testing\")
panel_4 = Panel(item_2)
model = HBModel(rooms=flatten(solveadj.adj_rooms))  # -> report, model; plug-in component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
model_2 = HBModel(rooms=flatten(allairhvac.rooms), name="withSys")  # -> report, model; plug-in component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
merge_3 = Merge(
    Data1=cluster_3,
    Data2=cluster_4,
    Data3=cluster_6,
    Data4=cluster,
    Data5=cluster_8,
    Data6=cluster_7,
    Data7=cluster_5,
    Data8=cluster_2,
    Data9=sys16)
panel_5 = Panel(all_air)
file_path = FilePath("C:\Program Files\ladybug_tools\resources\weather\CHN_SH_Shanghai-Hongqiao.Intl.AP.583670_TMYx.2004-2018\CHN_SH_Shanghai-Hongqiao.Intl.AP.583670_TMYx.2004-2018.epw")
concat = Concatenate(FragmentC=panel_3, FragmentA=panel_4, FragmentB=".json")
item_3 = ListItem(List=merge_3, Index=int, Wrap=True)
button = Button()
# D:\Dev\Ironbug\src\Ironbug.HVAC_Tests\TestSource\Integration Testing\FourOfficeBuilding.osm
panel_6 = Panel(item_2)
modeltoosm = HBModelToOSM(model=model.model, epw_file=file_path, write=Toggle(False), run="2")  # -> report, jsons, osw, osm, idf, sql, zsz, rdd, html; plug-in component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
modeltoosm_2 = HBModelToOSM(model=model_2.model, epw_file=file_path, write=Toggle(False), run="2")  # -> report, jsons, osw, osm, idf, sql, zsz, rdd, html; plug-in component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
savetojson = IB_SaveToJson(_JsonPath=concat, HVACSystem=item_3, _write=Toggle(True))
file = ReadFile(File=savetojson, PerLineParse=False)
fromjson = IB_FromJson(Json=file)
hvac = Data(fromjson)
panel_7 = Panel(modeltoosm.osm)
panel_8 = Panel(modeltoosm_2.osm)
savetofile = IB_SaveToFile(NewFilePath=modeltoosm.osm, HVACSystem=hvac, _write=Toggle(False), OverrideMode=False, writeMode=0)
boolean_toggle = BooleanToggle(False)
openfile = LBOpenFile(file_path=modeltoosm_2.osm)  # -> report; plug-in component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
runosm = HBRunOSM(osm=savetofile, epw_file=file_path, translate=boolean_toggle, run=boolean_toggle)  # -> out, idf, sql, zsz, rdd, html; plug-in component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
panel_9 = Panel(savetofile)
eui = HBEndUseIntensity(sql=runosm.sql)  # -> eui, eui_end_use, end_uses, gross_floor; plug-in component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
panel_10 = Panel(eui.eui)

# ==== cluster Cluster
rooms = ClusterInput()

# ----
# Cooling Coil Performance Curves
panel = Panel("1")
objparams = IB_ObjParams(
    MaximumCurveOutput=panel,
    MaximumValueofx=panel,
    MinimumCurveOutput="0.7",
    MinimumValueofx="0",
    DataFieldSetType="Ironbug.HVAC.Curves.IB_CurveQuadratic_FieldSet")
panel_2 = Panel("""0.342414409
0.034885008
-0.0006237
0.004977216
0.000437951
-0.000728028""")
objparams_2 = IB_ObjParams(MaximumValueofx="1.5", MinimumValueofx="0.5", DataFieldSetType="Ironbug.HVAC.Curves.IB_CurveQuadratic_FieldSet")
panel_3 = Panel("""1.1552
-0.1808
0.0256""")
objparams_3 = IB_ObjParams(
    MaximumValueofx="23.89",
    MaximumValueofy="46.11",
    MinimumValueofx="12.78",
    MinimumValueofy="23.89",
    DataFieldSetType="Ironbug.HVAC.Curves.IB_CurveBiquadratic_FieldSet")
panel_4 = Panel("""0.85
0.15
0""")
curvequadratic = IB_CurveQuadratic(Coefficients=panel_3, Parameters_=objparams_2, dupNum=False)
curvebiquadratic = IB_CurveBiquadratic(Coefficients=panel_2, Parameters_=objparams_3, dupNum=False)
curvequadratic_2 = IB_CurveQuadratic(Coefficients=panel_4, Parameters_=objparams, dupNum=False)
objparams_4 = IB_ObjParams(MaximumValueofx="1.5", MinimumValueofx="0.5", DataFieldSetType="Ironbug.HVAC.Curves.IB_CurveQuadratic_FieldSet")
panel_5 = Panel("""0.942587793
0.009543347
0.00068377
-0.011042676
0.000005249
-0.00000972""")
panel_6 = Panel("""0.8
0.2
0""")
objparams_5 = IB_ObjParams(
    MaximumValueofx="23.89",
    MaximumValueofy="46.11",
    MinimumValueofx="12.78",
    MinimumValueofy="23.89",
    DataFieldSetType="Ironbug.HVAC.Curves.IB_CurveBiquadratic_FieldSet")
curvequadratic_3 = IB_CurveQuadratic(Coefficients=panel_6, Parameters_=objparams_4, dupNum=False)
curvebiquadratic_2 = IB_CurveBiquadratic(Coefficients=panel_5, Parameters_=objparams_5, dupNum=False)
objparams_6 = IB_ObjParams(
    EnergyInputRatioFunctionOfFlowFractionCurve=curvequadratic,
    EnergyInputRatioFunctionOfTemperatureCurve=curvebiquadratic,
    PartLoadFractionCorrelationCurve=curvequadratic_2,
    TotalCoolingCapacityFunctionOfFlowFractionCurve=curvequadratic_3,
    TotalCoolingCapacityFunctionOfTemperatureCurve=curvebiquadratic_2,
    DataFieldSetType="Ironbug.HVAC.IB_CoilCoolingDXSingleSpeed_FieldSet")

coilclndx1 = IB_CoilCoolingDXSingleSpeed(Parameters_=objparams_6, dupNum=False)

# ----
# HBRooms
# PTAC
rooms_2 = Data(flatten(rooms))

lng = ListLength(List=rooms_2)
panel_7 = Panel(lng)
objparams_7 = IB_ObjParams(FanEfficiency="0.52", PressureRise="331", DataFieldSetType="Ironbug.HVAC.IB_FanOnOff_FieldSet")
objparams_8 = IB_ObjParams(ZoneHeatingDesignSupplyAirTemperature="50", DataFieldSetType="Ironbug.HVAC.IB_SizingZone_FieldSet")
fanonoff = IB_FanOnOff(Parameters_=objparams_7, dupNum=False)
sizingzone = IB_SizingZone(Parameters_=objparams_8, dupNum=False)

coilhtnelec = IB_CoilHeatingElectric(DuplicateNumber_=panel_7, dupNum=True)

ptac = Ironbug_ZoneHVACPackagedTerminalAirConditioner(HeatingCoil=coilhtnelec, CoolingCoil=coilclndx1, Fan_=fanonoff, dupNum=False)
thermalzone = Ironbug_ThermalZone(
    HoneybeeZonesOrOsZones=rooms_2,
    ZoneEquipment=ptac,
    SizingZone=sizingzone,
    IsAirTerminalPriorToZoneEquipments=True,
    dupNum=False)

noairloop = Ironbug_NoAirLoop(OSZones=thermalzone)
hvacsystem = Ironbug_HVACSystem(AirLoops=flatten(noairloop))

hvacsystem_2 = ClusterOutput(hvacsystem)

# ==== cluster Cluster_2
rooms = ClusterInput()

# ----
# Cooling Coil Performance Curves
panel = Panel("1")
objparams = IB_ObjParams(
    MaximumCurveOutput=panel,
    MaximumValueofx=panel,
    MinimumCurveOutput="0.7",
    MinimumValueofx="0",
    DataFieldSetType="Ironbug.HVAC.Curves.IB_CurveQuadratic_FieldSet")
panel_2 = Panel("""0.342414409
0.034885008
-0.0006237
0.004977216
0.000437951
-0.000728028""")
objparams_2 = IB_ObjParams(MaximumValueofx="1.5", MinimumValueofx="0.5", DataFieldSetType="Ironbug.HVAC.Curves.IB_CurveQuadratic_FieldSet")
panel_3 = Panel("""1.1552
-0.1808
0.0256""")
objparams_3 = IB_ObjParams(
    MaximumValueofx="23.89",
    MaximumValueofy="46.11",
    MinimumValueofx="12.78",
    MinimumValueofy="23.89",
    DataFieldSetType="Ironbug.HVAC.Curves.IB_CurveBiquadratic_FieldSet")
panel_4 = Panel("""0.85
0.15
0""")
curvequadratic = IB_CurveQuadratic(Coefficients=panel_3, Parameters_=objparams_2, dupNum=False)
curvebiquadratic = IB_CurveBiquadratic(Coefficients=panel_2, Parameters_=objparams_3, dupNum=False)
curvequadratic_2 = IB_CurveQuadratic(Coefficients=panel_4, Parameters_=objparams, dupNum=False)
objparams_4 = IB_ObjParams(MaximumValueofx="1.5", MinimumValueofx="0.5", DataFieldSetType="Ironbug.HVAC.Curves.IB_CurveQuadratic_FieldSet")
panel_5 = Panel("""0.942587793
0.009543347
0.00068377
-0.011042676
0.000005249
-0.00000972""")
panel_6 = Panel("""0.8
0.2
0""")
objparams_5 = IB_ObjParams(
    MaximumValueofx="23.89",
    MaximumValueofy="46.11",
    MinimumValueofx="12.78",
    MinimumValueofy="23.89",
    DataFieldSetType="Ironbug.HVAC.Curves.IB_CurveBiquadratic_FieldSet")
curvequadratic_3 = IB_CurveQuadratic(Coefficients=panel_6, Parameters_=objparams_4, dupNum=False)
curvebiquadratic_2 = IB_CurveBiquadratic(Coefficients=panel_5, Parameters_=objparams_5, dupNum=False)
objparams_6 = IB_ObjParams(
    EnergyInputRatioFunctionOfFlowFractionCurve=curvequadratic,
    EnergyInputRatioFunctionOfTemperatureCurve=curvebiquadratic,
    PartLoadFractionCorrelationCurve=curvequadratic_2,
    TotalCoolingCapacityFunctionOfFlowFractionCurve=curvequadratic_3,
    TotalCoolingCapacityFunctionOfTemperatureCurve=curvebiquadratic_2,
    DataFieldSetType="Ironbug.HVAC.IB_CoilCoolingDXSingleSpeed_FieldSet")

objparams_7 = IB_ObjParams(
    BoilerFlowMode="LeavingSetpointModulated",
    MaximumPartLoadRatio="1.2",
    NominalThermalEfficiency="0.78",
    DataFieldSetType="Ironbug.HVAC.IB_BoilerHotWater_FieldSet")
coilclndx1 = IB_CoilCoolingDXSingleSpeed(Parameters_=objparams_6, dupNum=False)

# ----
# HBRooms
# PTAC
rooms_2 = Data(flatten(rooms))

lng = ListLength(List=rooms_2)
panel_7 = Panel(lng)
objparams_8 = IB_ObjParams(FanEfficiency="0.52", PressureRise="331", DataFieldSetType="Ironbug.HVAC.IB_FanOnOff_FieldSet")
objparams_9 = IB_ObjParams(ZoneHeatingDesignSupplyAirTemperature="50", DataFieldSetType="Ironbug.HVAC.IB_SizingZone_FieldSet")
coilhtnwater = Ironbug_CoilHeatingWater(DuplicateNumber_=panel_7, dupNum=True)  # -> AirSide_CoilHeatingWater, graft(WaterSide_CoilHeatingWater)
fanonoff = IB_FanOnOff(Parameters_=objparams_8, dupNum=False)
ptac = Ironbug_ZoneHVACPackagedTerminalAirConditioner(HeatingCoil=coilhtnwater.AirSide_CoilHeatingWater, CoolingCoil=coilclndx1, Fan_=fanonoff, dupNum=False)
sizingzone = IB_SizingZone(Parameters_=objparams_9, dupNum=False)
thermalzone = Ironbug_ThermalZone(
    HoneybeeZonesOrOsZones=rooms_2,
    ZoneEquipment=ptac,
    SizingZone=sizingzone,
    IsAirTerminalPriorToZoneEquipments=True,
    dupNum=False)

# ----
# Hot water loop
panel_8 = Panel("82.2")
boiler = Ironbug_BoilerHotWater(Parameters_=objparams_7, dupNum=False)
objparams_10 = IB_ObjParams(DesignLoopExitTemperature=panel_8, DataFieldSetType="Ironbug.HVAC.IB_SizingPlant_FieldSet")
pumpvariable = Ironbug_PumpVariableSpeed(dupNum=False)
plantbranches = PlantBranches(Branch1=boiler, mapBranchToLoop=False)
plantbranches_2 = PlantBranches(Branch1=coilhtnwater.WaterSide_CoilHeatingWater, mapBranchToLoop=False)
spm_scheduled = Ironbug_SetpointManagerScheduled(Temperature=panel_8, dupNum=False)
sizingplant = IB_SizingPlant(Parameters_=objparams_10, dupNum=False)
hotwaterloop = Ironbug_HotWaterPlantLoop(Supply=[pumpvariable, plantbranches, spm_scheduled], Demand=plantbranches_2, SizingLoop=sizingplant, dupNum=False)

noairloop = Ironbug_NoAirLoop(OSZones=thermalzone)
hvacsystem = Ironbug_HVACSystem(AirLoops=flatten(noairloop), PlantLoops=flatten(hotwaterloop))

hvacsystem_2 = ClusterOutput(hvacsystem)

# ==== cluster Cluster_3
rooms = ClusterInput()

# ----
# Heating Coil Performance Curves
panel = Panel("-20")
objparams = IB_ObjParams(MaximumValueofx="20", MinimumValueofx=panel, DataFieldSetType="Ironbug.HVAC.Curves.IB_CurveCubic_FieldSet")
objparams_2 = IB_ObjParams(MaximumValueofx="1.5", MinimumValueofx="0.5", DataFieldSetType="Ironbug.HVAC.Curves.IB_CurveCubic_FieldSet")
objparams_3 = IB_ObjParams(MaximumValueofx="20", MinimumValueofx="-20", DataFieldSetType="Ironbug.HVAC.Curves.IB_CurveCubic_FieldSet")
panel_2 = Panel("""1.19248
-0.0300438
0.00103745
-0.000023328""")
panel_3 = Panel("""0.84
0.16
0.0
0.0""")
panel_4 = Panel("""0.758746
0.027626
0.000148716
0.0000034992""")
panel_5 = Panel("""1.3824
-0.4336
0.0512""")
panel_6 = Panel("""0.85
0.15
0""")
curvequadratic = IB_CurveQuadratic(Coefficients=panel_5, dupNum=False)
curvecubic = IB_CurveCubic(Coefficients=panel_2, Parameters_=objparams, dupNum=False)
curvequadratic_2 = IB_CurveQuadratic(Coefficients=panel_6, dupNum=False)
curvecubic_2 = IB_CurveCubic(Coefficients=panel_3, Parameters_=objparams_2, dupNum=False)
curvecubic_3 = IB_CurveCubic(Coefficients=panel_4, Parameters_=objparams_3, dupNum=False)
panel_7 = Panel(""" 0.297145
0.0430933
-0.000748766
0.00597727
0.000482112
-0.000956448""")
objparams_4 = IB_ObjParams(
    MaximumValueofx="29.44",
    MaximumValueofy="29.44",
    MinimumValueofx="-23.33",
    MinimumValueofy="-23.33",
    DataFieldSetType="Ironbug.HVAC.Curves.IB_CurveBiquadratic_FieldSet")
curvebiquadratic = IB_CurveBiquadratic(Coefficients=panel_7, Parameters_=objparams_4, dupNum=False)
objparams_5 = IB_ObjParams(
    DefrostControl="OnDemand",
    DefrostEnergyInputRatioFunctionofTemperatureCurve=curvebiquadratic,
    DefrostStrategy="ReverseCycle",
    EnergyInputRatioFunctionofFlowFractionCurve=curvequadratic,
    EnergyInputRatioFunctionofTemperatureCurve=curvecubic,
    PartLoadFractionCorrelationCurve=curvequadratic_2,
    RatedCOP="3.3",
    TotalHeatingCapacityFunctionofFlowFractionCurve=curvecubic_2,
    TotalHeatingCapacityFunctionofTemperatureCurve=curvecubic_3,
    DataFieldSetType="Ironbug.HVAC.IB_CoilHeatingDXSingleSpeed_FieldSet")

# ----
# Cooling Coil Performance Curves
# For Heat Pump
panel_8 = Panel("1.5")
panel_9 = Panel("""0.297145
0.0430933
-0.000748766
0.00597727
0.000482112
-0.000956448""")
objparams_6 = IB_ObjParams(MaximumValueofx=panel_8, MinimumValueofx="0.5", DataFieldSetType="Ironbug.HVAC.Curves.IB_CurveQuadratic_FieldSet")
objparams_7 = IB_ObjParams(MaximumValueofx="1", MinimumValueofx="0", DataFieldSetType="Ironbug.HVAC.Curves.IB_CurveQuadratic_FieldSet")
panel_10 = Panel("""1.156
-0.1816
0.0256""")
objparams_8 = IB_ObjParams(
    MaximumValueofx="23.89",
    MaximumValueofy="46.11",
    MinimumValueofx="12.78",
    MinimumValueofy="21.1",
    DataFieldSetType="Ironbug.HVAC.Curves.IB_CurveBiquadratic_FieldSet")
panel_11 = Panel("""0.85
0.15
0""")
curvequadratic_3 = IB_CurveQuadratic(Coefficients=panel_10, Parameters_=objparams_6, dupNum=False)
curvebiquadratic_2 = IB_CurveBiquadratic(Coefficients=panel_9, Parameters_=objparams_8, dupNum=False)
curvequadratic_4 = IB_CurveQuadratic(Coefficients=panel_11, Parameters_=objparams_7, dupNum=False)
objparams_9 = IB_ObjParams(MaximumValueofx="1.5", MinimumValueofx="0.5", DataFieldSetType="Ironbug.HVAC.Curves.IB_CurveQuadratic_FieldSet")
panel_12 = Panel("""0.766956
0.0107756
-0.0000414703
0.00134961
-0.000261144
0.000457488""")
panel_13 = Panel("""0.8
0.2
0""")
objparams_10 = IB_ObjParams(
    MaximumValueofx="23.89",
    MaximumValueofy="46.11",
    MinimumValueofx="12.78",
    MinimumValueofy="21.1",
    DataFieldSetType="Ironbug.HVAC.Curves.IB_CurveBiquadratic_FieldSet")
curvequadratic_5 = IB_CurveQuadratic(Coefficients=panel_13, Parameters_=objparams_9, dupNum=False)
curvebiquadratic_3 = IB_CurveBiquadratic(Coefficients=panel_12, Parameters_=objparams_10, dupNum=False)
objparams_11 = IB_ObjParams(
    EnergyInputRatioFunctionOfFlowFractionCurve=curvequadratic_3,
    EnergyInputRatioFunctionOfTemperatureCurve=curvebiquadratic_2,
    PartLoadFractionCorrelationCurve=curvequadratic_4,
    TotalCoolingCapacityFunctionOfFlowFractionCurve=curvequadratic_5,
    TotalCoolingCapacityFunctionOfTemperatureCurve=curvebiquadratic_3,
    DataFieldSetType="Ironbug.HVAC.IB_CoilCoolingDXSingleSpeed_FieldSet")

coilclndx1 = IB_CoilCoolingDXSingleSpeed(Parameters_=objparams_11, dupNum=False)

# ----
# HBRooms
# PTHP
rooms_2 = Data(flatten(rooms))

lng = ListLength(List=rooms_2)
objparams_12 = IB_ObjParams(FanEfficiency="0.52", PressureRise="331", DataFieldSetType="Ironbug.HVAC.IB_FanOnOff_FieldSet")
panel_14 = Panel(lng)
objparams_13 = IB_ObjParams(
    ZoneCoolingDesignSupplyAirTemperature="13.8",
    ZoneHeatingDesignSupplyAirTemperature="50",
    DataFieldSetType="Ironbug.HVAC.IB_SizingZone_FieldSet")
coilhtn_dx1 = IB_CoilHeatingDXSingleSpeed(Parameters_=objparams_5, dupNum=False)
fanonoff = IB_FanOnOff(Parameters_=objparams_12, dupNum=False)
sizingzone = IB_SizingZone(Parameters_=objparams_13, dupNum=False)

pt_heatpump = Ironbug_ZoneHVACPackagedTerminalHeatPump(HeatingCoil=coilhtn_dx1, CoolingCoil=coilclndx1, Fan_=fanonoff, dupNum=False)

duplicate = Ironbug_Duplicate(Reference=pt_heatpump, Amount=panel_14)  # -> Objects, port
thermalzone = Ironbug_ThermalZone(
    HoneybeeZonesOrOsZones=rooms_2,
    ZoneEquipment=duplicate.Objects,
    SizingZone=sizingzone,
    IsAirTerminalPriorToZoneEquipments=True,
    dupNum=False)

noairloop = Ironbug_NoAirLoop(OSZones=thermalzone)
hvacsystem = Ironbug_HVACSystem(AirLoops=flatten(noairloop))

hvacsystem_2 = ClusterOutput(hvacsystem)

# ==== cluster Cluster_4
rooms = ClusterInput()

# ----
# Cooling Coil Performance Curves
# For PSZ-AC
panel = Panel("1")
objparams = IB_ObjParams(
    MaximumCurveOutput=panel,
    MaximumValueofx=panel,
    MinimumCurveOutput="0.7",
    MinimumValueofx="0",
    DataFieldSetType="Ironbug.HVAC.Curves.IB_CurveQuadratic_FieldSet")
panel_2 = Panel("""0.28687133
0.023902164
-0.000810648
0.013458546
0.0003389364
-0.0004870044""")
panel_3 = Panel("""0.90949556
0.09864773
-0.00819488""")
objparams_2 = IB_ObjParams(
    MaximumValueofx="100",
    MaximumValueofy="100",
    MinimumValueofx="-100",
    MinimumValueofy="-100",
    DataFieldSetType="Ironbug.HVAC.Curves.IB_CurveBiquadratic_FieldSet")
curvebiquadratic = IB_CurveBiquadratic(Coefficients=panel_2, Parameters_=objparams_2, dupNum=False)
curvequadratic = IB_CurveQuadratic(Coefficients=panel_3, Parameters_=objparams, dupNum=False)
objparams_3 = IB_ObjParams(MaximumValueofx="100", MinimumValueofx="-100", DataFieldSetType="Ironbug.HVAC.Curves.IB_CurveQuadratic_FieldSet")
panel_4 = Panel("""0.9712123
-0.015275502
0.0014434524
-0.00039321
-0.0000068364
-0.0002905956""")
panel_5 = Panel("""1
0
0""")
objparams_4 = IB_ObjParams(
    MaximumValueofx="100",
    MaximumValueofy="100",
    MinimumValueofx="-100",
    MinimumValueofy="-100",
    DataFieldSetType="Ironbug.HVAC.Curves.IB_CurveBiquadratic_FieldSet")
curvequadratic_2 = IB_CurveQuadratic(Coefficients=panel_5, Parameters_=objparams_3, dupNum=False)
curvebiquadratic_2 = IB_CurveBiquadratic(Coefficients=panel_4, Parameters_=objparams_4, dupNum=False)
objparams_5 = IB_ObjParams(
    EnergyInputRatioFunctionOfFlowFractionCurve=curvequadratic_2,
    EnergyInputRatioFunctionOfTemperatureCurve=curvebiquadratic,
    PartLoadFractionCorrelationCurve=curvequadratic,
    TotalCoolingCapacityFunctionOfFlowFractionCurve=curvequadratic_2,
    TotalCoolingCapacityFunctionOfTemperatureCurve=curvebiquadratic_2,
    DataFieldSetType="Ironbug.HVAC.IB_CoilCoolingDXSingleSpeed_FieldSet")

supply_air_cooling_temperature = Panel("12.78")
supply_air_heating_temperature = Panel("50")

objparams_6 = IB_ObjParams(
    ZoneCoolingDesignSupplyAirTemperature=supply_air_cooling_temperature,
    ZoneHeatingDesignSupplyAirTemperature=supply_air_heating_temperature,
    DataFieldSetType="Ironbug.HVAC.IB_SizingZone_FieldSet")
coilclndx1 = IB_CoilCoolingDXSingleSpeed(Parameters_=objparams_5, dupNum=False)
coilhtngas = Ironbug_CoilHeatingGas(dupNum=False)
objparams_7 = IB_ObjParams(NightCycleControlType="CycleOnAny", DataFieldSetType="Ironbug.HVAC.IB_AirLoopHVAC_FieldSet")

sizingzone = IB_SizingZone(Parameters_=objparams_6, dupNum=False)
objparams_8 = IB_ObjParams(FanEfficiency="0.54", MotorEfficiency="0.9", PressureRise="623", DataFieldSetType="Ironbug.HVAC.IB_FanOnOff_FieldSet")
fanonoff = IB_FanOnOff(Parameters_=objparams_8, dupNum=False)

# ----
# Sys03_SZAC
# Airloop
# HBZones
rooms_2 = Data(flatten(rooms))
lng = ListLength(List=rooms_2)
diffuser = Ironbug_AirTerminalSingleDuctUncontrolled(dupNum=False)
duplicate = Ironbug_Duplicate(Reference=diffuser, Amount=lng)  # -> Objects, graft(port)
thermalzone = Ironbug_ThermalZone(
    HoneybeeZonesOrOsZones=rooms_2,
    AirTerminal_=duplicate.Objects,
    SizingZone=sizingzone,
    IsAirTerminalPriorToZoneEquipments=True,
    dupNum=False)
panel_6 = Panel(supply_air_heating_temperature)
graft = GraftTree(Tree=thermalzone, IncludeEmptyLists=True, IncludeNullItems=True)
objparams_9 = IB_ObjParams(
    AllOutdoorAirinCooling=Toggle(False),
    AllOutdoorAirinHeating=Toggle(False),
    CentralHeatingDesignSupplyAirTemperature=panel_6,
    CentralHeatingMaximumSystemAirFlowRatio="1",
    SizingOption="Coincident",
    DataFieldSetType="Ironbug.HVAC.IB_SizingSystem_FieldSet")
panel_7 = Panel(supply_air_cooling_temperature)
panel_8 = Panel(supply_air_heating_temperature)
oasystem = Ironbug_OutdoorAirSystem()
spm_szreheat = Ironbug_SetpointManagerSingleZoneReheat(ControlZone=graft, MinTemperature=panel_7, MaxTemperature=panel_8, dupNum=False)
sizingsystem = Ironbug_SizingSystem(Parameters_=objparams_9, dupNum=False)
airloopbranches = AirLoopBranches(Branch1=graft)

unitarysystem = IB_AirLoopHVACUnitarySystem(HeatingCoil=coilhtngas, CoolingCoil=coilclndx1, Fan_=fanonoff, ControllingZone=graft, dupNum=False)
duplicate_2 = IB_Duplicate(Reference=oasystem, Amount=lng)  # -> graft(Objects), graft(port)

merge = Merge(Data1=simplify(duplicate_2.Objects), Data2=simplify(unitarysystem), Data3=simplify(spm_szreheat))
airloop = Ironbug_AirLoopHVAC(Supply=merge, Demand=airloopbranches, SizingSystem=sizingsystem, Parameters_=objparams_7, dupNum=False)
hvacsystem = Ironbug_HVACSystem(AirLoops=flatten(airloop))

hvacsystem_2 = ClusterOutput(hvacsystem)

# ==== cluster Cluster_5
rooms = ClusterInput()

# ----
# Heating Coil Performance Curves
# For Heat Pump
panel = Panel("20")
objparams = IB_ObjParams(MaximumValueofx=panel, MinimumValueofx="-20", DataFieldSetType="Ironbug.HVAC.Curves.IB_CurveCubic_FieldSet")
objparams_2 = IB_ObjParams(MaximumValueofx="1.5", MinimumValueofx="0.5", DataFieldSetType="Ironbug.HVAC.Curves.IB_CurveCubic_FieldSet")
objparams_3 = IB_ObjParams(MaximumValueofx="20", MinimumValueofx="-20", DataFieldSetType="Ironbug.HVAC.Curves.IB_CurveCubic_FieldSet")
panel_2 = Panel("""0.84
0.16
0
0""")
panel_3 = Panel("""1.19248
-0.0300438
0.00103745
-0.000023328""")
panel_4 = Panel("""0.758746
0.027626
0.000148716
0.0000034992""")
panel_5 = Panel("""0.85
0.15
0""")
panel_6 = Panel("""1.3824
-0.4336
0.0512""")
curvecubic = IB_CurveCubic(Coefficients=panel_2, Parameters_=objparams_2, dupNum=False)
curvequadratic = IB_CurveQuadratic(Coefficients=panel_5, dupNum=False)
curvecubic_2 = IB_CurveCubic(Coefficients=panel_4, Parameters_=objparams, dupNum=False)
curvequadratic_2 = IB_CurveQuadratic(Coefficients=panel_6, dupNum=False)
curvecubic_3 = IB_CurveCubic(Coefficients=panel_3, Parameters_=objparams_3, dupNum=False)
panel_7 = Panel(""" 0.297145
0.0430933
-0.000748766
0.00597727
0.000482112
-0.000956448""")
objparams_4 = IB_ObjParams(
    MaximumValueofx="29.44",
    MaximumValueofy="29.44",
    MinimumValueofx="-23.33",
    MinimumValueofy="-23.33",
    DataFieldSetType="Ironbug.HVAC.Curves.IB_CurveBiquadratic_FieldSet")
curvebiquadratic = IB_CurveBiquadratic(Coefficients=panel_7, Parameters_=objparams_4, dupNum=False)
objparams_5 = IB_ObjParams(
    CrankcaseHeaterCapacity="50",
    DefrostControl="OnDemand",
    DefrostEnergyInputRatioFunctionofTemperatureCurve=curvebiquadratic,
    DefrostStrategy="ReverseCycle",
    EnergyInputRatioFunctionofFlowFractionCurve=curvequadratic_2,
    EnergyInputRatioFunctionofTemperatureCurve=curvecubic_3,
    MaximumOutdoorDryBulbTemperatureforCrankcaseHeaterOperation="4.4",
    MaximumOutdoorDryBulbTemperatureforDefrostOperation="1.67",
    MinimumOutdoorDryBulbTemperatureforCompressorOperation="-12.2",
    PartLoadFractionCorrelationCurve=curvequadratic,
    RatedCOP="3.3",
    TotalHeatingCapacityFunctionofFlowFractionCurve=curvecubic,
    TotalHeatingCapacityFunctionofTemperatureCurve=curvecubic_2,
    DataFieldSetType="Ironbug.HVAC.IB_CoilHeatingDXSingleSpeed_FieldSet")

supply_air_cooling_temperature = Panel("12.78")
supply_air_heating_temperature = Panel("50")

# ----
# Cooling Coil Performance Curves
# For Heat Pump
panel_8 = Panel("1")
objparams_6 = IB_ObjParams(MaximumValueofx=panel_8, MinimumValueofx="0", DataFieldSetType="Ironbug.HVAC.Curves.IB_CurveQuadratic_FieldSet")
objparams_7 = IB_ObjParams(MaximumValueofx="1.5", MinimumValueofx="0.5", DataFieldSetType="Ironbug.HVAC.Curves.IB_CurveQuadratic_FieldSet")
panel_9 = Panel("""0.297145
0.0430933
-0.000748766
0.00597727
0.000482112
-0.000956448""")
objparams_8 = IB_ObjParams(
    MaximumValueofx="23.89",
    MaximumValueofy="46.11",
    MinimumValueofx="12.78",
    MinimumValueofy="21.1",
    DataFieldSetType="Ironbug.HVAC.Curves.IB_CurveBiquadratic_FieldSet")
panel_10 = Panel("""1.1552
-0.1816
0.0256""")
panel_11 = Panel("""0.85
0.15
0""")
curvequadratic_3 = IB_CurveQuadratic(Coefficients=panel_11, Parameters_=objparams_6, dupNum=False)
curvebiquadratic_2 = IB_CurveBiquadratic(Coefficients=panel_9, Parameters_=objparams_8, dupNum=False)
curvequadratic_4 = IB_CurveQuadratic(Coefficients=panel_10, Parameters_=objparams_7, dupNum=False)
objparams_9 = IB_ObjParams(MaximumValueofx="1.5", MinimumValueofx="0.5", DataFieldSetType="Ironbug.HVAC.Curves.IB_CurveQuadratic_FieldSet")
panel_12 = Panel("""0.766956
0.0107756
-0.0000414703
0.00134961
-0.000261144
0.000457488""")
objparams_10 = IB_ObjParams(
    MaximumValueofx="23.89",
    MaximumValueofy="46.11",
    MinimumValueofx="12.78",
    MinimumValueofy="21.1",
    DataFieldSetType="Ironbug.HVAC.Curves.IB_CurveBiquadratic_FieldSet")
panel_13 = Panel("""0.8
0.2
0""")
curvebiquadratic_3 = IB_CurveBiquadratic(Coefficients=panel_12, Parameters_=objparams_10, dupNum=False)
curvequadratic_5 = IB_CurveQuadratic(Coefficients=panel_13, Parameters_=objparams_9, dupNum=False)
objparams_11 = IB_ObjParams(
    EnergyInputRatioFunctionOfFlowFractionCurve=curvequadratic_4,
    EnergyInputRatioFunctionOfTemperatureCurve=curvebiquadratic_2,
    PartLoadFractionCorrelationCurve=curvequadratic_3,
    TotalCoolingCapacityFunctionOfFlowFractionCurve=curvequadratic_5,
    TotalCoolingCapacityFunctionOfTemperatureCurve=curvebiquadratic_3,
    DataFieldSetType="Ironbug.HVAC.IB_CoilCoolingDXSingleSpeed_FieldSet")

coilhtnelec = IB_CoilHeatingElectric(dupNum=False)

# ----
# Sys03_SZHP
# Airloop
# HBZones
rooms_2 = Data(flatten(rooms))
lng = ListLength(List=rooms_2)
diffuser = Ironbug_AirTerminalSingleDuctUncontrolled(dupNum=False)
duplicate = Ironbug_Duplicate(Reference=diffuser, Amount=lng)  # -> Objects, graft(port)
panel_14 = Panel(supply_air_heating_temperature)
panel_15 = Panel(supply_air_cooling_temperature)
panel_16 = Panel(supply_air_heating_temperature)
oasystem = Ironbug_OutdoorAirSystem()

objparams_12 = IB_ObjParams(
    ZoneCoolingDesignSupplyAirTemperature=supply_air_cooling_temperature,
    ZoneHeatingDesignSupplyAirTemperature=supply_air_heating_temperature,
    DataFieldSetType="Ironbug.HVAC.IB_SizingZone_FieldSet")
sizingzone = IB_SizingZone(Parameters_=objparams_12, dupNum=False)
objparams_13 = IB_ObjParams(
    MaximumOutdoorDryBulbTemperatureforSupplementalHeaterOperation="4.4",
    DataFieldSetType="Ironbug.HVAC.IB_AirLoopHVACUnitarySystem_FieldSet")
objparams_14 = IB_ObjParams(FanEfficiency="0.54", MotorEfficiency="0.9", PressureRise="623", DataFieldSetType="Ironbug.HVAC.IB_FanOnOff_FieldSet")
coilhtn_dx1 = IB_CoilHeatingDXSingleSpeed(Parameters_=objparams_5, dupNum=False)
coilclndx1 = IB_CoilCoolingDXSingleSpeed(Parameters_=objparams_11, dupNum=False)
fanonoff = IB_FanOnOff(Parameters_=objparams_14, dupNum=False)
objparams_15 = IB_ObjParams(NightCycleControlType="CycleOnAny", DataFieldSetType="Ironbug.HVAC.IB_AirLoopHVAC_FieldSet")
duplicate_2 = IB_Duplicate(Reference=oasystem, Amount=lng)  # -> graft(Objects), graft(port)

thermalzone = Ironbug_ThermalZone(
    HoneybeeZonesOrOsZones=rooms_2,
    AirTerminal_=duplicate.Objects,
    SizingZone=sizingzone,
    IsAirTerminalPriorToZoneEquipments=True,
    dupNum=False)
graft = GraftTree(Tree=thermalzone, IncludeEmptyLists=True, IncludeNullItems=True)
objparams_16 = IB_ObjParams(
    AllOutdoorAirinCooling=Toggle(False),
    AllOutdoorAirinHeating=Toggle(False),
    CentralHeatingDesignSupplyAirTemperature=panel_14,
    CentralHeatingMaximumSystemAirFlowRatio="1",
    SizingOption="Coincident",
    DataFieldSetType="Ironbug.HVAC.IB_SizingSystem_FieldSet")
spm_szreheat = Ironbug_SetpointManagerSingleZoneReheat(ControlZone=graft, MinTemperature=panel_15, MaxTemperature=panel_16, dupNum=False)
sizingsystem = Ironbug_SizingSystem(Parameters_=objparams_16, dupNum=False)
airloopbranches = AirLoopBranches(Branch1=graft)

unitarysystem = IB_AirLoopHVACUnitarySystem(
    HeatingCoil=coilhtn_dx1,
    CoolingCoil=coilclndx1,
    Fan_=fanonoff,
    SupplementalHeatingCoil=coilhtnelec,
    ControllingZone=graft,
    Parameters_=objparams_13,
    dupNum=False)

merge = Merge(Data1=simplify(duplicate_2.Objects), Data2=simplify(unitarysystem), Data3=simplify(spm_szreheat))
airloop = Ironbug_AirLoopHVAC(Supply=merge, Demand=airloopbranches, SizingSystem=sizingsystem, Parameters_=objparams_15, dupNum=False)
hvacsystem = Ironbug_HVACSystem(AirLoops=flatten(airloop))

hvacsystem_2 = ClusterOutput(hvacsystem)

# ==== cluster Cluster_6
rooms = ClusterInput()

objparams = IB_ObjParams(
    RatedInletAirTemperature="12.8",
    RatedOutletAirTemperature="50",
    DataFieldSetType="Ironbug.HVAC.IB_CoilHeatingWater_FieldSet")
objparams_2 = IB_ObjParams(
    CoolingDesignAirFlowMethod="DesignDayWithLimit",
    ZoneCoolingDesignSupplyAirTemperature="12.8",
    ZoneHeatingDesignSupplyAirTemperature="50",
    DataFieldSetType="Ironbug.HVAC.IB_SizingZone_FieldSet")
objparams_3 = IB_ObjParams(MaximumReheatAirTemperature="50", DataFieldSetType="Ironbug.HVAC.IB_AirTerminalSingleDuctVAVReheat_FieldSet")
objparams_4 = IB_ObjParams(
    RatedInletAirTemperature="7.2",
    RatedOutletAirTemperature="12.8",
    DataFieldSetType="Ironbug.HVAC.IB_CoilHeatingWater_FieldSet")
sizingzone = IB_SizingZone(Parameters_=objparams_2, dupNum=False)
objparams_5 = IB_ObjParams(NightCycleControlType="CycleOnAny", DataFieldSetType="Ironbug.HVAC.IB_AirLoopHVAC_FieldSet")

# ----
# Sys05_PackagedVAV_Reheat
# Airloop
# HBZones
rooms_2 = Data(flatten(rooms))
lng = ListLength(List=rooms_2)
coilhtnwater = Ironbug_CoilHeatingWater(Parameters_=objparams, dupNum=False)  # -> AirSide_CoilHeatingWater, WaterSide_CoilHeatingWater
duplicate = Ironbug_Duplicate(Reference=coilhtnwater.AirSide_CoilHeatingWater, Amount=flatten(lng))  # -> Objects, graft(WaterSide_CoilHeatingWater)
objparams_6 = IB_ObjParams(
    AllOutdoorAirinCooling=Toggle(False),
    AllOutdoorAirinHeating=Toggle(False),
    CentralHeatingDesignSupplyAirTemperature="12.8",
    DataFieldSetType="Ironbug.HVAC.IB_SizingSystem_FieldSet")
vavreheat = Ironbug_AirTerminalSingleDuctVAVReheat(HeatingCoil=duplicate.Objects, Parameters_=objparams_3, dupNum=False)
coilhtnwater_2 = Ironbug_CoilHeatingWater(Parameters_=objparams_4, dupNum=False)  # -> AirSide_CoilHeatingWater, WaterSide_CoilHeatingWater
oasystem = Ironbug_OutdoorAirSystem()
thermalzone = Ironbug_ThermalZone(
    HoneybeeZonesOrOsZones=rooms_2,
    AirTerminal_=vavreheat,
    SizingZone=sizingzone,
    IsAirTerminalPriorToZoneEquipments=True,
    dupNum=False)
coilclndx2 = Ironbug_CoilCoolingDXTwoSpeed(dupNum=False)
fanvariable = Ironbug_FanVariableVolume(dupNum=False)
spm_scheduled = Ironbug_SetpointManagerScheduled(Temperature="12.8", dupNum=False)
airloopbranches = AirLoopBranches(Branch1=thermalzone)
sizingsystem = Ironbug_SizingSystem(Parameters_=objparams_6, dupNum=False)
merge = Merge(Data1=oasystem, Data2=coilclndx2, Data3=coilhtnwater_2.AirSide_CoilHeatingWater, Data4=fanvariable, Data5=spm_scheduled)
airloop = Ironbug_AirLoopHVAC(Supply=merge, Demand=airloopbranches, SizingSystem=sizingsystem, Parameters_=objparams_5, dupNum=False)

# ----
# Hot water loop
panel = Panel("LeavingSetpointModulated")
objparams_7 = IB_ObjParams(
    BoilerFlowMode=panel,
    MaximumPartLoadRatio="1.2",
    NominalThermalEfficiency="0.84",
    DataFieldSetType="Ironbug.HVAC.IB_BoilerHotWater_FieldSet")
boilerhw = Ironbug_BoilerHotWater(Parameters=objparams_7, dupNum=False)
objparams_8 = IB_ObjParams(MinimumLoopTemperature="10", DataFieldSetType="Ironbug.HVAC.IB_PlantLoop_FieldSet")
pumpvariable = Ironbug_PumpVariableSpeed(dupNum=False)
branches = PlantBranches(Branch1=boilerhw, mapBranchToLoop=False)
branches_2 = PlantBranches(B1=duplicate.WaterSide_CoilHeatingWater, B2=coilhtnwater_2.WaterSide_CoilHeatingWater, mapBranchToLoop=False)
spm_scheduled_2 = Ironbug_SetpointManagerScheduled(Temperature="82", dupNum=False)
hwloop = Ironbug_HotWaterPlantLoop(Supply=[pumpvariable, branches, spm_scheduled_2], Demand=branches_2, Parameters=objparams_8, dupNum=False)

hvacsystem = Ironbug_HVACSystem(AirLoops=flatten(airloop), PlantLoops=flatten(hwloop))

hvacsystem_2 = ClusterOutput(hvacsystem)

# ==== cluster Cluster_7
rooms = ClusterInput()

objparams = IB_ObjParams(
    EndUseSubcategory="VAV System Fans",
    FanEfficiency="0.616",
    FanPowerMinimumFlowFraction="0.25",
    FanPowerMinimumFlowRateInputMethod="Fraction",
    MotorEfficiency="0.895",
    PressureRise="996",
    DataFieldSetType="Ironbug.HVAC.IB_FanVariableVolume_FieldSet")
objparams_2 = IB_ObjParams(
    ZoneCoolingDesignSupplyAirTemperature="12.8",
    ZoneHeatingDesignSupplyAirTemperature="50",
    DataFieldSetType="Ironbug.HVAC.IB_SizingZone_FieldSet")
sizingzone = IB_SizingZone(Parameters_=objparams_2, dupNum=False)
coilhtnelec = IB_CoilHeatingElectric(dupNum=False)
objparams_3 = IB_ObjParams(NightCycleControlType="CycleOnAny", DataFieldSetType="Ironbug.HVAC.IB_AirLoopHVAC_FieldSet")

objparams_4 = IB_ObjParams(PressureRise="300", DataFieldSetType="Ironbug.HVAC.IB_FanConstantVolume_FieldSet")

# ----
# Sys06_PackagedVAV_PFP Reheat
# Airloop
# HBZones
rooms_2 = Data(flatten(rooms))
lng = ListLength(List=rooms_2)
objparams_5 = IB_ObjParams(
    AllOutdoorAirinCooling=Toggle(False),
    AllOutdoorAirinHeating=Toggle(False),
    CentralHeatingDesignSupplyAirTemperature="12.8",
    DataFieldSetType="Ironbug.HVAC.IB_SizingSystem_FieldSet")
oasystem = Ironbug_OutdoorAirSystem()
coilclndx2 = Ironbug_CoilCoolingDXTwoSpeed(dupNum=False)
fanvariable = Ironbug_FanVariableVolume(Parameters=objparams, dupNum=False)
spm_scheduled = Ironbug_SetpointManagerScheduled(Temperature="12.8", dupNum=False)
sizingsystem = Ironbug_SizingSystem(Parameters_=objparams_5, dupNum=False)
merge = Merge(Data1=oasystem, Data2=coilclndx2, Data3=coilhtnelec, Data4=fanvariable, Data5=spm_scheduled)

fanconstant = IB_FanConstantVolume(Parameters_=objparams_4, DuplicateNumber_=lng, dupNum=True)
coilhtnelec_2 = IB_CoilHeatingElectric(DuplicateNumber_=lng, dupNum=True)
parallelpiureheat = IB_AirTerminalSingleDuctParallelPIUReheat(HeatingCoil=coilhtnelec_2, Fan_=fanconstant, dupNum=False)

thermalzone = Ironbug_ThermalZone(
    HoneybeeZonesOrOsZones=rooms_2,
    AirTerminal_=parallelpiureheat,
    SizingZone=sizingzone,
    IsAirTerminalPriorToZoneEquipments=True,
    dupNum=False)
airloopbranches = AirLoopBranches(Branch1=thermalzone)
airloop = Ironbug_AirLoopHVAC(Supply=merge, Demand=airloopbranches, SizingSystem=sizingsystem, Parameters_=objparams_3, dupNum=False)
hvacsystem = Ironbug_HVACSystem(AirLoops=flatten(airloop))

hvacsystem_2 = ClusterOutput(hvacsystem)

# ==== cluster Cluster_8
rooms = ClusterInput()
panel = Panel("""0.310965
0.322519
0.372745""")
panel_2 = Panel("""0.96744
0.037082
0.000434
-0.005837
-4.9e-05
-0.000274""")
panel_3 = Panel("""0.665307
-0.009339
0.000483
0.009492
0.000544
-0.000864""")
objparams = IB_ObjParams(
    MaximumValueofx="12.22",
    MaximumValueofy="29.44",
    MinimumValueofx="4.44",
    MinimumValueofy="15.56",
    DataFieldSetType="Ironbug.HVAC.Curves.IB_CurveBiquadratic_FieldSet")
curvequadratic = IB_CurveQuadratic(Coefficients=panel, dupNum=False)
panel_4 = Panel("""0.33162901
-0.88567609
0.60556507
0.9484823""")
curvebiquadratic = IB_CurveBiquadratic(Coefficients=panel_2, Parameters_=objparams, dupNum=False)
curvebiquadratic_2 = IB_CurveBiquadratic(Coefficients=panel_3, Parameters_=objparams, dupNum=False)
curvecubic = IB_CurveCubic(Coefficients=panel_4, dupNum=False)
objparams_2 = IB_ObjParams(
    RatedInletAirTemperature="12.8",
    RatedOutletAirTemperature="40",
    DataFieldSetType="Ironbug.HVAC.IB_CoilHeatingWater_FieldSet")
objparams_3 = IB_ObjParams(
    CoolingDesignAirFlowMethod="DesignDayWithLimit",
    HeatingDesignAirFlowMethod="DesignDay",
    ZoneCoolingDesignSupplyAirTemperature="12.8",
    ZoneHeatingDesignSupplyAirTemperature="40",
    DataFieldSetType="Ironbug.HVAC.IB_SizingZone_FieldSet")
objparams_4 = IB_ObjParams(
    ChillerFlowMode="ConstantFlow",
    CondenserType="WaterCooled",
    CoolingCapacityFunctionOfTemperature=curvebiquadratic,
    ElectricInputToCoolingOutputRatioFunctionOfPLR=curvequadratic,
    ElectricInputToCoolingOutputRatioFunctionOfTemperature=curvebiquadratic_2,
    LeavingChilledWaterLowerTemperatureLimit="2.22",
    MinimumPartLoadRatio="0.15",
    MinimumUnloadingRatio="0.25",
    ReferenceCOP="5.77",
    ReferenceEnteringCondenserFluidTemperature="35",
    DataFieldSetType="Ironbug.HVAC.IB_ChillerElectricEIR_FieldSet")
objparams_5 = IB_ObjParams(
    DesignApproachTemperature="2.77",
    DesignInletAirWetBulbTemperature="26.66",
    DesignRangeTemperature="5.55",
    FanPowerRatioFunctionofAirFlowRateRatioCurve=curvecubic,
    FractionofTowerCapacityinFreeConvectionRegime="0.125",
    DataFieldSetType="Ironbug.HVAC.IB_CoolingTowerVariableSpeed_FieldSet")
objparams_6 = IB_ObjParams(
    Coefficient1OfthePartLoadPerformanceCurve="0",
    Coefficient2OfthePartLoadPerformanceCurve="0.0205",
    Coefficient3OfthePartLoadPerformanceCurve="0.4101",
    Coefficient4OfthePartLoadPerformanceCurve="0.5753",
    Name="Chilled Water Loop Secondary Pump",
    RatedPumpHead="134508",
    DataFieldSetType="Ironbug.HVAC.IB_PumpVariableSpeed_FieldSet")
objparams_7 = IB_ObjParams(
    RatedInletAirTemperature="7.1",
    RatedOutletAirTemperature="12.8",
    DataFieldSetType="Ironbug.HVAC.IB_CoilHeatingWater_FieldSet")
sizingzone = IB_SizingZone(Parameters_=objparams_3, dupNum=False)
objparams_8 = IB_ObjParams(
    CoincidentSizingFactorMode="GlobalCoolingSizingFactor",
    DesignLoopExitTemperature="29.4",
    LoopDesignTemperatureDifference="5.5",
    LoopType="Condenser",
    SizingOption="Coincident",
    ZoneTimestepsinAveragingWindow="6",
    DataFieldSetType="Ironbug.HVAC.IB_SizingPlant_FieldSet")
coolingtowerv = IB_CoolingTowerVariableSpeed(Parameters_=objparams_5, dupNum=False)
objparams_9 = IB_ObjParams(RatedPumpHead="148556.6", DataFieldSetType="Ironbug.HVAC.IB_PumpConstantSpeed_FieldSet")
pumpconstant = IB_PumpConstantSpeed(Parameters_=objparams_9, dupNum=False)

# ----
# HBZones
rooms_2 = Data(flatten(rooms))

# ----
# Sys07_VAV_Reheat
# Airloop
toggle = BooleanToggle(False)
objparams_10 = IB_ObjParams(
    AllOutdoorAirinCooling=toggle,
    AllOutdoorAirinHeating=Toggle(False),
    CentralHeatingDesignSupplyAirTemperature="12.8",
    SizingOption="Coincident",
    DataFieldSetType="Ironbug.HVAC.IB_SizingSystem_FieldSet")
lng = ListLength(List=rooms_2)
objparams_11 = IB_ObjParams(
    ConstantMinimumAirFlowFraction="0.2",
    DamperHeatingAction="ReverseWithLimits",
    MaximumFlowFractionDuringReheat="0.5",
    MaximumReheatAirTemperature="40",
    ZoneMinimumAirFlowInputMethod="Constant",
    DataFieldSetType="Ironbug.HVAC.IB_AirTerminalSingleDuctVAVReheat_FieldSet")
coilhtnwater = Ironbug_CoilHeatingWater(Parameters_=objparams_2, DuplicateNumber_=lng, dupNum=True)  # -> AirSide_CoilHeatingWater, WaterSide_CoilHeatingWater
objparams_12 = IB_ObjParams(EconomizerControlType="DifferentialDryBulb", DataFieldSetType="Ironbug.HVAC.IB_ControllerOutdoorAir_FieldSet")
objparams_13 = IB_ObjParams(
    EndUseSubcategory="VAV System Fans",
    FanEfficiency="0.62",
    PressureRise="996",
    DataFieldSetType="Ironbug.HVAC.IB_FanVariableVolume_FieldSet")
oacontroller = Ironbug_OAController(Parameters_=objparams_12, dupNum=False)
vavreheat = Ironbug_AirTerminalSingleDuctVAVReheat(HeatingCoil=coilhtnwater.AirSide_CoilHeatingWater, Parameters_=objparams_11, dupNum=False)
coilclnwater = Ironbug_CoilCoolingWater(dupNum=False)  # -> AirSide_CoilCoolingWater, WaterSide_CoilCoolingWater
coilhtnwater_2 = Ironbug_CoilHeatingWater(Parameters_=objparams_7, dupNum=False)  # -> AirSide_CoilHeatingWater, WaterSide_CoilHeatingWater
oasystem = Ironbug_OutdoorAirSystem(Controller_=oacontroller)
thermalzone = Ironbug_ThermalZone(
    HoneybeeZonesOrOsZones=rooms_2,
    AirTerminal_=vavreheat,
    SizingZone=sizingzone,
    IsAirTerminalPriorToZoneEquipments=True,
    dupNum=False)
fanvariable = Ironbug_FanVariableVolume(Parameters=objparams_13, dupNum=False)
spm_scheduled = Ironbug_SetpointManagerScheduled(Temperature="12.8", dupNum=False)
objparams_14 = IB_ObjParams(NightCycleControlType="CycleOnAny", DataFieldSetType="Ironbug.HVAC.IB_AirLoopHVAC_FieldSet")
branches = AirLoopBranches(Branch1=thermalzone)
sizingsystem = Ironbug_SizingSystem(Parameters_=objparams_10, dupNum=False)
merge = Merge(
    Data1=oasystem,
    Data2=coilclnwater.AirSide_CoilCoolingWater,
    Data3=coilhtnwater_2.AirSide_CoilHeatingWater,
    Data4=fanvariable,
    Data5=spm_scheduled)
airloop = Ironbug_AirLoopHVAC(Supply=merge, Demand=branches, SizingSystem=sizingsystem, Parameters_=objparams_14, dupNum=False)

# ----
# Hot water loop
panel_5 = Panel("LeavingSetpointModulated")
graft = GraftTree(Tree=coilhtnwater.WaterSide_CoilHeatingWater, IncludeEmptyLists=True, IncludeNullItems=True)
objparams_15 = IB_ObjParams(
    BoilerFlowMode=panel_5,
    MaximumPartLoadRatio="1.2",
    NominalThermalEfficiency="0.78",
    DataFieldSetType="Ironbug.HVAC.IB_BoilerHotWater_FieldSet")
boiler = Ironbug_BoilerHotWater(Parameters_=objparams_15, dupNum=False)
objparams_16 = IB_ObjParams(DesignLoopExitTemperature="82.2", DataFieldSetType="Ironbug.HVAC.IB_SizingPlant_FieldSet")
pumpvariable = Ironbug_PumpVariableSpeed(dupNum=False)
plantbranches = PlantBranches(Branch1=boiler, mapBranchToLoop=False)
plantbranches_2 = PlantBranches(B1=graft, B2=coilhtnwater_2.WaterSide_CoilHeatingWater, mapBranchToLoop=False)
spm_scheduled_2 = Ironbug_SetpointManagerScheduled(Temperature="82.2", dupNum=False)
sizingplant = IB_SizingPlant(Parameters_=objparams_16, dupNum=False)
hotwaterloop = Ironbug_HotWaterPlantLoop(Supply=[pumpvariable, plantbranches, spm_scheduled_2], Demand=plantbranches_2, SizingLoop=sizingplant, dupNum=False)

# ----
# Chilled water loop
chiller_watercooled = Ironbug_ChillerElectricEIR_WaterCooled(Parameters_=objparams_4, dupNum=False)  # -> ChillerElectricEIR, ChillerElectricEIR_CondenserLoop
objparams_17 = IB_ObjParams(
    DesignLoopExitTemperature="6.66",
    LoopDesignTemperatureDifference="5.61",
    LoopType="Cooling",
    DataFieldSetType="Ironbug.HVAC.IB_SizingPlant_FieldSet")
objparams_18 = IB_ObjParams(RatedPumpHead="44836", DataFieldSetType="Ironbug.HVAC.IB_PumpConstantSpeed_FieldSet")
objparams_19 = IB_ObjParams(CommonPipeSimulation="CommonPipe", DataFieldSetType="Ironbug.HVAC.IB_PlantLoop_FieldSet")
pumpvariable_2 = Ironbug_PumpVariableSpeed(Parameters=objparams_6, dupNum=False)
pumpconstant_2 = IB_PumpConstantSpeed(Parameters_=objparams_18, dupNum=False)
branches_2 = PlantBranches(Branch1=chiller_watercooled.ChillerElectricEIR, mapBranchToLoop=False)
spm_scheduled_3 = Ironbug_SetpointManagerScheduled(Temperature="6.7", dupNum=False)
branches_3 = PlantBranches(Branch1=coilclnwater.WaterSide_CoilCoolingWater, mapBranchToLoop=False)
sizingplant_2 = IB_SizingPlant(Parameters_=objparams_17, dupNum=False)
cwloop = Ironbug_ChilledWaterPlantLoop(
    Supply=[pumpconstant_2, branches_2, spm_scheduled_3],
    Demand=[pumpvariable_2, branches_3],
    SizingLoop=sizingplant_2,
    Parameters_=objparams_19,
    dupNum=False)

# ----
# Condenser water loop
pipeadiabatic = Ironbug_PipeAdiabatic(dupNum=False)
objparams_20 = IB_ObjParams(MaximumLoopTemperature="80", MinimumLoopTemperature="5", DataFieldSetType="Ironbug.HVAC.IB_PlantLoop_FieldSet")
spm_followoatemp = Ironbug_SetpointManagerFollowOutdoorAirTemperature(MaximumSetpointTemperature="29.4", MinimumSetpointTemperature="21.1", OffsetTemperatureDifference="2.77", dupNum=False)
plantbranches_3 = PlantBranches(Branch1=chiller_watercooled.ChillerElectricEIR_CondenserLoop, mapBranchToLoop=False)
sizingplant_3 = IB_SizingPlant(Parameters_=objparams_8, dupNum=False)
branches_4 = PlantBranches(B1=coolingtowerv, B2=pipeadiabatic, mapBranchToLoop=False)
dwloop = Ironbug_CondenserWaterPlantLoop(
    Supply=[pumpconstant, branches_4, spm_followoatemp],
    Demand=plantbranches_3,
    SizingLoop=sizingplant_3,
    Parameters_=objparams_20,
    dupNum=False)

merge_2 = Merge(Data1=hotwaterloop, Data2=cwloop, Data3=dwloop)
hvacsystem = Ironbug_HVACSystem(AirLoops=flatten(airloop), PlantLoops=flatten(merge_2))

hvacsystem_2 = ClusterOutput(hvacsystem)

# ==== cluster Sys16

# ----
# Cooling performance curves
panel = Panel("1")
objparams = IB_ObjParams(MaximumValueofx="30", MinimumValueofx="11", DataFieldSetType="Ironbug.HVAC.Curves.IB_CurveCubic_FieldSet")
objparams_2 = IB_ObjParams(MaximumValueofx="24", MinimumValueofx="15", DataFieldSetType="Ironbug.HVAC.Curves.IB_CurveCubic_FieldSet")
objparams_3 = IB_ObjParams(
    MaximumCurveOutput=panel,
    MaximumValueofx="1",
    MinimumCurveOutput="0",
    MinimumValueofx="0.25",
    DataFieldSetType="Ironbug.HVAC.Curves.IB_CurveCubic_FieldSet")
panel_2 = Panel("""0.0734992169827752
0.334783365234032
0.591613015486343
0.0""")
panel_3 = Panel("""25.73
-0.03150043
-0.01416595
0.0""")
panel_4 = Panel("""25.73473775
-0.03150043
-0.01416595
0.0""")
objparams_4 = IB_ObjParams(MaximumValueofx="1.5", MinimumValueofx="1", DataFieldSetType="Ironbug.HVAC.Curves.IB_CurveCubic_FieldSet")
objparams_5 = IB_ObjParams(
    MaximumCurveOutput="1.056",
    MaximumValueofx="2",
    MinimumCurveOutput="0.5",
    MinimumValueofx="0.5",
    DataFieldSetType="Ironbug.HVAC.Curves.IB_CurveCubic_FieldSet")
panel_5 = Panel("""1
0
0
0""")
panel_6 = Panel("""0.24034
-0.21873
1.97941
-1.02636""")
panel_7 = Panel("""0.85
0.15
0.0
0.0""")
objparams_6 = IB_ObjParams(MaximumValueofx="1", MinimumValueofx="1", DataFieldSetType="Ironbug.HVAC.Curves.IB_CurveCubic_FieldSet")
curvecubic = IB_CurveCubic(Coefficients=panel_2, Parameters_=objparams_3, dupNum=False)
curvecubic_2 = IB_CurveCubic(Coefficients=panel_3, Parameters_=objparams, dupNum=False)
curvecubic_3 = IB_CurveCubic(Coefficients=panel_5, Parameters_=objparams_4, dupNum=False)
curvecubic_4 = IB_CurveCubic(Coefficients=panel_4, Parameters_=objparams_2, dupNum=False)
curvecubic_5 = IB_CurveCubic(Coefficients=panel_6, Parameters_=objparams_5, dupNum=False)
curvecubic_6 = IB_CurveCubic(Coefficients=panel_7, Parameters_=objparams_6, dupNum=False)
objparams_7 = IB_ObjParams(
    MaximumCurveOutput="1.15",
    MaximumValueofx="23.9",
    MaximumValueofy="43.3",
    MinimumCurveOutput="0.27",
    MinimumValueofx="13.9",
    MinimumValueofy="-5",
    DataFieldSetType="Ironbug.HVAC.Curves.IB_CurveBiquadratic_FieldSet")
panel_8 = Panel("""-1.61908214818635
0.185964818731756
-0.00389610393381592
-0.00901995326324613
0.00030340007815629
0.000476048529099348""")
panel_9 = Panel("""-1.69653019339465
0.207248180531939
-0.00343146229659024
0.016381597419714
-6.7387172629965e-05
-0.000849848402870241""")
objparams_8 = IB_ObjParams(
    MaximumCurveOutput="1.33",
    MaximumValueofx="23.9",
    MaximumValueofy="43.3",
    MinimumCurveOutput="0.59",
    MinimumValueofx="13.9",
    MinimumValueofy="-5",
    DataFieldSetType="Ironbug.HVAC.Curves.IB_CurveBiquadratic_FieldSet")
panel_10 = Panel("""-1.4395110176
0.1619850459
-0.0034911781
0.0269442645
0.0001346163
-0.0006714941""")
panel_11 = Panel("""0.6867358
0.0207631
0.0005447
-0.0016218
-4.259e-07
-0.0003392""")
objparams_9 = IB_ObjParams(
    MaximumValueofx="24",
    MaximumValueofy="43",
    MinimumValueofx="15",
    MinimumValueofy="16",
    DataFieldSetType="Ironbug.HVAC.Curves.IB_CurveBiquadratic_FieldSet")
objparams_10 = IB_ObjParams(
    MaximumValueofx="23.9",
    MaximumValueofy="43.3",
    MinimumValueofx="15",
    MinimumValueofy="16.8",
    DataFieldSetType="Ironbug.HVAC.Curves.IB_CurveBiquadratic_FieldSet")
curvebiquadratic = IB_CurveBiquadratic(Coefficients=panel_9, Parameters_=objparams_8, dupNum=False)
curvebiquadratic_2 = IB_CurveBiquadratic(Coefficients=panel_11, Parameters_=objparams_9, dupNum=False)
curvebiquadratic_3 = IB_CurveBiquadratic(Coefficients=panel_8, Parameters_=objparams_7, dupNum=False)
curvebiquadratic_4 = IB_CurveBiquadratic(Coefficients=panel_10, Parameters_=objparams_10, dupNum=False)

data = ClusterInput()

# ----
# Heating performance curves
panel_12 = Panel("1")
objparams_11 = IB_ObjParams(MaximumValueofx="23.9", MinimumValueofx="15", DataFieldSetType="Ironbug.HVAC.Curves.IB_CurveCubic_FieldSet")
objparams_12 = IB_ObjParams(MaximumValueofx="23.9", MinimumValueofx="15", DataFieldSetType="Ironbug.HVAC.Curves.IB_CurveCubic_FieldSet")
objparams_13 = IB_ObjParams(
    MaximumCurveOutput=panel_12,
    MaximumValueofx="1",
    MinimumCurveOutput="0",
    MinimumValueofx="0.25",
    DataFieldSetType="Ironbug.HVAC.Curves.IB_CurveCubic_FieldSet")
panel_13 = Panel("""0.0724906507105475
0.658189977561701
0.269259536275246
0.0""")
panel_14 = Panel("""58.577
-3.0255
0.0193
0.0""")
objparams_14 = IB_ObjParams(MaximumValueofx="1.5", MinimumValueofx="1", DataFieldSetType="Ironbug.HVAC.Curves.IB_CurveCubic_FieldSet")
objparams_15 = IB_ObjParams(
    MaximumCurveOutput="1.155",
    MaximumValueofx="2",
    MinimumCurveOutput="0.5",
    MinimumValueofx="0.5",
    DataFieldSetType="Ironbug.HVAC.Curves.IB_CurveCubic_FieldSet")
panel_15 = Panel("""58.577
-3.0255
0.0193
0.0""")
panel_16 = Panel("""1
0
0
0""")
panel_17 = Panel("""0.62115
-1.55798
3.36817
-1.4224""")
panel_18 = Panel("""0.85
0.15
0.0
0.0""")
objparams_16 = IB_ObjParams(MaximumValueofx="1", MinimumValueofx="1", DataFieldSetType="Ironbug.HVAC.Curves.IB_CurveCubic_FieldSet")
curvecubic_7 = IB_CurveCubic(Coefficients=panel_13, Parameters_=objparams_13, dupNum=False)
curvecubic_8 = IB_CurveCubic(Coefficients=panel_14, Parameters_=objparams_11, dupNum=False)
curvecubic_9 = IB_CurveCubic(Coefficients=panel_16, Parameters_=objparams_14, dupNum=False)
curvecubic_10 = IB_CurveCubic(Coefficients=panel_15, Parameters_=objparams_12, dupNum=False)
curvecubic_11 = IB_CurveCubic(Coefficients=panel_17, Parameters_=objparams_15, dupNum=False)
curvecubic_12 = IB_CurveCubic(Coefficients=panel_18, Parameters_=objparams_16, dupNum=False)
objparams_17 = IB_ObjParams(
    MaximumCurveOutput="1.184",
    MaximumValueofx="23.9",
    MaximumValueofy="13.3",
    MinimumCurveOutput="0.7",
    MinimumValueofx="16.1",
    MinimumValueofy="-25",
    DataFieldSetType="Ironbug.HVAC.Curves.IB_CurveBiquadratic_FieldSet")
panel_19 = Panel("""0.756830029796909
0.0457499799042671
-0.00136357240431388
0.0554884599902023
-0.00120700875497686
-0.00303329271420931""")
panel_20 = Panel("""0.983220174655636
0.0157167577703294
-0.000835032422884084
0.0522939264581759
-0.000531556035364549
-0.00190605953116024""")
objparams_18 = IB_ObjParams(
    MaximumCurveOutput="1.2",
    MaximumValueofx="23.9",
    MaximumValueofy="13.3",
    MinimumCurveOutput="0.51515151515",
    MinimumValueofx="16.1",
    MinimumValueofy="-25",
    DataFieldSetType="Ironbug.HVAC.Curves.IB_CurveBiquadratic_FieldSet")
panel_21 = Panel("""1.3885703646
-0.0229771462
0.000537274
-0.0273936962
0.0004030426
-5.9786e-05""")
panel_22 = Panel("""2.5859872368
-0.0953227101
0.0009553288
0.0
0.0
0.0""")
objparams_19 = IB_ObjParams(
    MaximumValueofx="27.2",
    MaximumValueofy="15",
    MinimumValueofx="21.1",
    MinimumValueofy="-994",
    DataFieldSetType="Ironbug.HVAC.Curves.IB_CurveBiquadratic_FieldSet")
objparams_20 = IB_ObjParams(
    MaximumValueofx="27.2",
    MaximumValueofy="1",
    MinimumValueofx="21.1",
    MinimumValueofy="0",
    DataFieldSetType="Ironbug.HVAC.Curves.IB_CurveBiquadratic_FieldSet")
curvebiquadratic_5 = IB_CurveBiquadratic(Coefficients=panel_20, Parameters_=objparams_18, dupNum=False)
curvebiquadratic_6 = IB_CurveBiquadratic(Coefficients=panel_22, Parameters_=objparams_19, dupNum=False)
curvebiquadratic_7 = IB_CurveBiquadratic(Coefficients=panel_19, Parameters_=objparams_17, dupNum=False)
curvebiquadratic_8 = IB_CurveBiquadratic(Coefficients=panel_21, Parameters_=objparams_20, dupNum=False)

data_2 = Data(flatten(data))
objparams_21 = IB_ObjParams(
    OutdoorAirFlowRateDuringCoolingOperation="0",
    OutdoorAirFlowRateDuringHeatingOperation="0",
    OutdoorAirFlowRateWhenNoCoolingorHeatingisNeeded="0",
    DataFieldSetType="Ironbug.HVAC.IB_ZoneHVACTerminalUnitVariableRefrigerantFlow_FieldSet")

objparams_22 = IB_ObjParams(
    MaximumCurveOutput="1.155",
    MaximumValueofx="23.9",
    MaximumValueofy="50",
    MinimumCurveOutput="0.27",
    MinimumValueofx="13.9",
    MinimumValueofy="-5",
    DataFieldSetType="Ironbug.HVAC.Curves.IB_CurveBiquadratic_FieldSet")
# based on DAIKINREYQ 120 on BCL
# Reference:
# https://github.com/NREL/openstudio-standards/blob/master/lib/openstudio-standards/prototypes/common/objects/Prototype.AirConditionerVariableRefrigerantFlow.rb
panel_23 = Panel("""-1.61908214818635
0.185964818731756
-0.00389610393381592
-0.00901995326324613
0.00030340007815629
0.000476048529099348""")
curvebiquadratic_9 = IB_CurveBiquadratic(Coefficients=panel_23, Parameters_=objparams_22, dupNum=False)

objparams_23 = IB_ObjParams(
    ZoneCoolingDesignSupplyAirTemperature="12.8",
    ZoneHeatingDesignSupplyAirTemperature="40",
    DataFieldSetType="Ironbug.HVAC.IB_SizingZone_FieldSet")

# ----
# Main Heating Coil Parameters
panel_24 = Panel("0.5")
objparams_24 = IB_ObjParams(MaximumValueofx="1.5", MinimumValueofx=panel_24, DataFieldSetType="Ironbug.HVAC.Curves.IB_CurveCubic_FieldSet")
objparams_25 = IB_ObjParams(MaximumValueofx="20", MinimumValueofx="-20", DataFieldSetType="Ironbug.HVAC.Curves.IB_CurveCubic_FieldSet")
panel_25 = Panel("""1.19248
-0.0300438
0.00103745
-0.000023328""")
objparams_26 = IB_ObjParams(MaximumValueofx="20", MinimumValueofx="-20", DataFieldSetType="Ironbug.HVAC.Curves.IB_CurveCubic_FieldSet")
panel_26 = Panel("""0.84
0.16
0
0""")
panel_27 = Panel("""0.758746
0.027626
0.000148716
0.0000034992""")
panel_28 = Panel("""1.3824
-0.4336
0.0512""")
panel_29 = Panel("""0.85
0.15
0""")
curvecubic_13 = IB_CurveCubic(Coefficients=panel_26, Parameters_=objparams_24, dupNum=False)
curvequadratic = IB_CurveQuadratic(Coefficients=panel_29, dupNum=False)
curvecubic_14 = IB_CurveCubic(Coefficients=panel_25, Parameters_=objparams_26, dupNum=False)
curvequadratic_2 = IB_CurveQuadratic(Coefficients=panel_28, dupNum=False)
curvecubic_15 = IB_CurveCubic(Coefficients=panel_27, Parameters_=objparams_25, dupNum=False)
objparams_27 = IB_ObjParams(
    EnergyInputRatioFunctionofFlowFractionCurve=curvequadratic_2,
    EnergyInputRatioFunctionofTemperatureCurve=curvecubic_14,
    PartLoadFractionCorrelationCurve=curvequadratic,
    RatedCOP="3.3",
    TotalHeatingCapacityFunctionofFlowFractionCurve=curvecubic_13,
    TotalHeatingCapacityFunctionofTemperatureCurve=curvecubic_15,
    DataFieldSetType="Ironbug.HVAC.IB_CoilHeatingDXSingleSpeed_FieldSet")

sizingzone = IB_SizingZone(Parameters_=objparams_23, dupNum=False)
panel_30 = Panel("0.5")
objparams_28 = IB_ObjParams(
    CoolingCapacityRatioBoundaryCurve=curvecubic_2,
    CoolingCapacityRatioModifierFunctionofHighTemperatureCurve=curvebiquadratic_2,
    CoolingCapacityRatioModifierFunctionofLowTemperatureCurve=curvebiquadratic,
    CoolingCombinationRatioCorrectionFactorCurve=curvecubic_5,
    CoolingEnergyInputRatioBoundaryCurve=curvecubic_4,
    CoolingEnergyInputRatioModifierFunctionofHighPartLoadRatioCurve=curvecubic_3,
    CoolingEnergyInputRatioModifierFunctionofHighTemperatureCurve=curvebiquadratic_4,
    CoolingEnergyInputRatioModifierFunctionofLowPartLoadRatioCurve=curvecubic,
    CoolingEnergyInputRatioModifierFunctionofLowTemperatureCurve=curvebiquadratic_3,
    CoolingPartLoadFractionCorrelationCurve=curvecubic_6,
    DefrostControl="OnDemand",
    DefrostEnergyInputRatioModifierFunctionofTemperatureCurve=curvebiquadratic_9,
    DefrostStrategy="ReverseCycle",
    HeatingCapacityRatioBoundaryCurve=curvecubic_8,
    HeatingCapacityRatioModifierFunctionofHighTemperatureCurve=curvebiquadratic_6,
    HeatingCapacityRatioModifierFunctionofLowTemperatureCurve=curvebiquadratic_5,
    HeatingCombinationRatioCorrectionFactorCurve=curvecubic_11,
    HeatingEnergyInputRatioBoundaryCurve=curvecubic_10,
    HeatingEnergyInputRatioModifierFunctionofHighPartLoadRatioCurve=curvecubic_9,
    HeatingEnergyInputRatioModifierFunctionofHighTemperatureCurve=curvebiquadratic_8,
    HeatingEnergyInputRatioModifierFunctionofLowPartLoadRatioCurve=curvecubic_7,
    HeatingEnergyInputRatioModifierFunctionofLowTemperatureCurve=curvebiquadratic_7,
    HeatingPartLoadFractionCorrelationCurve=curvecubic_12,
    HeatingPerformanceCurveOutdoorTemperatureType="WetBulbTemperature",
    HeatPumpWasteHeatRecovery=Toggle(True),
    MaximumOutdoorTemperatureinCoolingMode="50",
    MaximumOutdoorTemperatureinHeatingMode="16.1",
    MaximumOutdoorTemperatureinHeatRecoveryMode="27.2",
    MinimumOutdoorTemperatureinCoolingMode="-15",
    MinimumOutdoorTemperatureinHeatingMode="-25",
    MinimumOutdoorTemperatureinHeatRecoveryMode="-10",
    RatedCoolingCOP="4.287",
    RatedHeatingCOP="4.147",
    DataFieldSetType="Ironbug.HVAC.IB_AirConditionerVariableRefrigerantFlow_FieldSet")

# ----
# HBZones
lng = ListLength(List=data_2)

# ----
# VRF Terminals
vrfterminal = Ironbug_ZoneHVACTerminalUnitVariableRefrigerantFlow(Parameters_=objparams_21, DuplicateNumber_=lng, airloop=False, dupNum=True)  # -> VRFUnit_In, VRFUnit_Out
thermalzone = Ironbug_ThermalZone(
    HoneybeeZonesOrOsZones=data_2,
    ZoneEquipment=vrfterminal.VRFUnit_In,
    SizingZone=sizingzone,
    IsAirTerminalPriorToZoneEquipments=True,
    dupNum=False)

# ----
# DOAS
# Backup Heating
autosize = Number(-9999)
objparams_29 = IB_ObjParams(MinimumOutdoorAirFlowRate=autosize, DataFieldSetType="Ironbug.HVAC.IB_ControllerOutdoorAir_FieldSet")
toggle = BooleanToggle(True)
objparams_30 = IB_ObjParams(
    EndUseSubcategory="DOAS_SupplyFan",
    FanEfficiency="0.55575",
    MotorEfficiency="0.855",
    PressureRise="373",
    DataFieldSetType="Ironbug.HVAC.IB_FanConstantVolume_FieldSet")
objparams_31 = IB_ObjParams(
    EndUseSubcategory="DOAS_SupplyFan",
    FanEfficiency="0.55575",
    MotorEfficiency="0.855",
    PressureRise="622",
    DataFieldSetType="Ironbug.HVAC.IB_FanConstantVolume_FieldSet")
objparams_32 = IB_ObjParams(
    AllOutdoorAirinCooling=toggle,
    AllOutdoorAirinHeating=toggle,
    CentralCoolingDesignSupplyAirTemperature="15.6",
    CentralHeatingDesignSupplyAirTemperature="21.1",
    CentralHeatingMaximumSystemAirFlowRatio="1",
    SizingOption="Coincident",
    TypeofLoadtoSizeOn="VentilationRequirement",
    DataFieldSetType="Ironbug.HVAC.IB_SizingSystem_FieldSet")
oacontroller = IB_OAController(Parameters_=objparams_29, dupNum=False)
oasystem = Ironbug_OutdoorAirSystem(Controller_=oacontroller)
spm_oareset = IB_SetpointManagerOutdoorAirReset(
    SetpointatOutdoorHighTemperature="15.6",
    OutdoorHighTemperature="21.1",
    SetpointatOutdoorLowTemperature="21.1",
    OutdoorLowTemperature="12.8",
    dupNum=False)
fanconstant = Ironbug_FanConstantVolume(Parameters_=objparams_30, dupNum=False)
coilhtn_dx1 = IB_CoilHeatingDXSingleSpeed(Parameters_=objparams_27, dupNum=False)
coilhtnelec = IB_CoilHeatingElectric(dupNum=False)
coilclndx1 = Ironbug_CoilCoolingDXSingleSpeed(dupNum=False)
fanconstant_2 = Ironbug_FanConstantVolume(Parameters_=objparams_31, dupNum=False)
objparams_33 = IB_ObjParams(Name="DOAS", DataFieldSetType="Ironbug.HVAC.IB_AirLoopHVAC_FieldSet")
airloopbranches = AirLoopBranches(Branch1=thermalzone)
sizingsystem = Ironbug_SizingSystem(Parameters_=objparams_32, dupNum=False)
merge = Merge(
    Data1=fanconstant,
    Data2=oasystem,
    Data3=coilclndx1,
    Data4=coilhtn_dx1,
    Data5=coilhtnelec,
    Data6=fanconstant_2,
    Data7=spm_oareset)
airloop = Ironbug_AirLoopHVAC(Supply=merge, Demand=airloopbranches, SizingSystem=sizingsystem, Parameters_=objparams_33, dupNum=False)

vrfsystem = Ironbug_AirConditionerVariableRefrigerantFlow(_terminals=vrfterminal.VRFUnit_Out, Parameters_=objparams_28, dupNum=False)
hvacsystem = Ironbug_HVACSystem(AirLoops=flatten(airloop), VRFSystems=flatten(vrfsystem))

hvacsystem_2 = ClusterOutput(hvacsystem)
